# Grasshopper definition IsoVist_ARUP_02.gh (Grasshopper 0.9.75)
# plug-ins: Python Interpreter

pt = Point([<point referenced from the Rhino model> x34])
crv = Curve([<curve referenced from the Rhino model> x2719])
pt_2 = Point([<point referenced from the Rhino model> x34])
overall_boundary = Curve(<curve referenced from the Rhino model>)
pdecon = Deconstruct(Point=pt)  # -> XComponent, YComponent, ZComponent
circle = CircleCNR(Center=pt_2, Normal=Vector(0, 0, 1), Radius=Slider(8000, range=0..10000))
whole_area = Geometry(overall_boundary)
python = PythonScript(points=pt, lines=Slider(100, range=0..100), radius=Slider(8000, range=0..10000), boundries=crv)  # -> pointOut, totalIsovist, isovistsClear, overlapSpace, isovistsList, isovistTotalSurface, nonOverlapSpace; inputs points: list of Point3d, lines: Int32, radius: Int32, boundries: list
# ---------- python: Python ----------
import ghpythonlib.components as ghcomp
import rhinoscriptsyntax as rs
import Rhino.Geometry as rg




isovistsList = []
overlapSpaceList = []
isovistsClear = []
pointOut = points

for point in points:
    isovists = ghcomp.IsoVist(point,lines,radius,boundries)
    getIsovistPoints=isovists[0]
    isovistsOutline = ghcomp.PolyLine(getIsovistPoints,True)
    makeSurface = ghcomp.BoundarySurfaces(isovistsOutline)
    print makeSurface
    isovistsList.append(makeSurface)

coerceBrepList = []

for individualIsovists in isovistsList:
    coercedOneBrep = rs.coercebrep(individualIsovists)
    coerceBrepList.append(coercedOneBrep)

isovistCoercedUnion = ghcomp.RegionUnion(coerceBrepList)
isovistTotalSurface = ghcomp.BoundarySurfaces(isovistCoercedUnion)

interA = isovistsList[0:len(isovistsList)-1]
interB = isovistsList[1:]

for itsA in interA:
    for itsB in interB:
        if itsA == itsB:
            print itsA
        else:
            regionInter = ghcomp.RegionIntersection(itsA,itsB)
            surfaceInter = ghcomp.BoundarySurfaces(regionInter)
            #if len(surfaceInter) != 1:
            #    for listList in surfaceInter:
            #        print listList
            #        overlapSpaceList.append(listList)
            overlapSpaceList.append(surfaceInter)


flatOver = []

for testList in overlapSpaceList:
    testIfList = isinstance(testList, list)
    if testIfList == True:
        for isList in testList:
            flatOver.append(isList)
    else:
        flatOver.append(testList)

overlapSpace = flatOver

##asd = []

##overlapSpace = ghcomp.RegionUnion(flatOver)

##for getnotOverlapSpace in isovistsList:
##    pineapple = ghcomp.RegionDifference(getnotOverlapSpace, overlapSpace)
##    asd.append(pineapple)
##nonOverlapSpace = asd


#overlapCombination = ghcomp.RegionUnion(flatOver)
#print overlapCombination
#overlapSurface = ghcomp.BoundarySurfaces(overlapCombination)
#overlapCalcArea = ghcomp.Area(overlapSurface)
#print overlapCalcArea


#for overlapPiece in overlapCalcArea[0]:
#    overlapArea = overlapArea + overlapPiece

#print overlapSpaceList
#overlapSpace = flatOver



#ghcomp.regi

#a = isovistsList
# ---------- end python ----------
panel = Panel(pdecon.XComponent)
panel_2 = Panel(pdecon.YComponent)
srf = Surface(whole_area)
boundary = BoundarySurfaces(Edges=circle)
srf_2 = Surface(python.isovistTotalSurface)  # disabled

# ---- group: Estimates area
crv_2 = Curve([<curve referenced from the Rhino model> x2])
runion = RegionUnion(Curves=crv_2)
boundary_2 = BoundarySurfaces(Edges=runion)

# ----
runion_2 = RegionUnion()
boundary_3 = BoundarySurfaces(Edges=runion_2)
debrep = DeconstructBrep(Brep=srf_2)  # -> Faces, Edges, Vertices
area = Area(Geometry=srf_2)  # -> Area, Centroid
area_2 = Area(Geometry=boundary_3)  # -> Area, Centroid
ma = MassAddition(Input=area.Area)  # -> Result, PartialResults
ma_2 = MassAddition(Input=area_2.Area)  # -> Result, PartialResults
area_3 = Area(Geometry=boundary_2)  # -> Area, Centroid
subtraction = Subtraction(A=area_3.Area, B=ma.Result)
division = Division(A=subtraction, B=area_3.Area)
multiplication = Multiplication(A=division, B=100)
data = Data(simplify(graft(["Units Squared", "Percentage (%)"])))
data_2 = Data(simplify(graft([subtraction, multiplication])))
total_area = Panel(area_3.Area)
overlap_area = Panel(ma_2.Result)
area_covered = Panel(ma.Result)
area_not_covered = Panel([data, data_2])
