# Grasshopper definition VISUALISATION_ACTIVE.gh (Grasshopper 0.9.75)
# plug-ins: Python Interpreter, Human, Agent, Shortest Walk in Gh

windows_simdata = FilePath("F:\BlankMindBlog\helpers\VISUALISATION\json_detection data\simdata.json")
names = PythonScript(FilePath=windows_simdata)  # -> uuids, a
# ---------- names: Python ----------
import json

if FilePath:
    
    # JSON file to read
    file = open(FilePath)
    
    # Load the data
    data = json.load(file)
    
    uuids = []
    
    for d in data:
        uuids.append( d['uuid'] )
    
    print uuids
# ---------- end names ----------
create_set = CreateSet(List=names.uuids)  # -> Set, Map

# ---- group: 01. Isovist Model
geometry_pipeline = GeometryPipeline(
    GroupByLayer=False,
    GroupByType=False,
    IncludeHidden=True,
    IncludeLocked=True,
    LayerFilter="BASESTATION POINTS",
    NameFilter="*",
    TypeFilter=1)
pipeline = GeometryPipeline(
    GroupByLayer=False,
    GroupByType=False,
    IncludeHidden=True,
    IncludeLocked=True,
    LayerFilter="_gh_boundary_isovist_BVN",
    NameFilter="*",
    TypeFilter=4)
point = Point(geometry_pipeline)
python = PythonScript(points=point, lines=Slider(1000, range=0..1000), radius=Slider(5000, range=0..10000), boundries=pipeline)  # -> pointOut, totalIsovist, isovistsClear, overlapSpace, isovistsList, isovistTotalSurface, nonOverlapSpace; inputs points: list of Point3d, lines: Int32, radius: Int32, boundries: list; disabled
# ---------- python: Python ----------
import ghpythonlib.components as ghcomp
import rhinoscriptsyntax as rs
import Rhino.Geometry as rg




isovistsList = []
overlapSpaceList = []
isovistsClear = []
pointOut = points

for point in points:
    isovists = ghcomp.IsoVist(point,lines,radius,boundries)
    getIsovistPoints=isovists[0]
    isovistsOutline = ghcomp.PolyLine(getIsovistPoints,True)
    makeSurface = ghcomp.BoundarySurfaces(isovistsOutline)
    print makeSurface
    isovistsList.append(makeSurface)

coerceBrepList = []

for individualIsovists in isovistsList:
    coercedOneBrep = rs.coercebrep(individualIsovists)
    coerceBrepList.append(coercedOneBrep)

isovistCoercedUnion = ghcomp.RegionUnion(coerceBrepList)
isovistTotalSurface = ghcomp.BoundarySurfaces(isovistCoercedUnion)

interA = isovistsList[0:len(isovistsList)-1]
interB = isovistsList[1:]

for itsA in interA:
    for itsB in interB:
        if itsA == itsB:
            print itsA
        else:
            regionInter = ghcomp.RegionIntersection(itsA,itsB)
            surfaceInter = ghcomp.BoundarySurfaces(regionInter)
            #if len(surfaceInter) != 1:
            #    for listList in surfaceInter:
            #        print listList
            #        overlapSpaceList.append(listList)
            overlapSpaceList.append(surfaceInter)


flatOver = []

for testList in overlapSpaceList:
    testIfList = isinstance(testList, list)
    if testIfList == True:
        for isList in testList:
            flatOver.append(isList)
    else:
        flatOver.append(testList)

overlapSpace = flatOver

##asd = []

##overlapSpace = ghcomp.RegionUnion(flatOver)

##for getnotOverlapSpace in isovistsList:
##    pineapple = ghcomp.RegionDifference(getnotOverlapSpace, overlapSpace)
##    asd.append(pineapple)
##nonOverlapSpace = asd


#overlapCombination = ghcomp.RegionUnion(flatOver)
#print overlapCombination
#overlapSurface = ghcomp.BoundarySurfaces(overlapCombination)
#overlapCalcArea = ghcomp.Area(overlapSurface)
#print overlapCalcArea


#for overlapPiece in overlapCalcArea[0]:
#    overlapArea = overlapArea + overlapPiece

#print overlapSpaceList
#overlapSpace = flatOver



#ghcomp.regi

#a = isovistsList
# ---------- end python ----------

# ----
names_2 = Panel("""Citizen
Library Table
Library
Resource Room
Training Room
Server Room
Boardroom
Reception
Lobby
Out
Shower
My Desk
Quiet N
Meeting N
V Table N
Pebble Sofa
V Table Round
V Meeting N
Coffee Machine
V Meeting S
V Table S
Hug
Meeting S
Quiet S
Model Table
M Toilet""")
geometry_pipeline_2 = GeometryPipeline(
    GroupByLayer=False,
    GroupByType=False,
    IncludeHidden=True,
    IncludeLocked=True,
    LayerFilter="STATE POINTS",
    NameFilter="*",
    TypeFilter=1)
point_2 = Point(geometry_pipeline_2)
deconstruct = Deconstruct(Point=point_2)  # -> XComponent, YComponent, ZComponent
basestation_tag = TextTag3D(
    Location=point_2,
    Text=names_2,
    Size=Slider(1163, range=0..10000),
    Colour=ColourSwatch(SwatchColor=RGB(255, 0, 0)),
    Justification=7)
x_coords = Panel(deconstruct.XComponent)
y_coords = Panel(deconstruct.YComponent)

panel = Panel(create_set.Set)

# ----
# Sorting Basestation based on Closest Curve
names_3 = Panel("""Ace
Alfa
Beer
Bravo
Charlie
Coco
Dee
Echo
Edward
Foxtrot
Hotel
George
Golf
Harry
Freddie
India
Ink
Johnnie
Juliett
Kilo
King
Lima
London
Mike
Monkey
November
Nuts
Orange
Oscar
Papa
Pip
Quebec
Queen
Robert
Romeo
Sierra
Sugar
Tango
Tick
Uncle
Uniform
Vic
Victor
Whisky
William
X-ray
X-men
Yankee
Yorker
Zebra
Zulu""")
geometry_pipeline_3 = GeometryPipeline(
    GroupByLayer=False,
    GroupByType=False,
    IncludeHidden=True,
    IncludeLocked=True,
    LayerFilter="SORTING CURVE -2",
    NameFilter="*",
    TypeFilter=4)
disc = Discontinuity(Curve=geometry_pipeline_3, Level=1)  # -> Points, Parameters
cluster = Cluster(source_list=disc.Points, target_list=names_3)
sorted_points = Point(disc.Points)
basestation_xy = Deconstruct(Point=sorted_points)  # -> XComponent, YComponent, ZComponent
sph = Sphere(Base=sorted_points, Radius=Slider(638, range=0..1000))
basestation_tag_2 = TextTag3D(
    Location=disc.Points,
    Text=cluster,
    Size=Slider(1163, range=0..10000),
    Colour=ColourSwatch(SwatchColor=RGB(255, 0, 0)),
    Justification=7)
y_coords_2 = Panel(basestation_xy.YComponent)
x_coords_2 = Panel(basestation_xy.XComponent)

bvn_path = FilePath("F:\BlankMindBlog\helpers\basestation_location\baseStations_BVN.json")
arup_path = FilePath("F:\BlankMindBlog\helpers\basestation_location\baseStations_ARUP.json")

# ----
# Detections
# Given a list of names, this finds all the detections related to each of those names and returns them as a list of lists.
json_detections = PythonScript(FilePath=windows_simdata, uuid=panel)  # -> agent, time
# ---------- json_detections: Python ----------
import json

if FilePath:
    
    # JSON file to read
    file = open(FilePath)
    
    # Load the data
    detections = json.load(file)
    #data = str(detections)
    
    time = []
    agent = []
    
    for d in detections:
        if d['uuid'] == uuid:
#            print detection
            time.append( d['time'] )
            agent.append( d['agentId'] )
# ---------- end json_detections ----------
create_set_2 = CreateSet(List=json_detections.agent)  # -> Set, Map
panel_2 = Panel(create_set_2.Set)
panel_3 = Panel(json_detections.agent)
panel_4 = Panel(json_detections.time)

# ----
# This maps the points so that the path is continous e.g. [0] to [1], [1] to [2]....
joining_curves = PythonScript(agent=json_detections.agent)  # -> start, end; inputs agent: list
# ---------- joining_curves: Python ----------
import ghpythonlib as gh

x = 0
start = []
end = []

while x < len(agent)-1:
    start.append(agent[x])
    end.append(agent[x + 1])
    x = x + 1
    
    print start
    print end
# ---------- end joining_curves ----------
panel_5 = Panel(joining_curves.start)
panel_6 = Panel(joining_curves.end)

# ----
# This takes list of detections and
# returns the x, y coords of the basestations
# Start and End Pts
number_slider = Slider(313, range=0..1000)
detection_of_start_point = DetectionOfStartPoint(filepath=bvn_path, inputname=panel_5)  # -> x, y
detection_of_end_point = DetectionOfStartPoint(filepath=bvn_path, inputname=panel_6)  # -> x, y
start_pts = ConstructPoint(XCoordinate=detection_of_start_point.x, YCoordinate=detection_of_start_point.y, ZCoordinate=0)
end_pts = ConstructPoint(XCoordinate=detection_of_end_point.x, YCoordinate=detection_of_end_point.y, ZCoordinate=0)
point_3 = Point(start_pts)
sphere = Sphere(Base=[start_pts, end_pts], Radius=number_slider)
panel_7 = Panel(end_pts)
panel_8 = Panel(start_pts)

# ----
# Obstacles and Nav Mesh BVN
geometry_pipeline_4 = GeometryPipeline(
    GroupByLayer=False,
    GroupByType=False,
    IncludeHidden=True,
    IncludeLocked=True,
    LayerFilter="_gh_nav_graph_BVN",
    NameFilter="*",
    TypeFilter=4)
data_dam = DataDam(DataDataA=geometry_pipeline_4, BufferDelay=10000000, BufferMode=0)
geometry = Geometry(data_dam)

number_slider_2 = Slider(10, range=0..10)  # disabled
number_slider_3 = Slider(100, range=0..100)  # disabled
construct_particle = ConstructParticle(
    UpDirection=Vector(0, 0, 1),
    Acceleration=Vector(0, 0, 0),
    Lifespan=30,
    Mass=1,
    BodySize=number_slider_3,
    HistoryLength=number_slider_2)  # disabled
number_slider_4 = Slider(20, range=0..100)  # disabled
point_emitter = PointEmitter(
    ContinuousFlow=True,
    CreationRate=1,
    NumberOfQuelea=0,
    MinimumInitialVelocity=Vector(-0.1, -0.1, -0.1),
    MaximumInitialVelocity=Vector(0.1, 0.1, 0.1),
    Point=Point(0, 0, 0))  # disabled
construct_agent = ConstructAgent(ParticleQueleaSettings=construct_particle, MaxSpeed=0.5, MaxForce=0.1, VisionRadius=number_slider_4, VisionAngle=360)  # disabled
system = System(QueleaSettings=construct_agent, Emitters=point_emitter)  # -> System, Quelea, QueleaNetwork; disabled
boolean_toggle = BooleanToggle(False)  # disabled
point_4 = Point(<point referenced from the Rhino model>)  # disabled
boolean_toggle_2 = BooleanToggle(False)  # disabled
number_slider_5 = Slider(100, range=0..100)  # disabled
timer = Timer(TimerInterval=20, Target=[engine, system])  # disabled
engine = Engine(Reset=boolean_toggle_2, System=system.System)  # disabled
arrive_force = ArriveForce(Apply=boolean_toggle, WeightMultiplier=1, AgentQuelea=system.Quelea, TargetPoint=point_4, ArrivalRadius=number_slider_5)  # -> Force, DesiredVelocity; disabled
get_particle_position = GetParticlePosition(ParticleQuelea=system.Quelea)  # -> Position, SurfacePosition; disabled
point_5 = Point(<point referenced from the Rhino model>)  # disabled
boolean_toggle_3 = BooleanToggle(False)  # disabled
deconstruct_quelea_network = DeconstructQueleaNetwork()  # disabled
arrive_force_2 = ArriveForce(Apply=boolean_toggle_3, WeightMultiplier=1, AgentQuelea=system.Quelea, TargetPoint=point_5, ArrivalRadius=5)  # -> Force, DesiredVelocity; disabled

# ----
# Direct Path
# What the path should be without the obstacles
number_slider_6 = Slider(72, range=0..100)
line = Line(StartPoint=panel_8, EndPoint=panel_7)
pipe = Pipe(Curve=line, Radius=number_slider_6, Caps=0)

data = Data([panel_7, panel_8])
create_set_3 = CreateSet(List=data)  # -> Set, Map
create_set_4 = CreateSet(List=create_set_3.Map)  # -> Set, Map
member_index = MemberIndex(Set=create_set_3.Map, Member=create_set_4.Set)  # -> Index, Count
panel_9 = Panel(member_index.Count)

# ----
# shortest walk/ simulated data
shortest_walk = ShortestWalk(Curves=geometry, WantedPath=line)  # -> ShortestWalk, Succession, Direction, Length
number_slider_7 = Slider(80, range=0..100)
point_on_curve = PointOnCurve(panel_7, parameter=0)
curve = Curve(shortest_walk.ShortestWalk)
text_tag_3d = TextTag3D(
    Location=shortest_walk.ShortestWalk,
    Text=graft(panel),
    Size=Slider(1297, range=0..5000),
    Colour=RGB(255, 0, 0),
    Justification=7)
discontinuity = Discontinuity(Curve=shortest_walk.ShortestWalk, Level=1)  # -> Points, Parameters
pipe_2 = Pipe(Curve=curve, Radius=number_slider_7, Caps=0)
mesh_sphere = MeshSphere(Base=point_on_curve, Radius=Slider(500, range=0..500), UCount=5, VCount=4)

# ----
# Vectors Along Path
list_item = ListItem(List=geometry, Index=shortest_walk.Succession, Wrap=False)
end_points = EndPoints(Curve=list_item)  # -> Start, End
evaluate_length = EvaluateLength(Curve=list_item, Length=0.5, Normalized=True)  # -> Point, Tangent, Parameter
vector_2pt = Vector2Pt(PointA=end_points.Start, PointB=end_points.End, Unitize=False)  # -> Vector, Length
remap_numbers = RemapNumbers(Values=shortest_walk.Direction, Source=Domain(0, 1), Target=Domain(-0.1, 0.1))
amplitude = Amplitude(Vector=vector_2pt.Vector, Amplitude=remap_numbers)
vector_display = VectorDisplay(Anchor=evaluate_length.Point, Vector=amplitude)

point_list = PointList(Points=point_on_curve, Size=number_slider_7)

len = Length(Curve=curve)
bnd = Bounds(Numbers=len)
dedomain = DeconstructDomain(Domain=bnd)  # -> Start, End
gradient = Gradient(
    LowerLimit=dedomain.Start,
    UpperLimit=dedomain.End,
    Parameter=len,
    stops=[0: RGB(255, 0, 0), 0.171: RGB(255, 212, 0), 0.342: RGB(81, 255, 0), 0.496: RGB(0, 255, 136), 0.667: RGB(0, 153, 255), 0.821: RGB(42, 0, 255), 1: RGB(255, 0, 255)])
previewlw = CustomPreviewLineweights(Geometry=mesh_sphere, Shader=gradient, Thickness=Slider(3, range=0..10))

sort_list = SortList(Keys=panel_9)  # -> reverse(Keys), ValuesValuesA

number_slider_8 = Slider(165, range=0..10000)
discontinuity_2 = Discontinuity(Curve=shortest_walk.ShortestWalk, Level=1)  # -> Points, Parameters
negative = Negative(Value=number_slider_8)
point_6 = Point(discontinuity_2.Points)
construct_domain = ConstructDomain(DomainStart=negative, DomainEnd=number_slider_8)
list_length = ListLength(List=point_6)
unit_x = UnitX(Factor=1)
random = Random(Range=construct_domain, Number=list_length, Seed=2)
amplitude_2 = Amplitude(Vector=unit_x, Amplitude=random)
move = Move(Geometry=point_6, Motion=amplitude_2)  # -> Geometry, Transform
nurbs_curve = NurbsCurve(Vertices=move.Geometry, Degree=3, Periodic=False)  # -> Curve, Length, Domain

# ----
# Checkpoints
evaluate_length_2 = EvaluateLength(Curve=shortest_walk.ShortestWalk, Length=[0, 1], Normalized=True)  # -> Point, Tangent, Parameter
unit_z = UnitZ(Factor=1)
cross_product = CrossProduct(VectorA=unit_z, VectorB=evaluate_length_2.Tangent, Unitize=False)  # -> Vector, Length
center_box = CenterBox(Base=evaluate_length_2.Point, X=0.1, Y=0.1, Z=0.07)
construct_plane = Plane(Origin=evaluate_length_2.Point, XAxis=cross_product.Vector, YAxis=unit_z)
T = Text(["START", "GOAL"])
text_tag = TextTag(Location=construct_plane, Text=T)

panel_10 = Panel(sort_list.Keys)

# ==== cluster DetectionOfStartPoint
inputname = ClusterInput()
filepath = ClusterInput()
data_json = PythonScript(FilePath=filepath, inputName=inputname)  # -> out, x, y
# ---------- data_json: Python ----------
import json

if FilePath:
    
    # JSON file to read
    file = open(FilePath)
    
    # Load the data
    data = json.load(file)
    
    # Do something with the data
    for basestation in data:
        print basestation["Name"]
#        print inputName
        if basestation["Name"] == inputName:
            x = basestation["X"]
            y = basestation["Y"]
            print x
            print y
# ---------- end data_json ----------
y = ClusterOutput(data_json.y)
x = ClusterOutput(data_json.x)

# ==== cluster Cluster
source_list = ClusterInput()
list_length = ListLength(SourceList=source_list)
construct_domain = ConstructDomain(DomainStart=0, DomainEnd=expr("x-1", list_length))
target_list = ClusterInput()
sub_list = SubList(TargetList=target_list, Domain=construct_domain, Wrap=False)  # -> List, Index
list = ClusterOutput(sub_list.List)
