# Grasshopper definition EXPERIMENT_9.gh (Grasshopper 0.9.76)

knob = ControlKnob(Decimals=2, Limit=True, Maximum=10, Minimum=0, Range=1, Value=5.73)
pt = Point([<point referenced from the Rhino model> x109])
pline = PolyLine(Vertices=pt, Closed=False)
divide = DivideCurve(Curve=pline, Count=Slider(1536, range=0..10000), Kinks=False)  # -> Points, Tangents, Parameters
item = ListItem(List=divide.Points, Index=Slider(1539, range=0..1539), Wrap=True)
tracker = ValueTracker(item, TrackerAutoDomain=True, TrackerColour=RGB(255, 155, 0), TrackerPeriod=10, TrackerUpdate=25, TrackerDomain=[0, 1])
sph = Sphere(Base=item, Radius=Slider(869, range=0..1000))
preview = CustomPreview(
    Geometry=sph,
    Shader={ambient=RGB(0, 0, 0), diffuse=RGB(255, 105, 180), emission=RGB(76, 32, 54), shine=0.5, specular=RGB(255, 255, 255), transparency=0})
