# Grasshopper definition unnamed.gh (Grasshopper 0.9.75)
# plug-ins: Python Interpreter

panel = Panel("""4
5
6
6
6
6
7""")
python_script = PythonScript(stops=panel)  # -> out, a; inputs stops: list
# ---------- python_script: Python ----------
import rhinoscriptsyntax as rs
import Rhino.Geometry as rg

a = []

for i in range(len(stops)-1):
    if (stops[i] == stops[i+1]):
        point = rs.AddPoint(0,0,0)
        a.append(point)
    else:
        a.append(stops[i])

a.append(stops[len(stops)-1])
# ---------- end python_script ----------
construct_domain = ConstructDomain(DomainStart=Slider(500, range=0..1000), DomainEnd=Slider(1000, range=0..1000))
panel_2 = Panel(python_script.a)
point = Point(python_script.a)
xy_plane = XYPlane(Origin=Point(0, 0, 0))
amplitude = Amplitude(Vector=xy_plane, Amplitude=construct_domain)
xz_plane = XZPlane(Origin=Point(0, 0, 0))
list_item = ListItem(List=python_script.a, Index=Slider(3, range=0..10), Wrap=True)
move = Move(Geometry=point, Motion=amplitude)  # -> Geometry, Transform
amplitude_2 = Amplitude(Vector=xz_plane, Amplitude=Slider(10, range=0..10))
point_2 = Point(list_item)
move_2 = Move(Geometry=point_2, Motion=amplitude_2)  # -> Geometry, Transform
