# Grasshopper definition 001.visualisation_triangles.gh (Grasshopper 0.9.76)
# plug-ins: Python Interpreter

# ----
# Import Json file
# of Base Station locations:
#  Must be for BVN!
# This draws out the points that corespond to the base stations.
# I've cheated and put in a static list of base stations instead of reading it froma file. This is for laziness and for performance (that list doesn't change much).
panel = Panel("""Alpha
Bravo
Charlie
Delta
Echo
Foxtrot
Gandalf
Golf
Hotel
India
Jean
Juliett
Kat
Kilo
Lima
Meow
Mike
Neil
November
Oscar
Papa
Quebec
Romeo
Sierra
Spock
Tango
Tony
Uniform
Victor""")
path = FilePath("C:\Users\Tiara\Desktop\gitfolder\BlankMindBlog\helpers\basestation_location\baseStations_BVN.json")
cluster = Cluster_2(filepath=path, inputname=panel)  # -> x, y
# original
#  centroid
panel_2 = Panel(cluster.x)
pt = ConstructPoint(XCoordinate=cluster.x, YCoordinate=cluster.y, ZCoordinate=0)
panel_3 = Panel(cluster.y)

tag = TextTag3D(Location=pt, Text=panel, Size=1562, Colour=RGB(3, 217, 255), Justification=5)
panel_4 = Panel("""[
  { "name": "alex",   "basestation": "Kilo",  "time": "2016-07-12T09:52:24.117117" },
  { "name": "annisa", "basestation": "Bravo", "time": "2016-07-12T09:52:26.021353" },
  { "name": "tiara",  "basestation": "Spock", "time": "2016-07-12T09:52:28.893738" },
  { "name": "alex",   "basestation": "Lima",  "time": "2016-07-12T09:52:19.344178" },
  { "name": "annisa", "basestation": "Papa",  "time": "2016-07-12T09:52:29.852827" },
  { "name": "tiara",  "basestation": "Alpha", "time": "2016-07-12T09:52:29.852827" },
  { "name": "alex",   "basestation": "Kilo",  "time": "2016-07-12T09:52:24.117117" },
  { "name": "annisa", "basestation": "Bravo", "time": "2016-07-12T09:52:26.021353" },
  { "name": "tiara",  "basestation": "Golf",  "time": "2016-07-12T09:52:28.893738" },
  { "name": "alex",   "basestation": "Neil",  "time": "2016-07-12T09:52:19.344178" },
  { "name": "annisa", "basestation": "Golf",  "time": "2016-07-12T09:52:29.852827" },
  { "name": "tiara",  "basestation": "Sierra", "time": "2016-07-12T09:52:29.852827"}
]""")

# ----
# Set the actual position
#  of person
pt_2 = Point(<point referenced from the Rhino model>)

# ----
# BaseStations
pt_3 = Point(pt)

# ----
# don't worry about me for now, still working
#  on this but eventually it is going to work
#  to replace the location data of the
# person within the rhino file with a
# guestimate location(based on rssi
# values and known locations of beacons
#  within a floorplan.
python = PythonScript(dateutil_parser=panel_4, baseStationNames=panel, searchName="tiara")  # -> out, a
# ---------- python: Python ----------
import json
import dateutil.parser
import datetime

# start the counter at a specific date and time, if not automatically specified, the 
# program will assume the first time stamp on the file is the first detection and will read from then. and make the time interval between 0 to 5 minutes

start = dateutil.parser.parse('2016-07-12T09:52:21.251939')
end = start + datetime.timedelta(minutes=5)

# after you have selected time, open the json file and go through the looking for 
#  

with open('in.json', 'r') as f:
    data = json.loads(f.read())
    d = []
    for x in data:
        time = dateutil.parser.parse(x['time'])
        if start < time < end:
            d.append(x['rssi'])
    
# print all the sorted rssi values from all the base stations within that time period
    print(sorted(d))
    

# now rank those base stations on the highest average of rssi, to make it indexing 
# x = np.array([0, 1, 2, 3, 4, 5, 6, 7, 8, 9]), x[1:7:2], array([1, 3, 5])

average = 0
sum = 0    
for n in numbers:
    sum = sum + n
average = sum / len(numbers)

### now output back to the three highest averages attached to the name sof the 
# base stations in their order or their appearance in the array. 
# sort by rssi and give me three basestation names as an output in order of rank

L = []
    L = [0,1,2]
    
    print L
    

# The output will give you three baseStation names. 
# search through the list of the baseStation names and  then place points at those coordinants
# you will have to look into the json file for this to happen

search
# ---------- end python ----------
panel_5 = Panel(python.out)

# ----
# Furniture
# boundarys
cluster_2 = Cluster()

# ----
# Actual position
#  of person
pt_4 = Point(pt_2)
preview = CustomPreview(Geometry=pt_4, Shader=ColourSwatch(SwatchColor=RGB(8, 8, 255)))

# ----
# Draw a triangle
# and make a centroid
number_slider = Slider(0, range=0..2)
cps = ClosestPoints(Point=pt_2, Cloud=pt_3, Count=Slider(3, range=0..10))  # -> ClosestPoint, CPIndex, Distance
pt_5 = Point(cps.ClosestPoint)
item = ListItem(List=pt_5, Index=Slider(2, range=0..2), Wrap=True)
item_2 = ListItem(List=pt_5, Index=number_slider, Wrap=True)
item_3 = ListItem(List=pt_5, Index=Slider(1, range=0..2), Wrap=True)

dist = Distance(PointA=item_2, PointB=item)
ln = Line(StartPoint=item_2, EndPoint=item)

dist_2 = Distance(PointA=item, PointB=item_3)
ln_2 = Line(StartPoint=item, EndPoint=item_3)

dist_3 = Distance(PointA=item_3, PointB=item_2)
ln_3 = Line(StartPoint=item_3, EndPoint=item_2)

panel_6 = Panel(dist_3)
panel_7 = Panel(dist)
panel_8 = Panel(dist_2)
boundary = BoundarySurfaces(Edges=[ln_2, ln_3, ln])
area = Area(Geometry=boundary)  # -> Area, Centroid
pt_6 = Point(area.Centroid)

# ----
# check if points are
#  inside a list of curves
# A = inside all curves
# B = outside all curves
# C = inside some curves
# Reporting: Project point
# outside of furniture
crv = Curve(cluster_2)
# Make the estimated
#  position avoid furniture
c_script = CSharpScript(pts=pt_6, crvs=crv)  # -> out, A, B, C; inputs pts: list of Point3d, crvs: list of Polyline
# ---------- c_script: C# ----------
    var inside = new List<Point3d>();
    var outside = new List<Point3d>();
    var other = new List<Point3d>();

    foreach (Point3d pt in pts)
    {
      int insideCount = 0;
      foreach (var crv in crvs)
      {
        if(IsInside(pt, crv)) insideCount++;
      }
      if(insideCount == crvs.Count) inside.Add(pt);
      else if(insideCount == 0) outside.Add(pt);
      else other.Add(pt);
    }
    A = inside;
    B = outside;
    C = other;
# ---------- c_script: C# additional code ----------
  bool IsInside (Point3d pt, Polyline crv)
  {
    Point3d pt1, pt2;
    bool oddNodes = false;

    for (int i = 0; i < crv.SegmentCount; i++) //for each contour line
    {

      pt1 = crv.SegmentAt(i).From; //get start and end pt
      pt2 = crv.SegmentAt(i).To;

      if ( (pt1[1] < pt[1] && pt2[1] >= pt[1] || pt2[1] < pt[1] && pt1[1] >= pt[1]) && (pt1[0] <= pt[0] || pt2[0] <= pt[0]) ) //if pt is between pts in y, and either of pts is before pt in x
        oddNodes ^= ( pt2[0] + (pt[1] - pt2[1]) * (pt1[0] - pt2[0]) / (pt1[1] - pt2[1]) < pt[0] ); //^= is xor
      //end.X + (pt-end).Y   * (start-end).X  /(start-end).Y   <   pt.X
    }


    if (!oddNodes)
    {
      double minDist = 1e10;
      for (int i = 0; i < crv.SegmentCount; i++) {
        Point3d cp = crv.SegmentAt(i).ClosestPoint(pt, true);
        //Point3d cp = mvContour[i].closestPoint(pt);
        //minDist = min(minDist, cp.distance(pt));
        minDist = Math.Min(minDist, cp.DistanceTo(pt));
      }
      if (minDist < 1e-10)
        return true;
    }

    if(oddNodes) return true;

    return false;

  }
# ---------- end c_script ----------
pt_c = Point(c_script.C)
panel_9 = Panel(pt_c)
pt_a = Point(c_script.A)
pt_b = Point(c_script.B)

# ----
# Check curve
# closet point
crv_cp = CurveClosestPoint(Point=[pt_c, pt_b], Curve=flatten(crv))  # -> Point, Parameter, Distance
sort = SortList(Keys=crv_cp.Distance, ValuesA=flatten(crv))  # -> Keys, ValuesA
panel_10 = Panel(sort.ValuesA)
panel_11 = Panel(crv_cp.Distance)
item_4 = ListItem(List=sort.ValuesA, Index=Slider(0, range=0..100), Wrap=True)

divide = DivideCurve(Curve=item_4, Count=Slider(4, range=0..10), Kinks=False)  # -> Points, Tangents, Parameters
cp = ClosestPoint(Point=pt_6, Cloud=divide.Points)  # -> ClosestPoint, CPIndex, Distance

# ----
# Estimated
# Position
# check accuracy >
# by comparing actual
# posiition with calculated
# position
swatch = ColourSwatch(SwatchColor=RGB(253, 8, 0))
# Test Me!
pt_7 = Point(cp.ClosestPoint)
preview_2 = CustomPreview(Geometry=pt_7, Shader=swatch)
dist_4 = Distance(PointA=pt_7, PointB=pt_4)
ln_4 = Line(StartPoint=pt_7, EndPoint=pt_4)
panel_12 = Panel(dist_4)

# ==== cluster Cluster

crv = Curve([<curve referenced from the Rhino model> x4806])
crv_2 = Curve([<curve referenced from the Rhino model> x58])
crv_3 = Curve([<curve referenced from the Rhino model> x62])
crv_4 = Curve([<curve referenced from the Rhino model> x3212])
crv_5 = Curve([<curve referenced from the Rhino model> x2945])
crv_6 = Curve([<curve referenced from the Rhino model> x62])
crv_7 = Curve([<curve referenced from the Rhino model> x3232])
crv_8 = Curve([<curve referenced from the Rhino model> x3204])
crv_9 = Curve([<curve referenced from the Rhino model> x2920])
crv_10 = Curve([<curve referenced from the Rhino model> x3204])
end = EndPoints(Curve=crv)  # -> Start, End
end_2 = EndPoints(Curve=crv_2)  # -> Start, End
end_3 = EndPoints(Curve=crv_3)  # -> Start, End
end_4 = EndPoints(Curve=crv_4)  # -> Start, End
end_5 = EndPoints(Curve=crv_5)  # -> Start, End
end_6 = EndPoints(Curve=crv_6)  # -> Start, End
end_7 = EndPoints(Curve=crv_7)  # -> Start, End
end_8 = EndPoints(Curve=crv_8)  # -> Start, End
end_9 = EndPoints(Curve=crv_9)  # -> Start, End
end_10 = EndPoints(Curve=crv_10)  # -> Start, End
hull = ConvexHull(Points=[end.Start, end.End], Plane=PlaneXY(0, 0, 0))  # -> Hull, HullZ, Indices
hull_2 = ConvexHull(Points=[end_2.Start, end_2.End], Plane=PlaneXY(0, 0, 0))  # -> Hull, HullZ, Indices
hull_3 = ConvexHull(Points=[end_4.Start, end_4.End], Plane=PlaneXY(0, 0, 0))  # -> Hull, HullZ, Indices
hull_4 = ConvexHull(Points=[end_5.Start, end_5.End], Plane=PlaneXY(0, 0, 0))  # -> Hull, HullZ, Indices
hull_5 = ConvexHull(Points=[end_6.Start, end_6.End], Plane=PlaneXY(0, 0, 0))  # -> Hull, HullZ, Indices
hull_6 = ConvexHull(Points=[end_3.Start, end_3.End], Plane=PlaneXY(0, 0, 0))  # -> Hull, HullZ, Indices
hull_7 = ConvexHull(Points=[end_7.Start, end_7.End], Plane=PlaneXY(0, 0, 0))  # -> Hull, HullZ, Indices
hull_8 = ConvexHull(Points=[end_8.Start, end_8.End], Plane=PlaneXY(0, 0, 0))  # -> Hull, HullZ, Indices
hull_9 = ConvexHull(Points=[end_9.Start, end_9.End], Plane=PlaneXY(0, 0, 0))  # -> Hull, HullZ, Indices
hull_10 = ConvexHull(Points=[end_10.Start, end_10.End], Plane=PlaneXY(0, 0, 0))  # -> Hull, HullZ, Indices

crv_11 = Curve([<curve referenced from the Rhino model> x30])
crv_12 = Curve([<curve referenced from the Rhino model> x246])
crv_13 = Curve([<curve referenced from the Rhino model> x75])
crv_14 = Curve([<curve referenced from the Rhino model> x57])
crv_15 = Curve([<curve referenced from the Rhino model> x45])
crv_16 = Curve([<curve referenced from the Rhino model> x32])
end_11 = EndPoints(Curve=crv_11)  # -> Start, End
end_12 = EndPoints(Curve=crv_12)  # -> Start, End
end_13 = EndPoints(Curve=crv_13)  # -> Start, End
end_14 = EndPoints(Curve=crv_14)  # -> Start, End
end_15 = EndPoints(Curve=crv_15)  # -> Start, End
end_16 = EndPoints(Curve=crv_16)  # -> Start, End
hull_11 = ConvexHull(Points=[end_11.Start, end_11.End], Plane=PlaneXY(0, 0, 0))  # -> Hull, HullZ, Indices
hull_12 = ConvexHull(Points=[end_12.Start, end_12.End], Plane=PlaneXY(0, 0, 0))  # -> Hull, HullZ, Indices
hull_13 = ConvexHull(Points=[end_13.Start, end_13.End], Plane=PlaneXY(0, 0, 0))  # -> Hull, HullZ, Indices
hull_14 = ConvexHull(Points=[end_14.Start, end_14.End], Plane=PlaneXY(0, 0, 0))  # -> Hull, HullZ, Indices
hull_15 = ConvexHull(Points=[end_15.Start, end_15.End], Plane=PlaneXY(0, 0, 0))  # -> Hull, HullZ, Indices
hull_16 = ConvexHull(Points=[end_16.Start, end_16.End], Plane=PlaneXY(0, 0, 0))  # -> Hull, HullZ, Indices

crv_17 = Curve([<curve referenced from the Rhino model> x642])
crv_18 = Curve([<curve referenced from the Rhino model> x45])
crv_19 = Curve([<curve referenced from the Rhino model> x233])
crv_20 = Curve([<curve referenced from the Rhino model> x143])
crv_21 = Curve([<curve referenced from the Rhino model> x6])
crv_22 = Curve([<curve referenced from the Rhino model> x26])
crv_23 = Curve([<curve referenced from the Rhino model> x82])
crv_24 = Curve([<curve referenced from the Rhino model> x66])
crv_25 = Curve([<curve referenced from the Rhino model> x79])
crv_26 = Curve([<curve referenced from the Rhino model> x171])
divide = DivideCurve(Curve=crv_19, Count=10, Kinks=False)  # -> flatten(Points), Tangents, Parameters
divide_2 = DivideCurve(Curve=crv_18, Count=10, Kinks=False)  # -> flatten(Points), Tangents, Parameters
divide_3 = DivideCurve(Curve=crv_20, Count=10, Kinks=False)  # -> flatten(Points), Tangents, Parameters
divide_4 = DivideCurve(Curve=crv_21, Count=10, Kinks=False)  # -> flatten(Points), Tangents, Parameters
divide_5 = DivideCurve(Curve=crv_22, Count=10, Kinks=False)  # -> flatten(Points), Tangents, Parameters
divide_6 = DivideCurve(Curve=crv_23, Count=10, Kinks=False)  # -> flatten(Points), Tangents, Parameters
end_17 = EndPoints(Curve=crv_17)  # -> Start, End
divide_7 = DivideCurve(Curve=crv_24, Count=10, Kinks=False)  # -> flatten(Points), Tangents, Parameters
divide_8 = DivideCurve(Curve=crv_25, Count=10, Kinks=False)  # -> flatten(Points), Tangents, Parameters
divide_9 = DivideCurve(Curve=crv_26, Count=10, Kinks=False)  # -> flatten(Points), Tangents, Parameters
hull_17 = ConvexHull(Points=[end_17.Start, end_17.End], Plane=PlaneXY(0, 0, 0))  # -> Hull, HullZ, Indices
hull_18 = ConvexHull(Points=divide_3.Points, Plane=PlaneXY(0, 0, 0))  # -> Hull, HullZ, Indices
hull_19 = ConvexHull(Points=divide_2.Points, Plane=PlaneXY(0, 0, 0))  # -> Hull, HullZ, Indices
hull_20 = ConvexHull(Points=divide_5.Points, Plane=PlaneXY(0, 0, 0))  # -> Hull, HullZ, Indices
hull_21 = ConvexHull(Points=divide_6.Points, Plane=PlaneXY(0, 0, 0))  # -> Hull, HullZ, Indices
hull_22 = ConvexHull(Points=divide.Points, Plane=PlaneXY(0, 0, 0))  # -> Hull, HullZ, Indices
hull_23 = ConvexHull(Points=divide_7.Points, Plane=PlaneXY(0, 0, 0))  # -> Hull, HullZ, Indices
hull_24 = ConvexHull(Points=divide_4.Points, Plane=PlaneXY(0, 0, 0))  # -> Hull, HullZ, Indices
hull_25 = ConvexHull(Points=divide_8.Points, Plane=PlaneXY(0, 0, 0))  # -> Hull, HullZ, Indices
hull_26 = ConvexHull(Points=divide_9.Points, Plane=PlaneXY(0, 0, 0))  # -> Hull, HullZ, Indices

crv_27 = Curve([<curve referenced from the Rhino model> x7])
crv_28 = Curve([<curve referenced from the Rhino model> x4])
crv_29 = Curve([<curve referenced from the Rhino model> x8])
crv_30 = Curve([<curve referenced from the Rhino model> x8])

crv_31 = Curve([<curve referenced from the Rhino model> x9])
crv_32 = Curve(<curve referenced from the Rhino model>)
crv_33 = Curve([<curve referenced from the Rhino model> x16])

crv_34 = Curve([<curve referenced from the Rhino model> x4])
crv_35 = Curve([<curve referenced from the Rhino model> x3])
crv_36 = Curve([<curve referenced from the Rhino model> x2])

crv_37 = Curve(<curve referenced from the Rhino model>)
crv_38 = Curve([<curve referenced from the Rhino model> x4])

crv_39 = Curve([<curve referenced from the Rhino model> x4])
crv_40 = Curve(<curve referenced from the Rhino model>)
crv_41 = Curve(<curve referenced from the Rhino model>)
crv_42 = Curve([<curve referenced from the Rhino model> x6])
crv_43 = Curve([<curve referenced from the Rhino model> x5])
crv_44 = Curve([<curve referenced from the Rhino model> x4])
crv_45 = Curve([<curve referenced from the Rhino model> x4])
crv_46 = Curve([<curve referenced from the Rhino model> x4])

end_18 = EndPoints(Curve=crv_28)  # -> Start, End
end_19 = EndPoints(Curve=crv_30)  # -> Start, End
end_20 = EndPoints(Curve=crv_35)  # -> Start, End
end_21 = EndPoints(Curve=crv_27)  # -> Start, End
end_22 = EndPoints(Curve=crv_29)  # -> Start, End
end_23 = EndPoints(Curve=crv_34)  # -> Start, End
end_24 = EndPoints(Curve=crv_36)  # -> Start, End
hull_27 = ConvexHull(Points=[end_18.Start, end_18.End], Plane=PlaneXY(0, 0, 0))  # -> Hull, HullZ, Indices
hull_28 = ConvexHull(Points=[end_20.Start, end_20.End], Plane=PlaneXY(0, 0, 0))  # -> Hull, HullZ, Indices
hull_29 = ConvexHull(Points=[end_19.Start, end_19.End], Plane=PlaneXY(0, 0, 0))  # -> Hull, HullZ, Indices
hull_30 = ConvexHull(Points=[end_21.Start, end_21.End], Plane=PlaneXY(0, 0, 0))  # -> Hull, HullZ, Indices
hull_31 = ConvexHull(Points=[end_22.Start, end_22.End], Plane=PlaneXY(0, 0, 0))  # -> Hull, HullZ, Indices
hull_32 = ConvexHull(Points=[end_24.Start, end_24.End], Plane=PlaneXY(0, 0, 0))  # -> Hull, HullZ, Indices
hull_33 = ConvexHull(Points=[end_23.Start, end_23.End], Plane=PlaneXY(0, 0, 0))  # -> Hull, HullZ, Indices
end_25 = EndPoints(Curve=crv_41)  # -> Start, End
end_26 = EndPoints(Curve=crv_40)  # -> Start, End
end_27 = EndPoints(Curve=crv_43)  # -> Start, End
end_28 = EndPoints(Curve=crv_44)  # -> Start, End
end_29 = EndPoints(Curve=crv_46)  # -> Start, End
end_30 = EndPoints(Curve=crv_42)  # -> Start, End
end_31 = EndPoints(Curve=crv_45)  # -> Start, End
end_32 = EndPoints(Curve=crv_39)  # -> Start, End
hull_34 = ConvexHull(Points=[end_25.Start, end_25.End], Plane=PlaneXY(0, 0, 0))  # -> Hull, HullZ, Indices
end_33 = EndPoints(Curve=crv_38)  # -> Start, End
end_34 = EndPoints(Curve=crv_37)  # -> Start, End
end_35 = EndPoints(Curve=crv_33)  # -> Start, End
end_36 = EndPoints(Curve=crv_31)  # -> Start, End
end_37 = EndPoints(Curve=crv_32)  # -> Start, End
hull_35 = ConvexHull(Points=[end_26.Start, end_26.End], Plane=PlaneXY(0, 0, 0))  # -> Hull, HullZ, Indices
hull_36 = ConvexHull(Points=[end_27.Start, end_27.End], Plane=PlaneXY(0, 0, 0))  # -> Hull, HullZ, Indices
hull_37 = ConvexHull(Points=[end_28.Start, end_28.End], Plane=PlaneXY(0, 0, 0))  # -> Hull, HullZ, Indices
hull_38 = ConvexHull(Points=[end_29.Start, end_29.End], Plane=PlaneXY(0, 0, 0))  # -> Hull, HullZ, Indices
hull_39 = ConvexHull(Points=[end_30.Start, end_30.End], Plane=PlaneXY(0, 0, 0))  # -> Hull, HullZ, Indices
hull_40 = ConvexHull(Points=[end_31.Start, end_31.End], Plane=PlaneXY(0, 0, 0))  # -> Hull, HullZ, Indices
hull_41 = ConvexHull(Points=[end_32.Start, end_32.End], Plane=PlaneXY(0, 0, 0))  # -> Hull, HullZ, Indices
hull_42 = ConvexHull(Points=[end_33.Start, end_33.End], Plane=PlaneXY(0, 0, 0))  # -> Hull, HullZ, Indices
hull_43 = ConvexHull(Points=[end_34.Start, end_34.End], Plane=PlaneXY(0, 0, 0))  # -> Hull, HullZ, Indices
hull_44 = ConvexHull(Points=[end_35.Start, end_35.End], Plane=PlaneXY(0, 0, 0))  # -> Hull, HullZ, Indices
hull_45 = ConvexHull(Points=[end_36.Start, end_36.End], Plane=PlaneXY(0, 0, 0))  # -> Hull, HullZ, Indices
hull_46 = ConvexHull(Points=[end_37.Start, end_37.End], Plane=PlaneXY(0, 0, 0))  # -> Hull, HullZ, Indices

crv_47 = Curve([<curve referenced from the Rhino model> x4806])
crv_48 = Curve([<curve referenced from the Rhino model> x62])
crv_49 = Curve([<curve referenced from the Rhino model> x62])
crv_50 = Curve([<curve referenced from the Rhino model> x16])
crv_51 = Curve([<curve referenced from the Rhino model> x3204])
crv_52 = Curve([<curve referenced from the Rhino model> x2415])
crv_53 = Curve([<curve referenced from the Rhino model> x24])
crv_54 = Curve([<curve referenced from the Rhino model> x5000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])
crv_55 = Curve([<curve referenced from the Rhino model> x4770])
crv_56 = Curve([<curve referenced from the Rhino model> x3204])
end_38 = EndPoints(Curve=crv_47)  # -> Start, End
end_39 = EndPoints(Curve=crv_48)  # -> Start, End
end_40 = EndPoints(Curve=crv_49)  # -> Start, End
end_41 = EndPoints(Curve=crv_50)  # -> Start, End
end_42 = EndPoints(Curve=crv_51)  # -> Start, End
end_43 = EndPoints(Curve=crv_52)  # -> Start, End
end_44 = EndPoints(Curve=crv_53)  # -> Start, End
end_45 = EndPoints(Curve=crv_54)  # -> Start, End
end_46 = EndPoints(Curve=crv_55)  # -> Start, End
end_47 = EndPoints(Curve=crv_56)  # -> Start, End
hull_47 = ConvexHull(Points=[end_38.Start, end_38.End], Plane=PlaneXY(0, 0, 0))  # -> Hull, HullZ, Indices
hull_48 = ConvexHull(Points=[end_39.Start, end_39.End], Plane=PlaneXY(0, 0, 0))  # -> Hull, HullZ, Indices
hull_49 = ConvexHull(Points=[end_40.Start, end_40.End], Plane=PlaneXY(0, 0, 0))  # -> Hull, HullZ, Indices
hull_50 = ConvexHull(Points=[end_41.Start, end_41.End], Plane=PlaneXY(0, 0, 0))  # -> Hull, HullZ, Indices
hull_51 = ConvexHull(Points=[end_42.Start, end_42.End], Plane=PlaneXY(0, 0, 0))  # -> Hull, HullZ, Indices
hull_52 = ConvexHull(Points=[end_43.Start, end_43.End], Plane=PlaneXY(0, 0, 0))  # -> Hull, HullZ, Indices
hull_53 = ConvexHull(Points=[end_44.Start, end_44.End], Plane=PlaneXY(0, 0, 0))  # -> Hull, HullZ, Indices
hull_54 = ConvexHull(Points=[end_45.Start, end_45.End], Plane=PlaneXY(0, 0, 0))  # -> Hull, HullZ, Indices
hull_55 = ConvexHull(Points=[end_46.Start, end_46.End], Plane=PlaneXY(0, 0, 0))  # -> Hull, HullZ, Indices
hull_56 = ConvexHull(Points=[end_47.Start, end_47.End], Plane=PlaneXY(0, 0, 0))  # -> Hull, HullZ, Indices

crv_57 = Curve([<curve referenced from the Rhino model> x45])
crv_58 = Curve(<curve referenced from the Rhino model>)
crv_59 = Curve([<curve referenced from the Rhino model> x9])
crv_60 = Curve([<curve referenced from the Rhino model> x4])
crv_61 = Curve([<curve referenced from the Rhino model> x8])
crv_62 = Curve([<curve referenced from the Rhino model> x28])
divide_10 = DivideCurve(Curve=crv_58, Count=10, Kinks=False)  # -> flatten(Points), Tangents, Parameters
divide_11 = DivideCurve(Curve=crv_60, Count=10, Kinks=False)  # -> flatten(Points), Tangents, Parameters
divide_12 = DivideCurve(Curve=crv_57, Count=10, Kinks=False)  # -> flatten(Points), Tangents, Parameters
divide_13 = DivideCurve(Curve=crv_62, Count=10, Kinks=False)  # -> flatten(Points), Tangents, Parameters
divide_14 = DivideCurve(Curve=crv_59, Count=10, Kinks=False)  # -> flatten(Points), Tangents, Parameters
divide_15 = DivideCurve(Curve=crv_61, Count=10, Kinks=False)  # -> flatten(Points), Tangents, Parameters
hull_57 = ConvexHull(Points=divide_10.Points, Plane=PlaneXY(0, 0, 0))  # -> Hull, HullZ, Indices
hull_58 = ConvexHull(Points=divide_11.Points, Plane=PlaneXY(0, 0, 0))  # -> Hull, HullZ, Indices
hull_59 = ConvexHull(Points=divide_15.Points, Plane=PlaneXY(0, 0, 0))  # -> Hull, HullZ, Indices
hull_60 = ConvexHull(Points=divide_13.Points, Plane=PlaneXY(0, 0, 0))  # -> Hull, HullZ, Indices
hull_61 = ConvexHull(Points=divide_12.Points, Plane=PlaneXY(0, 0, 0))  # -> Hull, HullZ, Indices
hull_62 = ConvexHull(Points=divide_14.Points, Plane=PlaneXY(0, 0, 0))  # -> Hull, HullZ, Indices

crv_63 = Curve([<curve referenced from the Rhino model> x293])
crv_64 = Curve([<curve referenced from the Rhino model> x10])
crv_65 = Curve([<curve referenced from the Rhino model> x81])
crv_66 = Curve([<curve referenced from the Rhino model> x81])
crv_67 = Curve([<curve referenced from the Rhino model> x36])
end_48 = EndPoints(Curve=crv_65)  # -> Start, End
end_49 = EndPoints(Curve=crv_63)  # -> Start, End
end_50 = EndPoints(Curve=crv_64)  # -> Start, End
end_51 = EndPoints(Curve=crv_66)  # -> Start, End
end_52 = EndPoints(Curve=crv_67)  # -> Start, End
hull_63 = ConvexHull(Points=[end_49.Start, end_49.End], Plane=PlaneXY(0, 0, 0))  # -> Hull, HullZ, Indices
hull_64 = ConvexHull(Points=[end_50.Start, end_50.End], Plane=PlaneXY(0, 0, 0))  # -> Hull, HullZ, Indices
hull_65 = ConvexHull(Points=[end_51.Start, end_51.End], Plane=PlaneXY(0, 0, 0))  # -> Hull, HullZ, Indices
hull_66 = ConvexHull(Points=[end_52.Start, end_52.End], Plane=PlaneXY(0, 0, 0))  # -> Hull, HullZ, Indices
hull_67 = ConvexHull(Points=[end_48.Start, end_48.End], Plane=PlaneXY(0, 0, 0))  # -> Hull, HullZ, Indices

crv_68 = Curve([<curve referenced from the Rhino model> x12])
crv_69 = Curve([<curve referenced from the Rhino model> x772])
crv_70 = Curve([<curve referenced from the Rhino model> x30])
crv_71 = Curve([<curve referenced from the Rhino model> x855])
crv_72 = Curve([<curve referenced from the Rhino model> x790])
crv_73 = Curve([<curve referenced from the Rhino model> x31])
divide_16 = DivideCurve(Curve=crv_70, Count=10, Kinks=False)  # -> flatten(Points), Tangents, Parameters
divide_17 = DivideCurve(Curve=crv_72, Count=10, Kinks=False)  # -> flatten(Points), Tangents, Parameters
end_53 = EndPoints(Curve=crv_68)  # -> Start, End
end_54 = EndPoints(Curve=crv_69)  # -> Start, End
divide_18 = DivideCurve(Curve=crv_71, Count=10, Kinks=False)  # -> flatten(Points), Tangents, Parameters
end_55 = EndPoints(Curve=crv_73)  # -> Start, End
hull_68 = ConvexHull(Points=[end_53.Start, end_53.End], Plane=PlaneXY(0, 0, 0))  # -> Hull, HullZ, Indices
hull_69 = ConvexHull(Points=divide_16.Points, Plane=PlaneXY(0, 0, 0))  # -> Hull, HullZ, Indices
hull_70 = ConvexHull(Points=[end_54.Start, end_54.End], Plane=PlaneXY(0, 0, 0))  # -> Hull, HullZ, Indices
hull_71 = ConvexHull(Points=divide_18.Points, Plane=PlaneXY(0, 0, 0))  # -> Hull, HullZ, Indices
hull_72 = ConvexHull(Points=divide_17.Points, Plane=PlaneXY(0, 0, 0))  # -> Hull, HullZ, Indices
hull_73 = ConvexHull(Points=[end_55.Start, end_55.End], Plane=PlaneXY(0, 0, 0))  # -> Hull, HullZ, Indices

crv_74 = Curve([<curve referenced from the Rhino model> x36])
end_56 = EndPoints(Curve=crv_74)  # -> Start, End
hull_74 = ConvexHull(Points=[end_56.Start, end_56.End], Plane=PlaneXY(0, 0, 0))  # -> Hull, HullZ, Indices

crv_75 = Curve([<curve referenced from the Rhino model> x8])
crv_76 = Curve([<curve referenced from the Rhino model> x3981])
crv_77 = Curve([<curve referenced from the Rhino model> x136])
crv_78 = Curve([<curve referenced from the Rhino model> x131])
crv_79 = Curve([<curve referenced from the Rhino model> x5000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])
crv_80 = Curve([<curve referenced from the Rhino model> x66])
crv_81 = Curve([<curve referenced from the Rhino model> x772])
crv_82 = Curve([<curve referenced from the Rhino model> x87])
end_57 = EndPoints(Curve=crv_75)  # -> Start, End
end_58 = EndPoints(Curve=crv_77)  # -> Start, End
end_59 = EndPoints(Curve=crv_76)  # -> Start, End
end_60 = EndPoints(Curve=crv_80)  # -> Start, End
end_61 = EndPoints(Curve=crv_82)  # -> Start, End
end_62 = EndPoints(Curve=crv_79)  # -> Start, End
end_63 = EndPoints(Curve=crv_78)  # -> Start, End
end_64 = EndPoints(Curve=crv_81)  # -> Start, End
hull_75 = ConvexHull(Points=[end_57.Start, end_57.End], Plane=PlaneXY(0, 0, 0))  # -> Hull, HullZ, Indices
hull_76 = ConvexHull(Points=[end_58.Start, end_58.End], Plane=PlaneXY(0, 0, 0))  # -> Hull, HullZ, Indices
hull_77 = ConvexHull(Points=[end_59.Start, end_59.End], Plane=PlaneXY(0, 0, 0))  # -> Hull, HullZ, Indices
hull_78 = ConvexHull(Points=[end_60.Start, end_60.End], Plane=PlaneXY(0, 0, 0))  # -> Hull, HullZ, Indices
hull_79 = ConvexHull(Points=[end_61.Start, end_61.End], Plane=PlaneXY(0, 0, 0))  # -> Hull, HullZ, Indices
hull_80 = ConvexHull(Points=[end_62.Start, end_62.End], Plane=PlaneXY(0, 0, 0))  # -> Hull, HullZ, Indices
hull_81 = ConvexHull(Points=[end_64.Start, end_64.End], Plane=PlaneXY(0, 0, 0))  # -> Hull, HullZ, Indices
hull_82 = ConvexHull(Points=[end_63.Start, end_63.End], Plane=PlaneXY(0, 0, 0))  # -> Hull, HullZ, Indices

crv_83 = Curve([<curve referenced from the Rhino model> x64])
crv_84 = Curve([<curve referenced from the Rhino model> x219])
crv_85 = Curve([<curve referenced from the Rhino model> x3192])
crv_86 = Curve([<curve referenced from the Rhino model> x813])
end_65 = EndPoints(Curve=crv_84)  # -> Start, End
end_66 = EndPoints(Curve=crv_83)  # -> Start, End
end_67 = EndPoints(Curve=crv_85)  # -> Start, End
end_68 = EndPoints(Curve=crv_86)  # -> Start, End
hull_83 = ConvexHull(Points=[end_66.Start, end_66.End], Plane=PlaneXY(0, 0, 0))  # -> Hull, HullZ, Indices
hull_84 = ConvexHull(Points=[end_67.Start, end_67.End], Plane=PlaneXY(0, 0, 0))  # -> Hull, HullZ, Indices
hull_85 = ConvexHull(Points=[end_65.Start, end_65.End], Plane=PlaneXY(0, 0, 0))  # -> Hull, HullZ, Indices
hull_86 = ConvexHull(Points=[end_68.Start, end_68.End], Plane=PlaneXY(0, 0, 0))  # -> Hull, HullZ, Indices

crv_87 = Curve([<curve referenced from the Rhino model> x12])
crv_88 = Curve([<curve referenced from the Rhino model> x49])
crv_89 = Curve([<curve referenced from the Rhino model> x1603])
crv_90 = Curve([<curve referenced from the Rhino model> x536])
crv_91 = Curve([<curve referenced from the Rhino model> x321])
crv_92 = Curve([<curve referenced from the Rhino model> x2])
crv_93 = Curve([<curve referenced from the Rhino model> x5000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])
crv_94 = Curve([<curve referenced from the Rhino model> x24])
crv_95 = Curve([<curve referenced from the Rhino model> x4806])
crv_96 = Curve([<curve referenced from the Rhino model> x2417])
crv_97 = Curve([<curve referenced from the Rhino model> x4771])
crv_98 = Curve([<curve referenced from the Rhino model> x6])
divide_19 = DivideCurve(Curve=crv_87, Count=10, Kinks=False)  # -> flatten(Points), Tangents, Parameters
divide_20 = DivideCurve(Curve=crv_88, Count=10, Kinks=False)  # -> flatten(Points), Tangents, Parameters
divide_21 = DivideCurve(Curve=crv_90, Count=10, Kinks=False)  # -> flatten(Points), Tangents, Parameters
divide_22 = DivideCurve(Curve=crv_91, Count=10, Kinks=False)  # -> flatten(Points), Tangents, Parameters
divide_23 = DivideCurve(Curve=crv_92, Count=10, Kinks=False)  # -> flatten(Points), Tangents, Parameters
divide_24 = DivideCurve(Curve=crv_98, Count=10, Kinks=False)  # -> flatten(Points), Tangents, Parameters
end_69 = EndPoints(Curve=crv_89)  # -> Start, End
end_70 = EndPoints(Curve=crv_93)  # -> Start, End
end_71 = EndPoints(Curve=crv_94)  # -> Start, End
end_72 = EndPoints(Curve=crv_95)  # -> Start, End
end_73 = EndPoints(Curve=crv_96)  # -> Start, End
end_74 = EndPoints(Curve=crv_97)  # -> Start, End
hull_87 = ConvexHull(Points=divide_19.Points, Plane=PlaneXY(0, 0, 0))  # -> Hull, HullZ, Indices
hull_88 = ConvexHull(Points=divide_20.Points, Plane=PlaneXY(0, 0, 0))  # -> Hull, HullZ, Indices
hull_89 = ConvexHull(Points=divide_21.Points, Plane=PlaneXY(0, 0, 0))  # -> Hull, HullZ, Indices
hull_90 = ConvexHull(Points=divide_22.Points, Plane=PlaneXY(0, 0, 0))  # -> Hull, HullZ, Indices
hull_91 = ConvexHull(Points=divide_23.Points, Plane=PlaneXY(0, 0, 0))  # -> Hull, HullZ, Indices
hull_92 = ConvexHull(Points=[end_70.Start, end_70.End], Plane=PlaneXY(0, 0, 0))  # -> Hull, HullZ, Indices
hull_93 = ConvexHull(Points=[end_71.Start, end_71.End], Plane=PlaneXY(0, 0, 0))  # -> Hull, HullZ, Indices
hull_94 = ConvexHull(Points=[end_72.Start, end_72.End], Plane=PlaneXY(0, 0, 0))  # -> Hull, HullZ, Indices
hull_95 = ConvexHull(Points=[end_73.Start, end_73.End], Plane=PlaneXY(0, 0, 0))  # -> Hull, HullZ, Indices
hull_96 = ConvexHull(Points=[end_74.Start, end_74.End], Plane=PlaneXY(0, 0, 0))  # -> Hull, HullZ, Indices
hull_97 = ConvexHull(Points=divide_24.Points, Plane=PlaneXY(0, 0, 0))  # -> Hull, HullZ, Indices
hull_98 = ConvexHull(Points=[end_69.Start, end_69.End], Plane=PlaneXY(0, 0, 0))  # -> Hull, HullZ, Indices

crv_99 = Curve([<curve referenced from the Rhino model> x5000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])
crv_100 = Curve([<curve referenced from the Rhino model> x4806])
crv_101 = Curve([<curve referenced from the Rhino model> x12])
crv_102 = Curve([<curve referenced from the Rhino model> x82])
crv_103 = Curve([<curve referenced from the Rhino model> x5000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])
end_75 = EndPoints(Curve=crv_99)  # -> Start, End
end_76 = EndPoints(Curve=crv_100)  # -> Start, End
end_77 = EndPoints(Curve=crv_101)  # -> Start, End
end_78 = EndPoints(Curve=crv_103)  # -> Start, End
end_79 = EndPoints(Curve=crv_102)  # -> Start, End
hull_99 = ConvexHull(Points=[end_75.Start, end_75.End], Plane=PlaneXY(0, 0, 0))  # -> Hull, HullZ, Indices
hull_100 = ConvexHull(Points=[end_78.Start, end_78.End], Plane=PlaneXY(0, 0, 0))  # -> Hull, HullZ, Indices
hull_101 = ConvexHull(Points=[end_76.Start, end_76.End], Plane=PlaneXY(0, 0, 0))  # -> Hull, HullZ, Indices
hull_102 = ConvexHull(Points=[end_77.Start, end_77.End], Plane=PlaneXY(0, 0, 0))  # -> Hull, HullZ, Indices
hull_103 = ConvexHull(Points=[end_79.Start, end_79.End], Plane=PlaneXY(0, 0, 0))  # -> Hull, HullZ, Indices

crv_104 = Curve([<curve referenced from the Rhino model> x32])
crv_105 = Curve([<curve referenced from the Rhino model> x5000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])
crv_106 = Curve([<curve referenced from the Rhino model> x26])
crv_107 = Curve([<curve referenced from the Rhino model> x60])
crv_108 = Curve([<curve referenced from the Rhino model> x68])
crv_109 = Curve([<curve referenced from the Rhino model> x35])
crv_110 = Curve([<curve referenced from the Rhino model> x1230])
crv_111 = Curve([<curve referenced from the Rhino model> x80])
crv_112 = Curve([<curve referenced from the Rhino model> x51])
crv_113 = Curve([<curve referenced from the Rhino model> x37])
divide_25 = DivideCurve(Curve=crv_111, Count=10, Kinks=False)  # -> flatten(Points), Tangents, Parameters
divide_26 = DivideCurve(Curve=crv_104, Count=10, Kinks=False)  # -> flatten(Points), Tangents, Parameters
divide_27 = DivideCurve(Curve=crv_112, Count=10, Kinks=False)  # -> flatten(Points), Tangents, Parameters
divide_28 = DivideCurve(Curve=crv_113, Count=10, Kinks=False)  # -> flatten(Points), Tangents, Parameters
divide_29 = DivideCurve(Curve=crv_107, Count=33, Kinks=False)  # -> flatten(Points), Tangents, Parameters
divide_30 = DivideCurve(Curve=crv_108, Count=10, Kinks=False)  # -> flatten(Points), Tangents, Parameters
divide_31 = DivideCurve(Curve=crv_109, Count=10, Kinks=False)  # -> flatten(Points), Tangents, Parameters
divide_32 = DivideCurve(Curve=crv_110, Count=10, Kinks=False)  # -> flatten(Points), Tangents, Parameters
end_80 = EndPoints(Curve=crv_105)  # -> Start, End
end_81 = EndPoints(Curve=crv_106)  # -> Start, End
hull_104 = ConvexHull(Points=divide_30.Points, Plane=PlaneXY(0, 0, 0))  # -> Hull, HullZ, Indices
hull_105 = ConvexHull(Points=divide_25.Points, Plane=PlaneXY(0, 0, 0))  # -> Hull, HullZ, Indices
hull_106 = ConvexHull(Points=[end_80.Start, end_80.End], Plane=PlaneXY(0, 0, 0))  # -> Hull, HullZ, Indices
hull_107 = ConvexHull(Points=divide_26.Points, Plane=PlaneXY(0, 0, 0))  # -> Hull, HullZ, Indices
hull_108 = ConvexHull(Points=divide_29.Points, Plane=PlaneXY(0, 0, 0))  # -> Hull, HullZ, Indices
hull_109 = ConvexHull(Points=[end_81.Start, end_81.End], Plane=PlaneXY(0, 0, 0))  # -> Hull, HullZ, Indices
hull_110 = ConvexHull(Points=divide_31.Points, Plane=PlaneXY(0, 0, 0))  # -> Hull, HullZ, Indices
hull_111 = ConvexHull(Points=divide_32.Points, Plane=PlaneXY(0, 0, 0))  # -> Hull, HullZ, Indices
hull_112 = ConvexHull(Points=divide_27.Points, Plane=PlaneXY(0, 0, 0))  # -> Hull, HullZ, Indices
hull_113 = ConvexHull(Points=divide_28.Points, Plane=PlaneXY(0, 0, 0))  # -> Hull, HullZ, Indices

crv_114 = Curve([<curve referenced from the Rhino model> x32])
crv_115 = Curve([<curve referenced from the Rhino model> x5000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])
crv_116 = Curve([<curve referenced from the Rhino model> x57])
crv_117 = Curve([<curve referenced from the Rhino model> x65])
crv_118 = Curve([<curve referenced from the Rhino model> x3204])
crv_119 = Curve([<curve referenced from the Rhino model> x12])
crv_120 = Curve([<curve referenced from the Rhino model> x82])
crv_121 = Curve([<curve referenced from the Rhino model> x38])
crv_122 = Curve([<curve referenced from the Rhino model> x97])
crv_123 = Curve([<curve referenced from the Rhino model> x948])
divide_33 = DivideCurve(Curve=crv_122, Count=10, Kinks=False)  # -> flatten(Points), Tangents, Parameters
divide_34 = DivideCurve(Curve=crv_114, Count=10, Kinks=False)  # -> flatten(Points), Tangents, Parameters
divide_35 = DivideCurve(Curve=crv_117, Count=10, Kinks=False)  # -> flatten(Points), Tangents, Parameters
divide_36 = DivideCurve(Curve=crv_118, Count=10, Kinks=False)  # -> flatten(Points), Tangents, Parameters
divide_37 = DivideCurve(Curve=crv_115, Count=10, Kinks=False)  # -> flatten(Points), Tangents, Parameters
divide_38 = DivideCurve(Curve=crv_119, Count=10, Kinks=False)  # -> flatten(Points), Tangents, Parameters
divide_39 = DivideCurve(Curve=crv_120, Count=10, Kinks=False)  # -> flatten(Points), Tangents, Parameters
divide_40 = DivideCurve(Curve=crv_123, Count=10, Kinks=False)  # -> flatten(Points), Tangents, Parameters
divide_41 = DivideCurve(Curve=crv_121, Count=10, Kinks=False)  # -> flatten(Points), Tangents, Parameters
divide_42 = DivideCurve(Curve=crv_116, Count=10, Kinks=False)  # -> flatten(Points), Tangents, Parameters
hull_114 = ConvexHull(Points=divide_34.Points, Plane=PlaneXY(0, 0, 0))  # -> Hull, HullZ, Indices
hull_115 = ConvexHull(Points=divide_35.Points, Plane=PlaneXY(0, 0, 0))  # -> Hull, HullZ, Indices
hull_116 = ConvexHull(Points=divide_36.Points, Plane=PlaneXY(0, 0, 0))  # -> Hull, HullZ, Indices
hull_117 = ConvexHull(Points=divide_38.Points, Plane=PlaneXY(0, 0, 0))  # -> Hull, HullZ, Indices
hull_118 = ConvexHull(Points=divide_39.Points, Plane=PlaneXY(0, 0, 0))  # -> Hull, HullZ, Indices
hull_119 = ConvexHull(Points=divide_33.Points, Plane=PlaneXY(0, 0, 0))  # -> Hull, HullZ, Indices
hull_120 = ConvexHull(Points=divide_37.Points, Plane=PlaneXY(0, 0, 0))  # -> Hull, HullZ, Indices
hull_121 = ConvexHull(Points=divide_40.Points, Plane=PlaneXY(0, 0, 0))  # -> Hull, HullZ, Indices
hull_122 = ConvexHull(Points=divide_41.Points, Plane=PlaneXY(0, 0, 0))  # -> Hull, HullZ, Indices
hull_123 = ConvexHull(Points=divide_42.Points, Plane=PlaneXY(0, 0, 0))  # -> Hull, HullZ, Indices

crv_124 = Curve([<curve referenced from the Rhino model> x12])
crv_125 = Curve([<curve referenced from the Rhino model> x44])
end_82 = EndPoints(Curve=crv_124)  # -> Start, End
end_83 = EndPoints(Curve=crv_125)  # -> Start, End
hull_124 = ConvexHull(Points=[end_82.Start, end_82.End], Plane=PlaneXY(0, 0, 0))  # -> Hull, HullZ, Indices
hull_125 = ConvexHull(Points=[end_83.Start, end_83.End], Plane=PlaneXY(0, 0, 0))  # -> Hull, HullZ, Indices

crv_126 = Curve([<curve referenced from the Rhino model> x31])
crv_127 = Curve([<curve referenced from the Rhino model> x71])
crv_128 = Curve([<curve referenced from the Rhino model> x62])
crv_129 = Curve(<curve referenced from the Rhino model>)

divide_43 = DivideCurve(Curve=crv_128, Count=10, Kinks=False)  # -> flatten(Points), Tangents, Parameters
divide_44 = DivideCurve(Curve=crv_126, Count=10, Kinks=False)  # -> flatten(Points), Tangents, Parameters
divide_45 = DivideCurve(Curve=crv_127, Count=10, Kinks=False)  # -> flatten(Points), Tangents, Parameters
divide_46 = DivideCurve(Curve=crv_129, Count=10, Kinks=False)  # -> flatten(Points), Tangents, Parameters

hull_126 = ConvexHull(Points=divide_44.Points, Plane=PlaneXY(0, 0, 0))  # -> Hull, HullZ, Indices
hull_127 = ConvexHull(Points=divide_43.Points, Plane=PlaneXY(0, 0, 0))  # -> Hull, HullZ, Indices
hull_128 = ConvexHull(Points=divide_46.Points, Plane=PlaneXY(0, 0, 0))  # -> Hull, HullZ, Indices
hull_129 = ConvexHull(Points=divide_45.Points, Plane=PlaneXY(0, 0, 0))  # -> Hull, HullZ, Indices

join = JoinCurves(
    Curves=[hull_80.Hull, hull_81.Hull, hull_78.Hull, hull_79.Hull, hull_75.Hull, hull_76.Hull, hull_77.Hull, hull_99.Hull, hull_101.Hull, hull_102.Hull, hull_100.Hull, hull_92.Hull, hull_93.Hull, hull_94.Hull, hull_95.Hull, hull_96.Hull, hull_98.Hull, hull_89.Hull, hull_91.Hull, hull_97.Hull, hull_90.Hull, hull_88.Hull, hull_82.Hull, hull_85.Hull, hull_84.Hull, hull_87.Hull, hull_86.Hull, hull_83.Hull, hull_120.Hull, hull_122.Hull, hull_117.Hull, hull_116.Hull, hull_114.Hull, hull_115.Hull, hull_119.Hull, hull_118.Hull, hull_123.Hull, hull_121.Hull, hull_113.Hull, hull_112.Hull, hull_105.Hull, hull_107.Hull, hull_106.Hull, hull_109.Hull, hull_108.Hull, hull_104.Hull, hull_110.Hull, hull_111.Hull, hull_128.Hull, hull_126.Hull, hull_129.Hull, hull_127.Hull, hull_68.Hull, hull_70.Hull, hull_69.Hull, hull_71.Hull, hull_73.Hull, hull_72.Hull, hull_124.Hull, hull_125.Hull, hull_74.Hull, hull_66.Hull, hull_64.Hull, hull_67.Hull, hull_65.Hull, hull_63.Hull, hull_54.Hull, hull_50.Hull, hull_56.Hull, hull_52.Hull, hull_53.Hull, hull_49.Hull, hull_55.Hull, hull_51.Hull, hull_48.Hull, hull_47.Hull, hull_16.Hull, hull_15.Hull, hull_13.Hull, hull_14.Hull, hull_12.Hull, hull_11.Hull, hull_10.Hull, hull_7.Hull, hull_8.Hull, hull_5.Hull, hull_3.Hull, hull_2.HullZ, hull.Hull, hull_4.Hull, hull_6.Hull, hull_22.Hull, hull_19.Hull, hull_24.Hull, hull_20.Hull, hull_17.Hull, hull_18.Hull, hull_21.Hull, hull_23.HullZ, hull_25.Hull, hull_26.Hull, hull_61.Hull, hull_59.Hull, hull_60.Hull, hull_62.Hull, hull_57.Hull, hull_58.Hull, hull_31.Hull, hull_29.Hull, hull_30.Hull, hull_27.Hull, hull_28.Hull, hull_32.Hull, hull_46.Hull, hull_44.Hull, hull_33.Hull, hull_45.Hull, hull_43.Hull, hull_42.Hull, hull_42.HullZ, hull_41.Hull, hull_34.Hull, hull_35.Hull, hull_39.Hull, hull_36.Hull, hull_37.Hull, hull_40.Hull, hull_38.Hull],
    Preserve=False)
C = ClusterOutput(join)

# ==== cluster Cluster_2
filepath = ClusterInput()
inputname = ClusterInput()
data_json = PythonScript(FilePath=filepath, inputName=inputname)  # -> out, x, y
# ---------- data_json: Python ----------
import json

if FilePath:
    
    # JSON file to read
    file = open(FilePath)
    
    # Load the data
    data = json.load(file)
    
    # Do something with the data
    for basestation in data:
        print basestation["Name"]
        print inputName
        if basestation["Name"] == inputName:
            x = basestation["X"]
            y = basestation["Y"]
            print x
            print y
# ---------- end data_json ----------
x = ClusterOutput(data_json.x)
y = ClusterOutput(data_json.y)
