# Grasshopper definition 01_Isovist_basestationLayout.gh (Grasshopper 0.9.75)
# plug-ins: Python Interpreter

geometry_pipeline = GeometryPipeline(
    GroupByLayer=False,
    GroupByType=False,
    IncludeHidden=True,
    IncludeLocked=True,
    LayerFilter="POINTS",
    NameFilter="*",
    TypeFilter=1)
geometry_pipeline_2 = GeometryPipeline(
    GroupByLayer=False,
    GroupByType=False,
    IncludeHidden=True,
    IncludeLocked=True,
    LayerFilter="SORTING POINTS",
    NameFilter="*",
    TypeFilter=5)
point = Point(geometry_pipeline)

# ----
# Sorting Basestation based on Closest Curve
names = Panel("""Ace
Alfa
Beer
Bravo
Charlie
Coco
Dee
Delta
Echo
Edward
Foxtrot
Freddie
George
Golf
Harry
Hotel
India
Ink
Johnnie
Juliett
Kilo
King
Lima
London
Mike
Monkey
November
Nuts
Orange
Oscar
Papa
Pip
Quebec
Queen
Robert
Romeo
Sierra
Sugar
Tango
Tick
Uncle
Uniform
Vic
Victor
Whisky
William
X-ray
X-men
Yankee
Yorker
Zebra
Zulu""")
curve = Curve(reparameterize(geometry_pipeline_2))
point_2 = Point(point)
sort_along_curve = SortAlongCurve(values_a=point_2, curve=curve)  # -> docs_2, sorted_points_2
cluster = Cluster(source_list=point_2, target_list=names)
text_tag_3d = TextTag3D(
    Location=sort_along_curve.sorted_points_2,
    Text=cluster,
    Size=Slider(532, range=0..10000),
    Colour=ColourSwatch(SwatchColor=RGB(255, 0, 0)),
    Justification=7)
sorted_points = Point(sort_along_curve.sorted_points_2)

# ---- group: Basestation XY Coords
arup_basestation_points = Point([<point referenced from the Rhino model> x37])
bvn_basestation_points = Point([<point referenced from the Rhino model> x46])
basestation_xy = Deconstruct(Point=sorted_points)  # -> XComponent, YComponent, ZComponent
panel = Panel(basestation_xy.YComponent)
panel_2 = Panel(basestation_xy.XComponent)
sphere = Sphere(Base=point, Radius=Slider(547, range=0..1000))

# ---- group: Isovist
# Isovist Python (takes a while to compute if enabled)
pipeline = GeometryPipeline(
    GroupByLayer=False,
    GroupByType=False,
    IncludeHidden=True,
    IncludeLocked=True,
    LayerFilter="_gh_boundary_isovist_ARUP",
    NameFilter="*",
    TypeFilter=4)
pipeline_2 = GeometryPipeline(
    GroupByLayer=False,
    GroupByType=False,
    IncludeHidden=True,
    IncludeLocked=True,
    LayerFilter="_gh_boundary_isovist_BVN",
    NameFilter="*",
    TypeFilter=4)
number_slider = Slider(5000, range=0..10000)
runion = RegionUnion()
crv = Curve([<curve referenced from the Rhino model> x2])
boundary = BoundarySurfaces(Edges=runion)
runion_2 = RegionUnion(Curves=crv)
area = Area(Geometry=boundary)  # -> Area, Centroid
boundary_2 = BoundarySurfaces(Edges=runion_2)
ma = MassAddition(Input=area.Area)  # -> Result, PartialResults
area_2 = Area(Geometry=boundary_2)  # -> Area, Centroid
data = Data(simplify(graft(["Units Squared", "Percentage (%)"])))
total_area = Panel(area_2.Area)
overlap_area = Panel(ma.Result)

# ----
data_dam = DataDam(DataDataA=pipeline_2, BufferDelay=10000000, BufferMode=0)

isovist = IsoVist(Plane=point, Count=Slider(100, range=0..100), Radius=number_slider, Obstacles=pipeline)  # -> Points, Distance, Index
polyline = PolyLine(Vertices=isovist.Points, Closed=invert(False))
surface = Surface(polyline)

# ---- group: Isovist (continued)
python = PythonScript(points=point, lines=Slider(1000, range=0..1000), radius=number_slider, boundries=data_dam)  # -> pointOut, totalIsovist, isovistsClear, overlapSpace, isovistsList, isovistTotalSurface, nonOverlapSpace; inputs points: list of Point3d, lines: Int32, radius: Int32, boundries: list
# ---------- python: Python ----------
import ghpythonlib.components as ghcomp
import rhinoscriptsyntax as rs
import Rhino.Geometry as rg




isovistsList = []
overlapSpaceList = []
isovistsClear = []
pointOut = points

for point in points:
    isovists = ghcomp.IsoVist(point,lines,radius,boundries)
    getIsovistPoints=isovists[0]
    isovistsOutline = ghcomp.PolyLine(getIsovistPoints,True)
    makeSurface = ghcomp.BoundarySurfaces(isovistsOutline)
    print makeSurface
    isovistsList.append(makeSurface)

coerceBrepList = []

for individualIsovists in isovistsList:
    coercedOneBrep = rs.coercebrep(individualIsovists)
    coerceBrepList.append(coercedOneBrep)

isovistCoercedUnion = ghcomp.RegionUnion(coerceBrepList)
isovistTotalSurface = ghcomp.BoundarySurfaces(isovistCoercedUnion)

interA = isovistsList[0:len(isovistsList)-1]
interB = isovistsList[1:]

for itsA in interA:
    for itsB in interB:
        if itsA == itsB:
            print itsA
        else:
            regionInter = ghcomp.RegionIntersection(itsA,itsB)
            surfaceInter = ghcomp.BoundarySurfaces(regionInter)
            #if len(surfaceInter) != 1:
            #    for listList in surfaceInter:
            #        print listList
            #        overlapSpaceList.append(listList)
            overlapSpaceList.append(surfaceInter)


flatOver = []

for testList in overlapSpaceList:
    testIfList = isinstance(testList, list)
    if testIfList == True:
        for isList in testList:
            flatOver.append(isList)
    else:
        flatOver.append(testList)

overlapSpace = flatOver

##asd = []

##overlapSpace = ghcomp.RegionUnion(flatOver)

##for getnotOverlapSpace in isovistsList:
##    pineapple = ghcomp.RegionDifference(getnotOverlapSpace, overlapSpace)
##    asd.append(pineapple)
##nonOverlapSpace = asd


#overlapCombination = ghcomp.RegionUnion(flatOver)
#print overlapCombination
#overlapSurface = ghcomp.BoundarySurfaces(overlapCombination)
#overlapCalcArea = ghcomp.Area(overlapSurface)
#print overlapCalcArea


#for overlapPiece in overlapCalcArea[0]:
#    overlapArea = overlapArea + overlapPiece

#print overlapSpaceList
#overlapSpace = flatOver



#ghcomp.regi

#a = isovistsList
# ---------- end python ----------
srf = Surface(python.isovistTotalSurface)  # disabled
debrep = DeconstructBrep(Brep=srf)  # -> Faces, Edges, Vertices
area_3 = Area(Geometry=srf)  # -> Area, Centroid
ma_2 = MassAddition(Input=area_3.Area)  # -> Result, PartialResults
subtraction = Subtraction(A=area_2.Area, B=ma_2.Result)
division = Division(A=subtraction, B=area_2.Area)
multiplication = Multiplication(A=division, B=100)
data_2 = Data(simplify(graft([subtraction, multiplication])))
area_covered = Panel(ma_2.Result)
area_not_covered = Panel([data, data_2])

# ----
curve_2 = Curve(python.isovistsList)

# ==== cluster SortAlongCurve
values_a = ClusterInput()
curve = ClusterInput()
curve_closest_point = CurveClosestPoint(Points=values_a, Curve=curve)  # -> Point, Parameter, Distance
panel = Panel("this takes a curve and list of points. It sorts the points by their t along that curve (by CP)")
sort_list = SortList(Keys=curve_closest_point.Parameter, ValuesValuesA=values_a)  # -> Keys, ValuesValuesA
sorted_points = Point(sort_list.ValuesValuesA)
docs = Text(panel)
docs_2 = ClusterOutput(docs)
sorted_points_2 = ClusterOutput(sorted_points)

# ==== cluster Cluster
source_list = ClusterInput()
list_length = ListLength(SourceList=source_list)
construct_domain = ConstructDomain(DomainStart=0, DomainEnd=expr("x-1", list_length))
target_list = ClusterInput()
sub_list = SubList(TargetList=target_list, Domain=construct_domain, Wrap=False)  # -> List, Index
list = ClusterOutput(sub_list.List)
