# Grasshopper definition 04_BasestationToBasestation01.gh (Grasshopper 0.9.76)
# plug-ins: Python Interpreter, Human, Agent, Shortest Walk in Gh

# ----
# Names/UUID
# This gets all the unique names.
# 
# 1. Sim Data - Test with real but still fake data, preferred use for now
# 
# 2. Sample Real Daka - From Test Dump, has limited beacon and basestation input
# 
# 3. Fake data altogether
windows_samplerealdata = FilePath("F:\InfoTech\ARIVERA - DO NOT REMOVE\BlankMindBlog\helpers\gh_visualisation\json_detection data\dumpdata.json")
windows_simdata = FilePath("F:\InfoTech\ARIVERA - DO NOT REMOVE\BlankMindBlog\helpers\gh_visualisation\json_detection data\test.json")
windows_fakedata = FilePath("F:\InfoTech\ARIVERA - DO NOT REMOVE\BlankMindBlog\helpers\gh_visualisation\json_detection data\fakedata.json")
names = PythonScript(FilePath=windows_simdata)  # -> uuids, a
# ---------- names: Python ----------
import json

if FilePath:
    
    # JSON file to read
    file = open(FilePath)
    
    # Load the data
    data = json.load(file)
    
    uuids = []
    
    for d in data:
        uuids.append( d['uuid'] )
    
    print uuids
# ---------- end names ----------
names_2 = PythonScript(FilePath=windows_fakedata)  # -> flatten(names)
# ---------- names_2: Python ----------
import json

if FilePath:
    
    # JSON file to read
    file = open(FilePath)
    
    # Load the data
    data = json.load(file)
    
    names = []
    
    for d in data:
        names.append( d['name'] )
    
    print names
# ---------- end names_2 ----------
names_3 = PythonScript(FilePath=windows_samplerealdata)  # -> flatten(uuids); same code as names
create_set = CreateSet(List=names.uuids)  # -> Set, Map
create_set_2 = CreateSet(List=names_3)  # -> Set, Map
create_set_3 = CreateSet(List=names_2)  # -> Set, Map
panel = Panel(create_set.Set)
panel_2 = Panel(create_set_2.Set)
panel_3 = Panel(create_set_3.Set)
panel_4 = Panel(windows_simdata)

# ----
# Given a list of names, this finds all the detections related to each of those names and returns them as a list of lists.
# 
# Use second 'Json Detections' node if you're playing with the fake data file.
# Detections
json_detections_real_data = PythonScript(FilePath=windows_simdata, uuid=panel)  # -> agent, time
# ---------- json_detections_real_data: Python ----------
import json

if FilePath:
    
    # JSON file to read
    file = open(FilePath)
    
    # Load the data
    detections = json.load(file)
    #data = str(detections)
    
    time = []
    agent = []
    
    for d in detections:
        if d['uuid'] == uuid:
#            print detection
            time.append( d['time'] )
            agent.append( d['agentId'] )
# ---------- end json_detections_real_data ----------
json_detections_fake_data = PythonScript(FilePath=windows_fakedata, name=create_set_3.Set)  # -> data, base, time; disabled
# ---------- json_detections_fake_data: Python ----------
import json

if FilePath:
    
    # JSON file to read
    file = open(FilePath)
    
    # Load the data
    detections = json.load(file)
    data = str(detections)
    
    time = []
    base = []
    
    for detection in detections:
        if detection["name"] == name:
            print detection
            time.append( detection["time"] )
            base.append( detection["basestation"] )
# ---------- end json_detections_fake_data ----------
create_set_4 = CreateSet(List=json_detections_real_data.agent)  # -> Set, Map
panel_5 = Panel(create_set_4.Set)
panel_6 = Panel(json_detections_real_data.time)
panel_7 = Panel(json_detections_fake_data.base)
panel_8 = Panel(json_detections_fake_data.time)

# ----
# This draws out the points that correspond to the base stations.
# 
# The basestations names are static, change the list in the panel and the list in the json file if any basestation changes need to be done.
# Basestations
arup_basestations = Panel("""RPI001
RPI002
RPI003
RPI004
RPI005
RPI006
RPI007
RPI008
RPI009
RPI010
RPI011
RPI012
RPI013
RPI014
RPI015
RPI016
RPI017
RPI018
RPI019
RPI020
RPI021
RPI022
RPI023
RPI024
RPI025
RPI026
RPI027
RPI028
RPI029
RPI030
RPI031
RPI032
RPI033
RPI034
RPI035
RPI036
RPI037""")
bvn_basestations = Panel("""RPI001
RPI002
RPI003
RPI004
RPI005
RPI006
RPI007
RPI008
RPI009
RPI010
RPI011
RPI012
RPI013
RPI014
RPI015
RPI016
RPI017
RPI018
RPI019
RPI020
RPI021
RPI022
RPI023
RPI024
RPI025
RPI026
RPI027
RPI028
RPI029
RPI030
RPI031
RPI032
RPI033
RPI034
RPI035
RPI036
RPI037
RPI038
RPI039
RPI040
RPI041
RPI042""")
arup_path = FilePath("F:\BlankMindBlog\helpers\basestation_location\baseStations_ARUP.json")
bvn_path = FilePath("F:\InfoTech\ARIVERA - DO NOT REMOVE\BlankMindBlog\helpers\basestation_location\baseStations_BVN.json")
list_of_basestations = ListOfBasestations(filepath=bvn_path, inputname=bvn_basestations)  # -> x, y
x_y_coords = ConstructPoint(XCoordinate=list_of_basestations.x, YCoordinate=list_of_basestations.y, ZCoordinate=0)
text_tag_3d = TextTag3D(Location=x_y_coords, Text=bvn_basestations, Size=1562, Colour=ColourSwatch(SwatchColor=RGB(75, 209, 0)), Justification=5)

# ----
# Joining start and end pts
# This maps the points so that the path is continous e.g. [0] to [1], [1] to [2]....
joining_curves = PythonScript(agent=json_detections_real_data.agent)  # -> start, end; inputs agent: list
# ---------- joining_curves: Python ----------
import ghpythonlib as gh

x = 0
start = []
end = []

while x < len(agent)-1:
    start.append(agent[x])
    end.append(agent[x + 1])
    x = x + 1
    
    print start
    print end
# ---------- end joining_curves ----------
panel_9 = Panel(joining_curves.end)
panel_10 = Panel(joining_curves.start)

sort_points = SortPoints(Points=x_y_coords)  # -> Points, Indices
deconstruct = Deconstruct(Point=sort_points.Points)  # -> reverse(XComponent), reverse(YComponent), ZComponent
panel_11 = Panel(deconstruct.XComponent)
panel_12 = Panel(deconstruct.YComponent)

# ----
# Start and End Pts
# This takes list of detections and
# returns the x, y coords of the basestations
detection_of_start_point = ListOfBasestations(filepath=bvn_path, inputname=panel_10)  # -> x, y
detection_of_end_point = ListOfBasestations(filepath=bvn_path, inputname=panel_9)  # -> x, y
start_pts = ConstructPoint(XCoordinate=detection_of_start_point.x, YCoordinate=detection_of_start_point.y, ZCoordinate=0)
end_pts = ConstructPoint(XCoordinate=detection_of_end_point.x, YCoordinate=detection_of_end_point.y, ZCoordinate=0)
panel_13 = Panel(start_pts)
panel_14 = Panel(end_pts)

# ----
# Duplicates of Pts
start_endpts = Data([panel_14, panel_13])
create_set_5 = CreateSet(List=start_endpts)  # -> Set, Map
create_set_6 = CreateSet(List=create_set_5.Map)  # -> Set, Map
member_index = MemberIndex(Set=create_set_5.Map, Member=create_set_6.Set)  # -> Index, Count
panel_15 = Panel(member_index.Count)

# ----
# Direct Path
# What the path should be without the obstacles
number_slider = Slider(72, range=0..100)
line = Line(StartPoint=panel_13, EndPoint=panel_14)
pipe = Pipe(Curve=line, Radius=number_slider, Caps=0)
join = JoinCurves(Curves=line, Preserve=False)
animates_the_path = PointOnCurve(join, parameter=0)
sphere = Sphere(Base=animates_the_path, Radius=Slider(1000, range=0..1000))
join_2 = BrepJoin(Breps=[sphere, pipe])  # -> Breps, Closed

# ----
# Obstacles and Nav Mesh BVN
geometry_pipeline = GeometryPipeline(
    GroupByLayer=False,
    GroupByType=False,
    IncludeHidden=True,
    IncludeLocked=True,
    LayerFilter="_gh_nav_graph_BVN",
    NameFilter="*",
    TypeFilter=4)
data_dam = DataDam(DataDataA=geometry_pipeline, BufferDelay=10000000, BufferMode=0)
geometry = Geometry(data_dam)

construct_particle = ConstructParticle(
    UpDirection=Vector(0, 0, 1),
    Acceleration=Vector(0, 0, 0),
    Lifespan=30,
    Mass=1,
    BodySize=Slider(100, range=0..100),
    HistoryLength=Slider(10, range=0..10))
point_emitter = PointEmitter(
    ContinuousFlow=True,
    CreationRate=1,
    NumberOfQuelea=0,
    MinimumInitialVelocity=Vector(-0.1, -0.1, -0.1),
    MaximumInitialVelocity=Vector(0.1, 0.1, 0.1),
    Point=Point(0, 0, 0))
construct_agent = ConstructAgent(
    ParticleQueleaSettings=construct_particle,
    MaxSpeed=0.5,
    MaxForce=0.1,
    VisionRadius=Slider(20, range=0..100),
    VisionAngle=360)

# ----
# shortest walk/ simulated data
# Cluster of script uses the nav mesh script and executes shortest path, w vectors and tags.
# 
# Will turn up red if detection is stationary.
number_slider_2 = Slider(80, range=0..100)
shortest_walk = ShortestWalk(Curves=geometry, WantedPath=line)  # -> ShortestWalk, Succession, Direction, Length
pipe_2 = Pipe(Curve=shortest_walk.ShortestWalk, Radius=number_slider_2, Caps=0)
join_3 = JoinCurves(Curves=shortest_walk.ShortestWalk, Preserve=False)
number_slider_3 = Slider(1000, range=0..1000)
panel_16 = Panel(join_3)
point_on_curve = PointOnCurve(join_3, parameter=0.056)
sphere_2 = Sphere(Base=point_on_curve, Radius=number_slider_3)
text_tag_3d_2 = TextTag3D(Location=point_on_curve, Text=graft(panel), Size=number_slider_3, Colour=RGB(255, 0, 0), Justification=7)
item = ListItem(List=flatten(join_3), Index=Slider(0, range=0..100), Wrap=True)

# ----
# Vectors Along Path
list_item = ListItem(List=geometry, Index=shortest_walk.Succession, Wrap=False)
end_points = EndPoints(Curve=list_item)  # -> Start, End
evaluate_length = EvaluateLength(Curve=list_item, Length=0.5, Normalized=True)  # -> Point, Tangent, Parameter
vector_2pt = Vector2Pt(PointA=end_points.Start, PointB=end_points.End, Unitize=False)  # -> Vector, Length
remap_numbers = RemapNumbers(Values=shortest_walk.Direction, Source=Domain(0, 1), Target=Domain(-0.1, 0.1))
amplitude = Amplitude(Vector=vector_2pt.Vector, Amplitude=remap_numbers)
vector_display = VectorDisplay(Anchor=evaluate_length.Point, Vector=amplitude)

system = System(QueleaSettings=construct_agent, Emitters=point_emitter)  # -> System, Quelea, QueleaNetwork
point = Point(<point referenced from the Rhino model>)
timer = Timer(TimerInterval=20, Target=[engine, system])

# ----
# Checkpoints
evaluate_length_2 = EvaluateLength(Curve=shortest_walk.ShortestWalk, Length=[0, 1], Normalized=True)  # -> Point, Tangent, Parameter
unit_z = UnitZ(Factor=1)
cross_product = CrossProduct(VectorA=unit_z, VectorB=evaluate_length_2.Tangent, Unitize=False)  # -> Vector, Length
center_box = CenterBox(Base=evaluate_length_2.Point, X=0.1, Y=0.1, Z=0.07)
construct_plane = Plane(Origin=evaluate_length_2.Point, XAxis=cross_product.Vector, YAxis=unit_z)
T = Text(["START", "GOAL"])
text_tag = TextTag(Location=construct_plane, Text=T)

engine = Engine(Reset=Toggle(False), System=system.System)
arrive_force = ArriveForce(
    Apply=Toggle(False),
    WeightMultiplier=1,
    AgentQuelea=system.Quelea,
    TargetPoint=point,
    ArrivalRadius=Slider(100, range=0..100))  # -> Force, DesiredVelocity
get_particle_position = GetParticlePosition(ParticleQuelea=system.Quelea)  # -> Position, SurfacePosition
point_2 = Point(<point referenced from the Rhino model>)

# ----
# Separating Curves
# Finds the overlapping points and randomly moves it away to separate curves.
# 
# Also turns these curves into a nurbs curve.
number_slider_4 = Slider(96, range=0..10000)
exploded_points_of_overlapping_crvs = Curve(join_3)
discontinuity = Discontinuity(Curve=exploded_points_of_overlapping_crvs, Level=1)  # -> Points, Parameters
negative = Negative(Value=number_slider_4)
list_length = ListLength(List=discontinuity.Points)
construct_domain = ConstructDomain(DomainStart=negative, DomainEnd=number_slider_4)
unit_x = UnitX(Factor=1)
random = Random(Range=construct_domain, Number=list_length, Seed=2)
amplitude_2 = Amplitude(Vector=unit_x, Amplitude=random)
move = Move(Geometry=discontinuity.Points, Motion=amplitude_2)  # -> Geometry, Transform
nurbs_curve = NurbsCurve(Vertices=move.Geometry, Degree=3, Periodic=False)  # -> Curve, Length, Domain

deconstruct_quelea_network = DeconstructQueleaNetwork()
arrive_force_2 = ArriveForce(Apply=Toggle(False), WeightMultiplier=1, AgentQuelea=system.Quelea, TargetPoint=point_2, ArrivalRadius=5)  # -> Force, DesiredVelocity
path = Geometry(join_3)
sphere_3 = Geometry(sphere_2)

# ----
# Colours per person of sphere and path
len = Length(Curve=shortest_walk.ShortestWalk)
bnd = Bounds(Numbers=len)
dedomain = DeconstructDomain(Domain=bnd)  # -> Start, End
gradient = Gradient(
    LowerLimit=dedomain.Start,
    UpperLimit=dedomain.End,
    Parameter=len,
    stops=[0: RGB(255, 0, 0), 0.171: RGB(255, 212, 0), 0.342: RGB(81, 255, 0), 0.496: RGB(0, 255, 136), 0.667: RGB(0, 153, 255), 0.821: RGB(42, 0, 255), 1: RGB(255, 0, 255)])
sphere_4 = CustomPreview(Geometry=sphere_3, Shader=gradient)
path_2 = CustomPreviewLineweights(Geometry=path, Shader=gradient, Thickness=Slider(3, range=0..10))

# ==== cluster ListOfBasestations
inputname = ClusterInput()
filepath = ClusterInput()
data_json = PythonScript(FilePath=filepath, inputName=inputname)  # -> out, x, y
# ---------- data_json: Python ----------
import json

if FilePath:
    
    # JSON file to read
    file = open(FilePath)
    
    # Load the data
    data = json.load(file)
    
    # Do something with the data
    for basestation in data:
        print basestation["Name"]
#        print inputName
        if basestation["Name"] == inputName:
            x = basestation["X"]
            y = basestation["Y"]
            print x
            print y
# ---------- end data_json ----------
y = ClusterOutput(data_json.y)
x = ClusterOutput(data_json.x)
