# Grasshopper definition 04_BasestationToBasestation_triangles_AND_time_stuff.gh (Grasshopper 0.9.75)
# plug-ins: Python Interpreter, Human, Agent, Shortest Walk in Gh

# ----
# Names/UUID
# This gets all the unique names.
# 
# 1. Sim Data - Test with real but still fake data, preferred use for now
# 
# 2. Sample Real Daka - From Test Dump, has limited beacon and basestation input
# 
# 3. Fake data altogether
windows_samplerealdata = FilePath("F:\InfoTech\ARIVERA - DO NOT REMOVE\BlankMindBlog\helpers\gh_visualisation\json_detection data\dumpdata.json")
windows_simdata = FilePath("F:\BlankMindBlog\helpers\VISUALISATION\json_detection data\simdata.json")
windows_fakedata = FilePath("F:\InfoTech\ARIVERA - DO NOT REMOVE\BlankMindBlog\helpers\gh_visualisation\json_detection data\fakedata.json")
names = PythonScript(FilePath=windows_simdata)  # -> uuids, a
# ---------- names: Python ----------
import json

if FilePath:
    
    # JSON file to read
    file = open(FilePath)
    
    # Load the data
    data = json.load(file)
    
    uuids = []
    
    for d in data:
        uuids.append( d['uuid'] )
    
    print uuids
# ---------- end names ----------
names_2 = PythonScript(FilePath=windows_fakedata)  # -> flatten(names)
# ---------- names_2: Python ----------
import json

if FilePath:
    
    # JSON file to read
    file = open(FilePath)
    
    # Load the data
    data = json.load(file)
    
    names = []
    
    for d in data:
        names.append( d['name'] )
    
    print names
# ---------- end names_2 ----------
names_3 = PythonScript(FilePath=windows_samplerealdata)  # -> flatten(uuids); same code as names
create_set = CreateSet(List=names.uuids)  # -> Set, Map
create_set_2 = CreateSet(List=names_3)  # -> Set, Map
create_set_3 = CreateSet(List=names_2)  # -> Set, Map
panel = Panel(windows_simdata)
panel_2 = Panel(create_set.Set)
panel_3 = Panel(create_set_2.Set)
panel_4 = Panel(create_set_3.Set)

timer = Timer(TimerInterval=5, Target=[getmousepts, readsticky])  # disabled
getmousepts = PythonScript(toggle=Toggle(True), clear=Button())  # -> out, mp; inputs clear: Boolean
# ---------- getmousepts: Python ----------
import System
import Rhino as rc
import scriptcontext as sc

# Add empty list to sticky / clear list
if "points" not in sc.sticky or clear:
    sc.sticky["points"] = []

# Get the mouse position and append point to list
if toggle:
    mp = System.Windows.Forms.Control.MousePosition
    sc.sticky["points"].append(rc.Geometry.Point3d(mp.X,-mp.Y,0))
# ---------- end getmousepts ----------
panel_5 = Panel(getmousepts.mp)
readsticky = PythonScript()  # -> out, points, currentPoint
# ---------- readsticky: Python ----------
import scriptcontext as sc

# Read and output to GH
points = sc.sticky["points"]
currentPoint = points[-1]
# ---------- end readsticky ----------
nurbs_curve = NurbsCurve(Vertices=readsticky.points, Degree=3, Periodic=False)  # -> Curve, Length, Domain
point = Point(readsticky.currentPoint)
number_slider = Slider(11, range=-20..20)  # disabled
number_slider_2 = Slider(-4, range=-40..40)  # disabled
number_slider_3 = Slider(-4, range=-20..20)  # disabled
number_slider_4 = Slider(-1, range=-20..20)  # disabled
number_slider_5 = Slider(19, range=-40..40)  # disabled
number_slider_6 = Slider(-4, range=-20..20)  # disabled
construct_smooth_time = ConstructSmoothTime(Days=0, Hours=0, Minutes=0, Seconds=0)  # disabled
sort_list = SortList()  # -> Keys, ValuesValuesA

# ----
# Set the actual position
#  of person
point_2 = Point(<point referenced from the Rhino model>)

construct_point = ConstructPoint(XCoordinate=number_slider, YCoordinate=number_slider_2, ZCoordinate=number_slider_3)  # disabled
construct_point_2 = ConstructPoint(XCoordinate=number_slider_4, YCoordinate=number_slider_5, ZCoordinate=number_slider_6)  # disabled

# ----
# Given a list of names, this finds all the detections related to each of those names and returns them as a list of lists.
# 
# Use second 'Json Detections' node if you're playing with the fake data file.
# Detections
json_detections_real_data = PythonScript(FilePath=windows_simdata, uuid=panel_2)  # -> agent, time
# ---------- json_detections_real_data: Python ----------
import json

if FilePath:
    
    # JSON file to read
    file = open(FilePath)
    
    # Load the data
    detections = json.load(file)
    #data = str(detections)
    
    time = []
    agent = []
    
    for d in detections:
        if d['uuid'] == uuid:
#            print detection
            time.append( d['time'] )
            agent.append( d['agentId'] )
# ---------- end json_detections_real_data ----------
create_set_4 = CreateSet(List=json_detections_real_data.agent)  # -> Set, Map
panel_6 = Panel(create_set_4.Set)
panel_7 = Panel(json_detections_real_data.time)

number_slider_7 = Slider(2.84, range=0..7)  # disabled
python_script = PythonScript()  # -> out, a
# ---------- python_script: Python ----------
import json
import dateutil.parser
import datetime

# start the counter at a specific date and time, if not automatically specified, the 
# program will assume the first time stamp on the file is the first detection and will read from then. and make the time interval between 0 to 5 minutes

start = dateutil.parser.parse('2016-07-12T09:52:21.251939')
end = start + datetime.timedelta(minutes=5)

# after you have selected time, open the json file and go through the looking for 
#  

with open('in.json', 'r') as f:
    data = json.loads(f.read())
    d = []
    for x in data:
        time = dateutil.parser.parse(x['time'])
        if start < time < end:
            d.append(x['rssi'])
    
# print all the sorted rssi values from all the base stations within that time period
    print(sorted(d))
    

# now rank those base stations on the highest average of rssi, to make it indexing 
# x = np.array([0, 1, 2, 3, 4, 5, 6, 7, 8, 9]), x[1:7:2], array([1, 3, 5])

average = 0
sum = 0    
for n in numbers:
    sum = sum + n
average = sum / len(numbers)

### now output back to the three highest averages attached to the name sof the 
# base stations in their order or their appearance in the array. 
# sort by rssi and give me three basestation names as an output in order of rank

L = []
    L = [0,1,2]
    
    print L
    

# The output will give you three baseStation names. 
# search through the list of the baseStation names and  then place points at those coordinants
# you will have to look into the json file for this to happen

search
# ---------- end python_script ----------
boolean_toggle = BooleanToggle(True)  # disabled
button = Button()  # disabled
geometry = Geometry(construct_point)  # disabled
geometry_2 = Geometry(construct_point_2)  # disabled
timer_2 = Timer(TimerInterval=20, Target=python_script_2)  # disabled
python_script_2 = PythonScript(StartPt=geometry, DirPt=geometry_2, length=number_slider_7, Toggle=boolean_toggle, Reset=button)  # -> out, Count, a, b; inputs Toggle: Boolean, Reset: Boolean; disabled
# ---------- python_script_2: Python ----------
import scriptcontext as sc
import rhinoscriptsyntax as rs 


org = rs.AddPoint((0, 0, 0))
dir = rs.AddPoint(DirPt)
box = [20, 40, 20]

# Add the count variable to the sticky dict
if "count" not in sc.sticky:
    sc.sticky["count"] =  rs.VectorCreate(StartPt, org)
if "vel" not in sc.sticky:
    sc.sticky["vel"] = rs.VectorCreate(dir, StartPt)

def re():
    if Reset:
        sc.sticky["count"] = rs.VectorCreate(StartPt, org)
        s = rs.VectorCreate(dir, StartPt)
        sLen = rs.VectorUnitize(s)
        sc.sticky["vel"] = rs.VectorScale(sLen, length)
    return

def bound():
    if sc.sticky["count"][0]> box[0] or sc.sticky["count"][0]< -box[0]:
        sc.sticky["vel"][0] = - sc.sticky["vel"][0]
    if sc.sticky["count"][1]> box[1] or sc.sticky["count"][1]< -box[1]:
        sc.sticky["vel"][1] = - sc.sticky["vel"][1]
    if sc.sticky["count"][2]> box[2] or sc.sticky["count"][2]< -box[2]:
        sc.sticky["vel"][2] = - sc.sticky["vel"][2]
    return

def main():

    print(sc.sticky["count"])
    
    if Toggle:
        ac = sc.sticky["count"]
        bc = sc.sticky["vel"]
        add = rs.VectorAdd(ac, bc)
        sc.sticky["count"] = add
        print(sc.sticky["count"])
    
    bound()
    
    # Reset the count
    re()

    # Return count to GH
    Count = sc.sticky["count"]
    pt_x = sc.sticky["count"][0]
    pt_y = sc.sticky["count"][1]
    pt_z = sc.sticky["count"][2]
    
    a = rs.AddPoint(pt_x, pt_y, pt_z)
    
    return a

a = main()
b = box
# ---------- end python_script_2 ----------
construct_domain = ConstructDomain(DomainStart=graft(python_script_2.b), DomainEnd=expr("-x", graft(python_script_2.b)))  # disabled
explode_tree = ExplodeTree(Data=construct_domain)  # -> Branch0, Branch1, Branch2; disabled
sphere = Sphere(Base=python_script_2.a, Radius=1)  # disabled
panel_8 = Panel(python_script_2.out)  # disabled
domain_box = DomainBox(Base=PlaneXY(0, 0, 0), X=explode_tree.Branch0, Y=explode_tree.Branch1, Z=explode_tree.Branch2)  # disabled
colour_swatch = ColourSwatch(SwatchColor=RGBA(255, 255, 255, 54))  # disabled
custom_preview = CustomPreview(Geometry=domain_box, Shader=colour_swatch)  # disabled
panel_9 = Panel(python_script_2.a)  # disabled
panel_10 = Panel(explode_tree.Branch0)  # disabled

# ----
# This draws out the points that correspond to the base stations.
# 
# The basestations names are static, change the list in the panel and the list in the json file if any basestation changes need to be done.
# Basestations
arup_basestations = Panel("""RPI001
RPI002
RPI003
RPI004
RPI005
RPI006
RPI007
RPI008
RPI009
RPI010
RPI011
RPI012
RPI013
RPI014
RPI015
RPI016
RPI017
RPI018
RPI019
RPI020
RPI021
RPI022
RPI023
RPI024
RPI025
RPI026
RPI027
RPI028
RPI029
RPI030
RPI031
RPI032
RPI033
RPI034
RPI035
RPI036
RPI037""")
bvn_basestations = Panel("""RPI001
RPI002
RPI003
RPI004
RPI005
RPI006
RPI007
RPI008
RPI009
RPI010
RPI011
RPI012
RPI013
RPI014
RPI015
RPI016
RPI017
RPI018
RPI019
RPI020
RPI021
RPI022
RPI023
RPI024
RPI025
RPI026
RPI027
RPI028
RPI029
RPI030
RPI031
RPI032
RPI033
RPI034
RPI035
RPI036
RPI037
RPI038
RPI039
RPI040
RPI041
RPI042""")
arup_path = FilePath("F:\BlankMindBlog\helpers\basestation_location\baseStations_ARUP.json")
bvn_path = FilePath("F:\BlankMindBlog\helpers\basestation_location\baseStations_BVN.json")
list_of_basestations = ListOfBasestations(filepath=bvn_path, inputname=bvn_basestations)  # -> x, y
x_y_coords = ConstructPoint(XCoordinate=list_of_basestations.x, YCoordinate=list_of_basestations.y, ZCoordinate=0)
text_tag_3d = TextTag3D(Location=x_y_coords, Text=bvn_basestations, Size=1562, Colour=ColourSwatch(SwatchColor=RGB(75, 209, 0)), Justification=5)

# ----
# BaseStations
point_3 = Point(x_y_coords)

# ----
# Joining start and end pts
# This maps the points so that the path is continous e.g. [0] to [1], [1] to [2]....
joining_curves = PythonScript(agent=json_detections_real_data.agent)  # -> start, end; inputs agent: list
# ---------- joining_curves: Python ----------
import ghpythonlib as gh

x = 0
start = []
end = []

while x < len(agent)-1:
    start.append(agent[x])
    end.append(agent[x + 1])
    x = x + 1
    
    print start
    print end
# ---------- end joining_curves ----------
panel_11 = Panel(joining_curves.end)
panel_12 = Panel(joining_curves.start)

sort_points = SortPoints(Points=x_y_coords)  # -> Points, Indices
deconstruct = Deconstruct(Point=sort_points.Points)  # -> reverse(XComponent), reverse(YComponent), ZComponent
panel_13 = Panel(deconstruct.XComponent)
panel_14 = Panel(deconstruct.YComponent)

# ----
# Furniture
# boundarys
cluster = Cluster()

# ----
# Start and End Pts
# This takes list of detections and
# returns the x, y coords of the basestations
detection_of_start_point = ListOfBasestations(filepath=bvn_path, inputname=panel_12)  # -> x, y
detection_of_end_point = ListOfBasestations(filepath=bvn_path, inputname=panel_11)  # -> x, y
start_pts = ConstructPoint(XCoordinate=detection_of_start_point.x, YCoordinate=detection_of_start_point.y, ZCoordinate=0)
end_pts = ConstructPoint(XCoordinate=detection_of_end_point.x, YCoordinate=detection_of_end_point.y, ZCoordinate=0)
panel_15 = Panel(start_pts)
panel_16 = Panel(end_pts)

# ----
# Duplicates of Pts
start_endpts = Data([panel_16, panel_15])
create_set_5 = CreateSet(List=start_endpts)  # -> Set, Map
create_set_6 = CreateSet(List=create_set_5.Map)  # -> Set, Map
member_index = MemberIndex(Set=create_set_5.Map, Member=create_set_6.Set)  # -> Index, Count
panel_17 = Panel(member_index.Count)

point_4 = Point(point_2)
custom_preview_2 = CustomPreview(Geometry=point_4, Shader=ColourSwatch(SwatchColor=RGB(8, 8, 255)))

# ----
# Direct Path
# What the path should be without the obstacles
number_slider_8 = Slider(72, range=0..100)
line = Line(StartPoint=panel_15, EndPoint=panel_16)
join_curves = JoinCurves(Curves=line, Preserve=False)
pipe = Pipe(Curve=line, Radius=number_slider_8, Caps=0)
animates_the_path = PointOnCurve(join_curves, parameter=0)
sphere_2 = Sphere(Base=animates_the_path, Radius=Slider(1000, range=0..1000))
brep_join = BrepJoin(Breps=[sphere_2, pipe])  # -> Breps, Closed

# ----
# Obstacles and Nav Mesh BVN
geometry_pipeline = GeometryPipeline(
    GroupByLayer=False,
    GroupByType=False,
    IncludeHidden=True,
    IncludeLocked=True,
    LayerFilter="_gh_nav_graph_BVN",
    NameFilter="*",
    TypeFilter=4)
data_dam = DataDam(DataDataA=geometry_pipeline, BufferDelay=10000000, BufferMode=0)
geometry_3 = Geometry(data_dam)

number_slider_9 = Slider(10, range=0..10)  # disabled
number_slider_10 = Slider(100, range=0..100)  # disabled
construct_particle = ConstructParticle(
    UpDirection=Vector(0, 0, 1),
    Acceleration=Vector(0, 0, 0),
    Lifespan=30,
    Mass=1,
    BodySize=number_slider_10,
    HistoryLength=number_slider_9)  # disabled
number_slider_11 = Slider(20, range=0..100)  # disabled

# ----
# shortest walk/ simulated data
# Cluster of script uses the nav mesh script and executes shortest path, w vectors and tags.
# 
# Will turn up red if detection is stationary.
shortest_walk = ShortestWalk(Curves=geometry_3, WantedPath=line)  # -> ShortestWalk, Succession, Direction, Length
join_curves_2 = JoinCurves(Curves=shortest_walk.ShortestWalk, Preserve=False)
pipe_2 = Pipe(Curve=shortest_walk.ShortestWalk, Radius=Slider(80, range=0..100), Caps=0)
number_slider_12 = Slider(1000, range=0..1000)
panel_18 = Panel(join_curves_2)
point_on_curve = PointOnCurve(join_curves_2, parameter=1)
sphere_3 = Sphere(Base=point_on_curve, Radius=number_slider_12)
text_tag_3d_2 = TextTag3D(Location=point_on_curve, Text=panel_2, Size=number_slider_12, Colour=RGB(255, 0, 0), Justification=7)

point_emitter = PointEmitter(
    ContinuousFlow=True,
    CreationRate=1,
    NumberOfQuelea=0,
    MinimumInitialVelocity=Vector(-0.1, -0.1, -0.1),
    MaximumInitialVelocity=Vector(0.1, 0.1, 0.1),
    Point=Point(0, 0, 0))  # disabled
construct_agent = ConstructAgent(ParticleQueleaSettings=construct_particle, MaxSpeed=0.5, MaxForce=0.1, VisionRadius=number_slider_11, VisionAngle=360)  # disabled

# ----
# Vectors Along Path
list_item = ListItem(List=geometry_3, Index=shortest_walk.Succession, Wrap=False)
end_points = EndPoints(Curve=list_item)  # -> Start, End
evaluate_length = EvaluateLength(Curve=list_item, Length=0.5, Normalized=True)  # -> Point, Tangent, Parameter
vector_2pt = Vector2Pt(PointA=end_points.Start, PointB=end_points.End, Unitize=False)  # -> Vector, Length
remap_numbers = RemapNumbers(Values=shortest_walk.Direction, Source=Domain(0, 1), Target=Domain(-0.1, 0.1))
amplitude = Amplitude(Vector=vector_2pt.Vector, Amplitude=remap_numbers)
vector_display = VectorDisplay(Anchor=evaluate_length.Point, Vector=amplitude)

system = System(QueleaSettings=construct_agent, Emitters=point_emitter)  # -> System, Quelea, QueleaNetwork; disabled
boolean_toggle_2 = BooleanToggle(False)  # disabled
point_5 = Point(<point referenced from the Rhino model>)  # disabled
boolean_toggle_3 = BooleanToggle(False)  # disabled
number_slider_13 = Slider(100, range=0..100)  # disabled
timer_3 = Timer(TimerInterval=20, Target=[engine, system])  # disabled
engine = Engine(Reset=boolean_toggle_3, System=system.System)  # disabled

# ----
# Checkpoints
evaluate_length_2 = EvaluateLength(Curve=shortest_walk.ShortestWalk, Length=[0, 1], Normalized=True)  # -> Point, Tangent, Parameter
unit_z = UnitZ(Factor=1)
cross_product = CrossProduct(VectorA=unit_z, VectorB=evaluate_length_2.Tangent, Unitize=False)  # -> Vector, Length
center_box = CenterBox(Base=evaluate_length_2.Point, X=0.1, Y=0.1, Z=0.07)
construct_plane = Plane(Origin=evaluate_length_2.Point, XAxis=cross_product.Vector, YAxis=unit_z)
T = Text(["START", "GOAL"])
text_tag = TextTag(Location=construct_plane, Text=T)

arrive_force = ArriveForce(
    Apply=boolean_toggle_2,
    WeightMultiplier=1,
    AgentQuelea=system.Quelea,
    TargetPoint=point_5,
    ArrivalRadius=number_slider_13)  # -> Force, DesiredVelocity; disabled
get_particle_position = GetParticlePosition(ParticleQuelea=system.Quelea)  # -> Position, SurfacePosition; disabled
point_6 = Point(<point referenced from the Rhino model>)  # disabled
boolean_toggle_4 = BooleanToggle(False)  # disabled
deconstruct_quelea_network = DeconstructQueleaNetwork()  # disabled

# ----
# Separating Curves
# Finds the overlapping points and randomly moves it away to separate curves.
# 
# Also turns these curves into a nurbs curve.
exploded_points_of_overlapping_crvs = Curve(join_curves_2)
number_slider_14 = Slider(388, range=0..10000)
discontinuity = Discontinuity(Curve=exploded_points_of_overlapping_crvs, Level=1)  # -> Points, Parameters
negative = Negative(Value=number_slider_14)
construct_domain_2 = ConstructDomain(DomainStart=negative, DomainEnd=number_slider_14)
list_length = ListLength(List=discontinuity.Points)
random = Random(Range=construct_domain_2, Number=list_length, Seed=2)
unit_x = UnitX(Factor=1)
amplitude_2 = Amplitude(Vector=unit_x, Amplitude=random)
move = Move(Geometry=discontinuity.Points, Motion=amplitude_2)  # -> Geometry, Transform
nurbs_curve_2 = NurbsCurve(Vertices=move.Geometry, Degree=3, Periodic=False)  # -> Curve, Length, Domain
panel_19 = Panel("""0
4
3""")
group_1_e_g_arch = ListItem(List=flatten(nurbs_curve_2.Curve), Index=panel_19, Wrap=True)
point_on_curve_2 = PointOnCurve(group_1_e_g_arch, parameter=0.023)
sphere_4 = Sphere(Base=point_on_curve_2, Radius=Slider(1000, range=0..1000))
custom_preview_lineweights = CustomPreviewLineweights(
    Geometry=[group_1_e_g_arch, sphere_4],
    Shader=ColourSwatch(SwatchColor=RGB(142, 138, 255)),
    Thickness=Slider(3, range=0..10),
    Absolute=False)

arrive_force_2 = ArriveForce(Apply=boolean_toggle_4, WeightMultiplier=1, AgentQuelea=system.Quelea, TargetPoint=point_6, ArrivalRadius=5)  # -> Force, DesiredVelocity; disabled
sphere_5 = Geometry(sphere_3)
path = Geometry(join_curves_2)

# ----
# Colours per person of sphere and path
length = Length(Curve=shortest_walk.ShortestWalk)
bounds = Bounds(Numbers=length)
deconstruct_domain = DeconstructDomain(Domain=bounds)  # -> Start, End
gradient = Gradient(
    LowerLimit=deconstruct_domain.Start,
    UpperLimit=deconstruct_domain.End,
    Parameter=length,
    stops=[0: RGB(255, 0, 0), 0.171: RGB(255, 212, 0), 0.342: RGB(81, 255, 0), 0.496: RGB(0, 255, 136), 0.667: RGB(0, 153, 255), 0.821: RGB(42, 0, 255), 1: RGB(255, 0, 255)])
path_2 = CustomPreviewLineweights(Geometry=path, Shader=gradient, Thickness=Slider(3, range=0..10))
sphere_6 = CustomPreview(Geometry=sphere_5, Shader=gradient)

panel_20 = Panel("""1
2""")
group_2_e_g_str = ListItem(List=flatten(nurbs_curve_2.Curve), Index=panel_20, Wrap=True)
point_on_curve_3 = PointOnCurve(group_2_e_g_str, parameter=0.612)
sphere_7 = Sphere(Base=point_on_curve_3, Radius=Slider(1000, range=0..1000))
custom_preview_lineweights_2 = CustomPreviewLineweights(
    Geometry=[sphere_7, group_2_e_g_str],
    Shader=ColourSwatch(SwatchColor=RGB(212, 255, 138)),
    Thickness=Slider(3, range=0..10),
    Absolute=False)

closest_points = ClosestPoints(Point=point_2, Cloud=point_3, Count=Slider(3, range=0..10))  # -> ClosestPoint, CPIndex, Distance
# Draw a triangle
# and make a centroid
number_slider_15 = Slider(0, range=0..2)
point_7 = Point(closest_points.ClosestPoint)
list_item_2 = ListItem(List=point_7, Index=Slider(2, range=0..2), Wrap=True)
list_item_3 = ListItem(List=point_7, Index=number_slider_15, Wrap=True)
list_item_4 = ListItem(List=point_7, Index=Slider(1, range=0..2), Wrap=True)

line_2 = Line(StartPoint=list_item_4, EndPoint=list_item_3)
distance = Distance(PointA=list_item_4, PointB=list_item_3)

line_3 = Line(StartPoint=list_item_3, EndPoint=list_item_2)
distance_2 = Distance(PointA=list_item_3, PointB=list_item_2)

line_4 = Line(StartPoint=list_item_2, EndPoint=list_item_4)
distance_3 = Distance(PointA=list_item_2, PointB=list_item_4)

panel_21 = Panel(distance_2)
panel_22 = Panel(distance)
panel_23 = Panel(distance_3)
boundary_surfaces = BoundarySurfaces(Edges=[line_4, line_2, line_3])
area = Area(Geometry=boundary_surfaces)  # -> Area, Centroid
point_8 = Point(area.Centroid)

# ----
# check if points are
#  inside a list of curves
# A = inside all curves
# B = outside all curves
# C = inside some curves
# Reporting: Project point
# outside of furniture
curve = Curve(cluster)
# Make the estimated
#  position avoid furniture
c_script = CSharpScript(pts=point_8, crvs=curve)  # -> out, A, B, C; inputs pts: list of Point3d, crvs: list of Polyline
# ---------- c_script: C# ----------
    var inside = new List<Point3d>();
    var outside = new List<Point3d>();
    var other = new List<Point3d>();

    foreach (Point3d pt in pts)
    {
      int insideCount = 0;
      foreach (var crv in crvs)
      {
        if(IsInside(pt, crv)) insideCount++;
      }
      if(insideCount == crvs.Count) inside.Add(pt);
      else if(insideCount == 0) outside.Add(pt);
      else other.Add(pt);
    }
    A = inside;
    B = outside;
    C = other;
# ---------- c_script: C# additional code ----------
  bool IsInside (Point3d pt, Polyline crv)
  {
    Point3d pt1, pt2;
    bool oddNodes = false;

    for (int i = 0; i < crv.SegmentCount; i++) //for each contour line
    {

      pt1 = crv.SegmentAt(i).From; //get start and end pt
      pt2 = crv.SegmentAt(i).To;

      if ( (pt1[1] < pt[1] && pt2[1] >= pt[1] || pt2[1] < pt[1] && pt1[1] >= pt[1]) && (pt1[0] <= pt[0] || pt2[0] <= pt[0]) ) //if pt is between pts in y, and either of pts is before pt in x
        oddNodes ^= ( pt2[0] + (pt[1] - pt2[1]) * (pt1[0] - pt2[0]) / (pt1[1] - pt2[1]) < pt[0] ); //^= is xor
      //end.X + (pt-end).Y   * (start-end).X  /(start-end).Y   <   pt.X
    }


    if (!oddNodes)
    {
      double minDist = 1e10;
      for (int i = 0; i < crv.SegmentCount; i++) {
        Point3d cp = crv.SegmentAt(i).ClosestPoint(pt, true);
        //Point3d cp = mvContour[i].closestPoint(pt);
        //minDist = min(minDist, cp.distance(pt));
        minDist = Math.Min(minDist, cp.DistanceTo(pt));
      }
      if (minDist < 1e-10)
        return true;
    }

    if(oddNodes) return true;

    return false;

  }
# ---------- end c_script ----------
pt_c = Point(c_script.C)
panel_24 = Panel(pt_c)
pt_a = Point(c_script.A)
pt_b = Point(c_script.B)

# ----
# Check curve
# closet point
curve_closest_point = CurveClosestPoint(Point=[pt_c, pt_b], Curve=flatten(curve))  # -> Point, Parameter, Distance
sort_list_2 = SortList(Keys=curve_closest_point.Distance, ValuesValuesA=flatten(curve))  # -> Keys, ValuesValuesA
panel_25 = Panel(sort_list_2.ValuesValuesA)
panel_26 = Panel(curve_closest_point.Distance)
list_item_5 = ListItem(List=sort_list_2.ValuesValuesA, Index=Slider(0, range=0..100), Wrap=True)

divide_curve = DivideCurve(Curve=list_item_5, Count=Slider(4, range=0..10), Kinks=False)  # -> Points, Tangents, Parameters
closest_point = ClosestPoint(Point=point_8, Cloud=divide_curve.Points)  # -> ClosestPoint, CPIndex, Distance

point_9 = Point(closest_point.ClosestPoint)
# Test Me!
custom_preview_3 = CustomPreview(Geometry=point_9, Shader=ColourSwatch(SwatchColor=RGB(253, 8, 0)))
line_5 = Line(StartPoint=point_9, EndPoint=point_4)
distance_4 = Distance(PointA=point_9, PointB=point_4)
panel_27 = Panel(distance_4)

# ==== cluster ListOfBasestations
inputname = ClusterInput()
filepath = ClusterInput()
data_json = PythonScript(FilePath=filepath, inputName=inputname)  # -> out, x, y
# ---------- data_json: Python ----------
import json

if FilePath:
    
    # JSON file to read
    file = open(FilePath)
    
    # Load the data
    data = json.load(file)
    
    # Do something with the data
    for basestation in data:
        print basestation["Name"]
#        print inputName
        if basestation["Name"] == inputName:
            x = basestation["X"]
            y = basestation["Y"]
            print x
            print y
# ---------- end data_json ----------
y = ClusterOutput(data_json.y)
x = ClusterOutput(data_json.x)

# ==== cluster Cluster

crv = Curve([<curve referenced from the Rhino model> x4806])
crv_2 = Curve([<curve referenced from the Rhino model> x58])
crv_3 = Curve([<curve referenced from the Rhino model> x62])
crv_4 = Curve([<curve referenced from the Rhino model> x3212])
crv_5 = Curve([<curve referenced from the Rhino model> x2945])
crv_6 = Curve([<curve referenced from the Rhino model> x62])
crv_7 = Curve([<curve referenced from the Rhino model> x3232])
crv_8 = Curve([<curve referenced from the Rhino model> x3204])
crv_9 = Curve([<curve referenced from the Rhino model> x2920])
crv_10 = Curve([<curve referenced from the Rhino model> x3204])
end = EndPoints(Curve=crv)  # -> Start, End
end_2 = EndPoints(Curve=crv_2)  # -> Start, End
end_3 = EndPoints(Curve=crv_3)  # -> Start, End
end_4 = EndPoints(Curve=crv_4)  # -> Start, End
end_5 = EndPoints(Curve=crv_5)  # -> Start, End
end_6 = EndPoints(Curve=crv_6)  # -> Start, End
end_7 = EndPoints(Curve=crv_7)  # -> Start, End
end_8 = EndPoints(Curve=crv_8)  # -> Start, End
end_9 = EndPoints(Curve=crv_9)  # -> Start, End
end_10 = EndPoints(Curve=crv_10)  # -> Start, End
hull = ConvexHull(Points=[end.Start, end.End], Plane=PlaneXY(0, 0, 0))  # -> Hull, HullZ, Indices
hull_2 = ConvexHull(Points=[end_2.Start, end_2.End], Plane=PlaneXY(0, 0, 0))  # -> Hull, HullZ, Indices
hull_3 = ConvexHull(Points=[end_4.Start, end_4.End], Plane=PlaneXY(0, 0, 0))  # -> Hull, HullZ, Indices
hull_4 = ConvexHull(Points=[end_5.Start, end_5.End], Plane=PlaneXY(0, 0, 0))  # -> Hull, HullZ, Indices
hull_5 = ConvexHull(Points=[end_6.Start, end_6.End], Plane=PlaneXY(0, 0, 0))  # -> Hull, HullZ, Indices
hull_6 = ConvexHull(Points=[end_3.Start, end_3.End], Plane=PlaneXY(0, 0, 0))  # -> Hull, HullZ, Indices
hull_7 = ConvexHull(Points=[end_7.Start, end_7.End], Plane=PlaneXY(0, 0, 0))  # -> Hull, HullZ, Indices
hull_8 = ConvexHull(Points=[end_8.Start, end_8.End], Plane=PlaneXY(0, 0, 0))  # -> Hull, HullZ, Indices
hull_9 = ConvexHull(Points=[end_9.Start, end_9.End], Plane=PlaneXY(0, 0, 0))  # -> Hull, HullZ, Indices
hull_10 = ConvexHull(Points=[end_10.Start, end_10.End], Plane=PlaneXY(0, 0, 0))  # -> Hull, HullZ, Indices

crv_11 = Curve([<curve referenced from the Rhino model> x30])
crv_12 = Curve([<curve referenced from the Rhino model> x246])
crv_13 = Curve([<curve referenced from the Rhino model> x75])
crv_14 = Curve([<curve referenced from the Rhino model> x57])
crv_15 = Curve([<curve referenced from the Rhino model> x45])
crv_16 = Curve([<curve referenced from the Rhino model> x32])
end_11 = EndPoints(Curve=crv_11)  # -> Start, End
end_12 = EndPoints(Curve=crv_12)  # -> Start, End
end_13 = EndPoints(Curve=crv_13)  # -> Start, End
end_14 = EndPoints(Curve=crv_14)  # -> Start, End
end_15 = EndPoints(Curve=crv_15)  # -> Start, End
end_16 = EndPoints(Curve=crv_16)  # -> Start, End
hull_11 = ConvexHull(Points=[end_11.Start, end_11.End], Plane=PlaneXY(0, 0, 0))  # -> Hull, HullZ, Indices
hull_12 = ConvexHull(Points=[end_12.Start, end_12.End], Plane=PlaneXY(0, 0, 0))  # -> Hull, HullZ, Indices
hull_13 = ConvexHull(Points=[end_13.Start, end_13.End], Plane=PlaneXY(0, 0, 0))  # -> Hull, HullZ, Indices
hull_14 = ConvexHull(Points=[end_14.Start, end_14.End], Plane=PlaneXY(0, 0, 0))  # -> Hull, HullZ, Indices
hull_15 = ConvexHull(Points=[end_15.Start, end_15.End], Plane=PlaneXY(0, 0, 0))  # -> Hull, HullZ, Indices
hull_16 = ConvexHull(Points=[end_16.Start, end_16.End], Plane=PlaneXY(0, 0, 0))  # -> Hull, HullZ, Indices

crv_17 = Curve([<curve referenced from the Rhino model> x642])
crv_18 = Curve([<curve referenced from the Rhino model> x45])
crv_19 = Curve([<curve referenced from the Rhino model> x233])
crv_20 = Curve([<curve referenced from the Rhino model> x143])
crv_21 = Curve([<curve referenced from the Rhino model> x6])
crv_22 = Curve([<curve referenced from the Rhino model> x26])
crv_23 = Curve([<curve referenced from the Rhino model> x82])
crv_24 = Curve([<curve referenced from the Rhino model> x66])
crv_25 = Curve([<curve referenced from the Rhino model> x79])
crv_26 = Curve([<curve referenced from the Rhino model> x171])
divide = DivideCurve(Curve=crv_19, Count=10, Kinks=False)  # -> flatten(Points), Tangents, Parameters
divide_2 = DivideCurve(Curve=crv_18, Count=10, Kinks=False)  # -> flatten(Points), Tangents, Parameters
divide_3 = DivideCurve(Curve=crv_20, Count=10, Kinks=False)  # -> flatten(Points), Tangents, Parameters
divide_4 = DivideCurve(Curve=crv_21, Count=10, Kinks=False)  # -> flatten(Points), Tangents, Parameters
divide_5 = DivideCurve(Curve=crv_22, Count=10, Kinks=False)  # -> flatten(Points), Tangents, Parameters
divide_6 = DivideCurve(Curve=crv_23, Count=10, Kinks=False)  # -> flatten(Points), Tangents, Parameters
end_17 = EndPoints(Curve=crv_17)  # -> Start, End
divide_7 = DivideCurve(Curve=crv_24, Count=10, Kinks=False)  # -> flatten(Points), Tangents, Parameters
divide_8 = DivideCurve(Curve=crv_25, Count=10, Kinks=False)  # -> flatten(Points), Tangents, Parameters
divide_9 = DivideCurve(Curve=crv_26, Count=10, Kinks=False)  # -> flatten(Points), Tangents, Parameters
hull_17 = ConvexHull(Points=[end_17.Start, end_17.End], Plane=PlaneXY(0, 0, 0))  # -> Hull, HullZ, Indices
hull_18 = ConvexHull(Points=divide_3.Points, Plane=PlaneXY(0, 0, 0))  # -> Hull, HullZ, Indices
hull_19 = ConvexHull(Points=divide_2.Points, Plane=PlaneXY(0, 0, 0))  # -> Hull, HullZ, Indices
hull_20 = ConvexHull(Points=divide_5.Points, Plane=PlaneXY(0, 0, 0))  # -> Hull, HullZ, Indices
hull_21 = ConvexHull(Points=divide_6.Points, Plane=PlaneXY(0, 0, 0))  # -> Hull, HullZ, Indices
hull_22 = ConvexHull(Points=divide.Points, Plane=PlaneXY(0, 0, 0))  # -> Hull, HullZ, Indices
hull_23 = ConvexHull(Points=divide_7.Points, Plane=PlaneXY(0, 0, 0))  # -> Hull, HullZ, Indices
hull_24 = ConvexHull(Points=divide_4.Points, Plane=PlaneXY(0, 0, 0))  # -> Hull, HullZ, Indices
hull_25 = ConvexHull(Points=divide_8.Points, Plane=PlaneXY(0, 0, 0))  # -> Hull, HullZ, Indices
hull_26 = ConvexHull(Points=divide_9.Points, Plane=PlaneXY(0, 0, 0))  # -> Hull, HullZ, Indices

crv_27 = Curve([<curve referenced from the Rhino model> x7])
crv_28 = Curve([<curve referenced from the Rhino model> x4])
crv_29 = Curve([<curve referenced from the Rhino model> x8])
crv_30 = Curve([<curve referenced from the Rhino model> x8])

crv_31 = Curve([<curve referenced from the Rhino model> x9])
crv_32 = Curve(<curve referenced from the Rhino model>)
crv_33 = Curve([<curve referenced from the Rhino model> x16])

crv_34 = Curve([<curve referenced from the Rhino model> x4])
crv_35 = Curve([<curve referenced from the Rhino model> x3])
crv_36 = Curve([<curve referenced from the Rhino model> x2])

crv_37 = Curve(<curve referenced from the Rhino model>)
crv_38 = Curve([<curve referenced from the Rhino model> x4])

crv_39 = Curve([<curve referenced from the Rhino model> x4])
crv_40 = Curve(<curve referenced from the Rhino model>)
crv_41 = Curve(<curve referenced from the Rhino model>)
crv_42 = Curve([<curve referenced from the Rhino model> x6])
crv_43 = Curve([<curve referenced from the Rhino model> x5])
crv_44 = Curve([<curve referenced from the Rhino model> x4])
crv_45 = Curve([<curve referenced from the Rhino model> x4])
crv_46 = Curve([<curve referenced from the Rhino model> x4])

end_18 = EndPoints(Curve=crv_28)  # -> Start, End
end_19 = EndPoints(Curve=crv_30)  # -> Start, End
end_20 = EndPoints(Curve=crv_35)  # -> Start, End
end_21 = EndPoints(Curve=crv_27)  # -> Start, End
end_22 = EndPoints(Curve=crv_29)  # -> Start, End
end_23 = EndPoints(Curve=crv_34)  # -> Start, End
end_24 = EndPoints(Curve=crv_36)  # -> Start, End
hull_27 = ConvexHull(Points=[end_18.Start, end_18.End], Plane=PlaneXY(0, 0, 0))  # -> Hull, HullZ, Indices
hull_28 = ConvexHull(Points=[end_20.Start, end_20.End], Plane=PlaneXY(0, 0, 0))  # -> Hull, HullZ, Indices
hull_29 = ConvexHull(Points=[end_19.Start, end_19.End], Plane=PlaneXY(0, 0, 0))  # -> Hull, HullZ, Indices
hull_30 = ConvexHull(Points=[end_21.Start, end_21.End], Plane=PlaneXY(0, 0, 0))  # -> Hull, HullZ, Indices
hull_31 = ConvexHull(Points=[end_22.Start, end_22.End], Plane=PlaneXY(0, 0, 0))  # -> Hull, HullZ, Indices
hull_32 = ConvexHull(Points=[end_24.Start, end_24.End], Plane=PlaneXY(0, 0, 0))  # -> Hull, HullZ, Indices
hull_33 = ConvexHull(Points=[end_23.Start, end_23.End], Plane=PlaneXY(0, 0, 0))  # -> Hull, HullZ, Indices
end_25 = EndPoints(Curve=crv_41)  # -> Start, End
end_26 = EndPoints(Curve=crv_40)  # -> Start, End
end_27 = EndPoints(Curve=crv_43)  # -> Start, End
end_28 = EndPoints(Curve=crv_44)  # -> Start, End
end_29 = EndPoints(Curve=crv_46)  # -> Start, End
end_30 = EndPoints(Curve=crv_42)  # -> Start, End
end_31 = EndPoints(Curve=crv_45)  # -> Start, End
end_32 = EndPoints(Curve=crv_39)  # -> Start, End
hull_34 = ConvexHull(Points=[end_25.Start, end_25.End], Plane=PlaneXY(0, 0, 0))  # -> Hull, HullZ, Indices
end_33 = EndPoints(Curve=crv_38)  # -> Start, End
end_34 = EndPoints(Curve=crv_37)  # -> Start, End
end_35 = EndPoints(Curve=crv_33)  # -> Start, End
end_36 = EndPoints(Curve=crv_31)  # -> Start, End
end_37 = EndPoints(Curve=crv_32)  # -> Start, End
hull_35 = ConvexHull(Points=[end_26.Start, end_26.End], Plane=PlaneXY(0, 0, 0))  # -> Hull, HullZ, Indices
hull_36 = ConvexHull(Points=[end_27.Start, end_27.End], Plane=PlaneXY(0, 0, 0))  # -> Hull, HullZ, Indices
hull_37 = ConvexHull(Points=[end_28.Start, end_28.End], Plane=PlaneXY(0, 0, 0))  # -> Hull, HullZ, Indices
hull_38 = ConvexHull(Points=[end_29.Start, end_29.End], Plane=PlaneXY(0, 0, 0))  # -> Hull, HullZ, Indices
hull_39 = ConvexHull(Points=[end_30.Start, end_30.End], Plane=PlaneXY(0, 0, 0))  # -> Hull, HullZ, Indices
hull_40 = ConvexHull(Points=[end_31.Start, end_31.End], Plane=PlaneXY(0, 0, 0))  # -> Hull, HullZ, Indices
hull_41 = ConvexHull(Points=[end_32.Start, end_32.End], Plane=PlaneXY(0, 0, 0))  # -> Hull, HullZ, Indices
hull_42 = ConvexHull(Points=[end_33.Start, end_33.End], Plane=PlaneXY(0, 0, 0))  # -> Hull, HullZ, Indices
hull_43 = ConvexHull(Points=[end_34.Start, end_34.End], Plane=PlaneXY(0, 0, 0))  # -> Hull, HullZ, Indices
hull_44 = ConvexHull(Points=[end_35.Start, end_35.End], Plane=PlaneXY(0, 0, 0))  # -> Hull, HullZ, Indices
hull_45 = ConvexHull(Points=[end_36.Start, end_36.End], Plane=PlaneXY(0, 0, 0))  # -> Hull, HullZ, Indices
hull_46 = ConvexHull(Points=[end_37.Start, end_37.End], Plane=PlaneXY(0, 0, 0))  # -> Hull, HullZ, Indices

crv_47 = Curve([<curve referenced from the Rhino model> x4806])
crv_48 = Curve([<curve referenced from the Rhino model> x62])
crv_49 = Curve([<curve referenced from the Rhino model> x62])
crv_50 = Curve([<curve referenced from the Rhino model> x16])
crv_51 = Curve([<curve referenced from the Rhino model> x3204])
crv_52 = Curve([<curve referenced from the Rhino model> x2415])
crv_53 = Curve([<curve referenced from the Rhino model> x24])
crv_54 = Curve([<curve referenced from the Rhino model> x5000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])
crv_55 = Curve([<curve referenced from the Rhino model> x4770])
crv_56 = Curve([<curve referenced from the Rhino model> x3204])
end_38 = EndPoints(Curve=crv_47)  # -> Start, End
end_39 = EndPoints(Curve=crv_48)  # -> Start, End
end_40 = EndPoints(Curve=crv_49)  # -> Start, End
end_41 = EndPoints(Curve=crv_50)  # -> Start, End
end_42 = EndPoints(Curve=crv_51)  # -> Start, End
end_43 = EndPoints(Curve=crv_52)  # -> Start, End
end_44 = EndPoints(Curve=crv_53)  # -> Start, End
end_45 = EndPoints(Curve=crv_54)  # -> Start, End
end_46 = EndPoints(Curve=crv_55)  # -> Start, End
end_47 = EndPoints(Curve=crv_56)  # -> Start, End
hull_47 = ConvexHull(Points=[end_38.Start, end_38.End], Plane=PlaneXY(0, 0, 0))  # -> Hull, HullZ, Indices
hull_48 = ConvexHull(Points=[end_39.Start, end_39.End], Plane=PlaneXY(0, 0, 0))  # -> Hull, HullZ, Indices
hull_49 = ConvexHull(Points=[end_40.Start, end_40.End], Plane=PlaneXY(0, 0, 0))  # -> Hull, HullZ, Indices
hull_50 = ConvexHull(Points=[end_41.Start, end_41.End], Plane=PlaneXY(0, 0, 0))  # -> Hull, HullZ, Indices
hull_51 = ConvexHull(Points=[end_42.Start, end_42.End], Plane=PlaneXY(0, 0, 0))  # -> Hull, HullZ, Indices
hull_52 = ConvexHull(Points=[end_43.Start, end_43.End], Plane=PlaneXY(0, 0, 0))  # -> Hull, HullZ, Indices
hull_53 = ConvexHull(Points=[end_44.Start, end_44.End], Plane=PlaneXY(0, 0, 0))  # -> Hull, HullZ, Indices
hull_54 = ConvexHull(Points=[end_45.Start, end_45.End], Plane=PlaneXY(0, 0, 0))  # -> Hull, HullZ, Indices
hull_55 = ConvexHull(Points=[end_46.Start, end_46.End], Plane=PlaneXY(0, 0, 0))  # -> Hull, HullZ, Indices
hull_56 = ConvexHull(Points=[end_47.Start, end_47.End], Plane=PlaneXY(0, 0, 0))  # -> Hull, HullZ, Indices

crv_57 = Curve([<curve referenced from the Rhino model> x45])
crv_58 = Curve(<curve referenced from the Rhino model>)
crv_59 = Curve([<curve referenced from the Rhino model> x9])
crv_60 = Curve([<curve referenced from the Rhino model> x4])
crv_61 = Curve([<curve referenced from the Rhino model> x8])
crv_62 = Curve([<curve referenced from the Rhino model> x28])
divide_10 = DivideCurve(Curve=crv_58, Count=10, Kinks=False)  # -> flatten(Points), Tangents, Parameters
divide_11 = DivideCurve(Curve=crv_60, Count=10, Kinks=False)  # -> flatten(Points), Tangents, Parameters
divide_12 = DivideCurve(Curve=crv_57, Count=10, Kinks=False)  # -> flatten(Points), Tangents, Parameters
divide_13 = DivideCurve(Curve=crv_62, Count=10, Kinks=False)  # -> flatten(Points), Tangents, Parameters
divide_14 = DivideCurve(Curve=crv_59, Count=10, Kinks=False)  # -> flatten(Points), Tangents, Parameters
divide_15 = DivideCurve(Curve=crv_61, Count=10, Kinks=False)  # -> flatten(Points), Tangents, Parameters
hull_57 = ConvexHull(Points=divide_10.Points, Plane=PlaneXY(0, 0, 0))  # -> Hull, HullZ, Indices
hull_58 = ConvexHull(Points=divide_11.Points, Plane=PlaneXY(0, 0, 0))  # -> Hull, HullZ, Indices
hull_59 = ConvexHull(Points=divide_15.Points, Plane=PlaneXY(0, 0, 0))  # -> Hull, HullZ, Indices
hull_60 = ConvexHull(Points=divide_13.Points, Plane=PlaneXY(0, 0, 0))  # -> Hull, HullZ, Indices
hull_61 = ConvexHull(Points=divide_12.Points, Plane=PlaneXY(0, 0, 0))  # -> Hull, HullZ, Indices
hull_62 = ConvexHull(Points=divide_14.Points, Plane=PlaneXY(0, 0, 0))  # -> Hull, HullZ, Indices

crv_63 = Curve([<curve referenced from the Rhino model> x293])
crv_64 = Curve([<curve referenced from the Rhino model> x10])
crv_65 = Curve([<curve referenced from the Rhino model> x81])
crv_66 = Curve([<curve referenced from the Rhino model> x81])
crv_67 = Curve([<curve referenced from the Rhino model> x36])
end_48 = EndPoints(Curve=crv_65)  # -> Start, End
end_49 = EndPoints(Curve=crv_63)  # -> Start, End
end_50 = EndPoints(Curve=crv_64)  # -> Start, End
end_51 = EndPoints(Curve=crv_66)  # -> Start, End
end_52 = EndPoints(Curve=crv_67)  # -> Start, End
hull_63 = ConvexHull(Points=[end_49.Start, end_49.End], Plane=PlaneXY(0, 0, 0))  # -> Hull, HullZ, Indices
hull_64 = ConvexHull(Points=[end_50.Start, end_50.End], Plane=PlaneXY(0, 0, 0))  # -> Hull, HullZ, Indices
hull_65 = ConvexHull(Points=[end_51.Start, end_51.End], Plane=PlaneXY(0, 0, 0))  # -> Hull, HullZ, Indices
hull_66 = ConvexHull(Points=[end_52.Start, end_52.End], Plane=PlaneXY(0, 0, 0))  # -> Hull, HullZ, Indices
hull_67 = ConvexHull(Points=[end_48.Start, end_48.End], Plane=PlaneXY(0, 0, 0))  # -> Hull, HullZ, Indices

crv_68 = Curve([<curve referenced from the Rhino model> x12])
crv_69 = Curve([<curve referenced from the Rhino model> x772])
crv_70 = Curve([<curve referenced from the Rhino model> x30])
crv_71 = Curve([<curve referenced from the Rhino model> x855])
crv_72 = Curve([<curve referenced from the Rhino model> x790])
crv_73 = Curve([<curve referenced from the Rhino model> x31])
divide_16 = DivideCurve(Curve=crv_70, Count=10, Kinks=False)  # -> flatten(Points), Tangents, Parameters
divide_17 = DivideCurve(Curve=crv_72, Count=10, Kinks=False)  # -> flatten(Points), Tangents, Parameters
end_53 = EndPoints(Curve=crv_68)  # -> Start, End
end_54 = EndPoints(Curve=crv_69)  # -> Start, End
divide_18 = DivideCurve(Curve=crv_71, Count=10, Kinks=False)  # -> flatten(Points), Tangents, Parameters
end_55 = EndPoints(Curve=crv_73)  # -> Start, End
hull_68 = ConvexHull(Points=[end_53.Start, end_53.End], Plane=PlaneXY(0, 0, 0))  # -> Hull, HullZ, Indices
hull_69 = ConvexHull(Points=divide_16.Points, Plane=PlaneXY(0, 0, 0))  # -> Hull, HullZ, Indices
hull_70 = ConvexHull(Points=[end_54.Start, end_54.End], Plane=PlaneXY(0, 0, 0))  # -> Hull, HullZ, Indices
hull_71 = ConvexHull(Points=divide_18.Points, Plane=PlaneXY(0, 0, 0))  # -> Hull, HullZ, Indices
hull_72 = ConvexHull(Points=divide_17.Points, Plane=PlaneXY(0, 0, 0))  # -> Hull, HullZ, Indices
hull_73 = ConvexHull(Points=[end_55.Start, end_55.End], Plane=PlaneXY(0, 0, 0))  # -> Hull, HullZ, Indices

crv_74 = Curve([<curve referenced from the Rhino model> x36])
end_56 = EndPoints(Curve=crv_74)  # -> Start, End
hull_74 = ConvexHull(Points=[end_56.Start, end_56.End], Plane=PlaneXY(0, 0, 0))  # -> Hull, HullZ, Indices

crv_75 = Curve([<curve referenced from the Rhino model> x8])
crv_76 = Curve([<curve referenced from the Rhino model> x3981])
crv_77 = Curve([<curve referenced from the Rhino model> x136])
crv_78 = Curve([<curve referenced from the Rhino model> x131])
crv_79 = Curve([<curve referenced from the Rhino model> x5000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])
crv_80 = Curve([<curve referenced from the Rhino model> x66])
crv_81 = Curve([<curve referenced from the Rhino model> x772])
crv_82 = Curve([<curve referenced from the Rhino model> x87])
end_57 = EndPoints(Curve=crv_75)  # -> Start, End
end_58 = EndPoints(Curve=crv_77)  # -> Start, End
end_59 = EndPoints(Curve=crv_76)  # -> Start, End
end_60 = EndPoints(Curve=crv_80)  # -> Start, End
end_61 = EndPoints(Curve=crv_82)  # -> Start, End
end_62 = EndPoints(Curve=crv_79)  # -> Start, End
end_63 = EndPoints(Curve=crv_78)  # -> Start, End
end_64 = EndPoints(Curve=crv_81)  # -> Start, End
hull_75 = ConvexHull(Points=[end_57.Start, end_57.End], Plane=PlaneXY(0, 0, 0))  # -> Hull, HullZ, Indices
hull_76 = ConvexHull(Points=[end_58.Start, end_58.End], Plane=PlaneXY(0, 0, 0))  # -> Hull, HullZ, Indices
hull_77 = ConvexHull(Points=[end_59.Start, end_59.End], Plane=PlaneXY(0, 0, 0))  # -> Hull, HullZ, Indices
hull_78 = ConvexHull(Points=[end_60.Start, end_60.End], Plane=PlaneXY(0, 0, 0))  # -> Hull, HullZ, Indices
hull_79 = ConvexHull(Points=[end_61.Start, end_61.End], Plane=PlaneXY(0, 0, 0))  # -> Hull, HullZ, Indices
hull_80 = ConvexHull(Points=[end_62.Start, end_62.End], Plane=PlaneXY(0, 0, 0))  # -> Hull, HullZ, Indices
hull_81 = ConvexHull(Points=[end_64.Start, end_64.End], Plane=PlaneXY(0, 0, 0))  # -> Hull, HullZ, Indices
hull_82 = ConvexHull(Points=[end_63.Start, end_63.End], Plane=PlaneXY(0, 0, 0))  # -> Hull, HullZ, Indices

crv_83 = Curve([<curve referenced from the Rhino model> x64])
crv_84 = Curve([<curve referenced from the Rhino model> x219])
crv_85 = Curve([<curve referenced from the Rhino model> x3192])
crv_86 = Curve([<curve referenced from the Rhino model> x813])
end_65 = EndPoints(Curve=crv_84)  # -> Start, End
end_66 = EndPoints(Curve=crv_83)  # -> Start, End
end_67 = EndPoints(Curve=crv_85)  # -> Start, End
end_68 = EndPoints(Curve=crv_86)  # -> Start, End
hull_83 = ConvexHull(Points=[end_66.Start, end_66.End], Plane=PlaneXY(0, 0, 0))  # -> Hull, HullZ, Indices
hull_84 = ConvexHull(Points=[end_67.Start, end_67.End], Plane=PlaneXY(0, 0, 0))  # -> Hull, HullZ, Indices
hull_85 = ConvexHull(Points=[end_65.Start, end_65.End], Plane=PlaneXY(0, 0, 0))  # -> Hull, HullZ, Indices
hull_86 = ConvexHull(Points=[end_68.Start, end_68.End], Plane=PlaneXY(0, 0, 0))  # -> Hull, HullZ, Indices

crv_87 = Curve([<curve referenced from the Rhino model> x12])
crv_88 = Curve([<curve referenced from the Rhino model> x49])
crv_89 = Curve([<curve referenced from the Rhino model> x1603])
crv_90 = Curve([<curve referenced from the Rhino model> x536])
crv_91 = Curve([<curve referenced from the Rhino model> x321])
crv_92 = Curve([<curve referenced from the Rhino model> x2])
crv_93 = Curve([<curve referenced from the Rhino model> x5000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])
crv_94 = Curve([<curve referenced from the Rhino model> x24])
crv_95 = Curve([<curve referenced from the Rhino model> x4806])
crv_96 = Curve([<curve referenced from the Rhino model> x2417])
crv_97 = Curve([<curve referenced from the Rhino model> x4771])
crv_98 = Curve([<curve referenced from the Rhino model> x6])
divide_19 = DivideCurve(Curve=crv_87, Count=10, Kinks=False)  # -> flatten(Points), Tangents, Parameters
divide_20 = DivideCurve(Curve=crv_88, Count=10, Kinks=False)  # -> flatten(Points), Tangents, Parameters
divide_21 = DivideCurve(Curve=crv_90, Count=10, Kinks=False)  # -> flatten(Points), Tangents, Parameters
divide_22 = DivideCurve(Curve=crv_91, Count=10, Kinks=False)  # -> flatten(Points), Tangents, Parameters
divide_23 = DivideCurve(Curve=crv_92, Count=10, Kinks=False)  # -> flatten(Points), Tangents, Parameters
divide_24 = DivideCurve(Curve=crv_98, Count=10, Kinks=False)  # -> flatten(Points), Tangents, Parameters
end_69 = EndPoints(Curve=crv_89)  # -> Start, End
end_70 = EndPoints(Curve=crv_93)  # -> Start, End
end_71 = EndPoints(Curve=crv_94)  # -> Start, End
end_72 = EndPoints(Curve=crv_95)  # -> Start, End
end_73 = EndPoints(Curve=crv_96)  # -> Start, End
end_74 = EndPoints(Curve=crv_97)  # -> Start, End
hull_87 = ConvexHull(Points=divide_19.Points, Plane=PlaneXY(0, 0, 0))  # -> Hull, HullZ, Indices
hull_88 = ConvexHull(Points=divide_20.Points, Plane=PlaneXY(0, 0, 0))  # -> Hull, HullZ, Indices
hull_89 = ConvexHull(Points=divide_21.Points, Plane=PlaneXY(0, 0, 0))  # -> Hull, HullZ, Indices
hull_90 = ConvexHull(Points=divide_22.Points, Plane=PlaneXY(0, 0, 0))  # -> Hull, HullZ, Indices
hull_91 = ConvexHull(Points=divide_23.Points, Plane=PlaneXY(0, 0, 0))  # -> Hull, HullZ, Indices
hull_92 = ConvexHull(Points=[end_70.Start, end_70.End], Plane=PlaneXY(0, 0, 0))  # -> Hull, HullZ, Indices
hull_93 = ConvexHull(Points=[end_71.Start, end_71.End], Plane=PlaneXY(0, 0, 0))  # -> Hull, HullZ, Indices
hull_94 = ConvexHull(Points=[end_72.Start, end_72.End], Plane=PlaneXY(0, 0, 0))  # -> Hull, HullZ, Indices
hull_95 = ConvexHull(Points=[end_73.Start, end_73.End], Plane=PlaneXY(0, 0, 0))  # -> Hull, HullZ, Indices
hull_96 = ConvexHull(Points=[end_74.Start, end_74.End], Plane=PlaneXY(0, 0, 0))  # -> Hull, HullZ, Indices
hull_97 = ConvexHull(Points=divide_24.Points, Plane=PlaneXY(0, 0, 0))  # -> Hull, HullZ, Indices
hull_98 = ConvexHull(Points=[end_69.Start, end_69.End], Plane=PlaneXY(0, 0, 0))  # -> Hull, HullZ, Indices

crv_99 = Curve([<curve referenced from the Rhino model> x5000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])
crv_100 = Curve([<curve referenced from the Rhino model> x4806])
crv_101 = Curve([<curve referenced from the Rhino model> x12])
crv_102 = Curve([<curve referenced from the Rhino model> x82])
crv_103 = Curve([<curve referenced from the Rhino model> x5000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])
end_75 = EndPoints(Curve=crv_99)  # -> Start, End
end_76 = EndPoints(Curve=crv_100)  # -> Start, End
end_77 = EndPoints(Curve=crv_101)  # -> Start, End
end_78 = EndPoints(Curve=crv_103)  # -> Start, End
end_79 = EndPoints(Curve=crv_102)  # -> Start, End
hull_99 = ConvexHull(Points=[end_75.Start, end_75.End], Plane=PlaneXY(0, 0, 0))  # -> Hull, HullZ, Indices
hull_100 = ConvexHull(Points=[end_78.Start, end_78.End], Plane=PlaneXY(0, 0, 0))  # -> Hull, HullZ, Indices
hull_101 = ConvexHull(Points=[end_76.Start, end_76.End], Plane=PlaneXY(0, 0, 0))  # -> Hull, HullZ, Indices
hull_102 = ConvexHull(Points=[end_77.Start, end_77.End], Plane=PlaneXY(0, 0, 0))  # -> Hull, HullZ, Indices
hull_103 = ConvexHull(Points=[end_79.Start, end_79.End], Plane=PlaneXY(0, 0, 0))  # -> Hull, HullZ, Indices

crv_104 = Curve([<curve referenced from the Rhino model> x32])
crv_105 = Curve([<curve referenced from the Rhino model> x5000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])
crv_106 = Curve([<curve referenced from the Rhino model> x26])
crv_107 = Curve([<curve referenced from the Rhino model> x60])
crv_108 = Curve([<curve referenced from the Rhino model> x68])
crv_109 = Curve([<curve referenced from the Rhino model> x35])
crv_110 = Curve([<curve referenced from the Rhino model> x1230])
crv_111 = Curve([<curve referenced from the Rhino model> x80])
crv_112 = Curve([<curve referenced from the Rhino model> x51])
crv_113 = Curve([<curve referenced from the Rhino model> x37])
divide_25 = DivideCurve(Curve=crv_111, Count=10, Kinks=False)  # -> flatten(Points), Tangents, Parameters
divide_26 = DivideCurve(Curve=crv_104, Count=10, Kinks=False)  # -> flatten(Points), Tangents, Parameters
divide_27 = DivideCurve(Curve=crv_112, Count=10, Kinks=False)  # -> flatten(Points), Tangents, Parameters
divide_28 = DivideCurve(Curve=crv_113, Count=10, Kinks=False)  # -> flatten(Points), Tangents, Parameters
divide_29 = DivideCurve(Curve=crv_107, Count=33, Kinks=False)  # -> flatten(Points), Tangents, Parameters
divide_30 = DivideCurve(Curve=crv_108, Count=10, Kinks=False)  # -> flatten(Points), Tangents, Parameters
divide_31 = DivideCurve(Curve=crv_109, Count=10, Kinks=False)  # -> flatten(Points), Tangents, Parameters
divide_32 = DivideCurve(Curve=crv_110, Count=10, Kinks=False)  # -> flatten(Points), Tangents, Parameters
end_80 = EndPoints(Curve=crv_105)  # -> Start, End
end_81 = EndPoints(Curve=crv_106)  # -> Start, End
hull_104 = ConvexHull(Points=divide_30.Points, Plane=PlaneXY(0, 0, 0))  # -> Hull, HullZ, Indices
hull_105 = ConvexHull(Points=divide_25.Points, Plane=PlaneXY(0, 0, 0))  # -> Hull, HullZ, Indices
hull_106 = ConvexHull(Points=[end_80.Start, end_80.End], Plane=PlaneXY(0, 0, 0))  # -> Hull, HullZ, Indices
hull_107 = ConvexHull(Points=divide_26.Points, Plane=PlaneXY(0, 0, 0))  # -> Hull, HullZ, Indices
hull_108 = ConvexHull(Points=divide_29.Points, Plane=PlaneXY(0, 0, 0))  # -> Hull, HullZ, Indices
hull_109 = ConvexHull(Points=[end_81.Start, end_81.End], Plane=PlaneXY(0, 0, 0))  # -> Hull, HullZ, Indices
hull_110 = ConvexHull(Points=divide_31.Points, Plane=PlaneXY(0, 0, 0))  # -> Hull, HullZ, Indices
hull_111 = ConvexHull(Points=divide_32.Points, Plane=PlaneXY(0, 0, 0))  # -> Hull, HullZ, Indices
hull_112 = ConvexHull(Points=divide_27.Points, Plane=PlaneXY(0, 0, 0))  # -> Hull, HullZ, Indices
hull_113 = ConvexHull(Points=divide_28.Points, Plane=PlaneXY(0, 0, 0))  # -> Hull, HullZ, Indices

crv_114 = Curve([<curve referenced from the Rhino model> x32])
crv_115 = Curve([<curve referenced from the Rhino model> x5000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])
crv_116 = Curve([<curve referenced from the Rhino model> x57])
crv_117 = Curve([<curve referenced from the Rhino model> x65])
crv_118 = Curve([<curve referenced from the Rhino model> x3204])
crv_119 = Curve([<curve referenced from the Rhino model> x12])
crv_120 = Curve([<curve referenced from the Rhino model> x82])
crv_121 = Curve([<curve referenced from the Rhino model> x38])
crv_122 = Curve([<curve referenced from the Rhino model> x97])
crv_123 = Curve([<curve referenced from the Rhino model> x948])
divide_33 = DivideCurve(Curve=crv_122, Count=10, Kinks=False)  # -> flatten(Points), Tangents, Parameters
divide_34 = DivideCurve(Curve=crv_114, Count=10, Kinks=False)  # -> flatten(Points), Tangents, Parameters
divide_35 = DivideCurve(Curve=crv_117, Count=10, Kinks=False)  # -> flatten(Points), Tangents, Parameters
divide_36 = DivideCurve(Curve=crv_118, Count=10, Kinks=False)  # -> flatten(Points), Tangents, Parameters
divide_37 = DivideCurve(Curve=crv_115, Count=10, Kinks=False)  # -> flatten(Points), Tangents, Parameters
divide_38 = DivideCurve(Curve=crv_119, Count=10, Kinks=False)  # -> flatten(Points), Tangents, Parameters
divide_39 = DivideCurve(Curve=crv_120, Count=10, Kinks=False)  # -> flatten(Points), Tangents, Parameters
divide_40 = DivideCurve(Curve=crv_123, Count=10, Kinks=False)  # -> flatten(Points), Tangents, Parameters
divide_41 = DivideCurve(Curve=crv_121, Count=10, Kinks=False)  # -> flatten(Points), Tangents, Parameters
divide_42 = DivideCurve(Curve=crv_116, Count=10, Kinks=False)  # -> flatten(Points), Tangents, Parameters
hull_114 = ConvexHull(Points=divide_34.Points, Plane=PlaneXY(0, 0, 0))  # -> Hull, HullZ, Indices
hull_115 = ConvexHull(Points=divide_35.Points, Plane=PlaneXY(0, 0, 0))  # -> Hull, HullZ, Indices
hull_116 = ConvexHull(Points=divide_36.Points, Plane=PlaneXY(0, 0, 0))  # -> Hull, HullZ, Indices
hull_117 = ConvexHull(Points=divide_38.Points, Plane=PlaneXY(0, 0, 0))  # -> Hull, HullZ, Indices
hull_118 = ConvexHull(Points=divide_39.Points, Plane=PlaneXY(0, 0, 0))  # -> Hull, HullZ, Indices
hull_119 = ConvexHull(Points=divide_33.Points, Plane=PlaneXY(0, 0, 0))  # -> Hull, HullZ, Indices
hull_120 = ConvexHull(Points=divide_37.Points, Plane=PlaneXY(0, 0, 0))  # -> Hull, HullZ, Indices
hull_121 = ConvexHull(Points=divide_40.Points, Plane=PlaneXY(0, 0, 0))  # -> Hull, HullZ, Indices
hull_122 = ConvexHull(Points=divide_41.Points, Plane=PlaneXY(0, 0, 0))  # -> Hull, HullZ, Indices
hull_123 = ConvexHull(Points=divide_42.Points, Plane=PlaneXY(0, 0, 0))  # -> Hull, HullZ, Indices

crv_124 = Curve([<curve referenced from the Rhino model> x12])
crv_125 = Curve([<curve referenced from the Rhino model> x44])
end_82 = EndPoints(Curve=crv_124)  # -> Start, End
end_83 = EndPoints(Curve=crv_125)  # -> Start, End
hull_124 = ConvexHull(Points=[end_82.Start, end_82.End], Plane=PlaneXY(0, 0, 0))  # -> Hull, HullZ, Indices
hull_125 = ConvexHull(Points=[end_83.Start, end_83.End], Plane=PlaneXY(0, 0, 0))  # -> Hull, HullZ, Indices

crv_126 = Curve([<curve referenced from the Rhino model> x31])
crv_127 = Curve([<curve referenced from the Rhino model> x71])
crv_128 = Curve([<curve referenced from the Rhino model> x62])
crv_129 = Curve(<curve referenced from the Rhino model>)

divide_43 = DivideCurve(Curve=crv_128, Count=10, Kinks=False)  # -> flatten(Points), Tangents, Parameters
divide_44 = DivideCurve(Curve=crv_126, Count=10, Kinks=False)  # -> flatten(Points), Tangents, Parameters
divide_45 = DivideCurve(Curve=crv_127, Count=10, Kinks=False)  # -> flatten(Points), Tangents, Parameters
divide_46 = DivideCurve(Curve=crv_129, Count=10, Kinks=False)  # -> flatten(Points), Tangents, Parameters

hull_126 = ConvexHull(Points=divide_44.Points, Plane=PlaneXY(0, 0, 0))  # -> Hull, HullZ, Indices
hull_127 = ConvexHull(Points=divide_43.Points, Plane=PlaneXY(0, 0, 0))  # -> Hull, HullZ, Indices
hull_128 = ConvexHull(Points=divide_46.Points, Plane=PlaneXY(0, 0, 0))  # -> Hull, HullZ, Indices
hull_129 = ConvexHull(Points=divide_45.Points, Plane=PlaneXY(0, 0, 0))  # -> Hull, HullZ, Indices

join = JoinCurves(
    Curves=[hull_80.Hull, hull_81.Hull, hull_78.Hull, hull_79.Hull, hull_75.Hull, hull_76.Hull, hull_77.Hull, hull_99.Hull, hull_101.Hull, hull_102.Hull, hull_100.Hull, hull_92.Hull, hull_93.Hull, hull_94.Hull, hull_95.Hull, hull_96.Hull, hull_98.Hull, hull_89.Hull, hull_91.Hull, hull_97.Hull, hull_90.Hull, hull_88.Hull, hull_82.Hull, hull_85.Hull, hull_84.Hull, hull_87.Hull, hull_86.Hull, hull_83.Hull, hull_120.Hull, hull_122.Hull, hull_117.Hull, hull_116.Hull, hull_114.Hull, hull_115.Hull, hull_119.Hull, hull_118.Hull, hull_123.Hull, hull_121.Hull, hull_113.Hull, hull_112.Hull, hull_105.Hull, hull_107.Hull, hull_106.Hull, hull_109.Hull, hull_108.Hull, hull_104.Hull, hull_110.Hull, hull_111.Hull, hull_128.Hull, hull_126.Hull, hull_129.Hull, hull_127.Hull, hull_68.Hull, hull_70.Hull, hull_69.Hull, hull_71.Hull, hull_73.Hull, hull_72.Hull, hull_124.Hull, hull_125.Hull, hull_74.Hull, hull_66.Hull, hull_64.Hull, hull_67.Hull, hull_65.Hull, hull_63.Hull, hull_54.Hull, hull_50.Hull, hull_56.Hull, hull_52.Hull, hull_53.Hull, hull_49.Hull, hull_55.Hull, hull_51.Hull, hull_48.Hull, hull_47.Hull, hull_16.Hull, hull_15.Hull, hull_13.Hull, hull_14.Hull, hull_12.Hull, hull_11.Hull, hull_10.Hull, hull_7.Hull, hull_8.Hull, hull_5.Hull, hull_3.Hull, hull_2.HullZ, hull.Hull, hull_4.Hull, hull_6.Hull, hull_22.Hull, hull_19.Hull, hull_24.Hull, hull_20.Hull, hull_17.Hull, hull_18.Hull, hull_21.Hull, hull_23.HullZ, hull_25.Hull, hull_26.Hull, hull_61.Hull, hull_59.Hull, hull_60.Hull, hull_62.Hull, hull_57.Hull, hull_58.Hull, hull_31.Hull, hull_29.Hull, hull_30.Hull, hull_27.Hull, hull_28.Hull, hull_32.Hull, hull_46.Hull, hull_44.Hull, hull_33.Hull, hull_45.Hull, hull_43.Hull, hull_42.Hull, hull_42.HullZ, hull_41.Hull, hull_34.Hull, hull_35.Hull, hull_39.Hull, hull_36.Hull, hull_37.Hull, hull_40.Hull, hull_38.Hull],
    Preserve=False)
C = ClusterOutput(join)
