# Grasshopper definition basestation layout detection vis.gh (Grasshopper 0.9.76)
# plug-ins: Python Interpreter

crv = Curve(<curve referenced from the Rhino model>)
disc = Discontinuity(Curve=crv, Level=1)  # -> Points, Parameters
lng = ListLength(List=disc.Points)

# ----
# Sorting Basestation based on Closest Curve
names = Panel("""Ace
Alfa
Beer
Bravo
Charlie
Coco
Dee
Echo
Edward
Foxtrot
Hotel
George
Golf
Harry
Freddie
India
Ink
Johnnie
Juliett
Kilo
King
Lima
London
Mike
Monkey
November
Nuts
Orange
Oscar
Papa
Pip
Quebec
Queen
Robert
Romeo
Sierra
Sugar
Tango
Tick
Uncle
Uniform
Vic
Victor
Whisky
William
X-ray
X-men
Yankee
Yorker
Zebra
Zulu""")
cluster = Cluster(source_list=disc.Points, target_list=names)
text_tag_3d = TextTag3D(
    Location=disc.Points,
    Text=cluster,
    Size=Slider(1163, range=0..10000),
    Colour=ColourSwatch(SwatchColor=RGB(255, 0, 0)),
    Justification=7)

python = PythonScript(names=names, dataCount=Slider(500, range=0..500), nameCap=lng)  # -> out, a; inputs names: list, dataCount: Int32, nameCap: Int32; disabled
# ---------- python: Python ----------
import json
import random

fakey = []
for i in range(dataCount):
    index = random.randint(0, nameCap)
    detection = {"basestation": names[index-1],
                 "major": "5", 
                 "uuid": "d0d3fa86ca7645ec9bd96af400000005", 
                 "time": "2016-07-12T09:52:"+str(random.randint(10, 59))+"."+str(random.randint(1, 1000)), 
                 "rssi":  str( random.randint(1, 80)*-1 ), 
                 "minor": str( random.randint(1, 160) )}
    fakey.append(detection)

a = json.dumps(fakey)
print a


#"basestation": "george",   
#"major": "5", 
#"uuid": "d0d3fa86ca7645ec9bd96af400000005", 
#"time": "2016-07-12T09:52:31.709790", 
#"rssi": "-28", 
#"minor": "10"
# ---------- end python ----------
file = ReadFile(File="\\bvn\users\External\folders\bdoherty\Desktop\fake.json", PerLineParse=False)  # -> flatten(Content)
decode_detections = PythonScript(x=file)  # -> basestation, major, minor, uuid, time, rssi
# ---------- decode_detections: Python ----------
import json

myJSON = json.loads(x)


basestation = []
major = []
uuid = []
time = []
rssi = []
minor = []

for detection in myJSON:
    basestation.append(detection["basestation"])
    major.append(detection["major"])
    uuid.append(detection["uuid"])
    time.append(detection["time"])
    rssi.append(detection["rssi"])
    minor.append(detection["minor"])


print basestation
print major
print uuid
print time
print rssi
print minor
# ---------- end decode_detections ----------
case = TextCase(Text=names, Culture=127)  # -> UpperCase, LowerCase
case_2 = TextCase(Text=decode_detections.basestation, Culture=127)  # -> UpperCase, LowerCase

# ---- group: explicit end
date = ConstructDate(
    Year="2016",
    Month=Slider(7, range=1..12),
    Day=Slider(12, range=1..31),
    Hour=Slider(9, range=1..12),
    Minute=Slider(52, range=0..59),
    Second=Slider(59, range=0..59))

# ---- group: start time
number_slider = Slider(28.9, range=10..58.9)
number_slider_2 = Slider(52, range=0..59)
number_slider_3 = Slider(9, range=1..12)
number_slider_4 = Slider(7, range=1..12)
number_slider_5 = Slider(12, range=1..31)
panel = Panel("2016")
date_2 = ConstructDate(
    Year=panel,
    Month=number_slider_4,
    Day=number_slider_5,
    Hour=number_slider_3,
    Minute=number_slider_2,
    Second=number_slider)

# ---- group: windowed end
time_window = Slider(1, range=0..10)
addition = Addition(A=number_slider, B=time_window)
date_3 = ConstructDate(Year=panel, Month=number_slider_4, Day=number_slider_5, Hour=number_slider_3, Minute=number_slider_2, Second=addition)

# ----
number_slider_6 = Slider(29, range=22..29)
panel_2 = Panel(decode_detections.basestation)
panel_3 = Panel(decode_detections.major)
panel_4 = Panel(decode_detections.minor)
panel_5 = Panel(decode_detections.uuid)
panel_6 = Panel(decode_detections.time)
panel_7 = Panel(decode_detections.rssi)
base_index = PythonScript(baseNamesList=case.UpperCase, baseToMatch=case_2.UpperCase)  # -> a; inputs baseNamesList: list
# ---------- base_index: Python ----------
a = baseNamesList.index(baseToMatch)
# ---------- end base_index ----------
time = Time(panel_6)
panel_8 = Panel(date_2)
panel_9 = Panel(date_3)
panel_10 = Panel(date)
real_pts = Point(disc.Points)
rssi = Number(panel_7)
dom = ConstructDomain(DomainStart=date_2, DomainEnd=date_3)
abs = Absolute(Value=rssi)
scale = Number(Slider(38.976, range=0..101))
colours = Colours(L=panel_4)
item = ListItem(List=real_pts, Index=base_index, Wrap=False)
multiplication = Multiplication(A=abs, B=scale)
points = PointList(Points=real_pts, Size=1500)
inc = Includes(Value=time, Domain=dom)  # -> Includes, Deviation
cir = Circle(Plane=item, Radius=multiplication)
inclusion = Boolean(inc.Includes)
cull = CullPattern(List=colours, CullPattern=inclusion)
cull_2 = CullPattern(List=cir, CullPattern=inclusion)
pipe = Pipe(Curve=cull_2, Radius=Slider(315, range=0..400), Caps=0)  # -> flatten(Pipe)
preview = CustomPreview(Geometry=pipe, Shader=cull)

# ==== cluster Cluster
source_list = ClusterInput()
list_length = ListLength(SourceList=source_list)
target_list = ClusterInput()
construct_domain = ConstructDomain(DomainStart=0, DomainEnd=expr("x-1", list_length))
sub_list = SubList(TargetList=target_list, Domain=construct_domain, Wrap=False)  # -> List, Index
list = ClusterOutput(sub_list.List)

# ==== cluster Colours
L = ClusterInput()
lng = ListLength(List=L)
div = DivideDomain(Domain=Domain(0, 1), Count=lng)
dedomain = DeconstructDomain(Domain=div)  # -> Start, End
hsl = ColourHSL(Alpha=1, Hue=dedomain.End, Saturation=1, Luminance=0.5)
C = ClusterOutput(hsl)
