# Grasshopper definition base_number_minimiser.gh (Grasshopper 0.9.76)
# plug-ins: Python Interpreter

genes = GenePool(Decimals=0, Maximum=1, Minimum=0, Value=[0, 0, 0, 0, 0, 0, 1, 0, 0, 0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])
B = SecondNumber(1)
column_size = Slider(3, range=0..3)
num_bases = Slider(100, range=0..1000)
number_slider = Slider(126, range=0..1000)
num_columns = Slider(41, range=0..100)
equals = Equality(FirstNumber=genes, SecondNumber=B)  # -> Equality, Inequality
num_tables = Slider(30, range=0..30)
sample_points = Slider(1000, range=0..1000)
rectangle = Rectangle(Plane=PlaneXY(0, 0, 0), XSize=number_slider, YSize=number_slider, Radius=0)  # -> Rectangle, Length
counter = PythonScript(x=equals.Equality)  # -> out, a; inputs x: list
# ---------- counter: Python ----------
a=0
for p in x:
    if p:
        a = a+1
# ---------- end counter ----------
R = Region(rectangle.Rectangle)
table_size = Slider(11.3, range=0..15)
isovist_density = Slider(80, range=0..100)

# ---- group: columns
pop2d = Populate2D(Region=R, Count=num_columns, Seed=0)
rectangle_2 = Rectangle(Plane=pop2d, XSize=column_size, YSize=column_size, Radius=0)  # -> Rectangle, Length
boundary = BoundarySurfaces(Edges=rectangle_2.Rectangle)

# ----
pop2d_2 = Populate2D(Region=R, Count=num_bases, Seed=1)
cull = CullPattern(List=pop2d_2, CullPattern=equals.Equality)
ivist = IsoVist(
    Plane=cull,
    Count=isovist_density,
    Radius=Slider(30.5, range=0..100),
    Obstacles=flatten([rectangle.Rectangle, rectangle_2.Rectangle]))  # -> Points, Distance, Index
sph = Sphere(Base=cull, Radius=1)
pline = PolyLine(Vertices=ivist.Points, Closed=True)  # -> flatten(Polyline)
crv = Curve(pline)
cluster = Cluster(L=cull, i=Slider(0, range=0..100), L_2=crv)  # -> S, S_2
preview = CustomPreview(
    Geometry=[cluster.S, cluster.S_2],
    Shader={ambient=RGB(0, 0, 0), diffuse=RGB(255, 105, 180), emission=RGB(76, 32, 54), shine=0.5, specular=RGB(255, 255, 255), transparency=0})
galapagos = Galapagos(fitness=multiplication, gene=genes)

# ---- group: sample points
pop2d_3 = Populate2D(Region=R, Count=sample_points, Seed=1)
pop2d_4 = Populate2D(Region=R, Count=num_tables, Seed=1)

# ---- group: sample points / furniture
rectangle_3 = Rectangle(Plane=pop2d_4, XSize=table_size, YSize=table_size, Radius=0)  # -> Rectangle, Length

# ---- group: sample points (continued)
incurves = PointInCurves(Point=pop2d_3, Curves=rectangle_3.Rectangle)  # -> Relationship, Index, Point
equals_2 = Equality(FirstNumber=incurves.Relationship, SecondNumber=0)  # -> Equality, Inequality
cull_2 = CullPattern(List=pop2d_3, CullPattern=equals_2.Equality)

# ----
incurve = PointInCurve(Point=cull_2, Curve=graft(crv))  # -> simplify(Relationship), Point
counter_2 = PythonScript(x=incurve.Relationship)  # -> out, flatten(a); inputs x: list
# ---------- counter_2: Python ----------
a=0
for p in x:
    if p == 2:
        a = a+1
# ---------- end counter_2 ----------

# ---- group: fitnessfunction
number_slider_2 = Slider(10, range=0..10)
max_mbases = Slider(100, range=0..100)
runion = RegionUnion(Curves=flatten(crv))
A = DomainStart(0)
dom = ConstructDomain(DomainStart=A, DomainEnd=number_slider_2)
dom_2 = ConstructDomain(DomainStart=A, DomainEnd=max_mbases)
runion_2 = RegionUnion(Curves=flatten(runion))
remap = RemapNumbers(Value=counter.a, Source=dom_2, Target=dom)  # -> Mapped, Clipped
remap_2 = Remap(V=counter_2.a, B=number_slider_2)
boundary_2 = BoundarySurfaces(Edges=runion_2)
area = Area(Geometry=rectangle.Rectangle)  # -> Area, Centroid
area_2 = Area(Geometry=runion_2)  # -> Area, Centroid
subtraction = Subtraction(A=remap_2, B=remap.Mapped)
division = Division(A=area_2.Area, B=area.Area)
ma = MassAddition(Input=subtraction)  # -> Result, PartialResults
multiplication = Multiplication(A=division, B=ma.Result)

# ==== cluster Cluster
L = ClusterInput()
i = ClusterInput()
L_2 = ClusterInput()
item = ListItem(List=L, Index=i, Wrap=True)
item_2 = ListItem(List=L_2, Index=i, Wrap=True)
sph = Sphere(Base=item, Radius=3)
boundary = BoundarySurfaces(Edges=item_2)
S = ClusterOutput(sph)
S_2 = ClusterOutput(boundary)

# ==== cluster Remap
V = ClusterInput()
B = ClusterInput()
bnd = Bounds(Numbers=V)
dom = ConstructDomain(DomainStart=0, DomainEnd=B)
remap = RemapNumbers(Value=V, Source=bnd, Target=dom)  # -> Mapped, Clipped
R = ClusterOutput(remap.Mapped)
