# Grasshopper definition beacon_options.gh (Grasshopper 0.9.75)

beacon_radius = Slider(26.5, range=0..100)
origin_of_beacon = ConstructPoint(XCoordinate=0, YCoordinate=0, ZCoordinate=0)
beacon_radius_2 = Slider(27, range=0..100)
beacon = CircleCNR(Center=origin_of_beacon, Normal=Vector(0, 0, 1), Radius=beacon_radius)
beacon_2 = CircleCNR(Center=origin_of_beacon, Normal=Vector(0, 0, 1), Radius=Slider(26.5, range=0..100))
tab_for_hole = Slider(8, range=0..10)
thickness_mm = Slider(3, range=0..10)
beacon_3 = CircleCNR(Center=origin_of_beacon, Normal=Vector(0, 0, 1), Radius=beacon_radius)
addition = Addition(A=beacon_radius_2, B=Slider(5, range=0..20))
addition_2 = Addition(A=beacon_radius_2, B=Slider(13, range=0..20))
offset = Slider(7, range=0..10)
beacon_4 = CircleCNR(Center=origin_of_beacon, Normal=Vector(0, 0, 1), Radius=Slider(13.5, range=0..100))
beacon_5 = CircleCNR(Center=origin_of_beacon, Normal=Vector(0, 0, 1), Radius=addition_2)
beacon_6 = CircleCNR(Center=origin_of_beacon, Normal=Vector(0, 0, 1), Radius=addition)
beacon_7 = CircleCNR(Center=origin_of_beacon, Normal=Vector(0, 0, 1), Radius=beacon_radius_2)
srf = Surface(beacon_2)
srf_2 = Surface(beacon)
beacon_8 = CircleCNR(Center=origin_of_beacon, Normal=Vector(0, 0, 1), Radius=beacon_radius)
negative = Negative(Value=Slider(1, range=0..1))
offset_loose = OffsetLoose(Curve=beacon_6, Distance=1)
offset_loose_2 = OffsetLoose(Curve=beacon_5, Distance=1)
offset_2 = Slider(17, range=0..20)
number_of_segments = DivideCurve(Curve=beacon_2, Count=tab_for_hole, Kinks=False)  # -> Points, Tangents, Parameters
to_make_bigger_than_beacon = Addition(A=beacon_radius, B=offset)
unit_z = UnitZ(Factor=Slider(5, range=0..10))
srf_3 = Surface(beacon_7)
loft = Loft(
    Curves=[beacon_6, offset_loose],
    Options={Adjust=False, Closed=False, LoftEnds=0, LoftSimp=0, LoftType=0, Rebuild=10, Refit=0.01})
number_slider = Slider(5.6, range=0..10)
loft_2 = Loft(
    Curves=[beacon_5, beacon_6],
    Options={Adjust=False, Closed=False, LoftEnds=0, LoftSimp=0, LoftType=0, Rebuild=10, Refit=0.01})
negative_2 = Negative(Value=Slider(0.5, range=0..1))
negative_3 = Negative(Value=Slider(1, range=0..1))
loft_3 = Loft(
    Curves=[beacon_5, offset_loose_2],
    Options={Adjust=False, Closed=False, LoftEnds=0, LoftSimp=0, LoftType=0, Rebuild=10, Refit=0.01})
divide_curve = DivideCurve(Curve=beacon_7, Count=tab_for_hole, Kinks=False)  # -> Points, Tangents, Parameters
divide_curve_2 = DivideCurve(Curve=beacon_8, Count=10, Kinks=False)  # -> Points, Tangents, Parameters
divide_curve_3 = DivideCurve(Curve=beacon_6, Count=tab_for_hole, Kinks=False)  # -> Points, Tangents, Parameters
offset_3 = Slider(8, range=0..10)
polygon = Polygon(Plane=PlaneXY(0, 0, 0), Radius=to_make_bigger_than_beacon, Segments=Slider(6, range=0..10), FilletRadius=0)  # -> Polygon, Length
offset_4 = Slider(1, range=0..10)
unit_z_2 = UnitZ(Factor=thickness_mm)
line = Line(StartPoint=origin_of_beacon, EndPoint=number_of_segments.Points)
tabs = CircleCNR(Center=number_of_segments.Points, Normal=Vector(0, 0, 1), Radius=tab_for_hole)
to_make_bigger_than_beacon_2 = Addition(A=beacon_radius, B=offset_2)
number_slider_2 = Slider(41.4, range=0..100)
extrude = Extrude(Base=srf_2, Direction=unit_z)
custom_preview = CustomPreview(Geometry=extrude, Shader=ColourSwatch(SwatchColor=RGB(255, 255, 255)))
curve = Curve(<curve referenced from the Rhino model>)
offset_loose_3 = OffsetLoose(Curve=curve, Distance=negative_2)
offset_loose_4 = OffsetLoose(Curve=curve, Distance=negative_3)
populate_geometry = PopulateGeometry(Geometry=loft_2, Count=Slider(64, range=0..100), Seed=1)
negative_4 = Negative(Value=Slider(5.51, range=0..10))
beacon_thickness = Extrude(Base=[srf_3, loft_2], Direction=unit_z_2)
srf_4 = Surface(polygon.Polygon)
beacon_thickness_2 = Extrude(Base=[loft_3, loft], Direction=unit_z_2)
beacon_thickness_3 = Extrude(Base=loft_2, Direction=unit_z_2)
to_make_bigger_than_beacon_3 = Addition(A=beacon_radius, B=offset_3)
line_2 = Line(StartPoint=divide_curve_3.Points, EndPoint=divide_curve.Points)
deconstruct_brep = DeconstructBrep(Brep=srf_4)  # -> Faces, Edges, Vertices
srf_5 = Surface(tabs)
negative_5 = Negative(Value=offset_4)
offset_5 = Offset(Curve=beacon, Distance=negative_4, Plane=PlaneXY(0, 0, 0), Corners=1)
negative_6 = Negative(Value=number_slider_2)
polygon_2 = Polygon(Plane=PlaneXY(0, 0, 0), Radius=to_make_bigger_than_beacon_3, Segments=Slider(6, range=0..10), FilletRadius=0)  # -> Polygon, Length
divide_curve_4 = DivideCurve(Curve=offset_5, Count=Slider(53, range=0..100), Kinks=False)  # -> Points, Tangents, Parameters
list_item = ListItem(List=divide_curve_2.Points, Index=[Slider(0, range=0..100), Slider(5, range=0..10)], Wrap=True)
beacon_thickness_4 = Extrude(Base=srf, Direction=unit_z_2)
tab_thickness = Extrude(Base=srf_5, Direction=unit_z_2)
ellipse = Ellipse(Plane=PlaneXY(0, 0, 0), Radius1=to_make_bigger_than_beacon, Radius2=to_make_bigger_than_beacon_2)  # -> Ellipse, Focus1, Focus2
srf_6 = Surface(offset_5)
unit_y = UnitY(Factor=offset_4)
construct_point = ConstructPoint(XCoordinate=negative_6, YCoordinate=negative_6, ZCoordinate=0)
extend_curve = ExtendCurve(Curve=line, Type=0, Start=number_of_segments.Points, End=tab_for_hole)
construct_point_2 = ConstructPoint(XCoordinate=number_slider_2, YCoordinate=number_slider_2, ZCoordinate=0)
number_slider_3 = Slider(15, range=0..15)
line_3 = Line(StartPoint=origin_of_beacon, EndPoint=deconstruct_brep.Vertices)
isolate_tabs = ListItem(List=srf_5, Index=Slider(10, range=0..10), Wrap=True)
beacon_thickness_5 = Extrude(Base=srf_3, Direction=unit_z_2)
pipe = Pipe(Curve=line_2, Radius=1, Caps=0)
tab_thickness_2 = Extrude(Base=isolate_tabs, Direction=unit_z_2)
srf_7 = Surface(polygon_2.Polygon)
hole = CircleCNR(Center=deconstruct_brep.Vertices, Normal=Vector(0, 0, 1), Radius=tab_for_hole)
area = Area(Geometry=isolate_tabs)  # -> Area, Centroid
radius_of_hole = Slider(2.5, range=0..10)
box_2pt = Box2Pt(PointA=construct_point_2, PointB=construct_point, Plane=PlaneXY(0, 0, 0))
list_item_2 = ListItem(List=list_item, Index=Slider(5, range=0..10), Wrap=True)
point_on_curve = PointOnCurve(line_3, parameter=0.893)
deconstruct_brep_2 = DeconstructBrep(Brep=srf_7)  # -> Faces, Edges, Vertices
move = Move(Geometry=srf_7, Motion=unit_y)  # -> Geometry, Transform
construct_point_3 = ConstructPoint(XCoordinate=Slider(26.5, range=0..100), YCoordinate=Slider(38, range=0..100), ZCoordinate=0)
negative_7 = Negative(Value=number_slider_3)
surface = Surface(hole)
point_on_curve_2 = PointOnCurve(extend_curve, parameter=0.93)
voronoi = Voronoi(Points=populate_geometry, Boundary=box_2pt, BruteForceOverride=False)
beacon_with_tab = SolidDifference(BrepsA=tab_thickness, BrepsB=beacon_thickness_4)
extend_curve_2 = ExtendCurve(Curve=line_3, Type=0, Start=number_of_segments.Points, End=tab_for_hole)
polygon_3 = Polygon(Plane=deconstruct_brep.Vertices, Radius=Slider(8, range=0..10), Segments=6, FilletRadius=0)  # -> Polygon, Length
hole_2 = CircleCNR(Center=point_on_curve, Normal=Vector(0, 0, 1), Radius=radius_of_hole)
number_of_segments_2 = DivideCurve(Curve=isolate_tabs, Count=tab_for_hole, Kinks=False)  # -> Points, Tangents, Parameters
unit_y_2 = UnitY(Factor=number_slider_3)
line_4 = Line(StartPoint=origin_of_beacon, EndPoint=deconstruct_brep_2.Vertices)
point_on_curve_3 = PointOnCurve(extend_curve_2, parameter=0.934)
hole_3 = CircleCNR(Center=point_on_curve_2, Normal=Vector(0, 0, 1), Radius=radius_of_hole)
unit_y_3 = UnitY(Factor=Slider(53, range=0..100))
box_2pt_2 = Box2Pt(PointA=list_item_2, PointB=construct_point_3, Plane=PlaneXY(0, 0, 0))
negative_8 = Negative(Value=Slider(0.4, range=0..1))
surface_2 = Surface(polygon_3.Polygon)
surface_3 = Surface(hole_2)
line_5 = Line(StartPoint=area.Centroid, EndPoint=number_of_segments_2.Points)
move_2 = Move(Geometry=ellipse.Ellipse, Motion=unit_y_2)  # -> Geometry, Transform
point_on_curve_4 = PointOnCurve(line_4, parameter=0.878)
surface_4 = Surface(hole_3)
number_slider_4 = Slider(5, range=0..10)
hole_4 = CircleCNR(Center=point_on_curve_3, Normal=Vector(0, 0, 1), Radius=radius_of_hole)
number_slider_5 = Slider(4, range=0..10)
deconstruct_brep_3 = DeconstructBrep(Brep=box_2pt_2)  # -> Faces, Edges, Vertices
tab_thickness_3 = Extrude(Base=srf_4, Direction=unit_z_2)
radius_of_hole_2 = Slider(2, range=0..10)
hole_thickness = Extrude(Base=surface_3, Direction=unit_z_2)
hole_thickness_2 = Extrude(Base=surface_4, Direction=unit_z_2)
isolate_tabs_2 = ListItem(List=hole_thickness_2, Index=[Slider(1, range=0..1), Slider(3, range=0..10)], Wrap=True)
isolate_tabs_3 = ListItem(List=hole_thickness_2, Index=Slider(2, range=0..3), Wrap=True)
point_on_curve_5 = PointOnCurve(line_5, parameter=0.553)
polygon_4 = Polygon(Plane=point_on_curve_3, Radius=Slider(2.5, range=0..10), Segments=6, FilletRadius=0)  # -> Polygon, Length
move_3 = Move(Geometry=beacon_8, Motion=unit_y_3)  # -> Geometry, Transform
unit_z_3 = UnitZ(Factor=Slider(2, range=0..10))
offset_loose_5 = OffsetLoose(Curve=voronoi, Distance=negative_8)
offset_6 = Offset(Curve=deconstruct_brep_2.Faces, Distance=Slider(6, range=0..10), Plane=PlaneXY(0, 0, 0), Corners=1)
hole_5 = CircleCNR(Center=point_on_curve_4, Normal=Vector(0, 0, 1), Radius=radius_of_hole)
beacon_9 = CircleCNR(Center=origin_of_beacon, Normal=Vector(0, 0, 1), Radius=beacon_radius)
surface_5 = Surface(hole_4)
divide_curve_5 = DivideCurve(Curve=move_2.Geometry, Count=Slider(20, range=0..100), Kinks=False)  # -> Points, Tangents, Parameters
solid_difference = SolidDifference(BrepsA=offset_6, BrepsB=polygon_2.Polygon)
number_slider_6 = Slider(1, range=0..1)
number_slider_7 = Slider(3, range=0..10)
surface_6 = Surface(beacon_8)
surface_7 = Surface(move_3.Geometry)
surface_8 = Surface(offset_loose_5)
tab_thickness_4 = Extrude(Base=surface, Direction=unit_z_2)
cull_nth = CullNth(List=line_4, CullFrequency=Slider(2, range=0..10))
hole_thickness_3 = Extrude(Base=surface_5, Direction=unit_z_2)
surface_9 = Surface(hole_5)
list_item_3 = ListItem(List=surface_9, Index=[Slider(5, range=0..10), Slider(4, range=0..10)], Wrap=True)
solid_difference_2 = SolidDifference(BrepsA=tab_thickness_2, BrepsB=beacon_thickness_4)
solid_difference_3 = SolidDifference(BrepsA=beacon_with_tab, BrepsB=hole_thickness_2)
extrude_2 = Extrude(Base=surface_8, Direction=unit_z)
srf_8 = Surface(beacon_9)
hole_6 = CircleCNR(Center=point_on_curve_5, Normal=Vector(0, 0, 1), Radius=radius_of_hole_2)
line_6 = Line(StartPoint=origin_of_beacon, EndPoint=divide_curve_5.Points)
populate_geometry_2 = PopulateGeometry(Geometry=solid_difference, Count=100, Seed=1)
hole_thickness_4 = Extrude(Base=surface_9, Direction=unit_z_2)
extrude_3 = Extrude(Base=srf_8, Direction=unit_z)
number_of_segments_3 = DivideCurve(Curve=srf_8, Count=tab_for_hole, Kinks=False)  # -> Points, Tangents, Parameters
list_item_4 = ListItem(List=deconstruct_brep_3.Edges, Index=[Slider(5, range=0..10), Slider(6, range=0..10)], Wrap=True)
extrude_4 = Extrude(Base=surface_7, Direction=unit_z_3)
surface_10 = Surface(hole_6)
hole_thickness_5 = Extrude(Base=surface_10, Direction=unit_z_2)
isolate_tabs_4 = ListItem(List=surface_2, Index=[number_slider_5, number_slider_4], Wrap=True)
extrude_5 = Extrude(Base=box_2pt_2, Direction=unit_z_3)
point_on_curve_6 = PointOnCurve(cull_nth, parameter=0.745)
extrude_6 = Extrude(Base=surface_6, Direction=unit_z_3)
isolate_tabs_5 = ListItem(List=polygon_4.Polygon, Index=[number_slider_5, number_slider_4], Wrap=True)
solid_difference_4 = SolidDifference(BrepsA=beacon_thickness_3, BrepsB=extrude_2)
solid_difference_5 = SolidDifference(BrepsA=tab_thickness_4, BrepsB=tab_thickness_3)
extend_curve_3 = ExtendCurve(Curve=line_6, Type=0, Start=divide_curve_5.Points, End=Slider(8, range=0..10))
isolate_tabs_6 = ListItem(List=solid_difference_3, Index=[number_slider_6, number_slider_7], Wrap=True)
isolate_tabs_7 = ListItem(List=hole_thickness_5, Index=[number_slider_6, number_slider_7], Wrap=True)
solid_difference_6 = SolidDifference(BrepsA=solid_difference_2, BrepsB=isolate_tabs_7)
region_difference = RegionDifference(CurvesA=isolate_tabs_4, CurvesB=srf_4)
hole_7 = CircleCNR(Center=point_on_curve_6, Normal=Vector(0, 0, 1), Radius=radius_of_hole)
list_item_5 = ListItem(List=line_6, Index=Slider(5, range=0..100), Wrap=True)
list_item_6 = ListItem(List=line_6, Index=[Slider(6, range=0..10), Slider(4, range=0..10)], Wrap=True)
line_7 = Line(StartPoint=origin_of_beacon, EndPoint=number_of_segments_3.Points)
point_on_curve_7 = PointOnCurve(extend_curve_3, parameter=0.979)
voronoi_2 = Voronoi(Points=populate_geometry_2, BruteForceOverride=False)
point_on_curve_8 = PointOnCurve(list_item_5, parameter=0.909)
point_on_curve_9 = PointOnCurve(list_item_6, parameter=0.909)
isolate_tabs_8 = ListItem(List=solid_difference_5, Index=number_slider_4, Wrap=True)
isolate_tabs_9 = ListItem(List=solid_difference_5, Index=[number_slider_4, number_slider_5], Wrap=True)
boundary_surfaces = BoundarySurfaces(Edges=region_difference)
solid_difference_7 = SolidDifference(BrepsA=extrude_5, BrepsB=extrude_4)
surface_11 = Surface(hole_7)
hole_8 = CircleCNR(Center=number_of_segments_3.Points, Normal=Vector(0, 0, 1), Radius=tab_for_hole)
point_on_curve_10 = PointOnCurve(extend_curve_3, parameter=0.967)
list_item_7 = ListItem(List=[point_on_curve_7, point_on_curve_10], Index=[Slider(7, range=0..10), Slider(3, range=0..10)], Wrap=True)
solid_difference_8 = SolidDifference(BrepsA=isolate_tabs_8, BrepsB=hole_thickness_3)
hole_9 = CircleCNR(Center=point_on_curve_8, Normal=Vector(0, 0, 1), Radius=radius_of_hole)
hole_10 = CircleCNR(Center=point_on_curve_9, Normal=Vector(0, 0, 1), Radius=radius_of_hole)
hole_11 = CircleCNR(Center=list_item_7, Normal=Vector(0, 0, 1), Radius=Slider(8, range=0..10))
solid_difference_9 = SolidDifference(BrepsA=isolate_tabs_9, BrepsB=hole_thickness_3)
offset_loose_6 = OffsetLoose(Curve=voronoi_2, Distance=Slider(-0.3, range=-2..1))
hole_12 = CircleCNR(Center=list_item_7, Normal=Vector(0, 0, 1), Radius=radius_of_hole)
solid_difference_10 = SolidDifference(BrepsA=extrude_6, BrepsB=solid_difference_7)
surface_12 = Surface(hole_8)
region_difference_2 = RegionDifference(CurvesA=move.Geometry, CurvesB=list_item_3)
deconstruct_brep_4 = DeconstructBrep(Brep=solid_difference_7)  # -> Faces, Edges, Vertices
hole_thickness_6 = Extrude(Base=surface_12, Direction=unit_z_2)
hex_thickness = Extrude(Base=srf_7, Direction=unit_z_2)
hole_thickness_7 = Extrude(Base=surface_11, Direction=unit_z_2)
isolate_tabs_10 = ListItem(List=surface_9, Index=Slider(6, range=0..10), Wrap=True)
surface_13 = Surface(offset_loose_6)
region_difference_3 = RegionDifference(CurvesA=boundary_surfaces, CurvesB=isolate_tabs_5)
surface_14 = Surface(hole_9)
surface_15 = Surface(move_2.Geometry)
surface_16 = Surface(hole_10)
surface_17 = Surface(move_2.Geometry)
surface_18 = Surface(hole_12)
surface_19 = Surface(hole_11)
extrude_7 = Extrude(Base=solid_difference, Direction=unit_z_2)
extrude_8 = Extrude(Base=surface_13, Direction=unit_z_2)
extend_curve_4 = ExtendCurve(Curve=line_7, Type=0, Start=line_7, End=tab_for_hole)
tab_thickness_5 = Extrude(Base=surface_18, Direction=unit_z_2)
hole_thickness_8 = Extrude(Base=surface_14, Direction=unit_z_2)
tab_thickness_6 = Extrude(Base=surface_15, Direction=unit_z_2)
hole_thickness_9 = Extrude(Base=surface_16, Direction=unit_z_2)
tab_thickness_7 = Extrude(Base=surface_19, Direction=unit_z_2)
tab_thickness_8 = Extrude(Base=surface_17, Direction=unit_z_2)
region_difference_4 = RegionDifference(CurvesA=move.Geometry, CurvesB=list_item_3)
number_slider_8 = Slider(2, range=0..100)
solid_difference_11 = SolidDifference(BrepsA=hex_thickness, BrepsB=hole_thickness_7)
solid_difference_12 = SolidDifference(BrepsA=hole_thickness_6, BrepsB=extrude_3)
point_on_curve_11 = PointOnCurve(extend_curve_4, parameter=0.93)
boundary_surfaces_2 = BoundarySurfaces(Edges=region_difference_3)
solid_difference_13 = SolidDifference(BrepsA=extrude_7, BrepsB=extrude_8)
boundary_surfaces_3 = BoundarySurfaces(Edges=region_difference_4)
solid_difference_14 = SolidDifference(BrepsA=tab_thickness_7, BrepsB=tab_thickness_8)
list_item_8 = ListItem(List=deconstruct_brep_4.Vertices, Index=number_slider_8, Wrap=True)
list_item_9 = ListItem(List=deconstruct_brep_4.Edges, Index=Slider(20, range=0..100), Wrap=True)
list_item_10 = ListItem(List=deconstruct_brep_4.Edges, Index=Slider(15, range=0..100), Wrap=True)
hole_13 = CircleCNR(Center=point_on_curve_11, Normal=Vector(0, 0, 1), Radius=radius_of_hole)
region_difference_5 = RegionDifference(CurvesA=surface_19, CurvesB=surface_17)
divide_curve_6 = DivideCurve(Curve=list_item_9, Count=Slider(2, range=0..10), Kinks=False)  # -> Points, Tangents, Parameters
brep_join = BrepJoin(Breps=[tab_thickness_8, solid_difference_14])  # -> Breps, Closed
boundary_surfaces_4 = BoundarySurfaces(Edges=region_difference_2)
surface_20 = Surface(hole_13)
brep_join_2 = BrepJoin(Breps=[solid_difference_4, beacon_thickness_2, extrude, beacon_thickness_5, pipe])  # -> Breps, Closed
solid_difference_15 = SolidDifference(BrepsA=beacon_thickness, BrepsB=isolate_tabs_2)
solid_difference_16 = SolidDifference(BrepsA=beacon_thickness, BrepsB=isolate_tabs_3)
boundary_surfaces_5 = BoundarySurfaces(Edges=region_difference_5)
hole_thickness_10 = Extrude(Base=surface_20, Direction=unit_z_2)
solid_difference_17 = SolidDifference(BrepsA=solid_difference_12, BrepsB=hole_thickness_10)
divide_curve_7 = DivideCurve(Curve=list_item_10, Count=Slider(2, range=0..10), Kinks=False)  # -> Points, Tangents, Parameters
unit_y_4 = UnitY(Factor=Slider(2, range=0..10))
list_item_11 = ListItem(List=divide_curve_6.Points, Index=Slider(1, range=0..10), Wrap=True)
list_item_12 = ListItem(List=divide_curve_6.Points, Index=number_slider_8, Wrap=True)
region_difference_6 = RegionDifference(CurvesA=boundary_surfaces_5, CurvesB=surface_18)
isolate_tabs_11 = ListItem(List=solid_difference_17, Index=[Slider(1, range=0..1), Slider(3, range=0..10)], Wrap=True)
list_item_13 = ListItem(List=divide_curve_6.Points, Index=Slider(0, range=0..100), Wrap=True)
list_item_14 = ListItem(List=divide_curve_7.Points, Index=Slider(1, range=0..10), Wrap=True)
move_4 = Move(Geometry=list_item_11, Motion=unit_y_4)  # -> Geometry, Transform
negative_9 = Negative(Value=Slider(3, range=0..100))
arc_3pt = Arc3Pt(PointA=list_item_13, PointB=move_4.Geometry, PointC=list_item_12)  # -> Arc, Plane, Radius
hole_14 = CircleCNR(Center=list_item_14, Normal=Vector(0, 0, 1), Radius=radius_of_hole)
unit_y_5 = UnitY(Factor=negative_9)
solid_difference_18 = SolidDifference(BrepsA=brep_join.Breps, BrepsB=tab_thickness_5)
solid_difference_19 = SolidDifference(BrepsA=tab_thickness_8, BrepsB=hole_thickness_9)
solid_difference_20 = SolidDifference(BrepsA=tab_thickness_3, BrepsB=isolate_tabs_4)
solid_difference_21 = SolidDifference(BrepsA=tab_thickness_6, BrepsB=hole_thickness_8)
solid_difference_22 = SolidDifference(BrepsA=hex_thickness, BrepsB=isolate_tabs_10)
brep_join_3 = BrepJoin(Breps=[solid_difference_15, pipe])  # -> Breps, Closed
brep_join_4 = BrepJoin(Breps=[pipe, solid_difference_16])  # -> Breps, Closed
brep_join_5 = BrepJoin(Breps=[pipe, brep_join_2.Breps])  # -> Breps, Closed
option_1_flower = BrepJoin(Breps=[solid_difference_3, beacon_thickness_4])  # -> Breps, Closed
brep_join_6 = BrepJoin(Breps=[isolate_tabs_11, extrude_3])  # -> Breps, Closed
option_2_mouse_ears = BrepJoin(Breps=[isolate_tabs_6, beacon_thickness_4])  # -> Breps, Closed
option_3_double_hole = BrepJoin(Breps=[solid_difference_6, beacon_thickness_4])  # -> Breps, Closed
brep_join_7 = BrepJoin(Breps=[tab_thickness_3, solid_difference_8])  # -> Breps, Closed
brep_join_8 = BrepJoin(Breps=[tab_thickness_3, solid_difference_9])  # -> Breps, Closed
brep_join_9 = BrepJoin(Breps=[solid_difference_13, hex_thickness])  # -> Breps, Closed
line_8 = Line(StartPoint=list_item_13, EndPoint=list_item_12)
negative_10 = Negative(Value=Slider(5, range=0..10))
surface_21 = Surface(hole_14)
unit_y_6 = UnitY(Factor=negative_10)
boundary_surfaces_6 = BoundarySurfaces(Edges=[arc_3pt.Arc, line_8])
extrude_9 = Extrude(Base=boundary_surfaces_6, Direction=unit_z_3)
move_5 = Move(Geometry=extrude_9, Motion=list_item_14)  # -> Geometry, Transform
move_6 = Move(Geometry=surface_21, Motion=unit_y_6)  # -> Geometry, Transform
unit_x = UnitX(Factor=Slider(1.396, range=0..100))
hole_15 = CircleCNR(Center=list_item_11, Normal=Vector(0, 0, 1), Radius=radius_of_hole)
negative_11 = Negative(Value=Slider(1.477, range=0..100))
surface_22 = Surface(hole_15)
brep_join_10 = BrepJoin(Breps=[solid_difference_7, solid_difference_10])  # -> Breps, Closed
move_7 = Move(Geometry=move_6.Geometry, Motion=unit_x)  # -> Geometry, Transform
move_8 = Move(Geometry=surface_22, Motion=unit_y_5)  # -> Geometry, Transform
unit_x_2 = UnitX(Factor=negative_11)
unit_y_7 = UnitY(Factor=Slider(2, range=0..10))
negative_12 = Negative(Value=Slider(2, range=0..10))
move_9 = Move(Geometry=move_8.Geometry, Motion=unit_x_2)  # -> Geometry, Transform
negative_13 = Negative(Value=unit_y_7)
unit_z_4 = UnitZ(Factor=negative_12)
move_10 = Move(Geometry=move_9.Geometry, Motion=negative_13)  # -> Geometry, Transform
extrude_10 = Extrude(Base=move_7.Geometry, Direction=unit_z_4)
extrude_11 = Extrude(Base=[move_10.Geometry, move_7.Geometry], Direction=unit_z_3)
solid_difference_23 = SolidDifference(BrepsA=brep_join_10.Breps, BrepsB=extrude_11)
solid_difference_24 = SolidDifference(BrepsA=solid_difference_23, BrepsB=extrude_10)
