# Grasshopper definition beacons.gh (Grasshopper 0.9.76)

number_slider = Slider(52.6, range=0..100)
number_slider_2 = Slider(15, range=0..100)
construct_point = ConstructPoint(XCoordinate=0, YCoordinate=0, ZCoordinate=0)
construct_point_2 = ConstructPoint(XCoordinate=0, YCoordinate=number_slider, ZCoordinate=0)
unit_z = UnitZ(Factor=Slider(3, range=0..10))
circle_cnr = CircleCNR(Center=construct_point, Normal=Vector(0, 0, 1), Radius=number_slider)
circle_cnr_2 = CircleCNR(Center=construct_point_2, Normal=Vector(0, 0, 1), Radius=number_slider_2)
divide_curve = DivideCurve(Curve=circle_cnr_2, Count=Slider(10, range=0..10), Kinks=False)  # -> Points, Tangents, Parameters
divide_curve_2 = DivideCurve(Curve=circle_cnr, Count=Slider(8, range=0..10), Kinks=False)  # -> Points, Tangents, Parameters
surface = Surface(circle_cnr)
surface_2 = Surface(circle_cnr_2)
circle_cnr_3 = CircleCNR(Center=divide_curve_2.Points, Normal=Vector(0, 0, 1), Radius=number_slider_2)
extrude = Extrude(Base=surface, Direction=unit_z)
line = Line(StartPoint=construct_point_2, EndPoint=divide_curve.Points)
extrude_2 = Extrude(Base=surface_2, Direction=unit_z)
panel = Panel("""1
4""")
point_on_curve = PointOnCurve(line, parameter=0.571)
list_item = ListItem(List=circle_cnr_3, Index=[Slider(3, range=0..10), Slider(1, range=0..10)], Wrap=True)
list_item_2 = ListItem(List=point_on_curve, Index=panel, Wrap=True)
circle_cnr_4 = CircleCNR(Center=list_item_2, Normal=Vector(0, 0, 1), Radius=Slider(4, range=0..10))
solid_intersection = SolidIntersection(BrepsA=extrude_2, BrepsB=extrude)
surface_3 = Surface(circle_cnr_4)
extrude_3 = Extrude(Base=surface_3, Direction=unit_z)
solid_difference = SolidDifference(BrepsA=extrude_2, BrepsB=solid_intersection)
solid_difference_2 = SolidDifference(BrepsA=solid_difference, BrepsB=extrude_3)
