# Grasshopper definition beacons_frog_bunny.gh (Grasshopper 0.9.75)

beacon_radius = Slider(26.5, range=0..100)
number_slider = Slider(22, range=0..100)
beacon_radius_2 = Slider(26.5, range=0..100)
origin_of_beacon = ConstructPoint(XCoordinate=0, YCoordinate=0, ZCoordinate=0)
construct_point = ConstructPoint(XCoordinate=beacon_radius_2, YCoordinate=0, ZCoordinate=0)
unit_y = UnitY(Factor=1)
circle = Circle(Plane=PlaneXY(0, 0, 0), Radius=beacon_radius_2)
unit_y_2 = UnitY(Factor=expr("2*x", beacon_radius_2))
beacon = CircleCNR(Center=origin_of_beacon, Normal=Vector(0, 0, 1), Radius=beacon_radius)
number_of_segments = DivideCurve(Curve=beacon, Count=number_slider, Kinks=False)  # -> Points, Tangents, Parameters
srf = Surface(beacon)
line_sdl = LineSDL(Start=construct_point, Direction=unit_y, Length=100)
unit_y_3 = UnitY(Factor=Slider(28.593, range=20..30))
move = Move(Geometry=circle, Motion=unit_y_2)  # -> Geometry, Transform
move_2 = Move(Geometry=line_sdl, Motion=unit_y_3)  # -> Geometry, Transform
number_slider_2 = Slider(3, range=0..10)
xy_plane = XYPlane(Origin=Point(0, 0, 0))
number_slider_3 = Slider(8, range=0..100)
line = Line(StartPoint=origin_of_beacon, EndPoint=number_of_segments.Points)
tabs = CircleCNR(Center=number_of_segments.Points, Normal=Vector(0, 0, 1), Radius=Slider(9, range=0..10))
circle_tantan = CircleTanTan(CurveA=move.Geometry, CurveB=move_2.Geometry, Point=xy_plane)
extend_curve = ExtendCurve(Curve=line, Type=0, Start=number_of_segments.Points, End=number_slider)
radius_string_hole = Slider(2.5, range=0..10)
isolate_tabs = ListItem(List=tabs, Index=[number_slider_3, number_slider_2], Wrap=True)
area = Area(Geometry=circle_tantan)  # -> Area, Centroid
srf_2 = Surface(isolate_tabs)
point_on_curve = PointOnCurve(extend_curve, parameter=0.756)
radius_of_hole = Slider(2.5, range=0..10)

# ---- group: string hole
circle_2 = Circle(Plane=area.Centroid, Radius=radius_string_hole)

# ----
isolate_tabs_2 = ListItem(List=point_on_curve, Index=[number_slider_2, number_slider_3], Wrap=True)
curve_line = CurveLine(Curve=circle_tantan, Line=line_sdl)  # -> Points, Params, Count
region_difference = RegionDifference(CurvesA=srf_2, CurvesB=srf)
hole = CircleCNR(Center=isolate_tabs_2, Normal=Vector(0, 0, 1), Radius=Slider(6, range=0..10))
hole_2 = CircleCNR(Center=isolate_tabs_2, Normal=Vector(0, 0, 1), Radius=radius_of_hole)
line_2 = Line(StartPoint=construct_point, EndPoint=curve_line.Points)
region_difference_2 = RegionDifference(CurvesA=hole, CurvesB=beacon)
join_curves = JoinCurves(Curves=[region_difference, hole_2, beacon], Preserve=False)
merge = Merge(Data1=circle_tantan, Data2=circle_2, Data3=circle, Data4=move.Geometry, Data5=line_2)
bunny_ears = Curve(<curve referenced from the Rhino model>)
number_slider_4 = Slider(10, range=0..10)
bunny_ears_2 = Curve([<curve referenced from the Rhino model> x3])
frog_eyes = Curve([<curve referenced from the Rhino model> x7])
fillet = Fillet(Curve=bunny_ears, Radius=Slider(24, range=0..100))
