# Grasshopper definition fontToLines.gh (Grasshopper 0.9.76)

# Based on:
# Medial Axis definition by Daniel Piker 10/09/09
# 
# spacesymmetrystructure.wordpress.com
# 
# 
# Updates by Ben Doherty 2016/09/04
number_slider = Slider(50, range=50..200)
crv = Curve([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])
divide = DivideCurve(Curve=crv, Count=number_slider, Kinks=False)  # -> Points, Tangents, Parameters
flatten = FlattenTree(Tree=divide.Points, Path="{0}")
voronoi = Voronoi(Points=flatten, BruteForceOverride=False)
explode = Explode(Curve=voronoi, Recursive=True)  # -> Segments, Vertices
list = ValueList({"outside": 0, "inside": 2, "on": 1}, selected="inside")
exclude_crv = Curve([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])
list_2 = ValueList({"outside": 0, "inside": 2, "on": 1}, selected="outside")
crv_2 = Curve(crv)
cluster = Cluster(segments=explode.Segments, boundary=crv_2, location=list)
cluster_2 = Cluster(segments=explode.Segments, boundary=exclude_crv, location=list_2)
and = GateAnd(A=cluster, B=cluster_2)
cull = CullPattern(List=flatten(explode.Segments), CullPattern=and)
join = JoinCurves(Curves=cull, Preserve=False)
end = EndPoints(Curve=join)  # -> Start, End

# ==== cluster Cluster
segments = ClusterInput()
boundary = ClusterInput()
location = ClusterInput()
segments_2 = Curve(flatten(segments))
boundary_2 = Curve(boundary)
end = EndPoints(Curve=segments_2)  # -> Start, End
location_2 = Number(location)
incurves = PointInCurves(Point=end.Start, Curves=boundary_2)  # -> Relationship, Index, Point
incurves_2 = PointInCurves(Point=end.End, Curves=boundary_2)  # -> Relationship, Index, Point
equals = Equality(FirstNumber=incurves.Relationship, SecondNumber=location_2)  # -> Equality, Inequality
equals_2 = Equality(FirstNumber=incurves_2.Relationship, SecondNumber=location_2)  # -> Equality, Inequality
and = GateAnd(A=equals.Equality, B=equals_2.Equality)
R = ClusterOutput(and)
