# Grasshopper definition lasercut.gh (Grasshopper 0.9.76)

beacon_radius = Slider(26.5, range=0..100)
number_slider = Slider(22, range=0..100)
beacon_radius_2 = Slider(26.5, range=0..100)
origin_of_beacon = ConstructPoint(XCoordinate=0, YCoordinate=0, ZCoordinate=0)
unit_y = UnitY(Factor=1)
construct_point = ConstructPoint(XCoordinate=beacon_radius_2, YCoordinate=0, ZCoordinate=0)
circle = Circle(Plane=PlaneXY(0, 0, 0), Radius=beacon_radius_2)
unit_y_2 = UnitY(Factor=expr("2*x", beacon_radius_2))
beacon = CircleCNR(Center=origin_of_beacon, Normal=Vector(0, 0, 1), Radius=beacon_radius)
srf = Surface(beacon)
number_of_segments = DivideCurve(Curve=beacon, Count=number_slider, Kinks=False)  # -> Points, Tangents, Parameters
line_sdl = LineSDL(Start=construct_point, Direction=unit_y, Length=100)
unit_y_3 = UnitY(Factor=Slider(28.593, range=20..30))
move = Move(Geometry=circle, Motion=unit_y_2)  # -> Geometry, Transform
move_2 = Move(Geometry=line_sdl, Motion=unit_y_3)  # -> Geometry, Transform
number_slider_2 = Slider(3, range=0..10)
number_slider_3 = Slider(8, range=0..100)
xy_plane = XYPlane(Origin=Point(0, 0, 0))
line = Line(StartPoint=origin_of_beacon, EndPoint=number_of_segments.Points)
tabs = CircleCNR(Center=number_of_segments.Points, Normal=Vector(0, 0, 1), Radius=Slider(9, range=0..10))
circle_tantan = CircleTanTan(CurveA=move.Geometry, CurveB=move_2.Geometry, Point=xy_plane)
radius_string_hole = Slider(2.5, range=0..10)
extend_curve = ExtendCurve(Curve=line, Type=0, Start=number_of_segments.Points, End=number_slider)
isolate_tabs = ListItem(List=tabs, Index=[number_slider_3, number_slider_2], Wrap=True)
area = Area(Geometry=circle_tantan)  # -> Area, Centroid
srf_2 = Surface(isolate_tabs)
point_on_curve = PointOnCurve(extend_curve, parameter=0.756)
radius_of_hole = Slider(2.5, range=0..10)

# ---- group: string hole
circle_2 = Circle(Plane=area.Centroid, Radius=radius_string_hole)

# ----
isolate_tabs_2 = ListItem(List=point_on_curve, Index=[number_slider_2, number_slider_3], Wrap=True)
curve_line = CurveLine(Curve=circle_tantan, Line=line_sdl)  # -> Points, Params, Count
region_difference = RegionDifference(CurvesA=srf_2, CurvesB=srf)
hole = CircleCNR(Center=isolate_tabs_2, Normal=Vector(0, 0, 1), Radius=Slider(6, range=0..10))
hole_2 = CircleCNR(Center=isolate_tabs_2, Normal=Vector(0, 0, 1), Radius=radius_of_hole)
line_2 = Line(StartPoint=construct_point, EndPoint=curve_line.Points)
region_difference_2 = RegionDifference(CurvesA=hole, CurvesB=beacon)
join_curves = JoinCurves(Curves=[region_difference, hole_2, beacon], Preserve=False)
merge = Merge(Data1=circle_tantan, Data2=circle_2, Data3=circle, Data4=move.Geometry, Data5=line_2)
number_slider_4 = Slider(600, range=0..1000)
number_slider_5 = Slider(900, range=0..1000)
construct_point_2 = ConstructPoint(XCoordinate=number_slider_5, YCoordinate=number_slider_4, ZCoordinate=0)
construct_point_3 = ConstructPoint(XCoordinate=0, YCoordinate=0, ZCoordinate=0)
box_2pt = Box2Pt(PointA=construct_point_3, PointB=construct_point_2, Plane=PlaneXY(0, 0, 0))
number_slider_6 = Slider(4, range=-20..20)
deconstruct_brep = DeconstructBrep(Brep=box_2pt)  # -> Faces, Edges, Vertices
number_slider_7 = Slider(53, range=0..100)
number_slider_8 = Slider(53, range=0..100)
negative = Negative(Value=number_slider_6)
curve = Curve(deconstruct_brep.Edges)
division = Division(A=number_slider_5, B=number_slider_8)
division_2 = Division(A=number_slider_4, B=number_slider_7)
offset_loose = OffsetLoose(Curve=curve, Distance=negative)
construct_point_4 = ConstructPoint(XCoordinate=number_slider_6, YCoordinate=number_slider_6, ZCoordinate=0)
round = Round(Number=division)  # -> Nearest, Floor, Ceiling
round_2 = Round(Number=division_2)  # -> Nearest, Floor, Ceiling
rectangular = Rectangular(Plane=construct_point_4, SizeX=number_slider_8, SizeY=number_slider_7, ExtentX=round.Floor, ExtentY=round_2.Floor)  # -> Cells, Points
bunny_ears = Curve([<curve referenced from the Rhino model> x4])
area_2 = Area(Geometry=rectangular.Cells)  # -> Area, Centroid
boundary_surfaces = BoundarySurfaces(Edges=bunny_ears)
panel = Panel("""Kit Ku
Max Hu
Chi Tang
David Ho
Gary Cai
Caren Mok
Eric Yeoh
Felix Saw
Ian James
Jamie Don
Jamie Yoo
Kim Small
Marc Hine
Marc Sirl
Mark Gazy
Ali Bounds
Carolyn Jo
Chris Tate
Dan Rumery
Delia Ngay
Fiona Long
Guy Hanson
Jared Wood
Julie Wong
Katie Love
Kirby Rees
Leny Lembo
Max Melser
Neil Logan
Shanny Lam
Tim Gibson
Abbie Lewis
Amanda Tenn
Amelia Lipa
Andrew Fong
Andrew Mehr
Ben Doherty
Bill Dowzer
Craig Burns
David Brown
Elise Cuneo
Erika Halim
Fiona Young
Geoff Cooke
Glenn Irwin
Iain Godwin
James Duval
James Grose
Knut Menden
Kristy Weir
Laura Hinds
Marc Micuta
Mateusz Sum
Neil Carter
Rana Abboud
Rebecca Qin
Sam Sweeney
Tia Crocker
Tiara Dobbs
Yilun Zhang
Abbie Galvin
Alex Chaston
Ayelen Moure
Barry Cantor
Barry Dineen
Bella Pescia
Bianca Smith
David Madden
Domino Risch
Haydn Davies
Ian Goodbury
Ian Kirkland
Isabell Beck
Jan Christel
Kathy Hansen
Lovro Smoljo
Melanie Mury
Patrik Typpo
Paul Wintour
Peter Clarke
Rosa Cotrona
Ross Seymour
Saskia Arief
Simon Hubert
Tim Crawshaw
Victoria Hey
Zainab Sadek
Alexander Lee
Andrew Godwin
Conor Larkins
Daisy Szakaly
Elena Bonanni
Julian Ashton
Kirsten Karst
Kristin Neise
Marc Sullivan
Marcos Camara
Martin Stacey
Matthew Blair
Namik Handzic
Peter Titmuss
Rose Steedman
Sally Johnson
Susanne Mayer
Adriana Haindl
Andre Callanan
Brenda Hocking
Brian Clohessy
Byron Sullivan
Camila Beltran
Connor Badenko
Heather McCabe
Joseph O'Meara
Kate O'Mullane
Kinder Goodall
Kurt Schilling
Lynn Limpivest
Natalia Norton
Neil Haybittel
William Cobine
Alex Harrington
Andrew Buchanan
Andrew Ferguson
Anne-Renee Robb
Chris Bickerton
Daniel Cruddace
Debbie Nicholls
Jessica Enander
Joe Fiumedinisi
Michelle Farman
Namaste Burrell
Sara Pellegrini
Sebastian Tsang
Trent Middleton
Bernard Whitcher
Charlie Fanniere
Stella de Vulder
Wikanya Amornsak
Catherine Skinner
Hector Barrientos
Jessica Battersby
Kaye Purificacion
Marco Montevecchi
Nicholas Crawford
Suleiman Alhadidi
Valentine Steisel
Alessandra Colusso
Danielle McParland
Johannes Grissmann
Katherine Withnell
Madeline Kurpeikis
Michele Di Giorgio
Michelle Vassiliou
Nikita Notowidigdo
Phillip Rossington
Annisa Rivera Rizal
Farbod Fathalipouri
Jonathan Capparelli
Stephanie Costelloe
Alan Monckton-Milnes
Alessandra Moschella
Katherine Wiedersehn
Mary Mangan-Streeter
Nicholas Souksamrane
Ninotschka Titchkosky
 """)
move_3 = Move(Geometry=boundary_surfaces, Motion=area_2.Centroid)  # -> Geometry, Transform
case = TextCase(Text=panel, Culture=127)  # -> UpperCase, LowerCase
circle_cnr = CircleCNR(Center=area_2.Centroid, Normal=Vector(0, 0, 1), Radius=Slider(19.31, range=0..100))
characters = Characters(Text=case.UpperCase)  # -> Result, Unicode
characters_2 = Characters(Text="WHERE-IN.SPACE")  # -> Result, Unicode
deconstruct_brep_2 = DeconstructBrep(Brep=move_3.Geometry)  # -> Faces, Edges, Vertices
list_length = ListLength(List=characters.Result)  # -> expr("x-1", Length)
divide_curve = DivideCurve(Curve=circle_cnr, Count=Slider(12, range=0..20), Kinks=False)  # -> Points, Tangents, Parameters
list_length_2 = ListLength(List=characters_2.Result)  # -> expr("x-1", Length)
curve_2 = Curve(deconstruct_brep_2.Edges)
list_item = ListItem(List=divide_curve.Points, Index=Slider(7, range=0..100), Wrap=True)
list_item_2 = ListItem(List=divide_curve.Points, Index=Slider(9, range=0..100), Wrap=True)
list_item_3 = ListItem(List=divide_curve.Points, Index=Slider(11, range=0..100), Wrap=True)
list_item_4 = ListItem(List=divide_curve.Points, Index=Slider(6, range=0..100), Wrap=True)
list_item_5 = ListItem(List=divide_curve.Points, Index=Slider(3, range=0..100), Wrap=True)
list_item_6 = ListItem(List=divide_curve.Points, Index=Slider(0, range=0..100), Wrap=True)
arc_3pt = Arc3Pt(PointA=list_item, PointB=list_item_2, PointC=list_item_3)  # -> flatten(Arc), Plane, Radius
arc_3pt_2 = Arc3Pt(PointA=list_item_4, PointB=list_item_5, PointC=list_item_6)  # -> Arc, Plane, Radius
cluster_adjuster = ClusterAdjuster(space_factor=Slider(14, range=0..100), base_curve=arc_3pt.Arc, letter_count=list_length_2)
cluster_adjuster_2 = ClusterAdjuster(space_factor=Slider(24, range=0..100), base_curve=arc_3pt_2.Arc, letter_count=list_length)
horizontal_frames = HorizontalFrames(Curve=reparameterize(flatten(cluster_adjuster_2)), Count=flatten(list_length))  # -> Frames, Parameters
horizontal_frames_2 = HorizontalFrames(Curve=cluster_adjuster, Count=list_length_2)  # -> Frames, Parameters
number_slider_9 = Slider(2.5, range=1..4)
colour_swatch = ColourSwatch(SwatchColor=RGB(0, 0, 255))
text_tag_3d = TextTag3D(Location=horizontal_frames.Frames, Text=characters.Result, Size=number_slider_9, Colour=colour_swatch, Justification=2)
text_tag_3d_2 = TextTag3D(
    Location=horizontal_frames_2.Frames,
    Text=characters_2.Result,
    Size=number_slider_9,
    Colour=colour_swatch,
    Justification=8)

# ==== cluster ClusterAdjuster
space_factor = ClusterInput()
base_curve = ClusterInput()
letter_count = ClusterInput()
space_factor_2 = Number(space_factor)
base_curve_2 = Curve(reparameterize(flatten(base_curve)))
letter_count_2 = Number(letter_count)
len = Length(Curve=base_curve_2)
division = Division(A=len, B=space_factor_2)
num_check = PythonScript(x=flatten(letter_count_2))  # -> a
# ---------- num_check: Python ----------
if x == 0:
    a=4
else:
    a=x
# ---------- end num_check ----------
multiplication = Multiplication(A=division, B=flatten(num_check))
division_2 = Division(A=len, B="2")
division_3 = Division(A=multiplication, B="2")
crv = Curve(reparameterize(flatten(base_curve_2)))
subtraction = Subtraction(A=division_2, B=division_3)
addition = Addition(A=division_2, B=division_3)
eval = EvaluateLength(Curve=crv, Length=subtraction, Normalized=False)  # -> Point, Tangent, Parameter
eval_2 = EvaluateLength(Curve=crv, Length=division_2, Normalized=False)  # -> Point, Tangent, Parameter
eval_3 = EvaluateLength(Curve=crv, Length=addition, Normalized=False)  # -> Point, Tangent, Parameter
arc_3pt = Arc3Pt(PointA=eval.Point, PointB=eval_2.Point, PointC=eval_3.Point)  # -> Arc, Plane, Radius
adjusted_crv = Curve(arc_3pt.Arc)
adjusted_crv_2 = ClusterOutput(adjusted_crv)
