# Grasshopper definition gh-python-json-name-coordinant-reader1.gh (Grasshopper 0.9.75)
# plug-ins: Python Interpreter

panel = Panel("""Alpha
Bravo""")
path = FilePath("F:\BlankMindBlog\helpers\baseStations_ARUP.json")
path_2 = FilePath("F:\BlankMindBlog\helpers\experiments\exp7\raw_json\fourmetre.json")
json = PythonScript(FilePath=path, inputName=panel)  # -> out, x, y
# ---------- json: Python ----------
import json

if FilePath:
    
    # JSON file to read
    file = open(FilePath)
    
    # Load the data
    data = json.load(file)
    
    # Do something with the data
    for basestation in data:
        print basestation["Name"]
        print inputName
        if basestation["Name"] == inputName:
            x = basestation["X"]
            y = basestation["Y"]
            print x
            print y
# ---------- end json ----------
json_2 = PythonScript(FilePath=path_2, uuid="d0d3fa86ca7645ec9bd96af400000005")  # -> out, xys, y
# ---------- json_2: Python ----------
import json

if FilePath:
    
    # JSON file to read
    file = open(FilePath)
    
    # Load the data
    detections = json.load(file)
    
    # Do something with the data
    xys = []
    
    for person in detections:
        if person["uuid"] == uuid:
            time = person["time"]
            major = person["major"]
            minor = person["minor"]
            rssi = person["rssi"]
            
            xys.append({"time": time, "major" : major, "major" : minor, "rssi": rssi })
            
            print xys
# ---------- end json_2 ----------
panel_2 = Panel(json.x)
panel_3 = Panel(json.y)
panel_4 = Panel(json_2.xys)
