# Grasshopper definition gh-python-json-name-coordinant-reader1.gh (Grasshopper 0.9.76)
# plug-ins: Python Interpreter

# ----
# This gets all the unique names. Because it's using toy data we can use names. On the real data we'd need to use UUIDs.
windowspath = FilePath("F:\BlankMindBlog\helpers\gh_visualisation\json_detection data\fakedata.json")
linuxpath = FilePath("\\VBOXSVR\projects\tuksun\BlankMindBlog\helpers\gh_visualisation\json_detection data\fakedata.json")
panel = Panel(linuxpath)
names = PythonScript(FilePath=linuxpath)  # -> flatten(names)
# ---------- names: Python ----------
import json

if FilePath:
    
    # JSON file to read
    file = open(FilePath)
    
    # Load the data
    data = json.load(file)
    
    names = []
    
    for d in data:
        names.append( d['name'] )
    
    print names
# ---------- end names ----------
cset = CreateSet(List=names)  # -> Set, Map
panel_2 = Panel(cset.Set)

# ----
# This draws out the points that corespond to the base stations.
# I've cheated and put in a static list of base stations instead of reading it froma file. This is for laziness and for performance (that list doesn't change much).
panel_3 = Panel("""Alpha
Bravo
Charlie
Delta
Echo
Foxtrot
Gandalf
Golf
Hotel
India
Jean
Juliett
Kat
Kilo
Lima
Meow
Mike
Neil
November
Oscar
Papa
Quebec
Romeo
Sierra
Spock
Tango
Tony
Uniform
Victor""")
path = FilePath("\\VBOXSVR\projects\tuksun\BlankMindBlog\helpers\gh_visualisation\json_basestation\baseStations_BVN_NEW.json")
cluster = Cluster(filepath=path, inputname=panel_3)  # -> x, y
panel_4 = Panel(cluster.x)
pt = ConstructPoint(XCoordinate=cluster.x, YCoordinate=cluster.y, ZCoordinate=0)
panel_5 = Panel(cluster.y)

tag = TextTag3D(Location=pt, Text=panel_3, Size=1562, Colour=RGB(3, 217, 255), Justification=5)

# ----
# Given a list of names, this finds all the detections related to each of those names and returns them as a list of lists.
json = PythonScript(FilePath=linuxpath, name=cset.Set)  # -> data, base, time
# ---------- json: Python ----------
import json

if FilePath:
    
    # JSON file to read
    file = open(FilePath)
    
    # Load the data
    detections = json.load(file)
    data = str(detections)
    
    time = []
    base = []
    
    for detection in detections:
        if detection["name"] == name:
            print detection
            time.append( detection["time"] )
            base.append( detection["basestation"] )
# ---------- end json ----------
panel_6 = Panel(json.base)
panel_7 = Panel(json.time)

# ----
# This takes the list of lists, and looks up (x,y) coords for each item.
# Returns lists of lists of x and y to build polylines onto.
cluster_2 = Cluster(filepath=path, inputname=json.base)  # -> x, y
pt_2 = ConstructPoint(XCoordinate=cluster_2.x, YCoordinate=cluster_2.y, ZCoordinate=0)
pline = PolyLine(Vertices=pt_2, Closed=False)

curvepoint = PointOnCurve(pline, parameter=0.694)
pipe = Pipe(Curve=pline, Radius=200, Caps=0)
tag_2 = TextTag3D(Location=curvepoint, Text=graft(cset.Set), Size=Slider(2831, range=0..5000), Colour=RGB(255, 0, 0), Justification=7)
msphere = MeshSphere(Base=curvepoint, Radius=1000, UCount=5, VCount=4)

# ==== cluster Cluster
filepath = ClusterInput()
inputname = ClusterInput()
data_json = PythonScript(FilePath=filepath, inputName=inputname)  # -> out, x, y
# ---------- data_json: Python ----------
import json

if FilePath:
    
    # JSON file to read
    file = open(FilePath)
    
    # Load the data
    data = json.load(file)
    
    # Do something with the data
    for basestation in data:
        print basestation["Name"]
        print inputName
        if basestation["Name"] == inputName:
            x = basestation["X"]
            y = basestation["Y"]
            print x
            print y
# ---------- end data_json ----------
x = ClusterOutput(data_json.x)
y = ClusterOutput(data_json.y)
