# Grasshopper definition 01_Isovist_basestationLayout.gh (Grasshopper 0.9.75)
# plug-ins: Python Interpreter

pipeline = GeometryPipeline(
    GroupByLayer=False,
    GroupByType=False,
    IncludeHidden=True,
    IncludeLocked=True,
    LayerFilter="_gh_boundary_isovist",
    NameFilter="*",
    TypeFilter=4)

# ---- group: Basestation XY Coords
bvn_basestation_points = Point([<point referenced from the Rhino model> x40])
_5m_radius = Slider(5000, range=0..10000)
sphere = Sphere(Base=bvn_basestation_points, Radius=Slider(547, range=0..1000))
basestation_xy = Deconstruct(Point=bvn_basestation_points)  # -> XComponent, YComponent, ZComponent
ivist = IsoVist(Plane=bvn_basestation_points, Count=Slider(385, range=0..500), Radius=_5m_radius, Obstacles=pipeline)  # -> Points, Distance, Index
panel = Panel(basestation_xy.XComponent)
panel_2 = Panel(basestation_xy.YComponent)
pline = PolyLine(Vertices=ivist.Points, Closed=False)

# ----
arup_basestation_points = Point([<point referenced from the Rhino model> x37])

# ---- group: Isovist
# Isovist Python (takes a while to compute if enabled)
number_slider = Slider(5000, range=0..10000)
python = PythonScript(points=bvn_basestation_points, lines=Slider(1000, range=0..1000), radius=number_slider, boundries=pipeline)  # -> pointOut, totalIsovist, isovistsClear, overlapSpace, isovistsList, isovistTotalSurface, nonOverlapSpace; inputs points: list of Point3d, lines: Int32, radius: Int32, boundries: list
# ---------- python: Python ----------
import ghpythonlib.components as ghcomp
import rhinoscriptsyntax as rs
import Rhino.Geometry as rg




isovistsList = []
overlapSpaceList = []
isovistsClear = []
pointOut = points

for point in points:
    isovists = ghcomp.IsoVist(point,lines,radius,boundries)
    getIsovistPoints=isovists[0]
    isovistsOutline = ghcomp.PolyLine(getIsovistPoints,True)
    makeSurface = ghcomp.BoundarySurfaces(isovistsOutline)
    print makeSurface
    isovistsList.append(makeSurface)

coerceBrepList = []

for individualIsovists in isovistsList:
    coercedOneBrep = rs.coercebrep(individualIsovists)
    coerceBrepList.append(coercedOneBrep)

isovistCoercedUnion = ghcomp.RegionUnion(coerceBrepList)
isovistTotalSurface = ghcomp.BoundarySurfaces(isovistCoercedUnion)

interA = isovistsList[0:len(isovistsList)-1]
interB = isovistsList[1:]

for itsA in interA:
    for itsB in interB:
        if itsA == itsB:
            print itsA
        else:
            regionInter = ghcomp.RegionIntersection(itsA,itsB)
            surfaceInter = ghcomp.BoundarySurfaces(regionInter)
            #if len(surfaceInter) != 1:
            #    for listList in surfaceInter:
            #        print listList
            #        overlapSpaceList.append(listList)
            overlapSpaceList.append(surfaceInter)


flatOver = []

for testList in overlapSpaceList:
    testIfList = isinstance(testList, list)
    if testIfList == True:
        for isList in testList:
            flatOver.append(isList)
    else:
        flatOver.append(testList)

overlapSpace = flatOver

##asd = []

##overlapSpace = ghcomp.RegionUnion(flatOver)

##for getnotOverlapSpace in isovistsList:
##    pineapple = ghcomp.RegionDifference(getnotOverlapSpace, overlapSpace)
##    asd.append(pineapple)
##nonOverlapSpace = asd


#overlapCombination = ghcomp.RegionUnion(flatOver)
#print overlapCombination
#overlapSurface = ghcomp.BoundarySurfaces(overlapCombination)
#overlapCalcArea = ghcomp.Area(overlapSurface)
#print overlapCalcArea


#for overlapPiece in overlapCalcArea[0]:
#    overlapArea = overlapArea + overlapPiece

#print overlapSpaceList
#overlapSpace = flatOver



#ghcomp.regi

#a = isovistsList
# ---------- end python ----------
runion = RegionUnion()
srf = Surface(python.isovistTotalSurface)  # disabled
crv = Curve([<curve referenced from the Rhino model> x2])
boundary = BoundarySurfaces(Edges=runion)
debrep = DeconstructBrep(Brep=srf)  # -> Faces, Edges, Vertices
area = Area(Geometry=srf)  # -> Area, Centroid
runion_2 = RegionUnion(Curves=crv)
area_2 = Area(Geometry=boundary)  # -> Area, Centroid
ma = MassAddition(Input=area.Area)  # -> Result, PartialResults
boundary_2 = BoundarySurfaces(Edges=runion_2)
ma_2 = MassAddition(Input=area_2.Area)  # -> Result, PartialResults
area_3 = Area(Geometry=boundary_2)  # -> Area, Centroid
subtraction = Subtraction(A=area_3.Area, B=ma.Result)
division = Division(A=subtraction, B=area_3.Area)
multiplication = Multiplication(A=division, B=100)
data = Data(simplify(graft(["Units Squared", "Percentage (%)"])))
data_2 = Data(simplify(graft([subtraction, multiplication])))
total_area = Panel(area_3.Area)
area_not_covered = Panel([data, data_2])
overlap_area = Panel(ma_2.Result)
area_covered = Panel(ma.Result)

# ----
srf_2 = Surface(python.isovistTotalSurface)
