# Grasshopper definition 02_InnerBoundaries.gh (Grasshopper 0.9.75)
# plug-ins: LunchBox

crv = Curve([<curve referenced from the Rhino model> x948])
crv_2 = Curve([<curve referenced from the Rhino model> x727])
crv_3 = Curve([<curve referenced from the Rhino model> x42])
crv_4 = Curve([<curve referenced from the Rhino model> x34])
crv_5 = Curve([<curve referenced from the Rhino model> x28])
crv_6 = Curve([<curve referenced from the Rhino model> x9])
crv_7 = Curve([<curve referenced from the Rhino model> x35])
crv_8 = Curve([<curve referenced from the Rhino model> x42])
crv_9 = Curve([<curve referenced from the Rhino model> x26])
divide = DivideCurve(Curve=crv_5, Count=10, Kinks=False)  # -> flatten(Points), Tangents, Parameters
divide_2 = DivideCurve(Curve=crv_2, Count=10, Kinks=False)  # -> flatten(Points), Tangents, Parameters
divide_3 = DivideCurve(Curve=crv_6, Count=10, Kinks=False)  # -> flatten(Points), Tangents, Parameters
end = EndPoints(Curve=crv)  # -> Start, End
end_2 = EndPoints(Curve=crv_8)  # -> Start, End
end_3 = EndPoints(Curve=crv_3)  # -> Start, End
end_4 = EndPoints(Curve=crv_4)  # -> Start, End
end_5 = EndPoints(Curve=crv_7)  # -> Start, End
end_6 = EndPoints(Curve=crv_9)  # -> Start, End
hull = ConvexHull(Points=[end.Start, end.End], Plane=PlaneXY(0, 0, 0))  # -> Hull, HullZ, Indices
hull_2 = ConvexHull(Points=[end_2.Start, end_2.End], Plane=PlaneXY(0, 0, 0))  # -> Hull, HullZ, Indices
hull_3 = ConvexHull(Points=[end_3.Start, end_3.End], Plane=PlaneXY(0, 0, 0))  # -> Hull, HullZ, Indices
hull_4 = ConvexHull(Points=[end_4.Start, end_4.End], Plane=PlaneXY(0, 0, 0))  # -> Hull, HullZ, Indices
hull_5 = ConvexHull(Points=end_5.Start, Plane=PlaneXY(0, 0, 0))  # -> Hull, HullZ, Indices
hull_6 = ConvexHull(Points=[end_6.Start, end_6.End], Plane=PlaneXY(0, 0, 0))  # -> Hull, HullZ, Indices
hull_7 = ConvexHull(Points=divide.Points, Plane=PlaneXY(0, 0, 0))  # -> Hull, HullZ, Indices
hull_8 = ConvexHull(Points=divide_2.Points, Plane=PlaneXY(0, 0, 0))  # -> Hull, HullZ, Indices
hull_9 = ConvexHull(Points=divide_3.Points, Plane=PlaneXY(0, 0, 0))  # -> Hull, HullZ, Indices

crv_10 = Curve([<curve referenced from the Rhino model> x772])
crv_11 = Curve([<curve referenced from the Rhino model> x30])
crv_12 = Curve([<curve referenced from the Rhino model> x855])
crv_13 = Curve([<curve referenced from the Rhino model> x44])
crv_14 = Curve([<curve referenced from the Rhino model> x12])
crv_15 = Curve([<curve referenced from the Rhino model> x36])
crv_16 = Curve([<curve referenced from the Rhino model> x8])
crv_17 = Curve([<curve referenced from the Rhino model> x12])
end_7 = EndPoints(Curve=crv_10)  # -> Start, End
end_8 = EndPoints(Curve=crv_14)  # -> Start, End
end_9 = EndPoints(Curve=crv_11)  # -> Start, End
end_10 = EndPoints(Curve=crv_12)  # -> Start, End
end_11 = EndPoints(Curve=crv_13)  # -> Start, End
end_12 = EndPoints(Curve=crv_15)  # -> Start, End
end_13 = EndPoints(Curve=crv_16)  # -> Start, End
end_14 = EndPoints(Curve=crv_17)  # -> Start, End
hull_10 = ConvexHull(Points=[end_8.Start, end_8.End], Plane=PlaneXY(0, 0, 0))  # -> Hull, HullZ, Indices
hull_11 = ConvexHull(Points=[end_9.Start, end_9.End], Plane=PlaneXY(0, 0, 0))  # -> Hull, HullZ, Indices
hull_12 = ConvexHull(Points=[end_11.Start, end_11.End], Plane=PlaneXY(0, 0, 0))  # -> Hull, HullZ, Indices
hull_13 = ConvexHull(Points=[end_12.Start, end_12.End], Plane=PlaneXY(0, 0, 0))  # -> Hull, HullZ, Indices
hull_14 = ConvexHull(Points=[end_13.Start, end_13.End], Plane=PlaneXY(0, 0, 0))  # -> Hull, HullZ, Indices
hull_15 = ConvexHull(Points=[end_14.Start, end_14.End], Plane=PlaneXY(0, 0, 0))  # -> Hull, HullZ, Indices
hull_16 = ConvexHull(Points=[end_7.Start, end_7.End], Plane=PlaneXY(0, 0, 0))  # -> Hull, HullZ, Indices
hull_17 = ConvexHull(Points=[end_10.Start, end_10.End], Plane=PlaneXY(0, 0, 0))  # -> Hull, HullZ, Indices

crv_18 = Curve([<curve referenced from the Rhino model> x5000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])
crv_19 = Curve([<curve referenced from the Rhino model> x3204])
crv_20 = Curve([<curve referenced from the Rhino model> x3204])
crv_21 = Curve([<curve referenced from the Rhino model> x5000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])
crv_22 = Curve([<curve referenced from the Rhino model> x3204])
crv_23 = Curve([<curve referenced from the Rhino model> x2945])
crv_24 = Curve([<curve referenced from the Rhino model> x4806])
crv_25 = Curve([<curve referenced from the Rhino model> x32])
crv_26 = Curve([<curve referenced from the Rhino model> x24])
crv_27 = Curve([<curve referenced from the Rhino model> x62])
crv_28 = Curve([<curve referenced from the Rhino model> x16])
crv_29 = Curve([<curve referenced from the Rhino model> x62])
crv_30 = Curve([<curve referenced from the Rhino model> x58])
crv_31 = Curve([<curve referenced from the Rhino model> x62])
crv_32 = Curve([<curve referenced from the Rhino model> x45])
crv_33 = Curve([<curve referenced from the Rhino model> x4770])
crv_34 = Curve([<curve referenced from the Rhino model> x4806])
crv_35 = Curve([<curve referenced from the Rhino model> x2415])
crv_36 = Curve([<curve referenced from the Rhino model> x3204])
crv_37 = Curve([<curve referenced from the Rhino model> x3212])
crv_38 = Curve([<curve referenced from the Rhino model> x32])
crv_39 = Curve([<curve referenced from the Rhino model> x2920])
crv_40 = Curve([<curve referenced from the Rhino model> x62])
divide_4 = DivideCurve(Curve=crv_23, Count=20, Kinks=False)  # -> flatten(Points), Tangents, Parameters
divide_5 = DivideCurve(Curve=crv_25, Count=10, Kinks=False)  # -> flatten(Points), Tangents, Parameters
divide_6 = DivideCurve(Curve=crv_26, Count=10, Kinks=False)  # -> flatten(Points), Tangents, Parameters
divide_7 = DivideCurve(Curve=crv_39, Count=10, Kinks=False)  # -> flatten(Points), Tangents, Parameters
end_15 = EndPoints(Curve=crv_18)  # -> Start, End
end_16 = EndPoints(Curve=crv_19)  # -> Start, End
end_17 = EndPoints(Curve=crv_33)  # -> Start, End
end_18 = EndPoints(Curve=crv_34)  # -> Start, End
end_19 = EndPoints(Curve=crv_20)  # -> Start, End
end_20 = EndPoints(Curve=crv_35)  # -> Start, End
end_21 = EndPoints(Curve=crv_21)  # -> Start, End
end_22 = EndPoints(Curve=crv_22)  # -> Start, End
end_23 = EndPoints(Curve=crv_36)  # -> Start, End
end_24 = EndPoints(Curve=crv_37)  # -> Start, End
end_25 = EndPoints(Curve=crv_24)  # -> Start, End
end_26 = EndPoints(Curve=crv_38)  # -> Start, End
end_27 = EndPoints(Curve=crv_40)  # -> Start, End
end_28 = EndPoints(Curve=crv_27)  # -> Start, End
end_29 = EndPoints(Curve=crv_28)  # -> Start, End
end_30 = EndPoints(Curve=crv_29)  # -> Start, End
end_31 = EndPoints(Curve=crv_30)  # -> Start, End
end_32 = EndPoints(Curve=crv_31)  # -> Start, End
end_33 = EndPoints(Curve=crv_32)  # -> Start, End
hull_18 = ConvexHull(Points=end_15.Start, Plane=PlaneXY(0, 0, 0))  # -> Hull, HullZ, Indices
hull_19 = ConvexHull(Points=end_16.Start, Plane=PlaneXY(0, 0, 0))  # -> Hull, HullZ, Indices
hull_20 = ConvexHull(Points=end_17.Start, Plane=PlaneXY(0, 0, 0))  # -> Hull, HullZ, Indices
hull_21 = ConvexHull(Points=end_18.Start, Plane=PlaneXY(0, 0, 0))  # -> Hull, HullZ, Indices
hull_22 = ConvexHull(Points=[end_19.Start, end_19.End], Plane=PlaneXY(0, 0, 0))  # -> Hull, HullZ, Indices
hull_23 = ConvexHull(Points=[end_20.Start, end_20.End], Plane=PlaneXY(0, 0, 0))  # -> Hull, HullZ, Indices
hull_24 = ConvexHull(Points=[end_21.Start, end_21.End], Plane=PlaneXY(0, 0, 0))  # -> Hull, HullZ, Indices
hull_25 = ConvexHull(Points=[end_22.Start, end_22.End], Plane=PlaneXY(0, 0, 0))  # -> Hull, HullZ, Indices
hull_26 = ConvexHull(Points=[end_23.Start, end_23.End], Plane=PlaneXY(0, 0, 0))  # -> Hull, HullZ, Indices
hull_27 = ConvexHull(Points=[end_24.Start, end_24.End], Plane=PlaneXY(0, 0, 0))  # -> Hull, HullZ, Indices
hull_28 = ConvexHull(Points=divide_4.Points, Plane=PlaneXY(0, 0, 0))  # -> Hull, HullZ, Indices
hull_29 = ConvexHull(Points=[end_25.Start, end_25.End], Plane=PlaneXY(0, 0, 0))  # -> Hull, HullZ, Indices
hull_30 = ConvexHull(Points=[end_26.Start, end_26.End], Plane=PlaneXY(0, 0, 0))  # -> Hull, HullZ, Indices
hull_31 = ConvexHull(Points=divide_5.Points, Plane=PlaneXY(0, 0, 0))  # -> Hull, HullZ, Indices
hull_32 = ConvexHull(Points=divide_6.Points, Plane=PlaneXY(0, 0, 0))  # -> Hull, HullZ, Indices
hull_33 = ConvexHull(Points=divide_7.Points, Plane=PlaneXY(0, 0, 0))  # -> Hull, HullZ, Indices
hull_34 = ConvexHull(Points=end_27.Start, Plane=PlaneXY(0, 0, 0))  # -> Hull, HullZ, Indices
hull_35 = ConvexHull(Points=end_28.Start, Plane=PlaneXY(0, 0, 0))  # -> Hull, HullZ, Indices
hull_36 = ConvexHull(Points=end_29.Start, Plane=PlaneXY(0, 0, 0))  # -> Hull, HullZ, Indices
hull_37 = ConvexHull(Points=end_30.Start, Plane=PlaneXY(0, 0, 0))  # -> Hull, HullZ, Indices
hull_38 = ConvexHull(Points=end_31.Start, Plane=PlaneXY(0, 0, 0))  # -> Hull, HullZ, Indices
hull_39 = ConvexHull(Points=end_32.Start, Plane=PlaneXY(0, 0, 0))  # -> Hull, HullZ, Indices
hull_40 = ConvexHull(Points=end_33.Start, Plane=PlaneXY(0, 0, 0))  # -> Hull, HullZ, Indices

crv_41 = Curve([<curve referenced from the Rhino model> x83])
crv_42 = Curve([<curve referenced from the Rhino model> x852])
crv_43 = Curve([<curve referenced from the Rhino model> x136])
crv_44 = Curve([<curve referenced from the Rhino model> x44])
crv_45 = Curve([<curve referenced from the Rhino model> x44])
crv_46 = Curve([<curve referenced from the Rhino model> x44])
crv_47 = Curve([<curve referenced from the Rhino model> x25])
crv_48 = Curve([<curve referenced from the Rhino model> x94])
crv_49 = Curve([<curve referenced from the Rhino model> x76])
crv_50 = Curve([<curve referenced from the Rhino model> x254])
crv_51 = Curve([<curve referenced from the Rhino model> x364])
crv_52 = Curve([<curve referenced from the Rhino model> x110])
crv_53 = Curve([<curve referenced from the Rhino model> x766])
crv_54 = Curve([<curve referenced from the Rhino model> x181])
crv_55 = Curve([<curve referenced from the Rhino model> x20])
crv_56 = Curve([<curve referenced from the Rhino model> x25])
crv_57 = Curve([<curve referenced from the Rhino model> x98])
crv_58 = Curve([<curve referenced from the Rhino model> x98])
crv_59 = Curve([<curve referenced from the Rhino model> x129])
crv_60 = Curve([<curve referenced from the Rhino model> x346])
crv_61 = Curve([<curve referenced from the Rhino model> x119])
crv_62 = Curve([<curve referenced from the Rhino model> x347])
crv_63 = Curve([<curve referenced from the Rhino model> x110])
crv_64 = Curve([<curve referenced from the Rhino model> x82])
crv_65 = Curve([<curve referenced from the Rhino model> x119])
crv_66 = Curve([<curve referenced from the Rhino model> x200])
crv_67 = Curve([<curve referenced from the Rhino model> x364])
crv_68 = Curve([<curve referenced from the Rhino model> x113])
crv_69 = Curve([<curve referenced from the Rhino model> x90])
end_34 = EndPoints(Curve=crv_41)  # -> Start, End
end_35 = EndPoints(Curve=crv_42)  # -> Start, End
end_36 = EndPoints(Curve=crv_47)  # -> Start, End
end_37 = EndPoints(Curve=crv_48)  # -> Start, End
end_38 = EndPoints(Curve=crv_49)  # -> Start, End
end_39 = EndPoints(Curve=crv_50)  # -> Start, End
end_40 = EndPoints(Curve=crv_51)  # -> Start, End
end_41 = EndPoints(Curve=crv_68)  # -> Start, End
end_42 = EndPoints(Curve=crv_52)  # -> Start, End
end_43 = EndPoints(Curve=crv_69)  # -> Start, End
end_44 = EndPoints(Curve=crv_53)  # -> Start, End
end_45 = EndPoints(Curve=crv_54)  # -> Start, End
end_46 = EndPoints(Curve=crv_55)  # -> Start, End
end_47 = EndPoints(Curve=crv_56)  # -> Start, End
end_48 = EndPoints(Curve=crv_57)  # -> Start, End
end_49 = EndPoints(Curve=crv_58)  # -> Start, End
end_50 = EndPoints(Curve=crv_59)  # -> Start, End
end_51 = EndPoints(Curve=crv_60)  # -> Start, End
end_52 = EndPoints(Curve=crv_61)  # -> Start, End
end_53 = EndPoints(Curve=crv_62)  # -> Start, End
end_54 = EndPoints(Curve=crv_63)  # -> Start, End
end_55 = EndPoints(Curve=crv_64)  # -> Start, End
end_56 = EndPoints(Curve=crv_65)  # -> Start, End
end_57 = EndPoints(Curve=crv_66)  # -> Start, End
end_58 = EndPoints(Curve=crv_67)  # -> Start, End
end_59 = EndPoints(Curve=crv_43)  # -> Start, End
end_60 = EndPoints(Curve=crv_44)  # -> Start, End
end_61 = EndPoints(Curve=crv_45)  # -> Start, End
end_62 = EndPoints(Curve=crv_46)  # -> Start, End
hull_41 = ConvexHull(Points=[end_34.Start, end_34.End], Plane=PlaneXY(0, 0, 0))  # -> Hull, HullZ, Indices
hull_42 = ConvexHull(Points=[end_35.Start, end_35.End], Plane=PlaneXY(0, 0, 0))  # -> Hull, HullZ, Indices
hull_43 = ConvexHull(Points=[end_59.Start, end_59.End], Plane=PlaneXY(0, 0, 0))  # -> Hull, HullZ, Indices
hull_44 = ConvexHull(Points=[end_60.Start, end_60.End], Plane=PlaneXY(0, 0, 0))  # -> Hull, HullZ, Indices
hull_45 = ConvexHull(Points=[end_61.Start, end_61.End], Plane=PlaneXY(0, 0, 0))  # -> Hull, HullZ, Indices
hull_46 = ConvexHull(Points=[end_62.Start, end_62.End], Plane=PlaneXY(0, 0, 0))  # -> Hull, HullZ, Indices
hull_47 = ConvexHull(Points=[end_36.Start, end_36.End], Plane=PlaneXY(0, 0, 0))  # -> Hull, HullZ, Indices
hull_48 = ConvexHull(Points=[end_37.Start, end_37.End], Plane=PlaneXY(0, 0, 0))  # -> Hull, HullZ, Indices
hull_49 = ConvexHull(Points=[end_38.Start, end_38.End], Plane=PlaneXY(0, 0, 0))  # -> Hull, HullZ, Indices
hull_50 = ConvexHull(Points=[end_39.Start, end_39.End], Plane=PlaneXY(0, 0, 0))  # -> Hull, HullZ, Indices
hull_51 = ConvexHull(Points=[end_40.Start, end_40.End], Plane=PlaneXY(0, 0, 0))  # -> Hull, HullZ, Indices
hull_52 = ConvexHull(Points=[end_41.Start, end_41.End], Plane=PlaneXY(0, 0, 0))  # -> Hull, HullZ, Indices
hull_53 = ConvexHull(Points=[end_42.Start, end_42.End], Plane=PlaneXY(0, 0, 0))  # -> Hull, HullZ, Indices
hull_54 = ConvexHull(Points=[end_43.Start, end_43.End], Plane=PlaneXY(0, 0, 0))  # -> Hull, HullZ, Indices
hull_55 = ConvexHull(Points=[end_44.Start, end_44.End], Plane=PlaneXY(0, 0, 0))  # -> Hull, HullZ, Indices
hull_56 = ConvexHull(Points=[end_45.Start, end_45.End], Plane=PlaneXY(0, 0, 0))  # -> Hull, HullZ, Indices
hull_57 = ConvexHull(Points=[end_46.Start, end_46.End], Plane=PlaneXY(0, 0, 0))  # -> Hull, HullZ, Indices
hull_58 = ConvexHull(Points=[end_47.Start, end_47.End], Plane=PlaneXY(0, 0, 0))  # -> Hull, HullZ, Indices
hull_59 = ConvexHull(Points=[end_48.Start, end_48.End], Plane=PlaneXY(0, 0, 0))  # -> Hull, HullZ, Indices
hull_60 = ConvexHull(Points=[end_49.Start, end_49.End], Plane=PlaneXY(0, 0, 0))  # -> Hull, HullZ, Indices
hull_61 = ConvexHull(Points=end_50.Start, Plane=PlaneXY(0, 0, 0))  # -> Hull, HullZ, Indices
hull_62 = ConvexHull(Points=[end_51.Start, end_51.End], Plane=PlaneXY(0, 0, 0))  # -> Hull, HullZ, Indices
hull_63 = ConvexHull(Points=[end_52.Start, end_52.End], Plane=PlaneXY(0, 0, 0))  # -> Hull, HullZ, Indices
hull_64 = ConvexHull(Points=[end_53.Start, end_53.End], Plane=PlaneXY(0, 0, 0))  # -> Hull, HullZ, Indices
hull_65 = ConvexHull(Points=[end_54.Start, end_54.End], Plane=PlaneXY(0, 0, 0))  # -> Hull, HullZ, Indices
hull_66 = ConvexHull(Points=[end_55.Start, end_55.End], Plane=PlaneXY(0, 0, 0))  # -> Hull, HullZ, Indices
hull_67 = ConvexHull(Points=[end_56.Start, end_56.End], Plane=PlaneXY(0, 0, 0))  # -> Hull, HullZ, Indices
hull_68 = ConvexHull(Points=[end_57.Start, end_57.End], Plane=PlaneXY(0, 0, 0))  # -> Hull, HullZ, Indices
hull_69 = ConvexHull(Points=[end_58.Start, end_58.End], Plane=PlaneXY(0, 0, 0))  # -> Hull, HullZ, Indices
boundary = BoundarySurfaces(Edges=[hull_43.Hull, hull_44.Hull, hull_45.Hull, hull_46.Hull, hull_41.Hull, hull_42.Hull])
boundary_2 = BoundarySurfaces(Edges=[hull_48.Hull, hull_49.Hull, hull_50.Hull, hull_52.Hull, hull_53.Hull, hull_54.Hull, hull_55.Hull, hull_56.Hull, hull_57.Hull, hull_59.Hull, hull_60.Hull, hull_61.Hull, hull_62.Hull, hull_63.Hull, hull_64.Hull, hull_65.Hull, hull_66.Hull, hull_67.Hull, hull_68.Hull, hull_69.Hull, hull_47.Hull])
crv_70 = Curve([<curve referenced from the Rhino model> x17])
join = JoinCurves(Curves=[boundary_2, crv_70, boundary], Preserve=False)
outer_curve_arup = Curve(<curve referenced from the Rhino model>)
inner_curve_arup = Geometry(join)
# ARUP OBSTACLES
toggle = BooleanToggle(False)
boundary_3 = BoundarySurfaces(Edges=join)
rdiff = RegionDifference(CurvesA=outer_curve_arup, CurvesB=boundary_3)
bake = ObjectBake(
    BakeToggle=Toggle(False),
    GeometryObjects=inner_curve_arup,
    Layer="_gh_boundary_inner_ARUP",
    ObjectName="GH_Obj",
    ObjectColor=RGB(255, 255, 255),
    LayerColor=RGB(255, 255, 255))
bake_2 = ObjectBake(
    BakeToggle=toggle,
    GeometryObjects=outer_curve_arup,
    Layer="_gh_boundary_outer_ARUP",
    ObjectName="GH_Obj",
    ObjectColor=RGB(255, 255, 255),
    LayerColor=RGB(255, 255, 255))

# ---- group: Final Boundary_ARUP
boundary_4 = BoundarySurfaces(Edges=rdiff)

# ----
crv_71 = Curve([<curve referenced from the Rhino model> x5000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])
crv_72 = Curve([<curve referenced from the Rhino model> x2411])
crv_73 = Curve([<curve referenced from the Rhino model> x5000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])
crv_74 = Curve([<curve referenced from the Rhino model> x4806])
crv_75 = Curve([<curve referenced from the Rhino model> x4771])
crv_76 = Curve([<curve referenced from the Rhino model> x4806])
crv_77 = Curve([<curve referenced from the Rhino model> x5000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])
crv_78 = Curve([<curve referenced from the Rhino model> x13])
crv_79 = Curve([<curve referenced from the Rhino model> x24])
crv_80 = Curve([<curve referenced from the Rhino model> x32])
crv_81 = Curve([<curve referenced from the Rhino model> x12])
crv_82 = Curve([<curve referenced from the Rhino model> x5000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])
crv_83 = Curve([<curve referenced from the Rhino model> x5000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])
crv_84 = Curve([<curve referenced from the Rhino model> x5000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])
crv_85 = Curve([<curve referenced from the Rhino model> x13])
crv_86 = Curve([<curve referenced from the Rhino model> x49])
crv_87 = Curve([<curve referenced from the Rhino model> x3204])
crv_88 = Curve([<curve referenced from the Rhino model> x38])
divide_8 = DivideCurve(Curve=crv_82, Count=10, Kinks=False)  # -> flatten(Points), Tangents, Parameters
divide_9 = DivideCurve(Curve=crv_83, Count=10, Kinks=False)  # -> flatten(Points), Tangents, Parameters
divide_10 = DivideCurve(Curve=crv_71, Count=10, Kinks=False)  # -> flatten(Points), Tangents, Parameters
end_63 = EndPoints(Curve=crv_72)  # -> Start, End
end_64 = EndPoints(Curve=crv_73)  # -> Start, End
end_65 = EndPoints(Curve=crv_74)  # -> Start, End
end_66 = EndPoints(Curve=crv_75)  # -> Start, End
end_67 = EndPoints(Curve=crv_84)  # -> Start, End
end_68 = EndPoints(Curve=crv_76)  # -> Start, End
end_69 = EndPoints(Curve=crv_86)  # -> Start, End
end_70 = EndPoints(Curve=crv_77)  # -> Start, End
divide_11 = DivideCurve(Curve=crv_87, Count=10, Kinks=False)  # -> flatten(Points), Tangents, Parameters
divide_12 = DivideCurve(Curve=crv_88, Count=10, Kinks=False)  # -> flatten(Points), Tangents, Parameters
divide_13 = DivideCurve(Curve=crv_78, Count=10, Kinks=False)  # -> flatten(Points), Tangents, Parameters
end_71 = EndPoints(Curve=crv_79)  # -> Start, End
end_72 = EndPoints(Curve=crv_80)  # -> Start, End
end_73 = EndPoints(Curve=crv_81)  # -> Start, End
hull_70 = ConvexHull(Points=divide_8.Points, Plane=PlaneXY(0, 0, 0))  # -> Hull, HullZ, Indices
hull_71 = ConvexHull(Points=divide_9.Points, Plane=PlaneXY(0, 0, 0))  # -> Hull, HullZ, Indices
hull_72 = ConvexHull(Points=divide_10.Points, Plane=PlaneXY(0, 0, 0))  # -> Hull, HullZ, Indices
hull_73 = ConvexHull(Points=end_63.Start, Plane=PlaneXY(0, 0, 0))  # -> Hull, HullZ, Indices
hull_74 = ConvexHull(Points=[end_64.Start, end_64.End], Plane=PlaneXY(0, 0, 0))  # -> Hull, HullZ, Indices
hull_75 = ConvexHull(Points=[end_65.Start, end_65.End], Plane=PlaneXY(0, 0, 0))  # -> Hull, HullZ, Indices
hull_76 = ConvexHull(Points=[end_66.Start, end_66.End], Plane=PlaneXY(0, 0, 0))  # -> Hull, HullZ, Indices
hull_77 = ConvexHull(Points=[end_67.Start, end_67.End], Plane=PlaneXY(0, 0, 0))  # -> Hull, HullZ, Indices
hull_78 = ConvexHull(Points=[end_68.Start, end_68.End], Plane=PlaneXY(0, 0, 0))  # -> Hull, HullZ, Indices
hull_79 = ConvexHull(Points=[end_69.Start, end_69.End], Plane=PlaneXY(0, 0, 0))  # -> Hull, HullZ, Indices
hull_80 = ConvexHull(Points=[end_70.Start, end_70.End], Plane=PlaneXY(0, 0, 0))  # -> Hull, HullZ, Indices
hull_81 = ConvexHull(Points=divide_11.Points, Plane=PlaneXY(0, 0, 0))  # -> Hull, HullZ, Indices
hull_82 = ConvexHull(Points=divide_12.Points, Plane=PlaneXY(0, 0, 0))  # -> Hull, HullZ, Indices
hull_83 = ConvexHull(Points=divide_13.Points, Plane=PlaneXY(0, 0, 0))  # -> Hull, HullZ, Indices
hull_84 = ConvexHull(Points=end_71.Start, Plane=PlaneXY(0, 0, 0))  # -> Hull, HullZ, Indices
hull_85 = ConvexHull(Points=end_72.Start, Plane=PlaneXY(0, 0, 0))  # -> Hull, HullZ, Indices
hull_86 = ConvexHull(Points=end_73.Start, Plane=PlaneXY(0, 0, 0))  # -> Hull, HullZ, Indices

# ----
# BVN OBSTACLES
crv_89 = Curve([<curve referenced from the Rhino model> x82])
crv_90 = Curve([<curve referenced from the Rhino model> x37])
divide_14 = DivideCurve(Curve=crv_85, Count=20, Kinks=False)  # -> flatten(Points), Tangents, Parameters
divide_15 = DivideCurve(Curve=crv_90, Count=20, Kinks=False)  # -> flatten(Points), Tangents, Parameters
boundary_5 = BoundarySurfaces(Edges=[hull_16.Hull, hull_10.Hull, hull_11.Hull, hull_17.Hull, hull_12.Hull, hull_13.Hull, hull_14.Hull, hull_15.Hull])
boundary_6 = BoundarySurfaces(Edges=[hull_7.Hull, hull_9.Hull, hull_5.Hull, hull_8.Hull, hull_3.Hull, hull_4.Hull, hull_6.Hull, hull.Hull])
boundary_7 = BoundarySurfaces(Edges=[hull_23.Hull, hull_22.Hull, hull_21.Hull, hull_20.Hull, hull_19.Hull, hull_18.Hull, hull_24.Hull, hull_25.Hull, hull_26.Hull, hull_27.Hull, hull_28.Hull, hull_29.Hull, hull_30.Hull, hull_31.Hull, hull_32.Hull, hull_33.Hull, hull_34.Hull, hull_35.Hull, hull_36.Hull, hull_37.Hull, hull_38.Hull, hull_39.Hull, hull_40.Hull])
columns = Surface([<surface referenced from the Rhino model> x11])
outer_curve_bvn = Curve(<curve referenced from the Rhino model>)
boundary_8 = BoundarySurfaces(Edges=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)
bake_3 = ObjectBake(
    BakeToggle=Toggle(False),
    GeometryObjects=outer_curve_bvn,
    Layer="_gh_boundary_outer_BVN",
    ObjectName="GH_Obj",
    ObjectColor=RGB(255, 255, 255),
    LayerColor=RGB(255, 255, 255))

end_74 = EndPoints(Curve=crv_89)  # -> Start, End
hull_87 = ConvexHull(Points=[end_74.Start, end_74.End], Plane=PlaneXY(0, 0, 0))  # -> Hull, HullZ, Indices
hull_88 = ConvexHull(Points=divide_14.Points, Plane=PlaneXY(0, 0, 0))  # -> Hull, HullZ, Indices

crv_91 = Curve([<curve referenced from the Rhino model> x536])
crv_92 = Curve([<curve referenced from the Rhino model> x321])
crv_93 = Curve([<curve referenced from the Rhino model> x642])
crv_94 = Curve([<curve referenced from the Rhino model> x81])
crv_95 = Curve([<curve referenced from the Rhino model> x131])
crv_96 = Curve([<curve referenced from the Rhino model> x772])
crv_97 = Curve([<curve referenced from the Rhino model> x219])
crv_98 = Curve([<curve referenced from the Rhino model> x64])
crv_99 = Curve([<curve referenced from the Rhino model> x8])
crv_100 = Curve([<curve referenced from the Rhino model> x35])
crv_101 = Curve([<curve referenced from the Rhino model> x35])
crv_102 = Curve([<curve referenced from the Rhino model> x35])
crv_103 = Curve([<curve referenced from the Rhino model> x35])
crv_104 = Curve([<curve referenced from the Rhino model> x52])
crv_105 = Curve([<curve referenced from the Rhino model> x217])
crv_106 = Curve([<curve referenced from the Rhino model> x233])
crv_107 = Curve([<curve referenced from the Rhino model> x19])
crv_108 = Curve([<curve referenced from the Rhino model> x4])
crv_109 = Curve([<curve referenced from the Rhino model> x12])
crv_110 = Curve([<curve referenced from the Rhino model> x69])
crv_111 = Curve([<curve referenced from the Rhino model> x80])
crv_112 = Curve([<curve referenced from the Rhino model> x61])
crv_113 = Curve([<curve referenced from the Rhino model> x8])
divide_16 = DivideCurve(Curve=crv_95, Count=10, Kinks=False)  # -> flatten(Points), Tangents, Parameters
divide_17 = DivideCurve(Curve=crv_96, Count=10, Kinks=False)  # -> flatten(Points), Tangents, Parameters
divide_18 = DivideCurve(Curve=crv_97, Count=10, Kinks=False)  # -> flatten(Points), Tangents, Parameters
end_75 = EndPoints(Curve=crv_98)  # -> Start, End
divide_19 = DivideCurve(Curve=crv_105, Count=10, Kinks=False)  # -> flatten(Points), Tangents, Parameters
divide_20 = DivideCurve(Curve=crv_106, Count=10, Kinks=False)  # -> flatten(Points), Tangents, Parameters
divide_21 = DivideCurve(Curve=crv_107, Count=10, Kinks=False)  # -> flatten(Points), Tangents, Parameters
end_76 = EndPoints(Curve=crv_108)  # -> Start, End
end_77 = EndPoints(Curve=crv_93)  # -> Start, End
end_78 = EndPoints(Curve=crv_92)  # -> Start, End
end_79 = EndPoints(Curve=crv_110)  # -> Start, End
end_80 = EndPoints(Curve=crv_109)  # -> Start, End
end_81 = EndPoints(Curve=crv_112)  # -> Start, End
end_82 = EndPoints(Curve=crv_111)  # -> Start, End
end_83 = EndPoints(Curve=crv_113)  # -> Start, End
hull_89 = ConvexHull(Points=divide_16.Points, Plane=PlaneXY(0, 0, 0))  # -> Hull, HullZ, Indices
hull_90 = ConvexHull(Points=divide_17.Points, Plane=PlaneXY(0, 0, 0))  # -> Hull, HullZ, Indices
hull_91 = ConvexHull(Points=divide_18.Points, Plane=PlaneXY(0, 0, 0))  # -> Hull, HullZ, Indices
hull_92 = ConvexHull(Points=end_75.Start, Plane=PlaneXY(0, 0, 0))  # -> Hull, HullZ, Indices
hull_93 = ConvexHull(Points=[end_78.Start, end_78.End], Plane=PlaneXY(0, 0, 0))  # -> Hull, HullZ, Indices
hull_94 = ConvexHull(Points=divide_15.Points, Plane=PlaneXY(0, 0, 0))  # -> Hull, HullZ, Indices
hull_95 = ConvexHull(Points=divide_19.Points, Plane=PlaneXY(0, 0, 0))  # -> Hull, HullZ, Indices
hull_96 = ConvexHull(Points=divide_20.Points, Plane=PlaneXY(0, 0, 0))  # -> Hull, HullZ, Indices
hull_97 = ConvexHull(Points=divide_21.Points, Plane=PlaneXY(0, 0, 0))  # -> Hull, HullZ, Indices
hull_98 = ConvexHull(Points=end_76.Start, Plane=PlaneXY(0, 0, 0))  # -> Hull, HullZ, Indices
hull_99 = ConvexHull(Points=end_77.Start, Plane=PlaneXY(0, 0, 0))  # -> Hull, HullZ, Indices
hull_100 = ConvexHull(Points=end_79.Start, Plane=PlaneXY(0, 0, 0))  # -> Hull, HullZ, Indices
hull_101 = ConvexHull(Points=end_80.Start, Plane=PlaneXY(0, 0, 0))  # -> Hull, HullZ, Indices
hull_102 = ConvexHull(Points=end_81.Start, Plane=PlaneXY(0, 0, 0))  # -> Hull, HullZ, Indices
hull_103 = ConvexHull(Points=end_82.Start, Plane=PlaneXY(0, 0, 0))  # -> Hull, HullZ, Indices
hull_104 = ConvexHull(Points=end_83.Start, Plane=PlaneXY(0, 0, 0))  # -> Hull, HullZ, Indices

divide_22 = DivideCurve(Curve=crv_99, Count=20, Kinks=False)  # -> flatten(Points), Tangents, Parameters
divide_23 = DivideCurve(Curve=crv_102, Count=20, Kinks=False)  # -> flatten(Points), Tangents, Parameters
divide_24 = DivideCurve(Curve=crv_91, Count=20, Kinks=False)  # -> flatten(Points), Tangents, Parameters
divide_25 = DivideCurve(Curve=crv_101, Count=20, Kinks=False)  # -> flatten(Points), Tangents, Parameters
divide_26 = DivideCurve(Curve=crv_103, Count=10, Kinks=False)  # -> flatten(Points), Tangents, Parameters
divide_27 = DivideCurve(Curve=crv_94, Count=10, Kinks=False)  # -> flatten(Points), Tangents, Parameters
divide_28 = DivideCurve(Curve=crv_100, Count=20, Kinks=False)  # -> flatten(Points), Tangents, Parameters
divide_29 = DivideCurve(Curve=crv_104, Count=10, Kinks=False)  # -> flatten(Points), Tangents, Parameters
boundary_9 = BoundarySurfaces(Edges=[hull_70.Hull, hull_71.Hull, hull_72.Hull, hull_73.Hull, hull_74.Hull, hull_75.Hull, hull_76.Hull, hull_77.Hull, hull_78.Hull, hull_87.HullZ, hull_88.Hull, hull_79.Hull, hull_80.Hull, hull_81.Hull, hull_82.Hull, hull_83.Hull, hull_84.Hull, hull_85.Hull, hull_86.Hull])

hull_105 = ConvexHull(Points=divide_24.Points, Plane=PlaneXY(0, 0, 0))  # -> Hull, HullZ, Indices
hull_106 = ConvexHull(Points=divide_22.Points, Plane=PlaneXY(0, 0, 0))  # -> Hull, HullZ, Indices
hull_107 = ConvexHull(Points=divide_25.Points, Plane=PlaneXY(0, 0, 0))  # -> Hull, HullZ, Indices
hull_108 = ConvexHull(Points=divide_23.Points, Plane=PlaneXY(0, 0, 0))  # -> Hull, HullZ, Indices
hull_109 = ConvexHull(Points=divide_26.Points, Plane=PlaneXY(0, 0, 0))  # -> Hull, HullZ, Indices
hull_110 = ConvexHull(Points=divide_29.Points, Plane=PlaneXY(0, 0, 0))  # -> Hull, HullZ, Indices
hull_111 = ConvexHull(Points=divide_27.Points, Plane=PlaneXY(0, 0, 0))  # -> Hull, HullZ, Indices
hull_112 = ConvexHull(Points=divide_28.Points, Plane=PlaneXY(0, 0, 0))  # -> Hull, HullZ, Indices

boundary_10 = BoundarySurfaces(Edges=[hull_90.Hull, hull_89.Hull, hull_91.Hull, hull_92.Hull, hull_105.Hull, hull_106.Hull, hull_93.Hull, hull_112.Hull, hull_107.Hull, hull_94.Hull, hull_108.Hull, hull_109.Hull, hull_110.Hull, hull_95.Hull, hull_96.Hull, hull_97.Hull, hull_98.Hull, hull_99.Hull, hull_111.Hull, hull_101.Hull, hull_104.Hull, hull_100.Hull, hull_103.Hull, hull_102.Hull])
join_2 = JoinCurves(Curves=[boundary_10, boundary_7, boundary_9, boundary_6, boundary_5, columns], Preserve=False)
inner_curve_bvn = Geometry(join_2)
rdiff_2 = RegionDifference(CurvesA=boundary_8, CurvesB=join_2)  # disabled
bake_4 = ObjectBake(
    BakeToggle=Toggle(True),
    GeometryObjects=inner_curve_bvn,
    Layer="_gh_boundary_inner_BVN",
    ObjectName="GH_Obj",
    ObjectColor=RGB(255, 255, 255),
    LayerColor=RGB(255, 255, 255))

# ---- group: Final Boundary_BVN
boundary_11 = BoundarySurfaces(Edges=rdiff_2)
