# Grasshopper definition 04_BasestationToBasestation.gh (Grasshopper 0.9.75)
# plug-ins: Python Interpreter, Human, Agent, Shortest Walk in Gh

# ----
# Names/UUID
# This gets all the unique names. Because it's using toy data we can use names. On the real data we'd need to use UUIDs.
windows_samplerealdata = FilePath("F:\BlankMindBlog\helpers\gh_visualisation\json_detection data\dumpdata.json")
windows_fakedata = FilePath("F:\BlankMindBlog\helpers\gh_visualisation\json_detection data\fakedata.json")
linuxpath = FilePath("\\VBOXSVR\projects\tuksun\BlankMindBlog\helpers\gh_visualisation\json_detection data\fakedata.json")
names = PythonScript(FilePath=windows_samplerealdata)  # -> flatten(uuids)
# ---------- names: Python ----------
import json

if FilePath:
    
    # JSON file to read
    file = open(FilePath)
    
    # Load the data
    data = json.load(file)
    
    uuids = []
    
    for d in data:
        uuids.append( d['uuid'] )
    
    print uuids
# ---------- end names ----------
panel = Panel(windows_fakedata)
names_2 = PythonScript(FilePath=windows_fakedata)  # -> flatten(names)
# ---------- names_2: Python ----------
import json

if FilePath:
    
    # JSON file to read
    file = open(FilePath)
    
    # Load the data
    data = json.load(file)
    
    names = []
    
    for d in data:
        names.append( d['name'] )
    
    print names
# ---------- end names_2 ----------
create_set = CreateSet(List=names_2)  # -> Set, Map
create_set_2 = CreateSet(List=names)  # -> Set, Map
panel_2 = Panel(create_set_2.Set)
panel_3 = Panel(create_set.Set)

windows_samplerealdata_2 = FilePath("F:\BlankMindBlog\helpers\gh_visualisation\json_detection data\dumpdata.json")
windows_simdata = FilePath("F:\BlankMindBlog\helpers\gh_visualisation\json_detection data\simdata.json")
names_3 = PythonScript(FilePath=windows_simdata)  # -> uuids, a; same code as names
create_set_3 = CreateSet(List=names_3.uuids)  # -> Set, Map
panel_4 = Panel(create_set_3.Set)

# ----
# Basestations
# This draws out the points that corespond to the base stations.
# I've cheated and put in a static list of base stations instead of reading it froma file. This is for laziness and for performance (that list doesn't change much).
arup_basestations = Panel("""RPI001
RPI002
RPI003
RPI004
RPI005
RPI006
RPI007
RPI008
RPI009
RPI010
RPI011
RPI012
RPI013
RPI014
RPI015
RPI016
RPI017
RPI018
RPI019
RPI020
RPI021
RPI022
RPI023
RPI024
RPI025
RPI026
RPI027
RPI028
RPI029
RPI030
RPI031
RPI032
RPI033
RPI034
RPI035
RPI036
RPI037""")
bvn_basestations = Panel("""RPI004
RPI005
RPI006
RPI007
RPI008
RPI009
RPI010
RPI011
RPI012
RPI013
RPI014
RPI015
RPI016
RPI017
RPI018
RPI019
RPI020
RPI021
RPI022
RPI023
RPI024
RPI025
RPI026
RPI027
RPI028
RPI029
RPI030
RPI031
RPI032
RPI033
RPI034
RPI035
RPI036
RPI037
RPI038
RPI039
RPI040
RPI041
RPI042""")
arup_path = FilePath("F:\BlankMindBlog\helpers\basestation_location\baseStations_ARUP.json")
bvn_path = FilePath("F:\BlankMindBlog\helpers\basestation_location\baseStations_BVN.json")
list_of_basestations = ListOfBasestations(filepath=bvn_path, inputname=bvn_basestations)  # -> x, y
x_y_coords = ConstructPoint(XCoordinate=list_of_basestations.x, YCoordinate=list_of_basestations.y, ZCoordinate=0)
sort_points = SortPoints(Points=x_y_coords)  # -> Points, Indices
text_tag_3d = TextTag3D(Location=sort_points.Points, Text=arup_basestations, Size=1562, Colour=RGB(3, 217, 255), Justification=5)
deconstruct = Deconstruct(Point=sort_points.Points)  # -> XComponent, YComponent, ZComponent
panel_5 = Panel(deconstruct.YComponent)
panel_6 = Panel(deconstruct.XComponent)

# ----
# Detections
# Given a list of names, this finds all the detections related to each of those names and returns them as a list of lists.
json_detections = PythonScript(FilePath=windows_fakedata, name=create_set.Set)  # -> data, base, time
# ---------- json_detections: Python ----------
import json

if FilePath:
    
    # JSON file to read
    file = open(FilePath)
    
    # Load the data
    detections = json.load(file)
    data = str(detections)
    
    time = []
    base = []
    
    for detection in detections:
        if detection["name"] == name:
            print detection
            time.append( detection["time"] )
            base.append( detection["basestation"] )
# ---------- end json_detections ----------
json_detections_2 = PythonScript(FilePath=windows_simdata, uuid=panel_4)  # -> agent, time
# ---------- json_detections_2: Python ----------
import json

if FilePath:
    
    # JSON file to read
    file = open(FilePath)
    
    # Load the data
    detections = json.load(file)
    #data = str(detections)
    
    time = []
    agent = []
    
    for d in detections:
        if d['uuid'] == uuid:
#            print detection
            time.append( d['time'] )
            agent.append( d['agentId'] )
# ---------- end json_detections_2 ----------
create_set_4 = CreateSet(List=json_detections_2.agent)  # -> Set, Map
panel_7 = Panel(json_detections_2.time)
panel_8 = Panel(json_detections.base)
panel_9 = Panel(json_detections.time)
panel_10 = Panel(json_detections_2.agent)
panel_11 = Panel(create_set_4.Set)

text_split = TextSplit(Text=panel_7)

# ----
# This maps the points so that the path is continous e.g. [0] to [1], [1] to [2]....
joining_curves = PythonScript(agent=json_detections_2.agent)  # -> start, end; inputs agent: list
# ---------- joining_curves: Python ----------
import ghpythonlib as gh

x = 0
start = []
end = []

while x < len(agent)-1:
    start.append(agent[x])
    end.append(agent[x + 1])
    x = x + 1
    
    print start
    print end
# ---------- end joining_curves ----------
panel_12 = Panel(joining_curves.start)
panel_13 = Panel(joining_curves.end)

# ----
# This takes list of detections and
# returns the x, y coords of the basestations
# Start and End Pts
number_slider = Slider(313, range=0..1000)
detection_of_end_point = ListOfBasestations(filepath=bvn_path, inputname=panel_13)  # -> x, y
detection_of_start_point = ListOfBasestations(filepath=bvn_path, inputname=panel_12)  # -> x, y
end_pts = ConstructPoint(XCoordinate=detection_of_end_point.x, YCoordinate=detection_of_end_point.y, ZCoordinate=0)
start_pts = ConstructPoint(XCoordinate=detection_of_start_point.x, YCoordinate=detection_of_start_point.y, ZCoordinate=0)
panel_14 = Panel(end_pts)
panel_15 = Panel(start_pts)
sphere = Sphere(Base=[start_pts, end_pts], Radius=number_slider)

# ----
# Direct Path
# What the path should be without the obstacles
number_slider_2 = Slider(72, range=0..100)
line = Line(StartPoint=panel_15, EndPoint=panel_14)
pipe = Pipe(Curve=line, Radius=number_slider_2, Caps=0)

# ----
# Obstacles and Nav Mesh BVN
geometry_pipeline = GeometryPipeline(
    GroupByLayer=False,
    GroupByType=False,
    IncludeHidden=True,
    IncludeLocked=True,
    LayerFilter="_gh_nav_graph_BVN",
    NameFilter="*",
    TypeFilter=4)
data_dam = DataDam(DataDataA=geometry_pipeline, BufferDelay=10000000, BufferMode=0)
geometry = Geometry(data_dam)

construct_particle = ConstructParticle(
    UpDirection=Vector(0, 0, 1),
    Acceleration=Vector(0, 0, 0),
    Lifespan=30,
    Mass=1,
    BodySize=Slider(100, range=0..100),
    HistoryLength=Slider(10, range=0..10))
point_emitter = PointEmitter(
    ContinuousFlow=True,
    CreationRate=1,
    NumberOfQuelea=0,
    MinimumInitialVelocity=Vector(-0.1, -0.1, -0.1),
    MaximumInitialVelocity=Vector(0.1, 0.1, 0.1),
    Point=Point(0, 0, 0))
construct_agent = ConstructAgent(
    ParticleQueleaSettings=construct_particle,
    MaxSpeed=0.5,
    MaxForce=0.1,
    VisionRadius=Slider(20, range=0..100),
    VisionAngle=360)
curve = Curve([<curve referenced from the Rhino model> x2])
system = System(QueleaSettings=construct_agent, Emitters=point_emitter)  # -> System, Quelea, QueleaNetwork
construct_point = ConstructPoint(XCoordinate=0, YCoordinate=Slider(100, range=0..100), ZCoordinate=0)
point = Point(<point referenced from the Rhino model>)
timer = Timer(TimerInterval=20, Target=[engine, system])
duplcrvs = RemoveDuplicateCurves(C=curve)  # -> out, UC, DC, DI; inputs C: list of Curve
# ---------- duplcrvs: Python ----------
#********************************************************************************************#
#********* Select duplicate curves **********************************************************#
#********* by Djordje Spasic ****************************************************************#
#********* issworld2000@yahoo.com 16-May-2014 ***********************************************#

"""
Removes all duplicate curves, whether they're positioned on top of each other or scattered around.
Supports any kind of curves (lines, polyline, rectangles, circles, arcs, freeform curves, helix... ).
Supports both lists and datatrees as inputs - and removes different types of curve duplicates from 
the same list or branch:

    Input:
        C: The curves you wish to "clean" from duplicates
        tol: Tolerances. If not supplied, Rhino's Model absolute tolerances will be used
        plusFlipped: This will clean the curves of the same shape, but flipped
        onlyOverlapped: Only equal curves positioned on top of each other will be considered, not those scattered around
    Output:
        readMe!: ...
        UC: Unique curves
        DC: Duplicate curves
        DI: Duplicate indices
"""

ghenv.Component.Name = "Remove duplicate curves"
ghenv.Component.NickName = "duplCrvs"
ghenv.Component.Category = "Milkbox"
ghenv.Component.SubCategory = "Curves"
try: ghenv.Component.AdditionalHelpFromDocStrings = "1"
except: pass

import scriptcontext as sc
import Rhino

def cullDuplicateCurves(_crvs, _t, _tol, _flippedCrvs, _overlapped):
    duplCrvs = []
    nc_objs = [crv.ToNurbsCurve() for crv in _crvs]
    indx = []
    for i in range(len(nc_objs)):
        for k in range(len(nc_objs)):
            if (i != k) and (i not in indx) and (k not in indx) and (round(nc_objs[i].GetLength(), 3) == round(nc_objs[k].GetLength(), 3)):
                    if nc_objs[i].EpsilonEquals(nc_objs[k], _t):
                        crv1TVst = nc_objs[i].TangentAt(nc_objs[i].Domain[0])
                        crv1CVst = nc_objs[i].CurvatureAt(nc_objs[i].Domain[0])
                        crv1t1 = round( nc_objs[i].NormalizedLengthParameter( 0.33, Rhino.Geometry.Interval(0, nc_objs[i].GetLength()) )[1], 3 )
                        crv1CVmid1 = nc_objs[i].CurvatureAt(crv1t1)
                        crv1t2 = round( nc_objs[i].NormalizedLengthParameter( 0.66, Rhino.Geometry.Interval(0, nc_objs[i].GetLength()) )[1], 3 )
                        crv1CVmid2 = nc_objs[i].CurvatureAt(crv1t2)
                        crv1CVend = nc_objs[i].CurvatureAt(nc_objs[i].Domain[1])
                        crv1TVend = nc_objs[i].TangentAt(nc_objs[i].Domain[1])

                        crv2TVst = nc_objs[k].TangentAt(nc_objs[k].Domain[0])
                        crv2CVst = nc_objs[k].CurvatureAt(nc_objs[k].Domain[0])
                        crv2t1 = round( nc_objs[k].NormalizedLengthParameter( 0.33, Rhino.Geometry.Interval(0, nc_objs[k].GetLength()) )[1], 3 )
                        crv2CVmid1 = nc_objs[i].CurvatureAt(crv2t1)
                        crv2t2 = round( nc_objs[k].NormalizedLengthParameter( 0.66, Rhino.Geometry.Interval(0, nc_objs[k].GetLength()) )[1], 3 )
                        crv2CVmid2 = nc_objs[i].CurvatureAt(crv2t2)
                        crv2CVend = nc_objs[k].CurvatureAt(nc_objs[k].Domain[1])
                        crv2TVend = nc_objs[k].TangentAt(nc_objs[k].Domain[1])

                        if _flippedCrvs == False and _overlapped == False:
                            if ( crv1TVst.EpsilonEquals(crv2TVst, _tol) and crv1CVst.EpsilonEquals(crv2CVst, _tol) and crv1CVmid1.EpsilonEquals(crv2CVmid1, _tol) and crv1CVmid2.EpsilonEquals(crv2CVmid2, _tol) and crv1CVend.EpsilonEquals(crv2CVend, _tol) and crv1TVend.EpsilonEquals(crv2TVend, _tol) ):
                                indx.append(i)
                        elif _flippedCrvs == True and _overlapped == False:
                            crv2TVstR = Rhino.Geometry.Vector3d(crv2TVst)
                            crv2TVstR.Reverse()
                            crv2TVendR = Rhino.Geometry.Vector3d(crv2TVend)
                            crv2TVendR.Reverse()
    
                            crv2R = nc_objs[k].Duplicate()
                            crv2R.Reverse()
                            crv2TVstRR = crv2R.TangentAt(crv2R.Domain[0])
                            crv2CVstR = crv2R.CurvatureAt(crv2R.Domain[0])
                            crv2t1R = round( crv2R.NormalizedLengthParameter( 0.33, Rhino.Geometry.Interval(0, crv2R.GetLength()) )[1], 3 )
                            crv2CVmid1R = crv2R.CurvatureAt(crv2t1R)
                            crv2t2R = round( crv2R.NormalizedLengthParameter( 0.66, Rhino.Geometry.Interval(0, crv2R.GetLength()) )[1], 3 )
                            crv2CVmid2R = crv2R.CurvatureAt(crv2t2R)
                            crv2CVendR = crv2R.CurvatureAt(crv2R.Domain[1])
                            crv2TVendRR = crv2R.TangentAt(crv2R.Domain[1])
                            if ( crv1TVst.EpsilonEquals(crv2TVst, _tol) and crv1CVst.EpsilonEquals(crv2CVst, _tol) and crv1CVmid1.EpsilonEquals(crv2CVmid1, _tol) and crv1CVmid2.EpsilonEquals(crv2CVmid2, _tol) and crv1CVend.EpsilonEquals(crv2CVend, _tol) and crv1TVend.EpsilonEquals(crv2TVend, _tol) )\
                            or ( crv1TVst.EpsilonEquals(crv2TVendR, _tol) and crv1CVst.EpsilonEquals(crv2CVend, _tol) and crv1CVmid1.EpsilonEquals(crv2CVmid2, _tol) and crv1CVmid2.EpsilonEquals(crv2CVmid1, _tol) and crv1CVend.EpsilonEquals(crv2CVst, _tol) and crv1TVend.EpsilonEquals(crv2TVstR, _tol) )\
                            or ( crv1TVst.EpsilonEquals(crv2TVstRR, _tol) and crv1CVst.EpsilonEquals(crv2CVstR, _tol) and crv1CVmid1.EpsilonEquals(crv2CVmid1R, _tol) and crv1CVmid2.EpsilonEquals(crv2CVmid2R, _tol) and crv1CVend.EpsilonEquals(crv2CVendR, _tol) and crv1TVend.EpsilonEquals(crv2TVendRR, _tol) ):
                                indx.append(i)
                        elif _flippedCrvs == False and _overlapped == True:
                            t1 = (nc_objs[i].Domain[0]+nc_objs[i].Domain[1])/2
                            midCrv1 = nc_objs[i].PointAt(t1)
                            t2 = (nc_objs[k].Domain[0]+nc_objs[k].Domain[1])/2
                            midCrv2 = nc_objs[k].PointAt(t2)
                            if ( midCrv1.EpsilonEquals(midCrv2, _tol) and crv1TVst.EpsilonEquals(crv2TVst, _tol) and crv1CVst.EpsilonEquals(crv2CVst, _t) and crv1CVmid1.EpsilonEquals(crv2CVmid1, _tol) and crv1CVmid2.EpsilonEquals(crv2CVmid2, _tol) and crv1CVend.EpsilonEquals(crv2CVend, _tol) and crv1TVend.EpsilonEquals(crv2TVend, _tol) ):
                                indx.append(i)
                        elif _flippedCrvs == True and _overlapped == True:
                            crv2TVstR = Rhino.Geometry.Vector3d(crv2TVst)
                            crv2TVstR.Reverse()
                            crv2TVendR = Rhino.Geometry.Vector3d(crv2TVend)
                            crv2TVendR.Reverse()
    
                            crv2R = nc_objs[k].Duplicate()
                            crv2R.Reverse()
                            crv2TVstRR = crv2R.TangentAt(crv2R.Domain[0])
                            crv2CVstR = crv2R.CurvatureAt(crv2R.Domain[0])
                            crv2t1R = round( crv2R.NormalizedLengthParameter( 0.33, Rhino.Geometry.Interval(0, crv2R.GetLength()) )[1], 3 )
                            crv2CVmid1R = crv2R.CurvatureAt(crv2t1R)
                            crv2t2R = round( crv2R.NormalizedLengthParameter( 0.66, Rhino.Geometry.Interval(0, crv2R.GetLength()) )[1], 3 )
                            crv2CVmid2R = crv2R.CurvatureAt(crv2t2R)
                            crv2CVendR = crv2R.CurvatureAt(crv2R.Domain[1])
                            crv2TVendRR = crv2R.TangentAt(crv2R.Domain[1])

                            t1 = (nc_objs[i].Domain[0]+nc_objs[i].Domain[1])/2
                            midCrv1 = nc_objs[i].PointAt(t1)
                            t2 = (nc_objs[k].Domain[0]+nc_objs[k].Domain[1])/2
                            midCrv2 = nc_objs[k].PointAt(t2)
                            if ( midCrv1.EpsilonEquals(midCrv2, _tol) and crv1TVst.EpsilonEquals(crv2TVst, _tol) and crv1CVst.EpsilonEquals(crv2CVst, _t) and crv1CVmid1.EpsilonEquals(crv2CVmid1, _tol) and crv1CVmid2.EpsilonEquals(crv2CVmid2, _tol) and crv1CVend.EpsilonEquals(crv2CVend, _tol) and crv1TVend.EpsilonEquals(crv2TVend, _tol) )\
                            or ( midCrv1.EpsilonEquals(midCrv2, _tol) and crv1TVst.EpsilonEquals(crv2TVendR, _tol) and crv1CVst.EpsilonEquals(crv2CVend, _tol) and crv1CVmid1.EpsilonEquals(crv2CVmid2, _tol) and crv1CVmid2.EpsilonEquals(crv2CVmid1, _tol) and crv1CVend.EpsilonEquals(crv2CVst, _tol) and crv1TVend.EpsilonEquals(crv2TVstR, _tol) )\
                            or ( midCrv1.EpsilonEquals(midCrv2, _tol) and crv1TVst.EpsilonEquals(crv2TVstRR, _tol) and crv1CVst.EpsilonEquals(crv2CVstR, _tol) and crv1CVmid1.EpsilonEquals(crv2CVmid1R, _tol) and crv1CVmid2.EpsilonEquals(crv2CVmid2R, _tol) and crv1CVend.EpsilonEquals(crv2CVendR, _tol) and crv1TVend.EpsilonEquals(crv2TVendRR, _tol) ):
                                indx.append(i)
    crvsIndexes = range(len(_crvs))
    uniqCrvs = []
    for index in indx:
        duplCrvs.append(_crvs[index])
    for index2 in crvsIndexes:
        if index2 not in indx:
            uniqCrvs.append(_crvs[index2])

    if len(indx) > 0:
        print "Found %s duplicate curves" % len(indx)
        return [duplCrvs, indx, uniqCrvs]
    else:
        print "No duplicate curves found"
        return [[], [], C]

if not tol:
    tol = Rhino.RhinoDoc.ActiveDoc.ModelAbsoluteTolerance
if not plusFlipped:
    plusFlipped = True
if not onlyOverlapped:
    onlyOverlapped = False

if C:
    if len(C)>1:
        t = 100000000
        a = cullDuplicateCurves(C, t, tol, plusFlipped, onlyOverlapped)
        UC = a[2]
        DC = a[0]
        DI = a[1]
    else:
        UC = []
        DC = []
        DI = []
        print "ONLY ONE CURVE HAS BEEN INPUTTED."
else:
    print "INPUT PARAMETER \"C\" FAILED TO COLLECT CURVE DATA !!!"
# ---------- end duplcrvs ----------
colour = Colour(panel_4)
engine = Engine(Reset=Toggle(False), System=system.System)
move = Move(Geometry=duplcrvs.DC, Motion=construct_point)  # -> Geometry, Transform
arrive_force = ArriveForce(
    Apply=Toggle(False),
    WeightMultiplier=1,
    AgentQuelea=system.Quelea,
    TargetPoint=point,
    ArrivalRadius=Slider(100, range=0..100))  # -> Force, DesiredVelocity
get_particle_position = GetParticlePosition(ParticleQuelea=system.Quelea)  # -> Position, SurfacePosition
point_2 = Point(<point referenced from the Rhino model>)
panel_16 = Panel(move.Geometry)
deconstruct_quelea_network = DeconstructQueleaNetwork()
arrive_force_2 = ArriveForce(Apply=Toggle(False), WeightMultiplier=1, AgentQuelea=system.Quelea, TargetPoint=point_2, ArrivalRadius=5)  # -> Force, DesiredVelocity

# ----
# shortest walk/ simulated data
shortest_walk = ShortestWalk(Curves=geometry, WantedPath=line)  # -> ShortestWalk, Succession, Direction, Length
point_on_curve = PointOnCurve(shortest_walk.ShortestWalk, parameter=0)
text_tag_3d_2 = TextTag3D(
    Location=point_on_curve,
    Text=graft(create_set.Set),
    Size=Slider(1297, range=0..5000),
    Colour=RGB(255, 0, 0),
    Justification=7)

len = Length(Curve=shortest_walk.ShortestWalk)
bnd = Bounds(Numbers=len)
dedomain = DeconstructDomain(Domain=bnd)  # -> Start, End
curve_2 = Curve(shortest_walk.ShortestWalk)
evaluate_curve = EvaluateCurve(Curve=shortest_walk.ShortestWalk, Parameter=Slider(0, range=0..100000))  # -> Point, Tangent, Angle
discontinuity = Discontinuity(Curve=shortest_walk.ShortestWalk, Level=1)  # -> Points, Parameters
length = Length(Curve=shortest_walk.ShortestWalk)
gradient = Gradient(
    LowerLimit=dedomain.Start,
    UpperLimit=dedomain.End,
    Parameter=len,
    stops=[0: RGB(255, 0, 0), 0.171: RGB(255, 212, 0), 0.342: RGB(81, 255, 0), 0.496: RGB(0, 255, 136), 0.667: RGB(0, 153, 255), 0.821: RGB(42, 0, 255), 1: RGB(255, 0, 255)])
nurbs_curve = NurbsCurve(Vertices=discontinuity.Points, Degree=3, Periodic=False)  # -> Curve, Length, Domain
pipe_2 = Pipe(Curve=shortest_walk.ShortestWalk, Radius=Slider(80, range=0..100), Caps=0)
panel_17 = Panel(length)
nurbs_curve_2 = NurbsCurve(Vertices=discontinuity.Points, Degree=3, Periodic=False)  # -> Curve, Length, Domain

mesh_sphere = MeshSphere(Base=evaluate_curve.Point, Radius=1000, UCount=5, VCount=4)

previewlw = CustomPreviewLineweights(Geometry=shortest_walk.ShortestWalk, Shader=gradient, Thickness=Slider(3, range=0..10))

# ----
# Checkpoints
evaluate_length = EvaluateLength(Curve=shortest_walk.ShortestWalk, Length=[0, 1], Normalized=True)  # -> Point, Tangent, Parameter
unit_z = UnitZ(Factor=1)
cross_product = CrossProduct(VectorA=unit_z, VectorB=evaluate_length.Tangent, Unitize=False)  # -> Vector, Length
center_box = CenterBox(Base=evaluate_length.Point, X=0.1, Y=0.1, Z=0.07)
construct_plane = Plane(Origin=evaluate_length.Point, XAxis=cross_product.Vector, YAxis=unit_z)
T = Text(["START", "GOAL"])
text_tag = TextTag(Location=construct_plane, Text=T)

# ----
# Vectors Along Path
list_item = ListItem(List=geometry, Index=shortest_walk.Succession, Wrap=False)
end_points = EndPoints(Curve=list_item)  # -> Start, End
evaluate_length_2 = EvaluateLength(Curve=list_item, Length=0.5, Normalized=True)  # -> Point, Tangent, Parameter
vector_2pt = Vector2Pt(PointA=end_points.Start, PointB=end_points.End, Unitize=False)  # -> Vector, Length
remap_numbers = RemapNumbers(Values=shortest_walk.Direction, Source=Domain(0, 1), Target=Domain(-0.1, 0.1))
amplitude = Amplitude(Vector=vector_2pt.Vector, Amplitude=remap_numbers)
vector_display = VectorDisplay(Anchor=evaluate_length_2.Point, Vector=amplitude)

panel_18 = Panel(nurbs_curve_2.Curve)

# ==== cluster ListOfBasestations
inputname = ClusterInput()
filepath = ClusterInput()
data_json = PythonScript(FilePath=filepath, inputName=inputname)  # -> out, x, y
# ---------- data_json: Python ----------
import json

if FilePath:
    
    # JSON file to read
    file = open(FilePath)
    
    # Load the data
    data = json.load(file)
    
    # Do something with the data
    for basestation in data:
        print basestation["Name"]
#        print inputName
        if basestation["Name"] == inputName:
            x = basestation["X"]
            y = basestation["Y"]
            print x
            print y
# ---------- end data_json ----------
y = ClusterOutput(data_json.y)
x = ClusterOutput(data_json.x)
