# Grasshopper definition 04_BasestationToBasestation01.gh (Grasshopper 0.9.75)
# plug-ins: Python Interpreter, Human, Agent, Shortest Walk in Gh

# ----
# Names/UUID
# This gets all the unique names. Because it's using toy data we can use names. On the real data we'd need to use UUIDs.
windows_samplerealdata = FilePath("F:\BlankMindBlog\helpers\gh_visualisation\json_detection data\dumpdata.json")
windows_fakedata = FilePath("F:\BlankMindBlog\helpers\gh_visualisation\json_detection data\fakedata.json")
linuxpath = FilePath("\\VBOXSVR\projects\tuksun\BlankMindBlog\helpers\gh_visualisation\json_detection data\fakedata.json")
names = PythonScript(FilePath=windows_samplerealdata)  # -> flatten(uuids)
# ---------- names: Python ----------
import json

if FilePath:
    
    # JSON file to read
    file = open(FilePath)
    
    # Load the data
    data = json.load(file)
    
    uuids = []
    
    for d in data:
        uuids.append( d['uuid'] )
    
    print uuids
# ---------- end names ----------
panel = Panel(windows_fakedata)
names_2 = PythonScript(FilePath=windows_fakedata)  # -> flatten(names)
# ---------- names_2: Python ----------
import json

if FilePath:
    
    # JSON file to read
    file = open(FilePath)
    
    # Load the data
    data = json.load(file)
    
    names = []
    
    for d in data:
        names.append( d['name'] )
    
    print names
# ---------- end names_2 ----------
create_set = CreateSet(List=names_2)  # -> Set, Map
create_set_2 = CreateSet(List=names)  # -> Set, Map
panel_2 = Panel(create_set_2.Set)
panel_3 = Panel(create_set.Set)

windows_samplerealdata_2 = FilePath("F:\BlankMindBlog\helpers\gh_visualisation\json_detection data\dumpdata.json")
windows_simdata = FilePath("F:\BlankMindBlog\helpers\gh_visualisation\json_detection data\simdata.json")
names_3 = PythonScript(FilePath=windows_simdata)  # -> uuids, a; same code as names
create_set_3 = CreateSet(List=names_3.uuids)  # -> Set, Map
panel_4 = Panel(create_set_3.Set)

# ----
# Basestations
# This draws out the points that corespond to the base stations.
# I've cheated and put in a static list of base stations instead of reading it froma file. This is for laziness and for performance (that list doesn't change much).
arup_basestations = Panel("""RPI001
RPI002
RPI003
RPI004
RPI005
RPI006
RPI007
RPI008
RPI009
RPI010
RPI011
RPI012
RPI013
RPI014
RPI015
RPI016
RPI017
RPI018
RPI019
RPI020
RPI021
RPI022
RPI023
RPI024
RPI025
RPI026
RPI027
RPI028
RPI029
RPI030
RPI031
RPI032
RPI033
RPI034
RPI035
RPI036
RPI037""")
bvn_basestations = Panel("""RPI001
RPI002
RPI003
RPI004
RPI005
RPI006
RPI007
RPI008
RPI009
RPI010
RPI011
RPI012
RPI013
RPI014
RPI015
RPI016
RPI017
RPI018
RPI019
RPI020
RPI021
RPI022
RPI023
RPI024
RPI025
RPI026
RPI027
RPI028
RPI029
RPI030
RPI031
RPI032
RPI033
RPI034
RPI035
RPI036
RPI037
RPI038
RPI039
RPI040
RPI041
RPI042""")
bvn_path = FilePath("F:\BlankMindBlog\helpers\basestation_location\baseStations_BVN.json")
arup_path = FilePath("F:\BlankMindBlog\helpers\basestation_location\baseStations_ARUP.json")
list_of_basestations = ListOfBasestations(filepath=bvn_path, inputname=bvn_basestations)  # -> x, y
x_y_coords = ConstructPoint(XCoordinate=list_of_basestations.x, YCoordinate=list_of_basestations.y, ZCoordinate=0)
sort_points = SortPoints(Points=x_y_coords)  # -> Points, Indices
deconstruct = Deconstruct(Point=sort_points.Points)  # -> reverse(XComponent), reverse(YComponent), ZComponent
text_tag_3d = TextTag3D(Location=sort_points.Points, Text=bvn_basestations, Size=1562, Colour=RGB(3, 217, 255), Justification=5)
panel_5 = Panel(deconstruct.YComponent)
panel_6 = Panel(deconstruct.XComponent)

# ----
# Detections
# Given a list of names, this finds all the detections related to each of those names and returns them as a list of lists.
json_detections = PythonScript(FilePath=windows_fakedata, name=create_set.Set)  # -> data, base, time; disabled
# ---------- json_detections: Python ----------
import json

if FilePath:
    
    # JSON file to read
    file = open(FilePath)
    
    # Load the data
    detections = json.load(file)
    data = str(detections)
    
    time = []
    base = []
    
    for detection in detections:
        if detection["name"] == name:
            print detection
            time.append( detection["time"] )
            base.append( detection["basestation"] )
# ---------- end json_detections ----------
json_detections_2 = PythonScript(FilePath=windows_simdata, uuid=panel_4)  # -> agent, time
# ---------- json_detections_2: Python ----------
import json

if FilePath:
    
    # JSON file to read
    file = open(FilePath)
    
    # Load the data
    detections = json.load(file)
    #data = str(detections)
    
    time = []
    agent = []
    
    for d in detections:
        if d['uuid'] == uuid:
#            print detection
            time.append( d['time'] )
            agent.append( d['agentId'] )
# ---------- end json_detections_2 ----------
create_set_4 = CreateSet(List=json_detections_2.agent)  # -> Set, Map
panel_7 = Panel(json_detections_2.time)
panel_8 = Panel(json_detections.base)
panel_9 = Panel(json_detections.time)
panel_10 = Panel(json_detections_2.agent)
panel_11 = Panel(create_set_4.Set)

# ----
# This maps the points so that the path is continous e.g. [0] to [1], [1] to [2]....
joining_curves = PythonScript(agent=json_detections_2.agent)  # -> start, end; inputs agent: list
# ---------- joining_curves: Python ----------
import ghpythonlib as gh

x = 0
start = []
end = []

while x < len(agent)-1:
    start.append(agent[x])
    end.append(agent[x + 1])
    x = x + 1
    
    print start
    print end
# ---------- end joining_curves ----------
panel_12 = Panel(joining_curves.end)
panel_13 = Panel(joining_curves.start)

# ----
# This takes list of detections and
# returns the x, y coords of the basestations
# Start and End Pts
number_slider = Slider(313, range=0..1000)
detection_of_end_point = ListOfBasestations(filepath=bvn_path, inputname=panel_12)  # -> x, y
detection_of_start_point = ListOfBasestations(filepath=bvn_path, inputname=panel_13)  # -> x, y
start_pts = ConstructPoint(XCoordinate=detection_of_start_point.x, YCoordinate=detection_of_start_point.y, ZCoordinate=0)
end_pts = ConstructPoint(XCoordinate=detection_of_end_point.x, YCoordinate=detection_of_end_point.y, ZCoordinate=0)
sphere = Sphere(Base=[start_pts, end_pts], Radius=number_slider)
panel_14 = Panel(start_pts)
panel_15 = Panel(end_pts)

# ----
# Direct Path
# What the path should be without the obstacles
number_slider_2 = Slider(72, range=0..100)
line = Line(StartPoint=panel_14, EndPoint=panel_15)
pipe = Pipe(Curve=line, Radius=number_slider_2, Caps=0)

# ----
# Obstacles and Nav Mesh BVN
geometry_pipeline = GeometryPipeline(
    GroupByLayer=False,
    GroupByType=False,
    IncludeHidden=True,
    IncludeLocked=True,
    LayerFilter="_gh_nav_graph_BVN",
    NameFilter="*",
    TypeFilter=4)
data_dam = DataDam(DataDataA=geometry_pipeline, BufferDelay=10000000, BufferMode=0)
geometry = Geometry(data_dam)

point_on_curve = PointOnCurve(line, parameter=1)
construct_particle = ConstructParticle(
    UpDirection=Vector(0, 0, 1),
    Acceleration=Vector(0, 0, 0),
    Lifespan=30,
    Mass=1,
    BodySize=Slider(100, range=0..100),
    HistoryLength=Slider(10, range=0..10))
point_emitter = PointEmitter(
    ContinuousFlow=True,
    CreationRate=1,
    NumberOfQuelea=0,
    MinimumInitialVelocity=Vector(-0.1, -0.1, -0.1),
    MaximumInitialVelocity=Vector(0.1, 0.1, 0.1),
    Point=Point(0, 0, 0))

# ----
# shortest walk/ simulated data
shortest_walk = ShortestWalk(Curves=geometry, WantedPath=line)  # -> ShortestWalk, Succession, Direction, Length
pipe_2 = Pipe(Curve=shortest_walk.ShortestWalk, Radius=Slider(80, range=0..100), Caps=0)
list_item = ListItem(List=shortest_walk.ShortestWalk, Index=0, Wrap=True)
number_slider_3 = Slider(1000, range=0..1000)
point_on_curve_2 = PointOnCurve(list_item, parameter=0)
sphere_2 = Sphere(Base=point_on_curve_2, Radius=number_slider_3)
text_tag_3d_2 = TextTag3D(Location=point_on_curve_2, Text=graft(panel_4), Size=Slider(1297, range=0..5000), Colour=RGB(255, 0, 0), Justification=7)

sphere_3 = Sphere(Base=point_on_curve, Radius=number_slider_3)
construct_agent = ConstructAgent(
    ParticleQueleaSettings=construct_particle,
    MaxSpeed=0.5,
    MaxForce=0.1,
    VisionRadius=Slider(20, range=0..100),
    VisionAngle=360)
colour_swatch = ColourSwatch(SwatchColor=RGB(17, 214, 162))
system = System(QueleaSettings=construct_agent, Emitters=point_emitter)  # -> System, Quelea, QueleaNetwork
point = Point(<point referenced from the Rhino model>)

data = Data([panel_15, panel_14])
create_set_5 = CreateSet(List=data)  # -> Set, Map
create_set_6 = CreateSet(List=create_set_5.Map)  # -> Set, Map
member_index = MemberIndex(Set=create_set_5.Map, Member=create_set_6.Set)  # -> Index, Count
panel_16 = Panel(member_index.Count)

# ----
# Vectors Along Path
list_item_2 = ListItem(List=geometry, Index=shortest_walk.Succession, Wrap=False)
end_points = EndPoints(Curve=list_item_2)  # -> Start, End
evaluate_length = EvaluateLength(Curve=list_item_2, Length=0.5, Normalized=True)  # -> Point, Tangent, Parameter
vector_2pt = Vector2Pt(PointA=end_points.Start, PointB=end_points.End, Unitize=False)  # -> Vector, Length
remap_numbers = RemapNumbers(Values=shortest_walk.Direction, Source=Domain(0, 1), Target=Domain(-0.1, 0.1))
amplitude = Amplitude(Vector=vector_2pt.Vector, Amplitude=remap_numbers)
vector_display = VectorDisplay(Anchor=evaluate_length.Point, Vector=amplitude)

timer = Timer(TimerInterval=20, Target=[engine, system])
engine = Engine(Reset=Toggle(False), System=system.System)
arrive_force = ArriveForce(
    Apply=Toggle(False),
    WeightMultiplier=1,
    AgentQuelea=system.Quelea,
    TargetPoint=point,
    ArrivalRadius=Slider(100, range=0..100))  # -> Force, DesiredVelocity
get_particle_position = GetParticlePosition(ParticleQuelea=system.Quelea)  # -> Position, SurfacePosition
point_2 = Point(<point referenced from the Rhino model>)

# ----
# Checkpoints
evaluate_length_2 = EvaluateLength(Curve=shortest_walk.ShortestWalk, Length=[0, 1], Normalized=True)  # -> Point, Tangent, Parameter
unit_z = UnitZ(Factor=1)
cross_product = CrossProduct(VectorA=unit_z, VectorB=evaluate_length_2.Tangent, Unitize=False)  # -> Vector, Length
center_box = CenterBox(Base=evaluate_length_2.Point, X=0.1, Y=0.1, Z=0.07)
construct_plane = Plane(Origin=evaluate_length_2.Point, XAxis=cross_product.Vector, YAxis=unit_z)
T = Text(["START", "GOAL"])
text_tag = TextTag(Location=construct_plane, Text=T)

len = Length(Curve=shortest_walk.ShortestWalk)
bnd = Bounds(Numbers=len)
dedomain = DeconstructDomain(Domain=bnd)  # -> Start, End
gradient = Gradient(
    LowerLimit=dedomain.Start,
    UpperLimit=dedomain.End,
    Parameter=len,
    stops=[0: RGB(255, 0, 0), 0.171: RGB(255, 212, 0), 0.342: RGB(81, 255, 0), 0.496: RGB(0, 255, 136), 0.667: RGB(0, 153, 255), 0.821: RGB(42, 0, 255), 1: RGB(255, 0, 255)])
previewlw = CustomPreviewLineweights(Geometry=shortest_walk.ShortestWalk, Shader=gradient, Thickness=Slider(3, range=0..10))

number_slider_4 = Slider(165, range=0..10000)
discontinuity = Discontinuity(Curve=shortest_walk.ShortestWalk, Level=1)  # -> Points, Parameters
negative = Negative(Value=number_slider_4)
construct_domain = ConstructDomain(DomainStart=negative, DomainEnd=number_slider_4)
list_length = ListLength(List=discontinuity.Points)
unit_x = UnitX(Factor=1)
random = Random(Range=construct_domain, Number=list_length, Seed=2)
amplitude_2 = Amplitude(Vector=unit_x, Amplitude=random)
move = Move(Geometry=discontinuity.Points, Motion=amplitude_2)  # -> Geometry, Transform
nurbs_curve = NurbsCurve(Vertices=move.Geometry, Degree=3, Periodic=False)  # -> Curve, Length, Domain

len_2 = Length(Curve=list_item)
bnd_2 = Bounds(Numbers=list_length)
dedomain_2 = DeconstructDomain(Domain=bnd_2)  # -> Start, End
gradient_2 = Gradient(
    LowerLimit=dedomain_2.Start,
    UpperLimit=dedomain_2.End,
    Parameter=list_length,
    stops=[0: RGB(255, 0, 0), 0.171: RGB(255, 212, 0), 0.342: RGB(81, 255, 0), 0.496: RGB(0, 255, 136), 0.667: RGB(0, 153, 255), 0.821: RGB(42, 0, 255), 1: RGB(255, 0, 255)])
previewlw_2 = CustomPreviewLineweights(Geometry=sphere_2, Shader=gradient_2, Thickness=Slider(3, range=0..10))

deconstruct_quelea_network = DeconstructQueleaNetwork()
arrive_force_2 = ArriveForce(Apply=Toggle(False), WeightMultiplier=1, AgentQuelea=system.Quelea, TargetPoint=point_2, ArrivalRadius=5)  # -> Force, DesiredVelocity
sort_list = SortList(Keys=panel_16)  # -> reverse(Keys), ValuesValuesA
panel_17 = Panel(sort_list.Keys)

# ==== cluster ListOfBasestations
inputname = ClusterInput()
filepath = ClusterInput()
data_json = PythonScript(FilePath=filepath, inputName=inputname)  # -> out, x, y
# ---------- data_json: Python ----------
import json

if FilePath:
    
    # JSON file to read
    file = open(FilePath)
    
    # Load the data
    data = json.load(file)
    
    # Do something with the data
    for basestation in data:
        print basestation["Name"]
#        print inputName
        if basestation["Name"] == inputName:
            x = basestation["X"]
            y = basestation["Y"]
            print x
            print y
# ---------- end data_json ----------
y = ClusterOutput(data_json.y)
x = ClusterOutput(data_json.x)
