# Grasshopper definition combined_vis_triangle_points_lines.gh (Grasshopper 0.9.76)
# plug-ins: Python Interpreter, Human, Kangaroo Components, Agent, Shortest Walk in Gh

panel = Panel("""[
{ "time" : "2016-07-12T09:52:24.117117" , "rssi" : -61 },
{ "time" : "2016-07-12T09:52:25.344178" , "rssi" : -78 },
{ "time" : "2016-07-12T09:52:26.117117" , "rssi" : -84 },
{ "time" : "2016-07-12T09:52:27.344178" , "rssi" : -56 },
{ "time" : "2016-07-12T09:52:28.021353" , "rssi" : -68 },
{ "time" : "2016-07-12T09:52:29.852827" , "rssi" : -75 },
{ "time" : "2016-07-12T09:52:30.021353" , "rssi" : -61 },
{ "time" : "2016-07-12T09:52:31.852827" , "rssi" : -69 },
{ "time" : "2016-07-12T09:52:32.893738" , "rssi" : -61 },
{ "time" : "2016-07-12T09:52:33.852827" , "rssi" : -73 },
{ "time" : "2016-07-12T09:52:34.893738" , "rssi" : -76 },
{ "time" : "2016-07-12T09:52:35.117117" , "rssi" : -69 },
{ "time" : "2016-07-12T09:52:36.344178" , "rssi" : -78 },
{ "time" : "2016-07-12T09:52:37.117117" , "rssi" : -65 },
{ "time" : "2016-07-12T09:52:38.344178" , "rssi" : -69 },
{ "time" : "2016-07-12T09:52:39.021353" , "rssi" : -70 },
{ "time" : "2016-07-12T09:52:40.852827" , "rssi" : -70 },
{ "time" : "2016-07-12T09:52:41.021353" , "rssi" : -87 },
{ "time" : "2016-07-12T09:52:42.852827" , "rssi" : -94 },
{ "time" : "2016-07-12T09:52:43.893738" , "rssi" : -97 },
{ "time" : "2016-07-12T09:52:44.852827" , "rssi" : -71 },
{ "time" : "2016-07-12T09:52:45.893738" , "rssi" : -72 },
{ "time" : "2016-07-12T09:52:46.852827" , "rssi" : -40 },
{ "time" : "2016-07-12T09:52:47.117117" , "rssi" : -54 },
{ "time" : "2016-07-12T09:52:48.344178" , "rssi" : -85 },
{ "time" : "2016-07-12T09:52:49.117117" , "rssi" : -42 },
{ "time" : "2016-07-12T09:52:50.344178" , "rssi" : -99 },
{ "time" : "2016-07-12T09:52:51.021353" , "rssi" : -54 },
{ "time" : "2016-07-12T09:52:52.852827" , "rssi" : -85 },
{ "time" : "2016-07-12T09:52:53.021353" , "rssi" : -88 },
{ "time" : "2016-07-12T09:52:54.852827" , "rssi" : -40 },
{ "time" : "2016-07-12T09:52:55.893738" , "rssi" : -97 },
{ "time" : "2016-07-12T09:52:56.852827" , "rssi" : -84 },
{ "time" : "2016-07-12T09:52:57.893738" , "rssi" : -40 },
{ "time" : "2016-07-12T09:52:58.117117" , "rssi" : -84 },
{ "time" : "2016-07-12T09:52:59.344178" , "rssi" : -66 },
{ "time" : "2016-07-12T09:53:00.117117" , "rssi" : -81 },
{ "time" : "2016-07-12T09:53:01.344178" , "rssi" : -59 },
{ "time" : "2016-07-12T09:53:02.021353" , "rssi" : -77 },
{ "time" : "2016-07-12T09:53:03.852827" , "rssi" : -57 },
{ "time" : "2016-07-12T09:53:04.021353" , "rssi" : -43 },
{ "time" : "2016-07-12T09:53:04.852827" , "rssi" : -56 },
{ "time" : "2016-07-12T09:53:05.893738" , "rssi" : -89 },
{ "time" : "2016-07-12T09:53:06.852827" , "rssi" : -58 },
{ "time" : "2016-07-12T09:53:07.893738" , "rssi" : -59 },
{ "time" : "2016-07-12T09:53:08.344178" , "rssi" : -75 },
{ "time" : "2016-07-12T09:53:09.117117" , "rssi" : -80 },
{ "time" : "2016-07-12T09:53:10.344178" , "rssi" : -88 },
{ "time" : "2016-07-12T09:53:11.021353" , "rssi" : -45 },
{ "time" : "2016-07-12T09:53:12.852827" , "rssi" : -57 },
{ "time" : "2016-07-12T09:53:13.021353" , "rssi" : -43 },
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""")

# ----
# convert your date
# and time to milliseconds
panel_2 = Panel("2")
timespan = VBScript(days="0", hours=panel_2, minutes="15", seconds="30")  # -> out, span
# ---------- timespan: VB ----------
    Dim s As New TimeSpan(days, hours, minutes, seconds)
    span = s.Ticks.ToString()
# ---------- end timespan ----------
panel_3 = Panel(timespan.span)

timer = Timer(TimerInterval=20, Target=runner_2)  # disabled
timer_2 = Timer(TimerInterval=20, Target=runner)
runner = PythonScript(reset=Toggle(True), stop=Toggle(False), record=Toggle(False), dataNum=Slider(188, range=0..500))  # -> out, rect, xy, pos, pathData
# ---------- runner: Python ----------
ghenv.Component.Message = "written by +GENEATCG"

import rhinoscriptsyntax as rs 
import Rhino as rc

rectX = 100
rectY = 100

class Runner:
    def __init__(self, x, y, mx, my):
        self.x = x
        self.y = y
        self.mx = mx
        self.my = my
        self.path = []
        
    def pt(self):
        self.x += mx
        self.y += my
        return self.x,self.y
    
    def reflect(self):
        if self.x >= rectX or self.x <= 0:
            self.mx *= -1
        if self.y >= rectY or self.y <= 0:
            self.my *= -1
        return self.mx, self.my
        
    def recordPath(self, x):
        self.path.append(x)
        
    def deletePath(self, n):
        if len(self.path) > n:
            self.path.pop(0)

if reset:
    run = Runner(3,5,1,2)
    c = rs.AddPoint(run.x, run.y, 0)
else:
    if not stop:
        mx, my = run.reflect()
        x, y = run.pt()
        xy = x, y
        pos = rs.AddPoint(x, y, 0)
        if record:
            run.recordPath(rc.Geometry.Point3d(x,y,0))
            pathData = run.path
        else:
            pathData = run.path
    else:
        pos = rs.AddPoint(x, y, 0)
        pathData = run.path
    run.deletePath(dataNum)


plane = rs.WorldXYPlane()

rect = rs.AddRectangle(plane, rectX, rectY)
# ---------- end runner ----------
runner_2 = PythonScript(
    reset=Toggle(False),
    stop=Toggle(False),
    ms=Slider(4, range=0..4),
    mc=Slider(0.001, range=0..0.003),
    ma=Slider(0.1, range=0..0.1),
    bound=Toggle(True))  # -> out, rect, pos, vec, ln
# ---------- runner_2: Python ----------
ghenv.Component.Message = "written by +GENEATCG"

import rhinoscriptsyntax as rs 
import Rhino as rc
from random import *

rectX = 600
rectY = 600

class Runner:
    def __init__(self, p, v):
        self.p = p
        self.v = v
        self.a = rs.VectorCreate( (0,0,0),(0,0,0) )
        
    def ptRun(self):
        self.v = rs.VectorAdd(self.v, self.a)
        v = rs.VectorLength(self.v)
        if v > 2:
            self.v = rs.VectorScale(rs.VectorUnitize(self.v), 2)
        self.p = rs.VectorAdd(self.p, self.v)
        
        self.a = rs.VectorCreate( (0,0,0),(0,0,0) )
    
    def reflect(self):
        if self.p[0] >= rectX or self.p[0] < 0:
            self.v[0] *= -1.2
        if self.p[1] >= rectY or self.p[1] < 0:
            self.v[1] *= -1.2
    
    def door(self):
        if self.p[0] >= rectX:
            self.p[0] -= rectX
        if self.p[0] <= 0:
            self.p[0] += rectX
        if self.p[1] >= rectY:
            self.p[1] -= rectY
        if self.p[1] <= 0:
            self.p[1] += rectY
        
    
    def flock(self):
        self.separate(ms)
        self.cohesion(mc)
        self.align(ma)
    
    def align(self, mag):
        
        steer = rs.VectorCreate( (0,0,0) , (0,0,0) )
        count = 0
        
        for i in pts:
            distance = rs.Distance(i.p, self.p)
            if distance > 0 and distance < 40:
                steer = rs.VectorAdd(steer, i.v)
                count += 1
        
        if count>0:
            steer = rs.VectorScale(steer, 1.0/count)
        
        steer = rs.VectorScale(steer, mag)
        self.a = rs.VectorAdd(self.a, steer)
    
    def cohesion(self, mag):
        
        sum = rs.VectorCreate( (0,0,0) , (0,0,0) )
        count = 0
        
        for i in pts:
            distance = rs.Distance(i.p, self.p)
            if distance > 0 and distance < 60:
                sum = rs.VectorAdd(sum, i.p)
                count += 1
        
        if count>0:
            sum = rs.VectorScale(sum, 1.0/count)
        
        steer = rs.VectorSubtract(sum, self.p)
        steer = rs.VectorScale(steer, mag)
        self.a = rs.VectorAdd(self.a, steer)
        #print(self.a)
    
    def separate(self, mag):
        
        steer = rs.VectorCreate( (0,0,0) , (0,0,0) )
        count = 0
        
        for i in pts:
            distance = rs.Distance(i.p, self.p)
            if distance > 0 and distance < 30:
                diff = rs.VectorSubtract(self.p, i.p)
                diff = rs.VectorUnitize(diff)
                diff = rs.VectorScale(diff, 1.0/distance)
                
                steer = rs.VectorAdd(steer , diff)
                count += 1
        
        if count>0:
            steer = rs.VectorScale(steer, 1.0/count)
        
        steer = rs.VectorScale(steer, mag)
        
        self.a = rs.VectorAdd(self.a, steer)
        #print(self.a)
    
    def drawPt(self):
        pt = rc.Geometry.Point3d(self.p[0], self.p[1], self.p[2])
        return pt

if reset:
    pts = []
    for i in range(20):
        p = rs.VectorCreate(   rs.AddPoint( randint(1,rectX-1),  randint(1,rectY-1),0  )  ,  rs.AddPoint(0,0,0)    )
        v = rs.VectorCreate(   rs.AddPoint( randint(1,3) ,  randint(1,3),0   )  ,  rs.AddPoint(0,0,0)    )
        run1 = Runner(p, v)
        pts.append(run1)
else:
    pos = []
    vec = []
    
    if not stop:
        for i in pts:
            pos.append(i.drawPt())
            vec.append(i.v)
        for i in pts:
            if bound:
                i.reflect()
            else:
                i.door()
            #i.separate(magnitude)
            i.flock()
            i.ptRun()
        
    else:
        for i in pts:
            pos.append(i.drawPt())
            vec.append(i.v)


plane = rs.WorldXYPlane()

rect = rs.AddRectangle(plane, rectX, rectY)
# ---------- end runner_2 ----------
panel_4 = Panel(runner.pathData)
panel_5 = Panel(runner.xy)
panel_6 = Panel(runner.pos)
panel_7 = Panel(runner_2.pos)
panel_8 = Panel(runner_2.vec)
vdis = VectorDisplay(Anchor=panel_7, Vector=panel_8)
T = Trail(Points=panel_7, Reset=Button(), Record=Toggle(True))
panel_9 = Panel(T)

panel_10 = Panel("""July 20 2012, 13:45:00
July 20 2012, 13:45:30
July 21 2012, 09:30:00
July 21 2012, 18:59:59
July 22 2012, 12:33:00
July 22 2012, 12:34:20
July 24 2012, 07:00:00
July 25 2012, 23:59:59""")

# ----
# Names/UUID
# This gets all the unique names.
# 
# 1. Sim Data - Test with real but still fake data, preferred use for now
# 
# 2. Sample Real Daka - From Test Dump, has limited beacon and basestation input
# 
# 3. Fake data altogether
windows_samplerealdata = FilePath("F:\InfoTech\ARIVERA - DO NOT REMOVE\BlankMindBlog\helpers\gh_visualisation\json_detection data\dumpdata.json")  # disabled
windows_simdata = FilePath("F:\InfoTech\ARIVERA - DO NOT REMOVE\BlankMindBlog\helpers\gh_visualisation\json_detection data\test.json")
windows_fakedata = FilePath("F:\InfoTech\ARIVERA - DO NOT REMOVE\BlankMindBlog\helpers\gh_visualisation\json_detection data\fakedata.json")  # disabled
names = PythonScript(FilePath=windows_simdata)  # -> uuids, a
# ---------- names: Python ----------
import json

if FilePath:
    
    # JSON file to read
    file = open(FilePath)
    
    # Load the data
    data = json.load(file)
    
    uuids = []
    
    for d in data:
        uuids.append( d['uuid'] )
    
    print uuids
# ---------- end names ----------
names_2 = PythonScript(FilePath=windows_fakedata)  # -> flatten(names); disabled
# ---------- names_2: Python ----------
import json

if FilePath:
    
    # JSON file to read
    file = open(FilePath)
    
    # Load the data
    data = json.load(file)
    
    names = []
    
    for d in data:
        names.append( d['name'] )
    
    print names
# ---------- end names_2 ----------
names_3 = PythonScript(FilePath=windows_samplerealdata)  # -> flatten(uuids); disabled; same code as names
create_set = CreateSet(List=names.uuids)  # -> Set, Map
create_set_2 = CreateSet(List=names_3)  # -> Set, Map; disabled
create_set_3 = CreateSet(List=names_2)  # -> Set, Map; disabled
panel_11 = Panel(create_set.Set)
panel_12 = Panel(create_set_2.Set)
panel_13 = Panel(create_set_3.Set)
panel_14 = Panel(windows_simdata)

time = Time("July 20 2012, 13:45:00")
time_2 = Time("Now")
time_3 = Time("July 20 2012, 13:45:30")
time_4 = Time("July 20 2012, 13:45:00")
time_5 = Time(panel_10)
subtractdates = VBScript(t0=time, t1=time_2)  # -> out, span
# ---------- subtractdates: VB ----------
    Dim s As TimeSpan = t1 - t0
    span = s.Ticks.ToString()
# ---------- end subtractdates ----------
multispan = VBScript(times=time_5)  # -> out, spans; inputs times: list
# ---------- multispan: VB ----------
    times.Sort()
    
    Dim s As New List(Of String)
    For i As Int32 = 0 To times.Count - 2
      Dim localSpan As TimeSpan = times(i + 1) - times(i)
      s.Add(localSpan.Ticks.ToString())
    Next
    spans = s
# ---------- end multispan ----------
time_6 = PythonScript(FilePath=windows_simdata)  # -> flatten(time)
# ---------- time_6: Python ----------
import json

if FilePath:
    
    # JSON file to read
    file = open(FilePath)
    
    # Load the data
    data = json.load(file)
    
    time = []
    
    for d in data:
        time.append( d['time'] )
    
    print time
# ---------- end time_6 ----------
number_slider = Slider(1, range=0..100)
number_slider_2 = Slider(30, range=0..100)
panel_15 = Panel(subtractdates.span)
formatspan = VBScript(span=multispan.spans)  # -> out, format
# ---------- formatspan: VB ----------
    Dim s As New TimeSpan(Int64.Parse(span))
    format = String.Format("{0} days, {1} hours, {2} minutes & {3} seconds", s.Days, s.Hours, s.Minutes, s.Seconds)
# ---------- end formatspan ----------
python = PythonScript(range=panel)  # -> avgRssi, a
# ---------- python: Python ----------
import json


avgRssi = []

i = 0
a = 0
b = 29

for i in range()
    sum[avgRssi] / float(len([a], [b]))
    
    
    total = avgRssi 
    
    print avgRssi

a = a + 30
b = b + 30
# ---------- end python ----------

time_7 = Time("Now")
time_8 = Time("July 20 2012, 13:45:00")
interpolate = VBScript(t0=time_8, t1=time_7, f=Slider(1, range=0..1))  # -> out, t
# ---------- interpolate: VB ----------
    Dim ticks0 As Int64 = t0.Ticks
    Dim ticks1 As Int64 = t1.Ticks

    Dim ticks As Int64 = Convert.ToInt64(ticks0 + f * (ticks1 - ticks0))
    t = New GH_Time(New DateTime(ticks))
# ---------- end interpolate ----------
panel_16 = Panel(interpolate.t)

formatspan_2 = VBScript(span=panel_15)  # -> out, format; same code as formatspan
panel_17 = Panel(formatspan.format)
item = ListItem(List=panel, Index=number_slider, Wrap=True)
item_2 = ListItem(List=panel, Index=number_slider_2, Wrap=True)
addition = VBScript(time=time_2, span=panel_3)  # -> out, time2
# ---------- addition: C# ----------
    time2 = New GH_Time(time + New TimeSpan(Int64.Parse(span)))
# ---------- end addition ----------
panel_18 = Panel(formatspan_2.format)
panel_19 = Panel(python.avgRssi)
panel_20 = Panel(item)
panel_21 = Panel(item_2)
panel_22 = Panel(addition.time2)
number_slider_3 = Slider(0, range=0..100)
dom = ConstructDomain(DomainStart=number_slider, DomainEnd=number_slider_2)
range = Range(Domain=dom, Steps=Slider(1, range=0..100))

# ----
# Check curve
# closet point
number_slider_4 = Slider(11, range=-20..20)  # disabled
number_slider_5 = Slider(-4, range=-40..40)  # disabled
number_slider_6 = Slider(-4, range=-20..20)  # disabled
number_slider_7 = Slider(-1, range=-20..20)  # disabled
number_slider_8 = Slider(19, range=-40..40)  # disabled
number_slider_9 = Slider(-4, range=-20..20)  # disabled
smtime = ConstructSmoothTime(Days=0, Hours=0, Minutes=0, Seconds=0)  # disabled
pt = ConstructPoint(XCoordinate=number_slider_4, YCoordinate=number_slider_5, ZCoordinate=number_slider_6)  # disabled
pt_2 = ConstructPoint(XCoordinate=number_slider_7, YCoordinate=number_slider_8, ZCoordinate=number_slider_9)  # disabled
number_slider_10 = Slider(2.84, range=0..7)  # disabled
toggle = BooleanToggle(True)  # disabled
button = Button()  # disabled
timer_3 = Timer(TimerInterval=20, Target=python_2)  # disabled
geo = Geometry(pt)  # disabled
geo_2 = Geometry(pt_2)  # disabled
python_2 = PythonScript(StartPt=geo, DirPt=geo_2, length=number_slider_10, Toggle=toggle, Reset=button)  # -> out, Count, a, b; inputs Toggle: Boolean, Reset: Boolean; disabled
# ---------- python_2: Python ----------
import scriptcontext as sc
import rhinoscriptsyntax as rs 


org = rs.AddPoint((0, 0, 0))
dir = rs.AddPoint(DirPt)
box = [20, 40, 20]

# Add the count variable to the sticky dict
if "count" not in sc.sticky:
    sc.sticky["count"] =  rs.VectorCreate(StartPt, org)
if "vel" not in sc.sticky:
    sc.sticky["vel"] = rs.VectorCreate(dir, StartPt)

def re():
    if Reset:
        sc.sticky["count"] = rs.VectorCreate(StartPt, org)
        s = rs.VectorCreate(dir, StartPt)
        sLen = rs.VectorUnitize(s)
        sc.sticky["vel"] = rs.VectorScale(sLen, length)
    return

def bound():
    if sc.sticky["count"][0]> box[0] or sc.sticky["count"][0]< -box[0]:
        sc.sticky["vel"][0] = - sc.sticky["vel"][0]
    if sc.sticky["count"][1]> box[1] or sc.sticky["count"][1]< -box[1]:
        sc.sticky["vel"][1] = - sc.sticky["vel"][1]
    if sc.sticky["count"][2]> box[2] or sc.sticky["count"][2]< -box[2]:
        sc.sticky["vel"][2] = - sc.sticky["vel"][2]
    return

def main():

    print(sc.sticky["count"])
    
    if Toggle:
        ac = sc.sticky["count"]
        bc = sc.sticky["vel"]
        add = rs.VectorAdd(ac, bc)
        sc.sticky["count"] = add
        print(sc.sticky["count"])
    
    bound()
    
    # Reset the count
    re()

    # Return count to GH
    Count = sc.sticky["count"]
    pt_x = sc.sticky["count"][0]
    pt_y = sc.sticky["count"][1]
    pt_z = sc.sticky["count"][2]
    
    a = rs.AddPoint(pt_x, pt_y, pt_z)
    
    return a

a = main()
b = box
# ---------- end python_2 ----------
dom_2 = ConstructDomain(DomainStart=graft(python_2.b), DomainEnd=expr("-x", graft(python_2.b)))  # disabled
bang = ExplodeTree(Data=dom_2)  # -> Branch0, Branch1, Branch2; disabled
panel_23 = Panel(python_2.out)  # disabled
sph = Sphere(Base=python_2.a, Radius=1)  # disabled
swatch = ColourSwatch(SwatchColor=RGBA(255, 255, 255, 54))  # disabled
box = DomainBox(Base=PlaneXY(0, 0, 0), X=bang.Branch0, Y=bang.Branch1, Z=bang.Branch2)  # disabled
panel_24 = Panel(python_2.a)  # disabled
preview = CustomPreview(Geometry=box, Shader=swatch)  # disabled
panel_25 = Panel(bang.Branch0)  # disabled

panel_26 = Panel(time_6)

# ----
# Sort list
# Averaging time
milliseconds = Slider(30000, range=0..100000)

# ----
# end time
# date
# time
panel_27 = Panel("2016-03-11")
panel_28 = Panel("11-00-30")

# ----
# start time
# date
# time
panel_29 = Panel("2016-03-11")

timer_4 = Timer(TimerInterval=5, Target=[getmousepts, readsticky])  # disabled
sort = SortList(Keys=panel_26)  # -> Keys, ValuesA
getmousepts = PythonScript(toggle=Toggle(True), clear=Button())  # -> out, mp; inputs clear: Boolean
# ---------- getmousepts: Python ----------
import System
import Rhino as rc
import scriptcontext as sc

# Add empty list to sticky / clear list
if "points" not in sc.sticky or clear:
    sc.sticky["points"] = []

# Get the mouse position and append point to list
if toggle:
    mp = System.Windows.Forms.Control.MousePosition
    sc.sticky["points"].append(rc.Geometry.Point3d(mp.X,-mp.Y,0))
# ---------- end getmousepts ----------

# ----
# Given a list of names, this finds all the detections related to each of those names and returns them as a list of lists.
# 
# Use second 'Json Detections' node if you're playing with the fake data file.
# Detections
json_detections_real_data = PythonScript(FilePath=windows_simdata, uuid=panel_11)  # -> agent, time
# ---------- json_detections_real_data: Python ----------
import json

if FilePath:
    
    # JSON file to read
    file = open(FilePath)
    
    # Load the data
    detections = json.load(file)
    #data = str(detections)
    
    time = []
    agent = []
    
    for d in detections:
        if d['uuid'] == uuid:
#            print detection
            time.append( d['time'] )
            agent.append( d['agentId'] )
# ---------- end json_detections_real_data ----------
json_detections_fake_data = PythonScript(FilePath=windows_fakedata, name=create_set_3.Set)  # -> data, base, time; disabled
# ---------- json_detections_fake_data: Python ----------
import json

if FilePath:
    
    # JSON file to read
    file = open(FilePath)
    
    # Load the data
    detections = json.load(file)
    data = str(detections)
    
    time = []
    base = []
    
    for detection in detections:
        if detection["name"] == name:
            print detection
            time.append( detection["time"] )
            base.append( detection["basestation"] )
# ---------- end json_detections_fake_data ----------
create_set_4 = CreateSet(List=json_detections_real_data.agent)  # -> Set, Map
panel_30 = Panel(create_set_4.Set)
panel_31 = Panel(json_detections_real_data.time)
panel_32 = Panel(json_detections_fake_data.base)
panel_33 = Panel(json_detections_fake_data.time)

addition_2 = Addition(A=panel_29, B="10-54-30")
python_3 = PythonScript()  # -> out, a
# ---------- python_3: Python ----------
import datetime
import datetime.date
import datetime.datetime
import datetime.date

from time import gmtime, strftime
>>> strftime("%a, %d %b %Y %H:%M:%S +0000", gmtime())
# ---------- end python_3 ----------
panel_34 = Panel(getmousepts.mp)
datetime_to_milliseconds = PythonScript(x=addition_2)  # -> out, a
# ---------- datetime_to_milliseconds: Python ----------
import datetime
import datetime.tzinfo
import datetime.MAXYEAR
import datetime.MINYEAR

epoch = datetime.datetime.utcfromtimestamp(0)

def unix_time_millis(dt):
    return (dt - epoch).total_seconds() * 1000.0
# ---------- end datetime_to_milliseconds ----------
readsticky = PythonScript()  # -> out, points, currentPoint
# ---------- readsticky: Python ----------
import scriptcontext as sc

# Read and output to GH
points = sc.sticky["points"]
currentPoint = points[-1]
# ---------- end readsticky ----------
panel_35 = Panel(datetime_to_milliseconds.out)
multiplication = Multiplication(A=addition_2, B=Slider(1000, range=0..10000))
nurbs = NurbsCurve(Vertices=readsticky.points, Degree=3, Periodic=False)  # -> Curve, Length, Domain
pt_3 = Point(readsticky.currentPoint)
panel_36 = Panel(multiplication)

# ----
# This draws out the points that correspond to the base stations.
# 
# The basestations names are static, change the list in the panel and the list in the json file if any basestation changes need to be done.
# Basestations
arup_basestations = Panel("""RPI001
RPI002
RPI003
RPI004
RPI005
RPI006
RPI007
RPI008
RPI009
RPI010
RPI011
RPI012
RPI013
RPI014
RPI015
RPI016
RPI017
RPI018
RPI019
RPI020
RPI021
RPI022
RPI023
RPI024
RPI025
RPI026
RPI027
RPI028
RPI029
RPI030
RPI031
RPI032
RPI033
RPI034
RPI035
RPI036
RPI037""")
bvn_basestations = Panel("""RPI001
RPI002
RPI003
RPI004
RPI005
RPI006
RPI007
RPI008
RPI009
RPI010
RPI011
RPI012
RPI013
RPI014
RPI015
RPI016
RPI017
RPI018
RPI019
RPI020
RPI021
RPI022
RPI023
RPI024
RPI025
RPI026
RPI027
RPI028
RPI029
RPI030
RPI031
RPI032
RPI033
RPI034
RPI035
RPI036
RPI037
RPI038
RPI039
RPI040
RPI041
RPI042""")
arup_path = FilePath("F:\BlankMindBlog\helpers\basestation_location\baseStations_ARUP.json")
bvn_path = FilePath("F:\InfoTech\ARIVERA - DO NOT REMOVE\BlankMindBlog\helpers\basestation_location\baseStations_BVN.json")
list_of_basestations = ListOfBasestations(filepath=bvn_path, inputname=bvn_basestations)  # -> x, y
x_y_coords = ConstructPoint(XCoordinate=list_of_basestations.x, YCoordinate=list_of_basestations.y, ZCoordinate=0)
text_tag_3d = TextTag3D(Location=x_y_coords, Text=bvn_basestations, Size=1562, Colour=ColourSwatch(SwatchColor=RGB(75, 209, 0)), Justification=5)

sort_2 = SortList()  # -> Keys, ValuesA
joining_curves = PythonScript(agent=json_detections_real_data.agent)  # -> start, end; inputs agent: list
# ---------- joining_curves: Python ----------
import ghpythonlib as gh

x = 0
colour = []

while x < len(uuid)-1:
    start.append(agent[x])
    x = x + 1
    
    print start
    print end
# ---------- end joining_curves ----------

# ----
# Joining start and end pts
# This maps the points so that the path is continous e.g. [0] to [1], [1] to [2]....
joining_curves_2 = PythonScript(agent=json_detections_real_data.agent)  # -> start, end; inputs agent: list
# ---------- joining_curves_2: Python ----------
import ghpythonlib as gh

x = 0
start = []
end = []

while x < len(agent)-1:
    start.append(agent[x])
    end.append(agent[x + 1])
    x = x + 1
    
    print start
    print end
# ---------- end joining_curves_2 ----------
panel_37 = Panel(joining_curves_2.end)
panel_38 = Panel(joining_curves_2.start)

sort_points = SortPoints(Points=x_y_coords)  # -> Points, Indices
deconstruct = Deconstruct(Point=sort_points.Points)  # -> reverse(XComponent), reverse(YComponent), ZComponent
panel_39 = Panel(deconstruct.XComponent)
panel_40 = Panel(deconstruct.YComponent)

# ----
# Set the actual position
#  of person
pt_4 = Point(<point referenced from the Rhino model>)

# ----
# BaseStations
pt_5 = Point(x_y_coords)

# ----
# Start and End Pts
# This takes list of detections and
# returns the x, y coords of the basestations
detection_of_start_point = ListOfBasestations(filepath=bvn_path, inputname=panel_38)  # -> x, y
detection_of_end_point = ListOfBasestations(filepath=bvn_path, inputname=panel_37)  # -> x, y
start_pts = ConstructPoint(XCoordinate=detection_of_start_point.x, YCoordinate=detection_of_start_point.y, ZCoordinate=0)
end_pts = ConstructPoint(XCoordinate=detection_of_end_point.x, YCoordinate=detection_of_end_point.y, ZCoordinate=0)
panel_41 = Panel(start_pts)
panel_42 = Panel(end_pts)

# ----
# Duplicates of Pts
start_endpts = Data([panel_42, panel_41])
create_set_5 = CreateSet(List=start_endpts)  # -> Set, Map
create_set_6 = CreateSet(List=create_set_5.Map)  # -> Set, Map
member_index = MemberIndex(Set=create_set_5.Map, Member=create_set_6.Set)  # -> Index, Count
panel_43 = Panel(member_index.Count)

# ----
# Furniture
# boundarys
cluster = Cluster()

# ----
# Direct Path
# What the path should be without the obstacles
number_slider_11 = Slider(72, range=0..100)
line = Line(StartPoint=panel_41, EndPoint=panel_42)
pipe = Pipe(Curve=line, Radius=number_slider_11, Caps=0)
join = JoinCurves(Curves=line, Preserve=False)
animates_the_path = PointOnCurve(join, parameter=0)
sphere = Sphere(Base=animates_the_path, Radius=Slider(1000, range=0..1000))
join_2 = BrepJoin(Breps=[sphere, pipe])  # -> Breps, Closed

number_slider_12 = Slider(10, range=0..10)  # disabled
number_slider_13 = Slider(100, range=0..100)  # disabled

# ----
# Obstacles and Nav Mesh BVN
geometry_pipeline = GeometryPipeline(
    GroupByLayer=False,
    GroupByType=False,
    IncludeHidden=True,
    IncludeLocked=True,
    LayerFilter="_gh_nav_graph_BVN",
    NameFilter="*",
    TypeFilter=4)
data_dam = DataDam(DataDataA=geometry_pipeline, BufferDelay=10000000, BufferMode=0)
geometry = Geometry(data_dam)

number_slider_14 = Slider(20, range=0..100)  # disabled
construct_particle = ConstructParticle(
    UpDirection=Vector(0, 0, 1),
    Acceleration=Vector(0, 0, 0),
    Lifespan=30,
    Mass=1,
    BodySize=number_slider_13,
    HistoryLength=number_slider_12)  # disabled
point_emitter = PointEmitter(
    ContinuousFlow=True,
    CreationRate=1,
    NumberOfQuelea=0,
    MinimumInitialVelocity=Vector(-0.1, -0.1, -0.1),
    MaximumInitialVelocity=Vector(0.1, 0.1, 0.1),
    Point=Point(0, 0, 0))  # disabled
construct_agent = ConstructAgent(ParticleQueleaSettings=construct_particle, MaxSpeed=0.5, MaxForce=0.1, VisionRadius=number_slider_14, VisionAngle=360)  # disabled

pt_6 = Point(pt_4)
preview_2 = CustomPreview(Geometry=pt_6, Shader=ColourSwatch(SwatchColor=RGB(8, 8, 255)))

# ----
# shortest walk/ simulated data
# Cluster of script uses the nav mesh script and executes shortest path, w vectors and tags.
# 
# Will turn up red if detection is stationary.
number_slider_15 = Slider(80, range=0..100)
shortest_walk = ShortestWalk(Curves=geometry, WantedPath=line)  # -> ShortestWalk, Succession, Direction, Length
pipe_2 = Pipe(Curve=shortest_walk.ShortestWalk, Radius=number_slider_15, Caps=0)
join_3 = JoinCurves(Curves=shortest_walk.ShortestWalk, Preserve=False)
number_slider_16 = Slider(1000, range=0..1000)
panel_44 = Panel(join_3)
point_on_curve = PointOnCurve(join_3, parameter=0)
sphere_2 = Sphere(Base=point_on_curve, Radius=number_slider_16)
text_tag_3d_2 = TextTag3D(Location=point_on_curve, Text=graft(panel_11), Size=number_slider_16, Colour=RGB(255, 0, 0), Justification=7)
item_3 = ListItem(List=flatten(join_3), Index=Slider(0, range=0..100), Wrap=True)

# ----
# Vectors Along Path
list_item = ListItem(List=geometry, Index=shortest_walk.Succession, Wrap=False)
end_points = EndPoints(Curve=list_item)  # -> Start, End
evaluate_length = EvaluateLength(Curve=list_item, Length=0.5, Normalized=True)  # -> Point, Tangent, Parameter
vector_2pt = Vector2Pt(PointA=end_points.Start, PointB=end_points.End, Unitize=False)  # -> Vector, Length
remap_numbers = RemapNumbers(Values=shortest_walk.Direction, Source=Domain(0, 1), Target=Domain(-0.1, 0.1))
amplitude = Amplitude(Vector=vector_2pt.Vector, Amplitude=remap_numbers)
vector_display = VectorDisplay(Anchor=evaluate_length.Point, Vector=amplitude)

system = System(QueleaSettings=construct_agent, Emitters=point_emitter)  # -> System, Quelea, QueleaNetwork; disabled
boolean_toggle = BooleanToggle(False)  # disabled
point = Point(<point referenced from the Rhino model>)  # disabled
boolean_toggle_2 = BooleanToggle(False)  # disabled
number_slider_17 = Slider(100, range=0..100)  # disabled
timer_5 = Timer(TimerInterval=20, Target=[engine, system])  # disabled

# ----
# Checkpoints
evaluate_length_2 = EvaluateLength(Curve=shortest_walk.ShortestWalk, Length=[0, 1], Normalized=True)  # -> Point, Tangent, Parameter
unit_z = UnitZ(Factor=1)
cross_product = CrossProduct(VectorA=unit_z, VectorB=evaluate_length_2.Tangent, Unitize=False)  # -> Vector, Length
center_box = CenterBox(Base=evaluate_length_2.Point, X=0.1, Y=0.1, Z=0.07)
construct_plane = Plane(Origin=evaluate_length_2.Point, XAxis=cross_product.Vector, YAxis=unit_z)
T_2 = Text(["START", "GOAL"])
text_tag = TextTag(Location=construct_plane, Text=T_2)

engine = Engine(Reset=boolean_toggle_2, System=system.System)  # disabled
arrive_force = ArriveForce(Apply=boolean_toggle, WeightMultiplier=1, AgentQuelea=system.Quelea, TargetPoint=point, ArrivalRadius=number_slider_17)  # -> Force, DesiredVelocity; disabled
get_particle_position = GetParticlePosition(ParticleQuelea=system.Quelea)  # -> Position, SurfacePosition; disabled
point_2 = Point(<point referenced from the Rhino model>)  # disabled
boolean_toggle_3 = BooleanToggle(False)  # disabled

# ----
# Separating Curves
# Finds the overlapping points and randomly moves it away to separate curves.
# 
# Also turns these curves into a nurbs curve.
number_slider_18 = Slider(388, range=0..10000)
exploded_points_of_overlapping_crvs = Curve(join_3)
discontinuity = Discontinuity(Curve=exploded_points_of_overlapping_crvs, Level=1)  # -> Points, Parameters
negative = Negative(Value=number_slider_18)
list_length = ListLength(List=discontinuity.Points)
construct_domain = ConstructDomain(DomainStart=negative, DomainEnd=number_slider_18)
unit_x = UnitX(Factor=1)
random = Random(Range=construct_domain, Number=list_length, Seed=2)
amplitude_2 = Amplitude(Vector=unit_x, Amplitude=random)
move = Move(Geometry=discontinuity.Points, Motion=amplitude_2)  # -> Geometry, Transform
nurbs_curve = NurbsCurve(Vertices=move.Geometry, Degree=3, Periodic=False)  # -> Curve, Length, Domain

deconstruct_quelea_network = DeconstructQueleaNetwork()  # disabled
arrive_force_2 = ArriveForce(Apply=boolean_toggle_3, WeightMultiplier=1, AgentQuelea=system.Quelea, TargetPoint=point_2, ArrivalRadius=5)  # -> Force, DesiredVelocity; disabled
path = Geometry(join_3)
sphere_3 = Geometry(sphere_2)

# ----
# Colours per person of sphere and path
len = Length(Curve=shortest_walk.ShortestWalk)
bnd = Bounds(Numbers=len)
dedomain = DeconstructDomain(Domain=bnd)  # -> Start, End
gradient = Gradient(
    LowerLimit=dedomain.Start,
    UpperLimit=dedomain.End,
    Parameter=len,
    stops=[0: RGB(255, 0, 0), 0.171: RGB(255, 212, 0), 0.342: RGB(81, 255, 0), 0.496: RGB(0, 255, 136), 0.667: RGB(0, 153, 255), 0.821: RGB(42, 0, 255), 1: RGB(255, 0, 255)])
sphere_4 = CustomPreview(Geometry=sphere_3, Shader=gradient)
path_2 = CustomPreviewLineweights(Geometry=path, Shader=gradient, Thickness=Slider(3, range=0..10))

# ----
# Draw a triangle
# and make a centroid
number_slider_19 = Slider(0, range=0..2)
cps = ClosestPoints(Point=pt_4, Cloud=pt_5, Count=Slider(3, range=0..10))  # -> ClosestPoint, CPIndex, Distance
pt_7 = Point(cps.ClosestPoint)
item_4 = ListItem(List=pt_7, Index=Slider(2, range=0..2), Wrap=True)
item_5 = ListItem(List=pt_7, Index=number_slider_19, Wrap=True)
item_6 = ListItem(List=pt_7, Index=Slider(1, range=0..2), Wrap=True)

dist = Distance(PointA=item_5, PointB=item_4)
ln = Line(StartPoint=item_5, EndPoint=item_4)

dist_2 = Distance(PointA=item_4, PointB=item_6)
ln_2 = Line(StartPoint=item_4, EndPoint=item_6)

dist_3 = Distance(PointA=item_6, PointB=item_5)
ln_3 = Line(StartPoint=item_6, EndPoint=item_5)

panel_45 = Panel(dist)
panel_46 = Panel(dist_3)
panel_47 = Panel(dist_2)
boundary = BoundarySurfaces(Edges=[ln_2, ln_3, ln])
area = Area(Geometry=boundary)  # -> Area, Centroid
pt_8 = Point(area.Centroid)

# ----
# check if points are
#  inside a list of curves
# A = inside all curves
# B = outside all curves
# C = inside some curves
# Reporting: Project point
# outside of furniture
crv = Curve(cluster)
# Make the estimated
#  position avoid furniture
c_script = CSharpScript(pts=pt_8, crvs=crv)  # -> out, A, B, C; inputs pts: list of Point3d, crvs: list of Polyline
# ---------- c_script: C# ----------
    var inside = new List<Point3d>();
    var outside = new List<Point3d>();
    var other = new List<Point3d>();

    foreach (Point3d pt in pts)
    {
      int insideCount = 0;
      foreach (var crv in crvs)
      {
        if(IsInside(pt, crv)) insideCount++;
      }
      if(insideCount == crvs.Count) inside.Add(pt);
      else if(insideCount == 0) outside.Add(pt);
      else other.Add(pt);
    }
    A = inside;
    B = outside;
    C = other;
# ---------- c_script: C# additional code ----------
  bool IsInside (Point3d pt, Polyline crv)
  {
    Point3d pt1, pt2;
    bool oddNodes = false;

    for (int i = 0; i < crv.SegmentCount; i++) //for each contour line
    {

      pt1 = crv.SegmentAt(i).From; //get start and end pt
      pt2 = crv.SegmentAt(i).To;

      if ( (pt1[1] < pt[1] && pt2[1] >= pt[1] || pt2[1] < pt[1] && pt1[1] >= pt[1]) && (pt1[0] <= pt[0] || pt2[0] <= pt[0]) ) //if pt is between pts in y, and either of pts is before pt in x
        oddNodes ^= ( pt2[0] + (pt[1] - pt2[1]) * (pt1[0] - pt2[0]) / (pt1[1] - pt2[1]) < pt[0] ); //^= is xor
      //end.X + (pt-end).Y   * (start-end).X  /(start-end).Y   <   pt.X
    }


    if (!oddNodes)
    {
      double minDist = 1e10;
      for (int i = 0; i < crv.SegmentCount; i++) {
        Point3d cp = crv.SegmentAt(i).ClosestPoint(pt, true);
        //Point3d cp = mvContour[i].closestPoint(pt);
        //minDist = min(minDist, cp.distance(pt));
        minDist = Math.Min(minDist, cp.DistanceTo(pt));
      }
      if (minDist < 1e-10)
        return true;
    }

    if(oddNodes) return true;

    return false;

  }
# ---------- end c_script ----------
pt_c = Point(c_script.C)
panel_48 = Panel(pt_c)
pt_a = Point(c_script.A)
pt_b = Point(c_script.B)

crv_cp = CurveClosestPoint(Point=[pt_c, pt_b], Curve=flatten(crv))  # -> Point, Parameter, Distance
sort_3 = SortList(Keys=crv_cp.Distance, ValuesA=flatten(crv))  # -> Keys, ValuesA
panel_49 = Panel(sort_3.ValuesA)
panel_50 = Panel(crv_cp.Distance)
item_7 = ListItem(List=sort_3.ValuesA, Index=Slider(0, range=0..100), Wrap=True)

divide = DivideCurve(Curve=item_7, Count=Slider(4, range=0..10), Kinks=False)  # -> Points, Tangents, Parameters
cp = ClosestPoint(Point=pt_8, Cloud=divide.Points)  # -> ClosestPoint, CPIndex, Distance

# ----
# Test Me!
pt_9 = Point(cp.ClosestPoint)
preview_3 = CustomPreview(Geometry=pt_9, Shader=ColourSwatch(SwatchColor=RGB(253, 8, 0)))
dist_4 = Distance(PointA=pt_9, PointB=pt_6)
ln_4 = Line(StartPoint=pt_9, EndPoint=pt_6)
panel_51 = Panel(dist_4)

# ==== cluster ListOfBasestations
inputname = ClusterInput()
filepath = ClusterInput()
data_json = PythonScript(FilePath=filepath, inputName=inputname)  # -> out, x, y
# ---------- data_json: Python ----------
import json

if FilePath:
    
    # JSON file to read
    file = open(FilePath)
    
    # Load the data
    data = json.load(file)
    
    # Do something with the data
    for basestation in data:
        print basestation["Name"]
#        print inputName
        if basestation["Name"] == inputName:
            x = basestation["X"]
            y = basestation["Y"]
            print x
            print y
# ---------- end data_json ----------
y = ClusterOutput(data_json.y)
x = ClusterOutput(data_json.x)

# ==== cluster Cluster

crv = Curve([<curve referenced from the Rhino model> x4806])
crv_2 = Curve([<curve referenced from the Rhino model> x58])
crv_3 = Curve([<curve referenced from the Rhino model> x62])
crv_4 = Curve([<curve referenced from the Rhino model> x3212])
crv_5 = Curve([<curve referenced from the Rhino model> x2945])
crv_6 = Curve([<curve referenced from the Rhino model> x62])
crv_7 = Curve([<curve referenced from the Rhino model> x3232])
crv_8 = Curve([<curve referenced from the Rhino model> x3204])
crv_9 = Curve([<curve referenced from the Rhino model> x2920])
crv_10 = Curve([<curve referenced from the Rhino model> x3204])
end = EndPoints(Curve=crv)  # -> Start, End
end_2 = EndPoints(Curve=crv_2)  # -> Start, End
end_3 = EndPoints(Curve=crv_3)  # -> Start, End
end_4 = EndPoints(Curve=crv_4)  # -> Start, End
end_5 = EndPoints(Curve=crv_5)  # -> Start, End
end_6 = EndPoints(Curve=crv_6)  # -> Start, End
end_7 = EndPoints(Curve=crv_7)  # -> Start, End
end_8 = EndPoints(Curve=crv_8)  # -> Start, End
end_9 = EndPoints(Curve=crv_9)  # -> Start, End
end_10 = EndPoints(Curve=crv_10)  # -> Start, End
hull = ConvexHull(Points=[end.Start, end.End], Plane=PlaneXY(0, 0, 0))  # -> Hull, HullZ, Indices
hull_2 = ConvexHull(Points=[end_2.Start, end_2.End], Plane=PlaneXY(0, 0, 0))  # -> Hull, HullZ, Indices
hull_3 = ConvexHull(Points=[end_4.Start, end_4.End], Plane=PlaneXY(0, 0, 0))  # -> Hull, HullZ, Indices
hull_4 = ConvexHull(Points=[end_5.Start, end_5.End], Plane=PlaneXY(0, 0, 0))  # -> Hull, HullZ, Indices
hull_5 = ConvexHull(Points=[end_6.Start, end_6.End], Plane=PlaneXY(0, 0, 0))  # -> Hull, HullZ, Indices
hull_6 = ConvexHull(Points=[end_3.Start, end_3.End], Plane=PlaneXY(0, 0, 0))  # -> Hull, HullZ, Indices
hull_7 = ConvexHull(Points=[end_7.Start, end_7.End], Plane=PlaneXY(0, 0, 0))  # -> Hull, HullZ, Indices
hull_8 = ConvexHull(Points=[end_8.Start, end_8.End], Plane=PlaneXY(0, 0, 0))  # -> Hull, HullZ, Indices
hull_9 = ConvexHull(Points=[end_9.Start, end_9.End], Plane=PlaneXY(0, 0, 0))  # -> Hull, HullZ, Indices
hull_10 = ConvexHull(Points=[end_10.Start, end_10.End], Plane=PlaneXY(0, 0, 0))  # -> Hull, HullZ, Indices

crv_11 = Curve([<curve referenced from the Rhino model> x30])
crv_12 = Curve([<curve referenced from the Rhino model> x246])
crv_13 = Curve([<curve referenced from the Rhino model> x75])
crv_14 = Curve([<curve referenced from the Rhino model> x57])
crv_15 = Curve([<curve referenced from the Rhino model> x45])
crv_16 = Curve([<curve referenced from the Rhino model> x32])
end_11 = EndPoints(Curve=crv_11)  # -> Start, End
end_12 = EndPoints(Curve=crv_12)  # -> Start, End
end_13 = EndPoints(Curve=crv_13)  # -> Start, End
end_14 = EndPoints(Curve=crv_14)  # -> Start, End
end_15 = EndPoints(Curve=crv_15)  # -> Start, End
end_16 = EndPoints(Curve=crv_16)  # -> Start, End
hull_11 = ConvexHull(Points=[end_11.Start, end_11.End], Plane=PlaneXY(0, 0, 0))  # -> Hull, HullZ, Indices
hull_12 = ConvexHull(Points=[end_12.Start, end_12.End], Plane=PlaneXY(0, 0, 0))  # -> Hull, HullZ, Indices
hull_13 = ConvexHull(Points=[end_13.Start, end_13.End], Plane=PlaneXY(0, 0, 0))  # -> Hull, HullZ, Indices
hull_14 = ConvexHull(Points=[end_14.Start, end_14.End], Plane=PlaneXY(0, 0, 0))  # -> Hull, HullZ, Indices
hull_15 = ConvexHull(Points=[end_15.Start, end_15.End], Plane=PlaneXY(0, 0, 0))  # -> Hull, HullZ, Indices
hull_16 = ConvexHull(Points=[end_16.Start, end_16.End], Plane=PlaneXY(0, 0, 0))  # -> Hull, HullZ, Indices

crv_17 = Curve([<curve referenced from the Rhino model> x642])
crv_18 = Curve([<curve referenced from the Rhino model> x45])
crv_19 = Curve([<curve referenced from the Rhino model> x233])
crv_20 = Curve([<curve referenced from the Rhino model> x143])
crv_21 = Curve([<curve referenced from the Rhino model> x6])
crv_22 = Curve([<curve referenced from the Rhino model> x26])
crv_23 = Curve([<curve referenced from the Rhino model> x82])
crv_24 = Curve([<curve referenced from the Rhino model> x66])
crv_25 = Curve([<curve referenced from the Rhino model> x79])
crv_26 = Curve([<curve referenced from the Rhino model> x171])
divide = DivideCurve(Curve=crv_19, Count=10, Kinks=False)  # -> flatten(Points), Tangents, Parameters
divide_2 = DivideCurve(Curve=crv_18, Count=10, Kinks=False)  # -> flatten(Points), Tangents, Parameters
divide_3 = DivideCurve(Curve=crv_20, Count=10, Kinks=False)  # -> flatten(Points), Tangents, Parameters
divide_4 = DivideCurve(Curve=crv_21, Count=10, Kinks=False)  # -> flatten(Points), Tangents, Parameters
divide_5 = DivideCurve(Curve=crv_22, Count=10, Kinks=False)  # -> flatten(Points), Tangents, Parameters
divide_6 = DivideCurve(Curve=crv_23, Count=10, Kinks=False)  # -> flatten(Points), Tangents, Parameters
end_17 = EndPoints(Curve=crv_17)  # -> Start, End
divide_7 = DivideCurve(Curve=crv_24, Count=10, Kinks=False)  # -> flatten(Points), Tangents, Parameters
divide_8 = DivideCurve(Curve=crv_25, Count=10, Kinks=False)  # -> flatten(Points), Tangents, Parameters
divide_9 = DivideCurve(Curve=crv_26, Count=10, Kinks=False)  # -> flatten(Points), Tangents, Parameters
hull_17 = ConvexHull(Points=[end_17.Start, end_17.End], Plane=PlaneXY(0, 0, 0))  # -> Hull, HullZ, Indices
hull_18 = ConvexHull(Points=divide_3.Points, Plane=PlaneXY(0, 0, 0))  # -> Hull, HullZ, Indices
hull_19 = ConvexHull(Points=divide_2.Points, Plane=PlaneXY(0, 0, 0))  # -> Hull, HullZ, Indices
hull_20 = ConvexHull(Points=divide_5.Points, Plane=PlaneXY(0, 0, 0))  # -> Hull, HullZ, Indices
hull_21 = ConvexHull(Points=divide_6.Points, Plane=PlaneXY(0, 0, 0))  # -> Hull, HullZ, Indices
hull_22 = ConvexHull(Points=divide.Points, Plane=PlaneXY(0, 0, 0))  # -> Hull, HullZ, Indices
hull_23 = ConvexHull(Points=divide_7.Points, Plane=PlaneXY(0, 0, 0))  # -> Hull, HullZ, Indices
hull_24 = ConvexHull(Points=divide_4.Points, Plane=PlaneXY(0, 0, 0))  # -> Hull, HullZ, Indices
hull_25 = ConvexHull(Points=divide_8.Points, Plane=PlaneXY(0, 0, 0))  # -> Hull, HullZ, Indices
hull_26 = ConvexHull(Points=divide_9.Points, Plane=PlaneXY(0, 0, 0))  # -> Hull, HullZ, Indices

crv_27 = Curve([<curve referenced from the Rhino model> x7])
crv_28 = Curve([<curve referenced from the Rhino model> x4])
crv_29 = Curve([<curve referenced from the Rhino model> x8])
crv_30 = Curve([<curve referenced from the Rhino model> x8])

crv_31 = Curve([<curve referenced from the Rhino model> x9])
crv_32 = Curve(<curve referenced from the Rhino model>)
crv_33 = Curve([<curve referenced from the Rhino model> x16])

crv_34 = Curve([<curve referenced from the Rhino model> x4])
crv_35 = Curve([<curve referenced from the Rhino model> x3])
crv_36 = Curve([<curve referenced from the Rhino model> x2])

crv_37 = Curve(<curve referenced from the Rhino model>)
crv_38 = Curve([<curve referenced from the Rhino model> x4])

crv_39 = Curve([<curve referenced from the Rhino model> x4])
crv_40 = Curve(<curve referenced from the Rhino model>)
crv_41 = Curve(<curve referenced from the Rhino model>)
crv_42 = Curve([<curve referenced from the Rhino model> x6])
crv_43 = Curve([<curve referenced from the Rhino model> x5])
crv_44 = Curve([<curve referenced from the Rhino model> x4])
crv_45 = Curve([<curve referenced from the Rhino model> x4])
crv_46 = Curve([<curve referenced from the Rhino model> x4])

end_18 = EndPoints(Curve=crv_28)  # -> Start, End
end_19 = EndPoints(Curve=crv_30)  # -> Start, End
end_20 = EndPoints(Curve=crv_35)  # -> Start, End
end_21 = EndPoints(Curve=crv_27)  # -> Start, End
end_22 = EndPoints(Curve=crv_29)  # -> Start, End
end_23 = EndPoints(Curve=crv_34)  # -> Start, End
end_24 = EndPoints(Curve=crv_36)  # -> Start, End
hull_27 = ConvexHull(Points=[end_18.Start, end_18.End], Plane=PlaneXY(0, 0, 0))  # -> Hull, HullZ, Indices
hull_28 = ConvexHull(Points=[end_20.Start, end_20.End], Plane=PlaneXY(0, 0, 0))  # -> Hull, HullZ, Indices
hull_29 = ConvexHull(Points=[end_19.Start, end_19.End], Plane=PlaneXY(0, 0, 0))  # -> Hull, HullZ, Indices
hull_30 = ConvexHull(Points=[end_21.Start, end_21.End], Plane=PlaneXY(0, 0, 0))  # -> Hull, HullZ, Indices
hull_31 = ConvexHull(Points=[end_22.Start, end_22.End], Plane=PlaneXY(0, 0, 0))  # -> Hull, HullZ, Indices
hull_32 = ConvexHull(Points=[end_24.Start, end_24.End], Plane=PlaneXY(0, 0, 0))  # -> Hull, HullZ, Indices
hull_33 = ConvexHull(Points=[end_23.Start, end_23.End], Plane=PlaneXY(0, 0, 0))  # -> Hull, HullZ, Indices
end_25 = EndPoints(Curve=crv_41)  # -> Start, End
end_26 = EndPoints(Curve=crv_40)  # -> Start, End
end_27 = EndPoints(Curve=crv_43)  # -> Start, End
end_28 = EndPoints(Curve=crv_44)  # -> Start, End
end_29 = EndPoints(Curve=crv_46)  # -> Start, End
end_30 = EndPoints(Curve=crv_42)  # -> Start, End
end_31 = EndPoints(Curve=crv_45)  # -> Start, End
end_32 = EndPoints(Curve=crv_39)  # -> Start, End
hull_34 = ConvexHull(Points=[end_25.Start, end_25.End], Plane=PlaneXY(0, 0, 0))  # -> Hull, HullZ, Indices
end_33 = EndPoints(Curve=crv_38)  # -> Start, End
end_34 = EndPoints(Curve=crv_37)  # -> Start, End
end_35 = EndPoints(Curve=crv_33)  # -> Start, End
end_36 = EndPoints(Curve=crv_31)  # -> Start, End
end_37 = EndPoints(Curve=crv_32)  # -> Start, End
hull_35 = ConvexHull(Points=[end_26.Start, end_26.End], Plane=PlaneXY(0, 0, 0))  # -> Hull, HullZ, Indices
hull_36 = ConvexHull(Points=[end_27.Start, end_27.End], Plane=PlaneXY(0, 0, 0))  # -> Hull, HullZ, Indices
hull_37 = ConvexHull(Points=[end_28.Start, end_28.End], Plane=PlaneXY(0, 0, 0))  # -> Hull, HullZ, Indices
hull_38 = ConvexHull(Points=[end_29.Start, end_29.End], Plane=PlaneXY(0, 0, 0))  # -> Hull, HullZ, Indices
hull_39 = ConvexHull(Points=[end_30.Start, end_30.End], Plane=PlaneXY(0, 0, 0))  # -> Hull, HullZ, Indices
hull_40 = ConvexHull(Points=[end_31.Start, end_31.End], Plane=PlaneXY(0, 0, 0))  # -> Hull, HullZ, Indices
hull_41 = ConvexHull(Points=[end_32.Start, end_32.End], Plane=PlaneXY(0, 0, 0))  # -> Hull, HullZ, Indices
hull_42 = ConvexHull(Points=[end_33.Start, end_33.End], Plane=PlaneXY(0, 0, 0))  # -> Hull, HullZ, Indices
hull_43 = ConvexHull(Points=[end_34.Start, end_34.End], Plane=PlaneXY(0, 0, 0))  # -> Hull, HullZ, Indices
hull_44 = ConvexHull(Points=[end_35.Start, end_35.End], Plane=PlaneXY(0, 0, 0))  # -> Hull, HullZ, Indices
hull_45 = ConvexHull(Points=[end_36.Start, end_36.End], Plane=PlaneXY(0, 0, 0))  # -> Hull, HullZ, Indices
hull_46 = ConvexHull(Points=[end_37.Start, end_37.End], Plane=PlaneXY(0, 0, 0))  # -> Hull, HullZ, Indices

crv_47 = Curve([<curve referenced from the Rhino model> x4806])
crv_48 = Curve([<curve referenced from the Rhino model> x62])
crv_49 = Curve([<curve referenced from the Rhino model> x62])
crv_50 = Curve([<curve referenced from the Rhino model> x16])
crv_51 = Curve([<curve referenced from the Rhino model> x3204])
crv_52 = Curve([<curve referenced from the Rhino model> x2415])
crv_53 = Curve([<curve referenced from the Rhino model> x24])
crv_54 = Curve([<curve referenced from the Rhino model> x5000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])
crv_55 = Curve([<curve referenced from the Rhino model> x4770])
crv_56 = Curve([<curve referenced from the Rhino model> x3204])
end_38 = EndPoints(Curve=crv_47)  # -> Start, End
end_39 = EndPoints(Curve=crv_48)  # -> Start, End
end_40 = EndPoints(Curve=crv_49)  # -> Start, End
end_41 = EndPoints(Curve=crv_50)  # -> Start, End
end_42 = EndPoints(Curve=crv_51)  # -> Start, End
end_43 = EndPoints(Curve=crv_52)  # -> Start, End
end_44 = EndPoints(Curve=crv_53)  # -> Start, End
end_45 = EndPoints(Curve=crv_54)  # -> Start, End
end_46 = EndPoints(Curve=crv_55)  # -> Start, End
end_47 = EndPoints(Curve=crv_56)  # -> Start, End
hull_47 = ConvexHull(Points=[end_38.Start, end_38.End], Plane=PlaneXY(0, 0, 0))  # -> Hull, HullZ, Indices
hull_48 = ConvexHull(Points=[end_39.Start, end_39.End], Plane=PlaneXY(0, 0, 0))  # -> Hull, HullZ, Indices
hull_49 = ConvexHull(Points=[end_40.Start, end_40.End], Plane=PlaneXY(0, 0, 0))  # -> Hull, HullZ, Indices
hull_50 = ConvexHull(Points=[end_41.Start, end_41.End], Plane=PlaneXY(0, 0, 0))  # -> Hull, HullZ, Indices
hull_51 = ConvexHull(Points=[end_42.Start, end_42.End], Plane=PlaneXY(0, 0, 0))  # -> Hull, HullZ, Indices
hull_52 = ConvexHull(Points=[end_43.Start, end_43.End], Plane=PlaneXY(0, 0, 0))  # -> Hull, HullZ, Indices
hull_53 = ConvexHull(Points=[end_44.Start, end_44.End], Plane=PlaneXY(0, 0, 0))  # -> Hull, HullZ, Indices
hull_54 = ConvexHull(Points=[end_45.Start, end_45.End], Plane=PlaneXY(0, 0, 0))  # -> Hull, HullZ, Indices
hull_55 = ConvexHull(Points=[end_46.Start, end_46.End], Plane=PlaneXY(0, 0, 0))  # -> Hull, HullZ, Indices
hull_56 = ConvexHull(Points=[end_47.Start, end_47.End], Plane=PlaneXY(0, 0, 0))  # -> Hull, HullZ, Indices

crv_57 = Curve([<curve referenced from the Rhino model> x45])
crv_58 = Curve(<curve referenced from the Rhino model>)
crv_59 = Curve([<curve referenced from the Rhino model> x9])
crv_60 = Curve([<curve referenced from the Rhino model> x4])
crv_61 = Curve([<curve referenced from the Rhino model> x8])
crv_62 = Curve([<curve referenced from the Rhino model> x28])
divide_10 = DivideCurve(Curve=crv_58, Count=10, Kinks=False)  # -> flatten(Points), Tangents, Parameters
divide_11 = DivideCurve(Curve=crv_60, Count=10, Kinks=False)  # -> flatten(Points), Tangents, Parameters
divide_12 = DivideCurve(Curve=crv_57, Count=10, Kinks=False)  # -> flatten(Points), Tangents, Parameters
divide_13 = DivideCurve(Curve=crv_62, Count=10, Kinks=False)  # -> flatten(Points), Tangents, Parameters
divide_14 = DivideCurve(Curve=crv_59, Count=10, Kinks=False)  # -> flatten(Points), Tangents, Parameters
divide_15 = DivideCurve(Curve=crv_61, Count=10, Kinks=False)  # -> flatten(Points), Tangents, Parameters
hull_57 = ConvexHull(Points=divide_10.Points, Plane=PlaneXY(0, 0, 0))  # -> Hull, HullZ, Indices
hull_58 = ConvexHull(Points=divide_11.Points, Plane=PlaneXY(0, 0, 0))  # -> Hull, HullZ, Indices
hull_59 = ConvexHull(Points=divide_15.Points, Plane=PlaneXY(0, 0, 0))  # -> Hull, HullZ, Indices
hull_60 = ConvexHull(Points=divide_13.Points, Plane=PlaneXY(0, 0, 0))  # -> Hull, HullZ, Indices
hull_61 = ConvexHull(Points=divide_12.Points, Plane=PlaneXY(0, 0, 0))  # -> Hull, HullZ, Indices
hull_62 = ConvexHull(Points=divide_14.Points, Plane=PlaneXY(0, 0, 0))  # -> Hull, HullZ, Indices

crv_63 = Curve([<curve referenced from the Rhino model> x293])
crv_64 = Curve([<curve referenced from the Rhino model> x10])
crv_65 = Curve([<curve referenced from the Rhino model> x81])
crv_66 = Curve([<curve referenced from the Rhino model> x81])
crv_67 = Curve([<curve referenced from the Rhino model> x36])
end_48 = EndPoints(Curve=crv_65)  # -> Start, End
end_49 = EndPoints(Curve=crv_63)  # -> Start, End
end_50 = EndPoints(Curve=crv_64)  # -> Start, End
end_51 = EndPoints(Curve=crv_66)  # -> Start, End
end_52 = EndPoints(Curve=crv_67)  # -> Start, End
hull_63 = ConvexHull(Points=[end_49.Start, end_49.End], Plane=PlaneXY(0, 0, 0))  # -> Hull, HullZ, Indices
hull_64 = ConvexHull(Points=[end_50.Start, end_50.End], Plane=PlaneXY(0, 0, 0))  # -> Hull, HullZ, Indices
hull_65 = ConvexHull(Points=[end_51.Start, end_51.End], Plane=PlaneXY(0, 0, 0))  # -> Hull, HullZ, Indices
hull_66 = ConvexHull(Points=[end_52.Start, end_52.End], Plane=PlaneXY(0, 0, 0))  # -> Hull, HullZ, Indices
hull_67 = ConvexHull(Points=[end_48.Start, end_48.End], Plane=PlaneXY(0, 0, 0))  # -> Hull, HullZ, Indices

crv_68 = Curve([<curve referenced from the Rhino model> x12])
crv_69 = Curve([<curve referenced from the Rhino model> x772])
crv_70 = Curve([<curve referenced from the Rhino model> x30])
crv_71 = Curve([<curve referenced from the Rhino model> x855])
crv_72 = Curve([<curve referenced from the Rhino model> x790])
crv_73 = Curve([<curve referenced from the Rhino model> x31])
divide_16 = DivideCurve(Curve=crv_70, Count=10, Kinks=False)  # -> flatten(Points), Tangents, Parameters
divide_17 = DivideCurve(Curve=crv_72, Count=10, Kinks=False)  # -> flatten(Points), Tangents, Parameters
end_53 = EndPoints(Curve=crv_68)  # -> Start, End
end_54 = EndPoints(Curve=crv_69)  # -> Start, End
divide_18 = DivideCurve(Curve=crv_71, Count=10, Kinks=False)  # -> flatten(Points), Tangents, Parameters
end_55 = EndPoints(Curve=crv_73)  # -> Start, End
hull_68 = ConvexHull(Points=[end_53.Start, end_53.End], Plane=PlaneXY(0, 0, 0))  # -> Hull, HullZ, Indices
hull_69 = ConvexHull(Points=divide_16.Points, Plane=PlaneXY(0, 0, 0))  # -> Hull, HullZ, Indices
hull_70 = ConvexHull(Points=[end_54.Start, end_54.End], Plane=PlaneXY(0, 0, 0))  # -> Hull, HullZ, Indices
hull_71 = ConvexHull(Points=divide_18.Points, Plane=PlaneXY(0, 0, 0))  # -> Hull, HullZ, Indices
hull_72 = ConvexHull(Points=divide_17.Points, Plane=PlaneXY(0, 0, 0))  # -> Hull, HullZ, Indices
hull_73 = ConvexHull(Points=[end_55.Start, end_55.End], Plane=PlaneXY(0, 0, 0))  # -> Hull, HullZ, Indices

crv_74 = Curve([<curve referenced from the Rhino model> x36])
end_56 = EndPoints(Curve=crv_74)  # -> Start, End
hull_74 = ConvexHull(Points=[end_56.Start, end_56.End], Plane=PlaneXY(0, 0, 0))  # -> Hull, HullZ, Indices

crv_75 = Curve([<curve referenced from the Rhino model> x8])
crv_76 = Curve([<curve referenced from the Rhino model> x3981])
crv_77 = Curve([<curve referenced from the Rhino model> x136])
crv_78 = Curve([<curve referenced from the Rhino model> x131])
crv_79 = Curve([<curve referenced from the Rhino model> x5000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])
crv_80 = Curve([<curve referenced from the Rhino model> x66])
crv_81 = Curve([<curve referenced from the Rhino model> x772])
crv_82 = Curve([<curve referenced from the Rhino model> x87])
end_57 = EndPoints(Curve=crv_75)  # -> Start, End
end_58 = EndPoints(Curve=crv_77)  # -> Start, End
end_59 = EndPoints(Curve=crv_76)  # -> Start, End
end_60 = EndPoints(Curve=crv_80)  # -> Start, End
end_61 = EndPoints(Curve=crv_82)  # -> Start, End
end_62 = EndPoints(Curve=crv_79)  # -> Start, End
end_63 = EndPoints(Curve=crv_78)  # -> Start, End
end_64 = EndPoints(Curve=crv_81)  # -> Start, End
hull_75 = ConvexHull(Points=[end_57.Start, end_57.End], Plane=PlaneXY(0, 0, 0))  # -> Hull, HullZ, Indices
hull_76 = ConvexHull(Points=[end_58.Start, end_58.End], Plane=PlaneXY(0, 0, 0))  # -> Hull, HullZ, Indices
hull_77 = ConvexHull(Points=[end_59.Start, end_59.End], Plane=PlaneXY(0, 0, 0))  # -> Hull, HullZ, Indices
hull_78 = ConvexHull(Points=[end_60.Start, end_60.End], Plane=PlaneXY(0, 0, 0))  # -> Hull, HullZ, Indices
hull_79 = ConvexHull(Points=[end_61.Start, end_61.End], Plane=PlaneXY(0, 0, 0))  # -> Hull, HullZ, Indices
hull_80 = ConvexHull(Points=[end_62.Start, end_62.End], Plane=PlaneXY(0, 0, 0))  # -> Hull, HullZ, Indices
hull_81 = ConvexHull(Points=[end_64.Start, end_64.End], Plane=PlaneXY(0, 0, 0))  # -> Hull, HullZ, Indices
hull_82 = ConvexHull(Points=[end_63.Start, end_63.End], Plane=PlaneXY(0, 0, 0))  # -> Hull, HullZ, Indices

crv_83 = Curve([<curve referenced from the Rhino model> x64])
crv_84 = Curve([<curve referenced from the Rhino model> x219])
crv_85 = Curve([<curve referenced from the Rhino model> x3192])
crv_86 = Curve([<curve referenced from the Rhino model> x813])
end_65 = EndPoints(Curve=crv_84)  # -> Start, End
end_66 = EndPoints(Curve=crv_83)  # -> Start, End
end_67 = EndPoints(Curve=crv_85)  # -> Start, End
end_68 = EndPoints(Curve=crv_86)  # -> Start, End
hull_83 = ConvexHull(Points=[end_66.Start, end_66.End], Plane=PlaneXY(0, 0, 0))  # -> Hull, HullZ, Indices
hull_84 = ConvexHull(Points=[end_67.Start, end_67.End], Plane=PlaneXY(0, 0, 0))  # -> Hull, HullZ, Indices
hull_85 = ConvexHull(Points=[end_65.Start, end_65.End], Plane=PlaneXY(0, 0, 0))  # -> Hull, HullZ, Indices
hull_86 = ConvexHull(Points=[end_68.Start, end_68.End], Plane=PlaneXY(0, 0, 0))  # -> Hull, HullZ, Indices

crv_87 = Curve([<curve referenced from the Rhino model> x12])
crv_88 = Curve([<curve referenced from the Rhino model> x49])
crv_89 = Curve([<curve referenced from the Rhino model> x1603])
crv_90 = Curve([<curve referenced from the Rhino model> x536])
crv_91 = Curve([<curve referenced from the Rhino model> x321])
crv_92 = Curve([<curve referenced from the Rhino model> x2])
crv_93 = Curve([<curve referenced from the Rhino model> x5000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])
crv_94 = Curve([<curve referenced from the Rhino model> x24])
crv_95 = Curve([<curve referenced from the Rhino model> x4806])
crv_96 = Curve([<curve referenced from the Rhino model> x2417])
crv_97 = Curve([<curve referenced from the Rhino model> x4771])
crv_98 = Curve([<curve referenced from the Rhino model> x6])
divide_19 = DivideCurve(Curve=crv_87, Count=10, Kinks=False)  # -> flatten(Points), Tangents, Parameters
divide_20 = DivideCurve(Curve=crv_88, Count=10, Kinks=False)  # -> flatten(Points), Tangents, Parameters
divide_21 = DivideCurve(Curve=crv_90, Count=10, Kinks=False)  # -> flatten(Points), Tangents, Parameters
divide_22 = DivideCurve(Curve=crv_91, Count=10, Kinks=False)  # -> flatten(Points), Tangents, Parameters
divide_23 = DivideCurve(Curve=crv_92, Count=10, Kinks=False)  # -> flatten(Points), Tangents, Parameters
divide_24 = DivideCurve(Curve=crv_98, Count=10, Kinks=False)  # -> flatten(Points), Tangents, Parameters
end_69 = EndPoints(Curve=crv_89)  # -> Start, End
end_70 = EndPoints(Curve=crv_93)  # -> Start, End
end_71 = EndPoints(Curve=crv_94)  # -> Start, End
end_72 = EndPoints(Curve=crv_95)  # -> Start, End
end_73 = EndPoints(Curve=crv_96)  # -> Start, End
end_74 = EndPoints(Curve=crv_97)  # -> Start, End
hull_87 = ConvexHull(Points=divide_19.Points, Plane=PlaneXY(0, 0, 0))  # -> Hull, HullZ, Indices
hull_88 = ConvexHull(Points=divide_20.Points, Plane=PlaneXY(0, 0, 0))  # -> Hull, HullZ, Indices
hull_89 = ConvexHull(Points=divide_21.Points, Plane=PlaneXY(0, 0, 0))  # -> Hull, HullZ, Indices
hull_90 = ConvexHull(Points=divide_22.Points, Plane=PlaneXY(0, 0, 0))  # -> Hull, HullZ, Indices
hull_91 = ConvexHull(Points=divide_23.Points, Plane=PlaneXY(0, 0, 0))  # -> Hull, HullZ, Indices
hull_92 = ConvexHull(Points=[end_70.Start, end_70.End], Plane=PlaneXY(0, 0, 0))  # -> Hull, HullZ, Indices
hull_93 = ConvexHull(Points=[end_71.Start, end_71.End], Plane=PlaneXY(0, 0, 0))  # -> Hull, HullZ, Indices
hull_94 = ConvexHull(Points=[end_72.Start, end_72.End], Plane=PlaneXY(0, 0, 0))  # -> Hull, HullZ, Indices
hull_95 = ConvexHull(Points=[end_73.Start, end_73.End], Plane=PlaneXY(0, 0, 0))  # -> Hull, HullZ, Indices
hull_96 = ConvexHull(Points=[end_74.Start, end_74.End], Plane=PlaneXY(0, 0, 0))  # -> Hull, HullZ, Indices
hull_97 = ConvexHull(Points=divide_24.Points, Plane=PlaneXY(0, 0, 0))  # -> Hull, HullZ, Indices
hull_98 = ConvexHull(Points=[end_69.Start, end_69.End], Plane=PlaneXY(0, 0, 0))  # -> Hull, HullZ, Indices

crv_99 = Curve([<curve referenced from the Rhino model> x5000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])
crv_100 = Curve([<curve referenced from the Rhino model> x4806])
crv_101 = Curve([<curve referenced from the Rhino model> x12])
crv_102 = Curve([<curve referenced from the Rhino model> x82])
crv_103 = Curve([<curve referenced from the Rhino model> x5000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])
end_75 = EndPoints(Curve=crv_99)  # -> Start, End
end_76 = EndPoints(Curve=crv_100)  # -> Start, End
end_77 = EndPoints(Curve=crv_101)  # -> Start, End
end_78 = EndPoints(Curve=crv_103)  # -> Start, End
end_79 = EndPoints(Curve=crv_102)  # -> Start, End
hull_99 = ConvexHull(Points=[end_75.Start, end_75.End], Plane=PlaneXY(0, 0, 0))  # -> Hull, HullZ, Indices
hull_100 = ConvexHull(Points=[end_78.Start, end_78.End], Plane=PlaneXY(0, 0, 0))  # -> Hull, HullZ, Indices
hull_101 = ConvexHull(Points=[end_76.Start, end_76.End], Plane=PlaneXY(0, 0, 0))  # -> Hull, HullZ, Indices
hull_102 = ConvexHull(Points=[end_77.Start, end_77.End], Plane=PlaneXY(0, 0, 0))  # -> Hull, HullZ, Indices
hull_103 = ConvexHull(Points=[end_79.Start, end_79.End], Plane=PlaneXY(0, 0, 0))  # -> Hull, HullZ, Indices

crv_104 = Curve([<curve referenced from the Rhino model> x32])
crv_105 = Curve([<curve referenced from the Rhino model> x5000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])
crv_106 = Curve([<curve referenced from the Rhino model> x26])
crv_107 = Curve([<curve referenced from the Rhino model> x60])
crv_108 = Curve([<curve referenced from the Rhino model> x68])
crv_109 = Curve([<curve referenced from the Rhino model> x35])
crv_110 = Curve([<curve referenced from the Rhino model> x1230])
crv_111 = Curve([<curve referenced from the Rhino model> x80])
crv_112 = Curve([<curve referenced from the Rhino model> x51])
crv_113 = Curve([<curve referenced from the Rhino model> x37])
divide_25 = DivideCurve(Curve=crv_111, Count=10, Kinks=False)  # -> flatten(Points), Tangents, Parameters
divide_26 = DivideCurve(Curve=crv_104, Count=10, Kinks=False)  # -> flatten(Points), Tangents, Parameters
divide_27 = DivideCurve(Curve=crv_112, Count=10, Kinks=False)  # -> flatten(Points), Tangents, Parameters
divide_28 = DivideCurve(Curve=crv_113, Count=10, Kinks=False)  # -> flatten(Points), Tangents, Parameters
divide_29 = DivideCurve(Curve=crv_107, Count=33, Kinks=False)  # -> flatten(Points), Tangents, Parameters
divide_30 = DivideCurve(Curve=crv_108, Count=10, Kinks=False)  # -> flatten(Points), Tangents, Parameters
divide_31 = DivideCurve(Curve=crv_109, Count=10, Kinks=False)  # -> flatten(Points), Tangents, Parameters
divide_32 = DivideCurve(Curve=crv_110, Count=10, Kinks=False)  # -> flatten(Points), Tangents, Parameters
end_80 = EndPoints(Curve=crv_105)  # -> Start, End
end_81 = EndPoints(Curve=crv_106)  # -> Start, End
hull_104 = ConvexHull(Points=divide_30.Points, Plane=PlaneXY(0, 0, 0))  # -> Hull, HullZ, Indices
hull_105 = ConvexHull(Points=divide_25.Points, Plane=PlaneXY(0, 0, 0))  # -> Hull, HullZ, Indices
hull_106 = ConvexHull(Points=[end_80.Start, end_80.End], Plane=PlaneXY(0, 0, 0))  # -> Hull, HullZ, Indices
hull_107 = ConvexHull(Points=divide_26.Points, Plane=PlaneXY(0, 0, 0))  # -> Hull, HullZ, Indices
hull_108 = ConvexHull(Points=divide_29.Points, Plane=PlaneXY(0, 0, 0))  # -> Hull, HullZ, Indices
hull_109 = ConvexHull(Points=[end_81.Start, end_81.End], Plane=PlaneXY(0, 0, 0))  # -> Hull, HullZ, Indices
hull_110 = ConvexHull(Points=divide_31.Points, Plane=PlaneXY(0, 0, 0))  # -> Hull, HullZ, Indices
hull_111 = ConvexHull(Points=divide_32.Points, Plane=PlaneXY(0, 0, 0))  # -> Hull, HullZ, Indices
hull_112 = ConvexHull(Points=divide_27.Points, Plane=PlaneXY(0, 0, 0))  # -> Hull, HullZ, Indices
hull_113 = ConvexHull(Points=divide_28.Points, Plane=PlaneXY(0, 0, 0))  # -> Hull, HullZ, Indices

crv_114 = Curve([<curve referenced from the Rhino model> x32])
crv_115 = Curve([<curve referenced from the Rhino model> x5000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])
crv_116 = Curve([<curve referenced from the Rhino model> x57])
crv_117 = Curve([<curve referenced from the Rhino model> x65])
crv_118 = Curve([<curve referenced from the Rhino model> x3204])
crv_119 = Curve([<curve referenced from the Rhino model> x12])
crv_120 = Curve([<curve referenced from the Rhino model> x82])
crv_121 = Curve([<curve referenced from the Rhino model> x38])
crv_122 = Curve([<curve referenced from the Rhino model> x97])
crv_123 = Curve([<curve referenced from the Rhino model> x948])
divide_33 = DivideCurve(Curve=crv_122, Count=10, Kinks=False)  # -> flatten(Points), Tangents, Parameters
divide_34 = DivideCurve(Curve=crv_114, Count=10, Kinks=False)  # -> flatten(Points), Tangents, Parameters
divide_35 = DivideCurve(Curve=crv_117, Count=10, Kinks=False)  # -> flatten(Points), Tangents, Parameters
divide_36 = DivideCurve(Curve=crv_118, Count=10, Kinks=False)  # -> flatten(Points), Tangents, Parameters
divide_37 = DivideCurve(Curve=crv_115, Count=10, Kinks=False)  # -> flatten(Points), Tangents, Parameters
divide_38 = DivideCurve(Curve=crv_119, Count=10, Kinks=False)  # -> flatten(Points), Tangents, Parameters
divide_39 = DivideCurve(Curve=crv_120, Count=10, Kinks=False)  # -> flatten(Points), Tangents, Parameters
divide_40 = DivideCurve(Curve=crv_123, Count=10, Kinks=False)  # -> flatten(Points), Tangents, Parameters
divide_41 = DivideCurve(Curve=crv_121, Count=10, Kinks=False)  # -> flatten(Points), Tangents, Parameters
divide_42 = DivideCurve(Curve=crv_116, Count=10, Kinks=False)  # -> flatten(Points), Tangents, Parameters
hull_114 = ConvexHull(Points=divide_34.Points, Plane=PlaneXY(0, 0, 0))  # -> Hull, HullZ, Indices
hull_115 = ConvexHull(Points=divide_35.Points, Plane=PlaneXY(0, 0, 0))  # -> Hull, HullZ, Indices
hull_116 = ConvexHull(Points=divide_36.Points, Plane=PlaneXY(0, 0, 0))  # -> Hull, HullZ, Indices
hull_117 = ConvexHull(Points=divide_38.Points, Plane=PlaneXY(0, 0, 0))  # -> Hull, HullZ, Indices
hull_118 = ConvexHull(Points=divide_39.Points, Plane=PlaneXY(0, 0, 0))  # -> Hull, HullZ, Indices
hull_119 = ConvexHull(Points=divide_33.Points, Plane=PlaneXY(0, 0, 0))  # -> Hull, HullZ, Indices
hull_120 = ConvexHull(Points=divide_37.Points, Plane=PlaneXY(0, 0, 0))  # -> Hull, HullZ, Indices
hull_121 = ConvexHull(Points=divide_40.Points, Plane=PlaneXY(0, 0, 0))  # -> Hull, HullZ, Indices
hull_122 = ConvexHull(Points=divide_41.Points, Plane=PlaneXY(0, 0, 0))  # -> Hull, HullZ, Indices
hull_123 = ConvexHull(Points=divide_42.Points, Plane=PlaneXY(0, 0, 0))  # -> Hull, HullZ, Indices

crv_124 = Curve([<curve referenced from the Rhino model> x12])
crv_125 = Curve([<curve referenced from the Rhino model> x44])
end_82 = EndPoints(Curve=crv_124)  # -> Start, End
end_83 = EndPoints(Curve=crv_125)  # -> Start, End
hull_124 = ConvexHull(Points=[end_82.Start, end_82.End], Plane=PlaneXY(0, 0, 0))  # -> Hull, HullZ, Indices
hull_125 = ConvexHull(Points=[end_83.Start, end_83.End], Plane=PlaneXY(0, 0, 0))  # -> Hull, HullZ, Indices

crv_126 = Curve([<curve referenced from the Rhino model> x31])
crv_127 = Curve([<curve referenced from the Rhino model> x71])
crv_128 = Curve([<curve referenced from the Rhino model> x62])
crv_129 = Curve(<curve referenced from the Rhino model>)

divide_43 = DivideCurve(Curve=crv_128, Count=10, Kinks=False)  # -> flatten(Points), Tangents, Parameters
divide_44 = DivideCurve(Curve=crv_126, Count=10, Kinks=False)  # -> flatten(Points), Tangents, Parameters
divide_45 = DivideCurve(Curve=crv_127, Count=10, Kinks=False)  # -> flatten(Points), Tangents, Parameters
divide_46 = DivideCurve(Curve=crv_129, Count=10, Kinks=False)  # -> flatten(Points), Tangents, Parameters

hull_126 = ConvexHull(Points=divide_44.Points, Plane=PlaneXY(0, 0, 0))  # -> Hull, HullZ, Indices
hull_127 = ConvexHull(Points=divide_43.Points, Plane=PlaneXY(0, 0, 0))  # -> Hull, HullZ, Indices
hull_128 = ConvexHull(Points=divide_46.Points, Plane=PlaneXY(0, 0, 0))  # -> Hull, HullZ, Indices
hull_129 = ConvexHull(Points=divide_45.Points, Plane=PlaneXY(0, 0, 0))  # -> Hull, HullZ, Indices

join = JoinCurves(
    Curves=[hull_80.Hull, hull_81.Hull, hull_78.Hull, hull_79.Hull, hull_75.Hull, hull_76.Hull, hull_77.Hull, hull_99.Hull, hull_101.Hull, hull_102.Hull, hull_100.Hull, hull_92.Hull, hull_93.Hull, hull_94.Hull, hull_95.Hull, hull_96.Hull, hull_98.Hull, hull_89.Hull, hull_91.Hull, hull_97.Hull, hull_90.Hull, hull_88.Hull, hull_82.Hull, hull_85.Hull, hull_84.Hull, hull_87.Hull, hull_86.Hull, hull_83.Hull, hull_120.Hull, hull_122.Hull, hull_117.Hull, hull_116.Hull, hull_114.Hull, hull_115.Hull, hull_119.Hull, hull_118.Hull, hull_123.Hull, hull_121.Hull, hull_113.Hull, hull_112.Hull, hull_105.Hull, hull_107.Hull, hull_106.Hull, hull_109.Hull, hull_108.Hull, hull_104.Hull, hull_110.Hull, hull_111.Hull, hull_128.Hull, hull_126.Hull, hull_129.Hull, hull_127.Hull, hull_68.Hull, hull_70.Hull, hull_69.Hull, hull_71.Hull, hull_73.Hull, hull_72.Hull, hull_124.Hull, hull_125.Hull, hull_74.Hull, hull_66.Hull, hull_64.Hull, hull_67.Hull, hull_65.Hull, hull_63.Hull, hull_54.Hull, hull_50.Hull, hull_56.Hull, hull_52.Hull, hull_53.Hull, hull_49.Hull, hull_55.Hull, hull_51.Hull, hull_48.Hull, hull_47.Hull, hull_16.Hull, hull_15.Hull, hull_13.Hull, hull_14.Hull, hull_12.Hull, hull_11.Hull, hull_10.Hull, hull_7.Hull, hull_8.Hull, hull_5.Hull, hull_3.Hull, hull_2.HullZ, hull.Hull, hull_4.Hull, hull_6.Hull, hull_22.Hull, hull_19.Hull, hull_24.Hull, hull_20.Hull, hull_17.Hull, hull_18.Hull, hull_21.Hull, hull_23.HullZ, hull_25.Hull, hull_26.Hull, hull_61.Hull, hull_59.Hull, hull_60.Hull, hull_62.Hull, hull_57.Hull, hull_58.Hull, hull_31.Hull, hull_29.Hull, hull_30.Hull, hull_27.Hull, hull_28.Hull, hull_32.Hull, hull_46.Hull, hull_44.Hull, hull_33.Hull, hull_45.Hull, hull_43.Hull, hull_42.Hull, hull_42.HullZ, hull_41.Hull, hull_34.Hull, hull_35.Hull, hull_39.Hull, hull_36.Hull, hull_37.Hull, hull_40.Hull, hull_38.Hull],
    Preserve=False)
C = ClusterOutput(join)
