# Grasshopper definition obstructedPath.gh (Grasshopper 0.9.76)
# plug-ins: Shortest Walk in Gh

crv = Curve([<curve referenced from the Rhino model> x222])
crv_2 = Curve([<curve referenced from the Rhino model> x4])
crv_3 = Curve([<curve referenced from the Rhino model> x95])
crv_4 = Curve([<curve referenced from the Rhino model> x95])
crv_5 = Curve([<curve referenced from the Rhino model> x97])
crv_6 = Curve([<curve referenced from the Rhino model> x91])
crv_7 = Curve([<curve referenced from the Rhino model> x76])
crv_8 = Curve([<curve referenced from the Rhino model> x95])
crv_9 = Curve([<curve referenced from the Rhino model> x2])
crv_10 = Curve([<curve referenced from the Rhino model> x20])
crv_11 = Curve([<curve referenced from the Rhino model> x34])
divide = DivideCurve(Curve=crv_9, Count=8, Kinks=False)  # -> Points, Tangents, Parameters
end = EndPoints(Curve=crv_4)  # -> Start, End
end_2 = EndPoints(Curve=crv_3)  # -> Start, End
crv_cp = CurveClosestPoint(Point=divide.Points, Curve=[crv_9, crv_10])  # -> Point, Parameter, Distance
end_3 = EndPoints(Curve=crv)  # -> Start, End
end_4 = EndPoints(Curve=crv_5)  # -> Start, End
end_5 = EndPoints(Curve=crv_8)  # -> Start, End
end_6 = EndPoints(Curve=crv_6)  # -> Start, End
end_7 = EndPoints(Curve=crv_2)  # -> Start, End
end_8 = EndPoints(Curve=crv_11)  # -> Start, End
end_9 = EndPoints(Curve=crv_7)  # -> Start, End
hull = ConvexHull(Points=flatten(crv_cp.Point), Plane=PlaneXY(0, 0, 0))  # -> Hull, HullZ, Indices
hull_2 = ConvexHull(Points=[end.Start, end.End], Plane=PlaneXY(0, 0, 0))  # -> Hull, HullZ, Indices
hull_3 = ConvexHull(Points=[end_4.Start, end_4.End], Plane=PlaneXY(0, 0, 0))  # -> Hull, HullZ, Indices
hull_4 = ConvexHull(Points=[end_2.Start, end_2.End], Plane=PlaneXY(0, 0, 0))  # -> Hull, HullZ, Indices
hull_5 = ConvexHull(Points=[end_3.Start, end_3.End], Plane=PlaneXY(0, 0, 0))  # -> Hull, HullZ, Indices
hull_6 = ConvexHull(Points=[end_8.Start, end_8.End], Plane=PlaneXY(0, 0, 0))  # -> Hull, HullZ, Indices
hull_7 = ConvexHull(Points=[end_7.Start, end_7.End], Plane=PlaneXY(0, 0, 0))  # -> Hull, HullZ, Indices
hull_8 = ConvexHull(Points=[end_5.Start, end_5.End], Plane=PlaneXY(0, 0, 0))  # -> Hull, HullZ, Indices
hull_9 = ConvexHull(Points=[end_6.Start, end_6.End], Plane=PlaneXY(0, 0, 0))  # -> Hull, HullZ, Indices
hull_10 = ConvexHull(Points=[end_9.Start, end_9.End], Plane=PlaneXY(0, 0, 0))  # -> Hull, HullZ, Indices

crv_12 = Curve([<curve referenced from the Rhino model> x4])
crv_13 = Curve([<curve referenced from the Rhino model> x94])
crv_14 = Curve([<curve referenced from the Rhino model> x200])
crv_15 = Curve([<curve referenced from the Rhino model> x8])
crv_16 = Curve([<curve referenced from the Rhino model> x4])
end_10 = EndPoints(Curve=crv_12)  # -> Start, End
end_11 = EndPoints(Curve=crv_13)  # -> Start, End
end_12 = EndPoints(Curve=crv_14)  # -> Start, End
end_13 = EndPoints(Curve=crv_15)  # -> Start, End
end_14 = EndPoints(Curve=crv_16)  # -> Start, End
hull_11 = ConvexHull(Points=[end_10.Start, end_10.End], Plane=PlaneXY(0, 0, 0))  # -> Hull, HullZ, Indices
hull_12 = ConvexHull(Points=[end_11.Start, end_11.End], Plane=PlaneXY(0, 0, 0))  # -> Hull, HullZ, Indices
hull_13 = ConvexHull(Points=[end_12.Start, end_12.End], Plane=PlaneXY(0, 0, 0))  # -> Hull, HullZ, Indices
hull_14 = ConvexHull(Points=[end_13.Start, end_13.End], Plane=PlaneXY(0, 0, 0))  # -> Hull, HullZ, Indices
hull_15 = ConvexHull(Points=[end_14.Start, end_14.End], Plane=PlaneXY(0, 0, 0))  # -> Hull, HullZ, Indices

crv_17 = Curve([<curve referenced from the Rhino model> x119])
crv_18 = Curve([<curve referenced from the Rhino model> x32])
crv_19 = Curve([<curve referenced from the Rhino model> x116])
crv_20 = Curve([<curve referenced from the Rhino model> x82])
crv_21 = Curve([<curve referenced from the Rhino model> x20])
crv_22 = Curve([<curve referenced from the Rhino model> x347])
crv_23 = Curve([<curve referenced from the Rhino model> x24])
crv_24 = Curve([<curve referenced from the Rhino model> x119])
crv_25 = Curve([<curve referenced from the Rhino model> x189])
crv_26 = Curve([<curve referenced from the Rhino model> x4])
crv_27 = Curve([<curve referenced from the Rhino model> x35])
crv_28 = Curve([<curve referenced from the Rhino model> x183])
crv_29 = Curve([<curve referenced from the Rhino model> x110])
crv_30 = Curve([<curve referenced from the Rhino model> x98])
crv_31 = Curve([<curve referenced from the Rhino model> x181])
crv_32 = Curve([<curve referenced from the Rhino model> x766])
crv_33 = Curve([<curve referenced from the Rhino model> x346])
crv_34 = Curve([<curve referenced from the Rhino model> x24])
crv_35 = Curve([<curve referenced from the Rhino model> x42])
crv_36 = Curve([<curve referenced from the Rhino model> x42])
crv_37 = Curve([<curve referenced from the Rhino model> x71])
crv_38 = Curve([<curve referenced from the Rhino model> x14])
divide_2 = DivideCurve(Curve=crv_17, Count=10, Kinks=False)  # -> flatten(Points), Tangents, Parameters
divide_3 = DivideCurve(Curve=crv_19, Count=33, Kinks=False)  # -> flatten(Points), Tangents, Parameters
divide_4 = DivideCurve(Curve=crv_20, Count=10, Kinks=False)  # -> flatten(Points), Tangents, Parameters
divide_5 = DivideCurve(Curve=crv_29, Count=10, Kinks=False)  # -> flatten(Points), Tangents, Parameters
divide_6 = DivideCurve(Curve=crv_30, Count=10, Kinks=False)  # -> flatten(Points), Tangents, Parameters
divide_7 = DivideCurve(Curve=crv_31, Count=10, Kinks=False)  # -> flatten(Points), Tangents, Parameters
divide_8 = DivideCurve(Curve=crv_24, Count=10, Kinks=False)  # -> flatten(Points), Tangents, Parameters
end_15 = EndPoints(Curve=crv_18)  # -> Start, End
end_16 = EndPoints(Curve=crv_28)  # -> Start, End
end_17 = EndPoints(Curve=crv_21)  # -> Start, End
end_18 = EndPoints(Curve=crv_22)  # -> Start, End
end_19 = EndPoints(Curve=crv_23)  # -> Start, End
end_20 = EndPoints(Curve=crv_32)  # -> Start, End
end_21 = EndPoints(Curve=crv_25)  # -> Start, End
end_22 = EndPoints(Curve=crv_33)  # -> Start, End
end_23 = EndPoints(Curve=crv_34)  # -> Start, End
end_24 = EndPoints(Curve=crv_26)  # -> Start, End
end_25 = EndPoints(Curve=crv_35)  # -> Start, End
end_26 = EndPoints(Curve=crv_36)  # -> Start, End
end_27 = EndPoints(Curve=crv_27)  # -> Start, End
end_28 = EndPoints(Curve=crv_37)  # -> Start, End
end_29 = EndPoints(Curve=crv_38)  # -> Start, End
hull_16 = ConvexHull(Points=[end_25.Start, end_25.End], Plane=PlaneXY(0, 0, 0))  # -> Hull, HullZ, Indices
hull_17 = ConvexHull(Points=[end_23.Start, end_23.End], Plane=PlaneXY(0, 0, 0))  # -> Hull, HullZ, Indices
hull_18 = ConvexHull(Points=[end_24.Start, end_24.End], Plane=PlaneXY(0, 0, 0))  # -> Hull, HullZ, Indices
hull_19 = ConvexHull(Points=divide_4.Points, Plane=PlaneXY(0, 0, 0))  # -> Hull, HullZ, Indices
hull_20 = ConvexHull(Points=[end_21.Start, end_21.End], Plane=PlaneXY(0, 0, 0))  # -> Hull, HullZ, Indices
hull_21 = ConvexHull(Points=[end_26.Start, end_26.End], Plane=PlaneXY(0, 0, 0))  # -> Hull, HullZ, Indices
hull_22 = ConvexHull(Points=[end_27.Start, end_27.End], Plane=PlaneXY(0, 0, 0))  # -> Hull, HullZ, Indices
hull_23 = ConvexHull(Points=[end_28.Start, end_28.End], Plane=PlaneXY(0, 0, 0))  # -> Hull, HullZ, Indices
hull_24 = ConvexHull(Points=[end_29.Start, end_29.End], Plane=PlaneXY(0, 0, 0))  # -> Hull, HullZ, Indices
hull_25 = ConvexHull(Points=[end_20.Start, end_20.End], Plane=PlaneXY(0, 0, 0))  # -> Hull, HullZ, Indices
hull_26 = ConvexHull(Points=divide_2.Points, Plane=PlaneXY(0, 0, 0))  # -> Hull, HullZ, Indices
hull_27 = ConvexHull(Points=divide_3.Points, Plane=PlaneXY(0, 0, 0))  # -> Hull, HullZ, Indices
hull_28 = ConvexHull(Points=divide_8.Points, Plane=PlaneXY(0, 0, 0))  # -> Hull, HullZ, Indices
hull_29 = ConvexHull(Points=[end_22.Start, end_22.End], Plane=PlaneXY(0, 0, 0))  # -> Hull, HullZ, Indices
hull_30 = ConvexHull(Points=[end_15.Start, end_15.End], Plane=PlaneXY(0, 0, 0))  # -> Hull, HullZ, Indices
hull_31 = ConvexHull(Points=[end_16.Start, end_16.End], Plane=PlaneXY(0, 0, 0))  # -> Hull, HullZ, Indices
hull_32 = ConvexHull(Points=divide_5.Points, Plane=PlaneXY(0, 0, 0))  # -> Hull, HullZ, Indices
hull_33 = ConvexHull(Points=[end_17.Start, end_17.End], Plane=PlaneXY(0, 0, 0))  # -> Hull, HullZ, Indices
hull_34 = ConvexHull(Points=divide_6.Points, Plane=PlaneXY(0, 0, 0))  # -> Hull, HullZ, Indices
hull_35 = ConvexHull(Points=[end_18.Start, end_18.End], Plane=PlaneXY(0, 0, 0))  # -> Hull, HullZ, Indices
hull_36 = ConvexHull(Points=[end_19.Start, end_19.End], Plane=PlaneXY(0, 0, 0))  # -> Hull, HullZ, Indices
hull_37 = ConvexHull(Points=divide_7.Points, Plane=PlaneXY(0, 0, 0))  # -> Hull, HullZ, Indices

crv_39 = Curve([<curve referenced from the Rhino model> x364])
crv_40 = Curve([<curve referenced from the Rhino model> x55])
crv_41 = Curve([<curve referenced from the Rhino model> x110])
crv_42 = Curve([<curve referenced from the Rhino model> x90])
crv_43 = Curve([<curve referenced from the Rhino model> x89])
divide_9 = DivideCurve(Curve=crv_39, Count=10, Kinks=False)  # -> flatten(Points), Tangents, Parameters
divide_10 = DivideCurve(Curve=crv_40, Count=10, Kinks=False)  # -> flatten(Points), Tangents, Parameters
divide_11 = DivideCurve(Curve=crv_42, Count=10, Kinks=False)  # -> flatten(Points), Tangents, Parameters
divide_12 = DivideCurve(Curve=crv_41, Count=10, Kinks=False)  # -> flatten(Points), Tangents, Parameters
divide_13 = DivideCurve(Curve=crv_43, Count=10, Kinks=False)  # -> flatten(Points), Tangents, Parameters
hull_38 = ConvexHull(Points=divide_12.Points, Plane=PlaneXY(0, 0, 0))  # -> Hull, HullZ, Indices
hull_39 = ConvexHull(Points=divide_11.Points, Plane=PlaneXY(0, 0, 0))  # -> Hull, HullZ, Indices
hull_40 = ConvexHull(Points=divide_10.Points, Plane=PlaneXY(0, 0, 0))  # -> Hull, HullZ, Indices
hull_41 = ConvexHull(Points=divide_13.Points, Plane=PlaneXY(0, 0, 0))  # -> Hull, HullZ, Indices
hull_42 = ConvexHull(Points=divide_9.Points, Plane=PlaneXY(0, 0, 0))  # -> Hull, HullZ, Indices

crv_44 = Curve([<curve referenced from the Rhino model> x254])
crv_45 = Curve([<curve referenced from the Rhino model> x3])
crv_46 = Curve([<curve referenced from the Rhino model> x16])
crv_47 = Curve([<curve referenced from the Rhino model> x34])
end_30 = EndPoints(Curve=crv_44)  # -> Start, End
divide_14 = DivideCurve(Curve=crv_45, Count=10, Kinks=False)  # -> flatten(Points), Tangents, Parameters
end_31 = EndPoints(Curve=crv_47)  # -> Start, End
end_32 = EndPoints(Curve=crv_46)  # -> Start, End
hull_43 = ConvexHull(Points=divide_14.Points, Plane=PlaneXY(0, 0, 0))  # -> Hull, HullZ, Indices
hull_44 = ConvexHull(Points=[end_32.Start, end_32.End], Plane=PlaneXY(0, 0, 0))  # -> Hull, HullZ, Indices
hull_45 = ConvexHull(Points=[end_30.Start, end_30.End], Plane=PlaneXY(0, 0, 0))  # -> Hull, HullZ, Indices
hull_46 = ConvexHull(Points=[end_31.Start, end_31.End], Plane=PlaneXY(0, 0, 0))  # -> Hull, HullZ, Indices

wall_crv = Curve([<curve referenced from the Rhino model> x8])
wall_crv_2 = Curve([<curve referenced from the Rhino model> x4])

wall_srf = Surface([<surface referenced from the Rhino model> x3])
wall_srf_2 = Surface([<surface referenced from the Rhino model> x8])

wall_crv_3 = Curve([<curve referenced from the Rhino model> x4])

wall_crv_4 = Curve([<curve referenced from the Rhino model> x4])
wall_crv_5 = Curve([<curve referenced from the Rhino model> x8])

columns = Surface([<surface referenced from the Rhino model> x14])
join = JoinCurves(
    Curves=[hull_4.Hull, hull_2.Hull, hull_3.Hull, hull_8.Hull, hull_9.Hull, hull.Hull, hull_5.Hull, hull_10.Hull, hull_7.Hull, hull_6.Hull, hull_11.Hull, hull_12.Hull, hull_13.Hull, hull_14.Hull, hull_15.Hull, hull_26.Hull, hull_30.Hull, hull_31.Hull, hull_27.Hull, hull_19.Hull, hull_32.Hull, hull_33.Hull, hull_35.Hull, hull_34.Hull, hull_36.Hull, hull_37.Hull, hull_25.Hull, hull_29.Hull, hull_17.Hull, hull_20.Hull, hull_28.Hull, hull_18.Hull, hull_42.Hull, hull_40.Hull, hull_38.Hull, hull_39.Hull, hull_41.Hull, hull_45.Hull, hull_43.Hull, hull_44.Hull, hull_46.Hull, hull_16.Hull, hull_21.Hull, hull_22.Hull, hull_23.Hull, hull_24.Hull, columns, wall_srf, wall_srf_2, wall_crv, wall_crv_2, wall_crv_3, wall_crv_4, wall_crv_5],
    Preserve=False)
overall_boundary = Curve(<curve referenced from the Rhino model>)
rdiff = RegionDifference(CurvesA=overall_boundary, CurvesB=join)
brect = Brect(object=overall_boundary)
final_boundary = BoundarySurfaces(Edges=rdiff)  # disabled
pop2d = Populate2D(Region=brect, Count=Slider(4000, range=0..11000), Seed=1)
cullout = CullOut(pt=pop2d, C=overall_boundary)
del = DelaunayMesh(Points=cullout, Plane=PlaneXY(0, 0, 0))
cluster = Cluster(mesh=del, exclusioncrv=join)
crv_48 = Curve(cluster)

# ---- group: from
pt = Point(Point(38818.43411, -5873.790657, 0))

# ---- group: to
pt_2 = Point(Point(69258.05613, 15977.30077, 0))

# ----
explode = Explode(Curve=crv_48, Recursive=True)  # -> Segments, Vertices
ln = Line(PointA=pt, PointB=pt_2)
crv_49 = Curve(flatten(explode.Segments))
shortwalk = ShortestWalk(Curves=crv_49, WantedPath=ln)  # -> ShortestWalk, Succession, Direction, Length
computed_length_along_path = Panel(shortwalk.Length)
eval = EvaluateLength(Curve=shortwalk.ShortestWalk, Length=[0, 1], Normalized=True)  # -> Point, Tangent, Parameter
Z = UnitZ(Factor=1)
# directions along path
item = ListItem(List=crv_49, Index=shortwalk.Succession, Wrap=False)
# start and end boxes
box = CenterBox(Base=eval.Point, X=0.1, Y=0.1, Z=0.07)
xprod = CrossProduct(VectorA=Z, VectorB=eval.Tangent, Unitize=False)  # -> Vector, Length
end_33 = EndPoints(Curve=item)  # -> Start, End
eval_2 = EvaluateLength(Curve=item, Length=0.5, Normalized=True)  # -> Point, Tangent, Parameter
pl = Plane(Origin=eval.Point, XAxis=xprod.Vector, YAxis=Z)
T = Text(["START", "GOAL"])
vec2pt = Vector2Pt(PointA=end_33.Start, PointB=end_33.End, Unitize=False)  # -> Vector, Length
remap = RemapNumbers(Values=shortwalk.Direction, Source=Domain(0, 1), Target=Domain(-0.1, 0.1))
amp = Amplitude(Vector=vec2pt.Vector, Amplitude=remap)
tag = TextTag(Location=pl, Text=T)
vdis = VectorDisplay(Anchor=eval_2.Point, Vector=amp)

# ==== cluster Brect
object = ClusterInput()
object_2 = Geometry(object)
bbox = BoundingBox(Content=object_2, Plane=PlaneXY(0, 0, 0))  # -> Box, Box_2
boxprop = BoxProperties(Box=bbox.Box)  # -> Center, Diagonal, Area, Volume, Degeneracy
devec = DeconstructVector(Vector=boxprop.Diagonal)  # -> XComponent, YComponent, ZComponent
move = Move(Geometry=boxprop.Center, Motion=expr("x*-0.5", boxprop.Diagonal))  # -> Geometry, Transform
rectangle = Rectangle(Plane=move.Geometry, XSize=devec.XComponent, YSize=devec.YComponent, Radius=0)  # -> Rectangle, Length
R = ClusterOutput(rectangle.Rectangle)

# ==== cluster Cluster
exclusioncrv = ClusterInput()
mesh = ClusterInput()
exclusioncrv_2 = Curve(flatten(exclusioncrv))
mesh_2 = Mesh(mesh)
medges = MeshEdges(Mesh=mesh_2)  # -> NakedEdges, InteriorEdges, NonManifoldEdges
merge = Merge(Data1=medges.NakedEdges, Data2=medges.InteriorEdges, Data3=medges.NonManifoldEdges)
edges = Curve(merge)
curvepoint = PointOnCurve(edges, parameter=0.5)
incurves = PointInCurves(Point=curvepoint, Curves=exclusioncrv_2)  # -> Relationship, Index, Point
inside = Integer(2)
equals = Equality(FirstNumber=incurves.Relationship, SecondNumber=inside)  # -> Equality, Inequality
not = GateNot(A=equals.Equality)
cull = CullPattern(List=edges, CullPattern=flatten(not))
filteredcrv = Curve(cull)
exclusioncrv_3 = Curve(exclusioncrv_2)
ccx = CurveCurve(CurveA=filteredcrv, CurveB=graft(exclusioncrv_3))  # -> Points, simplify(ParamsA), ParamsB
path_mapper = PathMapper(ccx.ParamsA, source="{A;B}", target="{B}")
python = PythonScript(x=path_mapper)  # -> out, flatten(a); inputs x: list
# ---------- python: Python ----------
if x != []:
    print x
a =  x == []
# ---------- end python ----------
cull_2 = CullPattern(List=filteredcrv, CullPattern=python.a)
filteredcrv_2 = Curve(cull_2)
filteredcrv_3 = ClusterOutput(filteredcrv_2)

# ==== cluster CullOut
pt = ClusterInput()
C = ClusterInput()
pt_2 = Point(pt)
incurve = PointInCurve(Point=pt_2, Curve=C)  # -> Relationship, Point
cull = CullPattern(List=pt_2, CullPattern=incurve.Relationship)
L = ClusterOutput(cull)
