# Grasshopper definition prototype004.gh (Grasshopper 0.9.76)
# plug-ins: Python Interpreter, horsterCameraControl

# tube is really 90mmOD and 2mm wall, but I've given it some tollerance.
tube_wall_thickness = Slider(1, range=0..10)
sensor_tube_height = Slider(55, range=40..100)
lens_tube_height = Slider(90, range=40..100)
mirror_diameter = Slider(76.2, range=40..100)
pi_tube_height = Slider(120, range=70..200)
tube_radius = Slider(36.4, range=0..100)
cam_plug_height = Slider(10, range=10..30)
cam_lens_radius = Slider(8.4, range=3..10)

# ---- group: camera position tweak
addition = Addition(A=pi_tube_height, B=Slider(6.7, range=0..11))

# ---- group: base plug controls
pi_recess_depth = Slider(18, range=0..100)
pi_screw_height = Slider(11, range=0..15)
through_cut = Slider(11, range=0..15)
baseplugheight = Slider(20, range=0..100)

# ----
lens_groove_depth = Slider(3, range=0..10)
post_outside_rad = Slider(4.8, range=0..20)
xy = XYPlane(Origin=Point(0, 0, 0))

pole_length = Slider(-460, range=-1000..1001)
pt = Point(<point referenced from the Rhino model>)

cameramesh = Mesh([<mesh referenced from the Rhino model> x9])
pl_offset = PlaneOffset(BasePlane=xy, Offset=expr("x*-1", sensor_tube_height))
pl_offset_2 = PlaneOffset(BasePlane=xy, Offset=pi_tube_height)

# ---- group: camera
Z = UnitZ(Factor=1)
Z_2 = UnitZ(Factor=addition)
move = Move(Geometry=pl_offset_2, Motion=Z)  # -> Geometry, Transform
move_2 = Move(Geometry=cameramesh, Motion=Z_2)  # -> Geometry, Transform
setcam = SetCamera(
    CameraLocation=pl_offset_2,
    TargetLocation=move.Geometry,
    LensLength=Slider(18, range=5..60),
    UpDirection=Z,
    Activate=True)

# ----
number_slider = Slider(13, range=0..100)  # disabled

# ---- group: Pole
Z_3 = UnitZ(Factor=pi_tube_height)
cir = Circle(Plane=pt, Radius=post_outside_rad)
Z_4 = UnitZ(Factor=pole_length)
extr = Extrude(Base=cir, Direction=Z_4)

# ----
addition_2 = Addition(A=tube_radius, B=tube_wall_thickness)
Z_5 = UnitZ(Factor=cam_plug_height)
cir_2 = Circle(Plane=pl_offset_2, Radius=addition_2)
move_3 = Move(Geometry=cir_2, Motion=expr("x*-0.5", Z_5))  # -> Geometry, Transform
boundary = BoundarySurfaces(Edges=move_3.Geometry)
extr_2 = Extrude(Base=boundary, Direction=Z_5)

# ---- group: base plug mass
subtraction = Subtraction(A=tube_radius, B=tube_wall_thickness)
cir_3 = Circle(Plane=PlaneXY(0, 0, 0), Radius=subtraction)
boundary_2 = BoundarySurfaces(Edges=cir_3)
Z_6 = UnitZ(Factor=baseplugheight)
extr_3 = Extrude(Base=boundary_2, Direction=Z_6)

# ---- group: port holes
crv = Curve([<curve referenced from the Rhino model> x3])
Z_7 = UnitZ(Factor=through_cut)
boundary_3 = BoundarySurfaces(Edges=crv)
extr_4 = Extrude(Base=boundary_3, Direction=Z_7)

# ---- group: pi recess
crv_2 = Curve([<curve referenced from the Rhino model> x4])
Z_8 = UnitZ(Factor=baseplugheight)
move_4 = Move(Geometry=crv_2, Motion=Z_8)  # -> Geometry, Transform
Z_9 = UnitZ(Factor=expr("-x", pi_recess_depth))
boundary_4 = BoundarySurfaces(Edges=move_4.Geometry)
extr_5 = Extrude(Base=boundary_4, Direction=Z_9)
sunion = SolidUnion(Breps=extr_5)

# ---- group: screw posts
crv_3 = Curve([<curve referenced from the Rhino model> x3])  # disabled
Z_10 = UnitZ(Factor=baseplugheight)  # disabled
move_5 = Move(Geometry=crv_3, Motion=Z_10)  # -> Geometry, Transform; disabled
Z_11 = UnitZ(Factor=pi_screw_height)  # disabled
boundary_5 = BoundarySurfaces(Edges=move_5.Geometry)  # disabled
extr_6 = Extrude(Base=boundary_5, Direction=Z_11)  # disabled

# ----
pln = Plane(pl_offset_2)

subtraction_2 = Subtraction(A=tube_radius, B=tube_wall_thickness)
Z_12 = UnitZ(Factor=cam_plug_height)
Z_13 = UnitZ(Factor=lens_groove_depth)
cir_4 = Circle(Plane=pl_offset_2, Radius=subtraction_2)
cir_5 = Circle(Plane=pl_offset_2, Radius=tube_radius)
move_6 = Move(Geometry=[cir_4, cir_5], Motion=expr("x*0.5", Z_12))  # -> Geometry, Transform
boundary_6 = BoundarySurfaces(Edges=move_6.Geometry)
extr_7 = Extrude(Base=boundary_6, Direction=expr("-x", Z_13))

cp = PlaneClosestPoint(Point=pt, Plane=pln)  # -> Point, UVPoint, Distance; disabled

# ---- group: lens hole
cir_6 = Circle(Plane=pln, Radius=cam_lens_radius)
Z_14 = UnitZ(Factor=100)
boundary_7 = BoundarySurfaces(Edges=cir_6)
extr_8 = Extrude(Base=boundary_7, Direction=Z_14)

# ---- group: lens tube
tube = Tube(thickness=tube_wall_thickness, od=tube_radius, height=lens_tube_height, pln=pl_offset_2)

# ---- group: pi tube
tube_2 = Tube(thickness=tube_wall_thickness, od=tube_radius, height=pi_tube_height, pln=xy)

# ---- group: vent slots
cut_vertical_offset = Slider(57, range=0..100)
saw_thickness = Slider(2, range=0..10)
saw_diameter = Slider(50, range=0..100)
saw_centre_offset = Slider(74, range=50..100)
saw_angle = Slider(32, range=0..100)
X = UnitX(Factor=1)
xy_2 = XYPlane(Origin=Point(0, 0, 0))
rectangle = Rectangle(Plane=PlaneXY(0, 0, 0), XSize=saw_thickness, YSize=saw_diameter, Radius=expr("x*0.5", saw_thickness))  # -> Rectangle, Length
Y = UnitY(Factor=saw_centre_offset)
rad = Radians(Degrees=saw_angle)
line = LineSDL(Start=xy_2, Direction=X, Length=1)
revsrf = Revolution(Curve=rectangle.Rectangle, Axis=line, Domain=Domain(0, 6.283185307))
move_7 = Move(Geometry=revsrf, Motion=Y)  # -> Geometry, Transform
rotate = Rotate(Geometry=move_7.Geometry, Angle=rad, Plane=PlaneXZ(0, 0, 0))  # -> Geometry, Transform
arrpolar = PolarArray(Geometry=rotate.Geometry, Plane=PlaneXY(0, 0, 0), Count=Slider(11, range=0..100), Angle=6.283185307)  # -> Geometry, Transform
Z_15 = UnitZ(Factor=cut_vertical_offset)
brep = Brep(tube_2)
move_8 = Move(Geometry=arrpolar.Geometry, Motion=Z_15)  # -> Geometry, Transform
bbx = BrepBrep(BrepA=move_8.Geometry, BrepB=brep)  # -> Curves, Points

# ---- group: sensor tube
tube_3 = Tube(thickness=tube_wall_thickness, od=tube_radius, height=sensor_tube_height, pln=pl_offset)

# ----
cir_7 = Circle(Plane=cp.Point, Radius=number_slider)  # disabled
boundary_8 = BoundarySurfaces(Edges=cir_7)

multiplication = Multiplication(A=tube_radius, B=Slider(1.2, range=0..2))
cir_8 = Circle(Plane=pln, Radius=multiplication)
Z_16 = UnitZ(Factor=cam_plug_height)
Z_17 = UnitZ(Factor=Slider(3.5, range=0..4))
rdiff = RegionDifference(CurvesA=cir_8, CurvesB=boundary_8)
boundary_9 = BoundarySurfaces(Edges=rdiff)
move_9 = Move(Geometry=boundary_9, Motion=Z_17)  # -> Geometry, Transform
extr_9 = Extrude(Base=move_9.Geometry, Direction=expr("-x", Z_16))

cir_9 = Circle(Plane=pln, Radius=tube_radius)
Z_18 = UnitZ(Factor=cam_plug_height)
rdiff_2 = RegionDifference(CurvesA=cir_9, CurvesB=boundary_8)
boundary_10 = BoundarySurfaces(Edges=rdiff_2)
extr_10 = Extrude(Base=boundary_10, Direction=expr("-x", Z_18))

hsl = ColourHSL(Alpha=0.1, Hue=0.5, Saturation=1, Luminance=0.5)
cir_10 = Circle(Plane=cp.Point, Radius=1)  # disabled
preview = CustomPreview(Geometry=[tube, tube_3, tube_2], Shader=hsl)
boundary_11 = BoundarySurfaces(Edges=cir_10)  # disabled
sdiff = SolidDifference(BrepsA=extr_3, BrepsB=sunion)
extr_11 = Extrude(Base=boundary_11, Direction=expr("-x", Z_18))  # disabled
sunion_2 = SolidUnion(Breps=[sdiff, extr_6])
sunion_3 = SolidUnion(Breps=flatten([extr_10, extr_9, extr_8]))
sdiff_2 = SolidDifference(BrepsA=sunion_2, BrepsB=extr_4)
sdiff_3 = SolidDifference(BrepsA=extr_2, BrepsB=sunion_3)
sdiff_4 = SolidDifference(BrepsA=sdiff_2, BrepsB=extr)
sdiff_5 = SolidDifference(BrepsA=sdiff_3, BrepsB=extr_7)

# ---- group: mirror
mirror_diameter_2 = Number(expr("x/2", mirror_diameter))
pl_offset_3 = PlaneOffset(BasePlane=pl_offset_2, Offset=lens_tube_height)
cir_11 = Circle(Plane=pl_offset_3, Radius=mirror_diameter_2)
sph = Sphere(Base=pl_offset_3, Radius=mirror_diameter_2)
boundary_12 = BoundarySurfaces(Edges=cir_11)
Z_19 = UnitZ(Factor=mirror_diameter_2)
extr_12 = Extrude(Base=boundary_12, Direction=Z_19)
sdiff_6 = SolidDifference(BrepsA=sph, BrepsB=extr_12)

# ----
preview_2 = CustomPreview(Geometry=sdiff_2, Shader=ColourSwatch(SwatchColor=RGB(255, 0, 0)))  # disabled

# ---- group: vent slots / scrap inner curve
python = PythonScript(x=bbx.Curves)  # -> flatten(a); inputs x: list
# ---------- python: Python ----------
a=x[0]
# ---------- end python ----------

# ---- group: top cap
addition_3 = Addition(A=tube_radius, B=tube_wall_thickness)
Z_20 = UnitZ(Factor=cam_plug_height)
cir_12 = Circle(Plane=pl_offset_2, Radius=addition_3)
move_10 = Move(Geometry=cir_12, Motion=expr("x*-0.5", Z_20))  # -> Geometry, Transform
boundary_13 = BoundarySurfaces(Edges=move_10.Geometry)
extr_13 = Extrude(Base=boundary_13, Direction=Z_20)

subtraction_3 = Subtraction(A=tube_radius, B=tube_wall_thickness)
Z_21 = UnitZ(Factor=cam_plug_height)
Z_22 = UnitZ(Factor=lens_groove_depth)
cir_13 = Circle(Plane=pl_offset_2, Radius=subtraction_3)
cir_14 = Circle(Plane=pl_offset_2, Radius=tube_radius)
move_11 = Move(Geometry=[cir_13, cir_14], Motion=expr("x*0.5", Z_21))  # -> Geometry, Transform
boundary_14 = BoundarySurfaces(Edges=move_11.Geometry)
extr_14 = Extrude(Base=boundary_14, Direction=expr("-x", Z_22))

# ----
sensor_tube = Geometry(tube_3)
pi = Mesh([<mesh referenced from the Rhino model> x11])
lens_tube = Geometry(tube)
reflector = Geometry(sdiff_6)
camera = Geometry(move_2.Geometry)
base_plug = Geometry(sdiff_4)
pi_tube = Geometry(brep)
pole = Geometry(extr)
Z_23 = UnitZ(Factor=Slider(-1, range=-100..10))
cluster = Cluster(S=Slider(95, range=0..145), N=Slider(0.76, range=0..1), C_2=Slider(31, range=0..100), srf=sph, C=move_2.Geometry)
sdiff_7 = SolidDifference(BrepsA=sdiff_5, BrepsB=extr_11)
move_12 = Move(Geometry=extr_7, Motion=Z_23)  # -> Geometry, Transform
merge = Merge(Data1=pi, Data2=camera)  # -> flatten(Result)
preview_3 = CustomPreview(Geometry=cluster, Shader=ColourSwatch(SwatchColor=RGB(255, 255, 255)))
join = BrepJoin(Breps=[move_12.Geometry, sdiff_7])  # -> Breps, Closed
geo = Geometry(join.Breps)

# ---- group: top cap
sdiff_8 = SolidDifference(BrepsA=extr_13, BrepsB=extr_14)
mirror = Mirror(Geometry=sdiff_8, Plane=pl_offset_2)  # -> Geometry, Transform
Z_24 = UnitZ(Factor=lens_tube_height)
move_13 = Move(Geometry=mirror.Geometry, Motion=Z_24)  # -> Geometry, Transform

# ----
top_cap = Geometry(move_13.Geometry)
merge_2 = Merge(
    Data1=top_cap,
    Data2=reflector,
    Data3=lens_tube,
    Data4=geo,
    Data5=pi_tube,
    Data6=base_plug,
    Data7=sensor_tube,
    Data8=pole)

# ---- group: section
dashed_behind_depth = Slider(10, range=0..20)
xz = XZPlane(Origin=Point(0, 0, 0))
pl_offset_4 = PlaneOffset(BasePlane=xz, Offset=dashed_behind_depth)
sec = MeshPlane(Mesh=merge, Plane=xz)
sec_2 = BrepPlane(Brep=merge_2, Plane=xz)  # -> Curves, Points
X_2 = UnitX(Factor=Slider(155, range=0..300))
sec_3 = MeshPlane(Mesh=merge, Plane=pl_offset_4)
sec_4 = BrepPlane(Brep=merge_2, Plane=pl_offset_4)  # -> Curves, Points
dash = DashPattern(Curve=[sec_3, sec_4.Curves], Pattern=2.236067977)  # -> Dashes, Gaps; disabled
move_14 = Move(Geometry=[sec, sec_2.Curves, dash.Dashes], Motion=X_2)  # -> Geometry, Transform

# ---- group: labels
number_slider_2 = Slider(52, range=0..100)
number_slider_3 = Slider(5, range=5..30)
X_3 = UnitX(Factor=1)
label = Label(thing=geo, vec=X_3, scalar=number_slider_2, label="Camera Cap")  # -> L, label_4
label_2 = Label(thing=pi_tube, vec=X_3, scalar=number_slider_2, label="Pi Tube")  # -> L, label_4
label_3 = Label(thing=top_cap, vec=X_3, scalar=number_slider_2, label="Top Cap")  # -> L, label_4
label_4 = Label(thing=move_2.Geometry, vec=X_3, scalar=number_slider_2, label="Camera")  # -> L, label_4
label_5 = Label(thing=base_plug, vec=X_3, scalar=number_slider_2, label="Base Plug")  # -> L, label_4
label_6 = Label(thing=sensor_tube, vec=X_3, scalar=number_slider_2, label="Sensor Tube")  # -> L, label_4
label_7 = Label(thing=reflector, vec=X_3, scalar=number_slider_2, label="Mirror")  # -> L, label_4
label_8 = Label(thing=lens_tube, vec=X_3, scalar=number_slider_2, label="Lens Tube")  # -> L, label_4
label_9 = Label(thing=pole, vec=X_3, scalar=number_slider_2, label="Pole")  # -> L, label_4
label_10 = Label(thing=python, vec=X_3, scalar=number_slider_2, label="Air vents")  # -> L, label_4
markdim = MarkerDimension(Line=label.L, Text=label.label_4, Size=number_slider_3)
markdim_2 = MarkerDimension(Line=label_2.L, Text=label_2.label_4, Size=number_slider_3)
markdim_3 = MarkerDimension(Line=label_5.L, Text=label_5.label_4, Size=number_slider_3)
markdim_4 = MarkerDimension(Line=label_6.L, Text=label_6.label_4, Size=number_slider_3)
markdim_5 = MarkerDimension(Line=label_3.L, Text=label_3.label_4, Size=number_slider_3)
markdim_6 = MarkerDimension(Line=label_4.L, Text=label_4.label_4, Size=number_slider_3)
markdim_7 = MarkerDimension(Line=label_7.L, Text=label_7.label_4, Size=number_slider_3)
markdim_8 = MarkerDimension(Line=label_8.L, Text=label_8.label_4, Size=number_slider_3)
markdim_9 = MarkerDimension(Line=label_9.L, Text=label_9.label_4, Size=number_slider_3)
markdim_10 = MarkerDimension(Line=label_10.L, Text=label_10.label_4, Size=number_slider_3)

# ==== cluster Tube
thickness = ClusterInput()
od = ClusterInput()
height = ClusterInput()
pln = ClusterInput()
thickness_2 = Number(thickness)
od_2 = Number(od)
height_2 = Number(height)
pln_2 = Plane(pln)
subtraction = Subtraction(A=od_2, B=thickness_2)
cir = Circle(Plane=pln_2, Radius=subtraction)
cir_2 = Circle(Plane=pln_2, Radius=od_2)
Z = UnitZ(Factor=height_2)
boundary = BoundarySurfaces(Edges=[cir, cir_2])
extr = Extrude(Base=boundary, Direction=Z)
capex = CapHolesEx(Brep=extr)  # -> Brep, Caps, Solid
tube = Brep(capex.Brep)
tube_2 = ClusterOutput(tube)

# ==== cluster Label
thing = ClusterInput()
scalar = ClusterInput()
label = ClusterInput()
thing_2 = Geometry(thing)
vec = ClusterInput()
bbox = BoundingBox(Content=thing_2, Plane=PlaneXY(0, 0, 0), UnionBox=True)  # -> Box, Box_2
label_2 = Text(label)
scalar_2 = Number(scalar)
unit = UnitVector(Vector=vec)
boxprop = BoxProperties(Box=bbox.Box)  # -> Center, Diagonal, Area, Volume, Degeneracy
multiplication = Multiplication(A=unit, B=scalar_2)
label_3 = Text(label_2)
move = Move(Geometry=boxprop.Center, Motion=multiplication)  # -> Geometry, Transform
ln = Line(StartPoint=boxprop.Center, EndPoint=move.Geometry)
L = ClusterOutput(ln)
label_4 = ClusterOutput(label_3)

# ==== cluster Cluster
C = ClusterInput()
bbox = BoundingBox(Content=C, Plane=PlaneXY(0, 0, 0), UnionBox=True)  # -> Box, Box_2
boxprop = BoxProperties(Box=bbox.Box)  # -> Center, Diagonal, Area, Volume, Degeneracy
S = ClusterInput()
N = ClusterInput()
C_2 = ClusterInput()
xz = XZPlane(Origin=boxprop.Center)
series = Series(Start=S, Step=N, Count=C_2)
rad = Radians(Degrees=series)
pt = PointPolar(BasePlane=xz, XYAngle=rad, ZAngle=0, Offset=Slider(10, range=0..10))
number_slider = Slider(101, range=0..1000)
vec2pt = Vector2Pt(PointA=boxprop.Center, PointB=pt, Unitize=False)  # -> Vector, Length
line = LineSDL(Start=boxprop.Center, Direction=vec2pt.Vector, Length=number_slider)
srf = ClusterInput()
srf_2 = Surface(srf)
blx = BrepLine(Brep=srf_2, Line=line, LimitToFirst=False)  # -> Curves, Points
python = PythonScript(x=blx.Points, anchor=boxprop.Center)  # -> flatten(a); inputs x: list
# ---------- python: Python ----------
import rhinoscriptsyntax as rs
print x
print anchor

if len(x) > 0:
    da = rs.GetDistance(x[0], anchor)
    db = rs.GetDistance(x[1], anchor)
    
    if da>db:
        a=x[1]
    else:
        a=x[0]
else:
    a = None
# ---------- end python ----------
srf_cp = SurfaceClosestPoint(Point=python, Surface=srf_2)  # -> Point, UVPoint, Distance
ln = Line(StartPoint=boxprop.Center, EndPoint=python)
evalsrf = EvaluateSurface(Surface=srf_2, Point=srf_cp.UVPoint)  # -> Point, Normal, Frame
line_2 = LineSDL(Start=evalsrf.Point, Direction=evalsrf.Normal, Length=number_slider)
crv = Curve([line_2, ln])
crv_2 = ClusterOutput(crv)
