# Grasshopper definition prototype006.gh (Grasshopper 0.9.76)
# plug-ins: Human

crvprox = CurveProximity()  # -> PointA, PointB, Distance
fline = FitLine()
tube_wall_thickness = Slider(3, range=0..10)
mirror_diameter = Slider(64, range=40..100)
lens_tube_height = Slider(225, range=40..225)
mirror_offset = Slider(154.3, range=-1..300)
tube_radius = Slider(40.9, range=0..100)
tube_options = Panel("""45,39
50,44
60,54
60,50
70,64
70,60
80,74
80,70
90,84
90,80
100,94""")

# ---- group: base plug controls
through_cut = Slider(11, range=0..15)
# Base plug
baseplugheight = Slider(20, range=0..100)
pi_recess_depth = Slider(18, range=0..100)

# ----
post_outside_rad = Slider(11.25, range=0..12.5)
pole_length = Slider(-460, range=-1000..1001)
post_inside_rad = Slider(10, range=-1..11)
# Support pole
top_of_the_pole = Point(<point referenced from the Rhino model>)
cir = Circle(Plane=top_of_the_pole, Radius=post_inside_rad)
cir_2 = Circle(Plane=top_of_the_pole, Radius=post_outside_rad)
Z = UnitZ(Factor=pole_length)
rdiff = RegionDifference(CurvesA=cir_2, CurvesB=cir)
extr = Extrude(Base=rdiff, Direction=Z)

crv = Curve([<curve referenced from the Rhino model> x3])
Z_2 = UnitZ(Factor=Slider(191, range=180..250))
xy = XYPlane(Origin=Point(0, 0, 0))
P = Plane(PlaneXY(0, 0, 0))
list = ItemSelector(
    tube_options,
    {"45,39", "50,44", "60,54", "60,50", "70,64", "70,60", "80,74", "80,70", "90,84", "90,80", "100,94"}, selected="70,64")
pt = ConstructPoint(XCoordinate=0, YCoordinate=0, ZCoordinate=0)
tubespecs = TubeSpecs(T=list)  # -> od_2, or_2, id_3, ir_2, wt_2
subtraction = Subtraction(A=tubespecs.ir_2, B=Slider(1.5, range=0..10))
cir_3 = Circle(Plane=PlaneXY(0, 0, 0), Radius=tubespecs.or_2)
cir_4 = Circle(Plane=PlaneXY(0, 0, 0), Radius=tubespecs.ir_2)
cir_5 = Circle(Plane=PlaneXY(0, 0, 0), Radius=subtraction)
xy_2 = XYPlane(Origin=pt)
move = Move(Geometry=cir_3, Motion=Z_2)  # -> Geometry, Transform
move_2 = Move(Geometry=xy, Motion=Z_2)  # -> Geometry, Transform
move_3 = Move(Geometry=cir_4, Motion=Z_2)  # -> Geometry, Transform
move_4 = Move(Geometry=cir_5, Motion=Z_2)  # -> Geometry, Transform
unicorn = Curve([<curve referenced from the Rhino model> x3])
project = Project(Geometry=unicorn, Plane=move_2.Geometry)  # -> Geometry, Transform

# ---- group: base plug mass
subtraction_2 = Subtraction(A=tubespecs.or_2, B=tubespecs.wt_2)
cir_6 = Circle(Plane=PlaneXY(0, 0, 0), Radius=subtraction_2)
boundary = BoundarySurfaces(Edges=cir_6)
Z_3 = UnitZ(Factor=baseplugheight)
extr_2 = Extrude(Base=boundary, Direction=Z_3)

# ----
boundary_2 = BoundarySurfaces(Edges=flatten([project.Geometry, move.Geometry]))

# ---- group: usb slot
pt_2 = Point(<point referenced from the Rhino model>)
rectangle = Rectangle(Plane=pt_2, XSize="2.5", YSize="21", Radius=0)  # -> Rectangle, Length
chop = Chop(G=rectangle.Rectangle, F=baseplugheight, depth="12")

# ----
boundary_3 = BoundarySurfaces(Edges=[move_3.Geometry, move_4.Geometry])

# ---- group: port holes
crv_2 = Curve([<curve referenced from the Rhino model> x3])
Z_4 = UnitZ(Factor=through_cut)
boundary_4 = BoundarySurfaces(Edges=crv_2)
extr_3 = Extrude(Base=boundary_4, Direction=Z_4)

# ---- group: pi recess
crv_3 = Curve([<curve referenced from the Rhino model> x4])
chop_2 = Chop(G=crv_3, F=baseplugheight, depth=pi_recess_depth)
sunion = SolidUnion(Breps=chop_2)

# ---- group: Overall tube
tube = Tube(thickness=tubespecs.wt_2, od=tubespecs.or_2, height=lens_tube_height, pln=xy_2)

# ---- group: cutter
boundary_5 = BoundarySurfaces(Edges=cir)
boundary_6 = BoundarySurfaces(Edges=cir_2)
extr_4 = Extrude(Base=boundary_5, Direction=expr("-x", Z))
extr_5 = Extrude(Base=boundary_6, Direction=Z)
sunion_2 = SolidUnion(Breps=[extr_5, extr_4])

# ----
Z_5 = UnitZ(Factor=Slider(-4, range=-10..10))
Z_6 = UnitZ(Factor=Slider(2, range=0..10))
extr_6 = Extrude(Base=boundary_2, Direction=Z_6)
extr_7 = Extrude(Base=boundary_3, Direction=Z_5)

pl_offset = PlaneOffset(BasePlane=xy_2, Offset=mirror_offset)
mirror_diameter_2 = Number(expr("x/2", mirror_diameter))
cir_7 = Circle(Plane=pl_offset, Radius=mirror_diameter_2)
sph = Sphere(Base=pl_offset, Radius=mirror_diameter_2)
Z_7 = UnitZ(Factor=mirror_diameter_2)
boundary_7 = BoundarySurfaces(Edges=cir_7)
extr_8 = Extrude(Base=boundary_7, Direction=Z_7)
sdiff = SolidDifference(BrepsA=sph, BrepsB=extr_8)

sunion_3 = SolidUnion(Breps=flatten([extr_7, extr_6]))
Z_8 = UnitZ(Factor=Slider(-34, range=-400..201))
move_5 = Move(Geometry=tube, Motion=Z_8)  # -> Geometry, Transform
top_mirror_cap = Geometry(sunion_3)

lens_tube = Geometry(move_5.Geometry)
reflector = Geometry(sdiff)  # disabled

pole = Geometry(extr)

# ----
# Option 1: Mirror Top cap
camera_from_mirror = Slider(63, range=0..1000)
radius_of_mirror = Slider(36, range=0..100)
Z_9 = UnitZ(Factor=camera_from_mirror)

# ----
# Option 2: Mirror Top cap
number_slider = Slider(4, range=0..10)
Z_10 = UnitZ(Factor=number_slider)
offset = Offset(Curve=move.Geometry, Distance=Slider(-1, range=-20..11), Plane=PlaneXY(0, 0, 0), Corners=1)
patch = Patch(Curves=offset, Spans=20, Flexibility=1, Trim=True)
Z_11 = UnitZ(Factor=Slider(1, range=0..10))
extr_9 = Extrude(Base=patch, Direction=Z_11)

# ----
# Midd camera cap
cam_lens_radius = Slider(4, range=3..10)
number_slider_2 = Slider(125, range=100..140)
addition = Addition(A=number_slider_2, B=Slider(4, range=0..10))
subtraction_3 = Subtraction(A=tubespecs.or_2, B=tubespecs.wt_2)
cir_8 = Circle(Plane=PlaneXY(0, 0, 0), Radius=subtraction_3)
Z_12 = UnitZ(Factor=number_slider_2)
move_6 = Move(Geometry=cir_8, Motion=Z_12)  # -> Geometry, Transform
Z_13 = UnitZ(Factor=Slider(10, range=0..100))  # -> expr("-x", UnitVector)
Z_14 = UnitZ(Factor=Slider(2, range=0..100))  # -> expr("-x", UnitVector)
boundary_8 = BoundarySurfaces(Edges=move_6.Geometry)
extr_10 = Extrude(Base=boundary_8, Direction=Z_13)
extr_11 = Extrude(Base=boundary_8, Direction=Z_14)

# ----
# Cam suport rods
number_slider_3 = Slider(3.3, range=0..10)
subtraction_4 = Subtraction(A=subtraction_2, B=number_slider_3)
polygon = Polygon(Plane=P, Radius=subtraction_4, Segments=3, FilletRadius=0)  # -> Polygon, Length
rad = Radians(Degrees=Slider(180, range=0..180))
Z_15 = UnitZ(Factor=1)
off_deck = Slider(3.5, range=0..10)
rot3d = Rotate3D(Geometry=polygon.Polygon, Angle=rad, Center=P, Axis=Z_15)  # -> Geometry, Transform
disc = Discontinuity(Curve=rot3d.Geometry, Level=1)  # -> Points, Parameters
subtraction_5 = Subtraction(A=number_slider_3, B=Slider(1.3, range=0..2))
pin_radius = Panel(subtraction_5)
cir_9 = Circle(Plane=disc.Points, Radius=subtraction_5)
Z_16 = UnitZ(Factor=off_deck)
move_7 = Move(Geometry=cir_9, Motion=Z_16)  # -> Geometry, Transform
boundary_9 = BoundarySurfaces(Edges=move_7.Geometry)
Z_17 = UnitZ(Factor=number_slider_2)
extr_12 = Extrude(Base=boundary_9, Direction=Z_17)
brep = Brep(extr_12)

# ---- group: cam pins
shoulder_height = Slider(6, range=0..10)
Z_18 = UnitZ(Factor=addition)
pt_3 = Point([<point referenced from the Rhino model> x4])
move_8 = Move(Geometry=pt_3, Motion=Z_18)  # -> Geometry, Transform
cir_10 = Circle(Plane=move_8.Geometry, Radius=Slider(1.5, range=0..10))
cir_11 = Circle(Plane=move_8.Geometry, Radius=Slider(0.6, range=0..10))
boundary_10 = BoundarySurfaces(Edges=cir_10)
boundary_11 = BoundarySurfaces(Edges=cir_11)
addition_2 = Addition(A=shoulder_height, B=Slider(3, range=0..10))
Z_19 = UnitZ(Factor=shoulder_height)  # -> expr("-x", UnitVector)
Z_20 = UnitZ(Factor=addition_2)  # -> expr("-x", UnitVector)
extr_13 = Extrude(Base=boundary_11, Direction=Z_20)
extr_14 = Extrude(Base=boundary_10, Direction=Z_19)
sunion_4 = SolidUnion(Breps=[extr_14, extr_13])

# ---- group: lens hole
cir_12 = Circle(Plane=PlaneXY(0, 0, 0), Radius=cam_lens_radius)
Z_21 = UnitZ(Factor=200)
boundary_12 = BoundarySurfaces(Edges=cir_12)
extr_15 = Extrude(Base=boundary_12, Direction=Z_21)

# ----
move_9 = Move(Geometry=extr_10, Motion=Z_9)  # -> Geometry, Transform
debrep = DeconstructBrep(Brep=move_9.Geometry)  # -> Faces, Edges, Vertices
item = ListItem(List=debrep.Faces, Index=0, Wrap=True)
divide = DivideCurve(Curve=item, Count=10, Kinks=False)  # -> Points, Tangents, Parameters
avr = Average(Input=divide.Points)
sph_2 = Sphere(Base=avr, Radius=radius_of_mirror)
sdiff_2 = SolidDifference(BrepsA=move_9.Geometry, BrepsB=sph_2)

sdiff_3 = SolidDifference(BrepsA=extr_11, BrepsB=extr_15)
sunion_5 = SolidUnion(Breps=[sdiff_3, sunion_4])
sdiff_4 = SolidDifference(BrepsA=extr_10, BrepsB=extr_12)
sdiff_5 = SolidDifference(BrepsA=sunion_5, BrepsB=extr_15)
geo = Geometry([sdiff_5, sdiff_4])

sdiff_6 = SolidDifference(BrepsA=extr_2, BrepsB=sunion_2)
sdiff_7 = SolidDifference(BrepsA=sdiff_6, BrepsB=brep)
sdiff_8 = SolidDifference(BrepsA=sdiff_7, BrepsB=sunion)
sdiff_9 = SolidDifference(BrepsA=sdiff_8, BrepsB=extr_3)
sdiff_10 = SolidDifference(BrepsA=sdiff_9, BrepsB=extr)

sdiff_11 = SolidDifference(BrepsA=sdiff_10, BrepsB=chop)
camera_plug = Geometry(geo)
base_plug = Geometry(sdiff_11)
brep_2 = Brep(brep)
merge = Merge(Data1=camera_plug, Data3=reflector, Data4=lens_tube, Data5=base_plug, Data6=top_mirror_cap, Data7=pole, Data9=brep_2)

debrep_2 = DeconstructBrep(Brep=move_9.Geometry)  # -> Faces, Edges, Vertices
item_2 = ListItem(List=debrep_2.Faces, Index=0, Wrap=True)
item_3 = ListItem(List=debrep_2.Edges, Index=Slider(2, range=0..10), Wrap=True)
offset_2 = Offset(Curve=item_3, Distance=1, Plane=PlaneXY(0, 0, 0), Corners=1)
extr_16 = Extrude(Base=offset_2, Direction=Z_10)
extr_17 = Extrude(Base=item_2, Direction=Z_10)
debrep_3 = DeconstructBrep(Brep=extr_17)  # -> Faces, Edges, Vertices
item_4 = ListItem(List=debrep_3.Edges, Index=Slider(4, range=0..10), Wrap=True)

cap = CapHoles(Brep=extr_16)

sdiff_12 = SolidDifference(BrepsA=extr_17, BrepsB=cap)
join = BrepJoin(Breps=[extr_9, sdiff_12])  # -> Breps, Closed

# ==== cluster Tube
thickness = ClusterInput()
od = ClusterInput()
height = ClusterInput()
pln = ClusterInput()
thickness_2 = Number(thickness)
od_2 = Number(od)
height_2 = Number(height)
pln_2 = Plane(pln)
subtraction = Subtraction(A=od_2, B=thickness_2)
cir = Circle(Plane=pln_2, Radius=subtraction)
cir_2 = Circle(Plane=pln_2, Radius=od_2)
Z = UnitZ(Factor=height_2)
boundary = BoundarySurfaces(Edges=[cir, cir_2])
extr = Extrude(Base=boundary, Direction=Z)
capex = CapHolesEx(Brep=extr)  # -> Brep, Caps, Solid
tube = Brep(capex.Brep)
tube_2 = ClusterOutput(tube)

# ==== cluster TubeSpecs
T = ClusterInput()
split = TextSplit(Text=T, Separators=",")

# ---- group: OD
item = ListItem(List=split, Index=0, Wrap=True)

# ----
id = ListItem(List=split, Index=1, Wrap=True)
od = Number(item)
id_2 = Number(id)
subtraction = Subtraction(A=od, B=id_2)
division = Division(A=od, B="2")
division_2 = Division(A=subtraction, B="2")
or = Number(division)
division_3 = Division(A=id_2, B="2")
wt = Number(division_2)
ir = Number(division_3)
id_3 = ClusterOutput(id_2)
ir_2 = ClusterOutput(ir)
wt_2 = ClusterOutput(wt)
od_2 = ClusterOutput(od)
or_2 = ClusterOutput(or)

# ==== cluster Chop
depth = ClusterInput()
F = ClusterInput()
depth_2 = Number(depth)
G = ClusterInput()
Z = UnitZ(Factor=F)
move = Move(Geometry=G, Motion=Z)  # -> Geometry, Transform
Z_2 = UnitZ(Factor=expr("-x", depth_2))
boundary = BoundarySurfaces(Edges=move.Geometry)
extr = Extrude(Base=boundary, Direction=Z_2)
E = ClusterOutput(extr)
