# Grasshopper definition prototype007.gh (Grasshopper 0.9.76)
# plug-ins: Human

tube_wall_thickness = Slider(3, range=0..10)
mirror_diameter = Slider(64, range=40..100)
lens_tube_height = Slider(225, range=40..225)
mirror_offset = Slider(154.3, range=-1..300)
tube_radius = Slider(40.9, range=0..100)
tube_options = Panel("""45,39
50,44
60,54
60,50
70,64
70,60
80,74
80,70
90,84
90,80
100,94""")

# ---- group: base plug controls
through_cut = Slider(11, range=0..15)
# Base plug
baseplugheight = Slider(20, range=0..100)
pi_recess_depth = Slider(18, range=0..100)

# ----
post_outside_rad = Slider(11.25, range=0..12.5)
pole_length = Slider(-460, range=-1000..1001)
post_inside_rad = Slider(10, range=-1..11)
# Support pole
top_of_the_pole = Point(<point referenced from the Rhino model>)
cir = Circle(Plane=top_of_the_pole, Radius=post_inside_rad)
cir_2 = Circle(Plane=top_of_the_pole, Radius=post_outside_rad)
Z = UnitZ(Factor=pole_length)
rdiff = RegionDifference(CurvesA=cir_2, CurvesB=cir)
extr = Extrude(Base=rdiff, Direction=Z)

crv = Curve([<curve referenced from the Rhino model> x3])
P = Plane(PlaneXY(0, 0, 0))
list = ItemSelector(
    tube_options,
    {"45,39", "50,44", "60,54", "60,50", "70,64", "70,60", "80,74", "80,70", "90,84", "90,80", "100,94"}, selected="70,64")
pt = ConstructPoint(XCoordinate=0, YCoordinate=0, ZCoordinate=0)
tubespecs = TubeSpecs(T=list)  # -> od_2, or_2, id_3, ir_2, wt_2

Z_2 = UnitZ(Factor=Slider(191, range=180..250))
subtraction = Subtraction(A=tubespecs.ir_2, B=Slider(1.5, range=0..10))
xy = XYPlane(Origin=Point(0, 0, 0))
cir_3 = Circle(Plane=PlaneXY(0, 0, 0), Radius=tubespecs.or_2)
cir_4 = Circle(Plane=PlaneXY(0, 0, 0), Radius=tubespecs.ir_2)
cir_5 = Circle(Plane=PlaneXY(0, 0, 0), Radius=subtraction)
move = Move(Geometry=cir_3, Motion=Z_2)  # -> Geometry, Transform
move_2 = Move(Geometry=xy, Motion=Z_2)  # -> Geometry, Transform
move_3 = Move(Geometry=cir_4, Motion=Z_2)  # -> Geometry, Transform
move_4 = Move(Geometry=cir_5, Motion=Z_2)  # -> Geometry, Transform
unicorn = Curve([<curve referenced from the Rhino model> x3])
project = Project(Geometry=unicorn, Plane=move_2.Geometry)  # -> Geometry, Transform
boundary = BoundarySurfaces(Edges=flatten([project.Geometry, move.Geometry]))
boundary_2 = BoundarySurfaces(Edges=[move_3.Geometry, move_4.Geometry])
Z_3 = UnitZ(Factor=Slider(-4, range=-10..10))
Z_4 = UnitZ(Factor=Slider(2, range=0..10))
extr_2 = Extrude(Base=boundary, Direction=Z_4)
extr_3 = Extrude(Base=boundary_2, Direction=Z_3)
sunion = SolidUnion(Breps=flatten([extr_3, extr_2]))

xy_2 = XYPlane(Origin=pt)

# ---- group: base plug mass
subtraction_2 = Subtraction(A=tubespecs.or_2, B=tubespecs.wt_2)
cir_6 = Circle(Plane=PlaneXY(0, 0, 0), Radius=subtraction_2)
boundary_3 = BoundarySurfaces(Edges=cir_6)
Z_5 = UnitZ(Factor=baseplugheight)
extr_4 = Extrude(Base=boundary_3, Direction=Z_5)

# ---- group: usb slot
pt_2 = Point(<point referenced from the Rhino model>)
rectangle = Rectangle(Plane=pt_2, XSize="2.5", YSize="21", Radius=0)  # -> Rectangle, Length
chop = Chop(G=rectangle.Rectangle, F=baseplugheight, depth="12")

# ---- group: port holes
crv_2 = Curve([<curve referenced from the Rhino model> x3])
Z_6 = UnitZ(Factor=through_cut)
boundary_4 = BoundarySurfaces(Edges=crv_2)
extr_5 = Extrude(Base=boundary_4, Direction=Z_6)

# ---- group: pi recess
crv_3 = Curve([<curve referenced from the Rhino model> x4])
chop_2 = Chop(G=crv_3, F=baseplugheight, depth=pi_recess_depth)
sunion_2 = SolidUnion(Breps=chop_2)

# ---- group: Overall tube
tube = Tube(thickness=tubespecs.wt_2, od=tubespecs.or_2, height=lens_tube_height, pln=xy_2)

# ---- group: cutter
boundary_5 = BoundarySurfaces(Edges=cir)
boundary_6 = BoundarySurfaces(Edges=cir_2)
extr_6 = Extrude(Base=boundary_5, Direction=expr("-x", Z))
extr_7 = Extrude(Base=boundary_6, Direction=Z)
sunion_3 = SolidUnion(Breps=[extr_7, extr_6])

# ----
pl_offset = PlaneOffset(BasePlane=xy_2, Offset=mirror_offset)
mirror_diameter_2 = Number(expr("x/2", mirror_diameter))
cir_7 = Circle(Plane=pl_offset, Radius=mirror_diameter_2)
sph = Sphere(Base=pl_offset, Radius=mirror_diameter_2)
Z_7 = UnitZ(Factor=mirror_diameter_2)
boundary_7 = BoundarySurfaces(Edges=cir_7)
extr_8 = Extrude(Base=boundary_7, Direction=Z_7)
sdiff = SolidDifference(BrepsA=sph, BrepsB=extr_8)

Z_8 = UnitZ(Factor=Slider(-34, range=-400..201))
move_5 = Move(Geometry=tube, Motion=Z_8)  # -> Geometry, Transform
top_mirror_cap = Geometry(sunion)

lens_tube = Geometry(move_5.Geometry)
reflector = Geometry(sdiff)  # disabled

pole = Geometry(extr)

# ----
# Midd camera cap
cam_lens_radius = Slider(4, range=3..10)
number_slider = Slider(125, range=100..140)
addition = Addition(A=number_slider, B=Slider(4, range=0..10))
subtraction_3 = Subtraction(A=tubespecs.or_2, B=tubespecs.wt_2)
cir_8 = Circle(Plane=PlaneXY(0, 0, 0), Radius=subtraction_3)
Z_9 = UnitZ(Factor=number_slider)
move_6 = Move(Geometry=cir_8, Motion=Z_9)  # -> Geometry, Transform
Z_10 = UnitZ(Factor=Slider(10, range=0..100))  # -> expr("-x", UnitVector)
Z_11 = UnitZ(Factor=Slider(2, range=0..100))  # -> expr("-x", UnitVector)
boundary_8 = BoundarySurfaces(Edges=move_6.Geometry)
extr_9 = Extrude(Base=boundary_8, Direction=Z_10)
extr_10 = Extrude(Base=boundary_8, Direction=Z_11)

# ----
# Cam suport rods
number_slider_2 = Slider(3.3, range=0..10)
subtraction_4 = Subtraction(A=subtraction_2, B=number_slider_2)
polygon = Polygon(Plane=P, Radius=subtraction_4, Segments=3, FilletRadius=0)  # -> Polygon, Length
rad = Radians(Degrees=Slider(180, range=0..180))
Z_12 = UnitZ(Factor=1)
off_deck = Slider(3.5, range=0..10)
rot3d = Rotate3D(Geometry=polygon.Polygon, Angle=rad, Center=P, Axis=Z_12)  # -> Geometry, Transform
disc = Discontinuity(Curve=rot3d.Geometry, Level=1)  # -> Points, Parameters
subtraction_5 = Subtraction(A=number_slider_2, B=Slider(1.3, range=0..2))
pin_radius = Panel(subtraction_5)
cir_9 = Circle(Plane=disc.Points, Radius=subtraction_5)
Z_13 = UnitZ(Factor=off_deck)
move_7 = Move(Geometry=cir_9, Motion=Z_13)  # -> Geometry, Transform
boundary_9 = BoundarySurfaces(Edges=move_7.Geometry)
Z_14 = UnitZ(Factor=number_slider)
extr_11 = Extrude(Base=boundary_9, Direction=Z_14)
brep = Brep(extr_11)

# ---- group: cam pins
shoulder_height = Slider(6, range=0..10)
Z_15 = UnitZ(Factor=addition)
pt_3 = Point([<point referenced from the Rhino model> x4])
move_8 = Move(Geometry=pt_3, Motion=Z_15)  # -> Geometry, Transform
cir_10 = Circle(Plane=move_8.Geometry, Radius=Slider(1.5, range=0..10))
cir_11 = Circle(Plane=move_8.Geometry, Radius=Slider(0.6, range=0..10))
boundary_10 = BoundarySurfaces(Edges=cir_10)
boundary_11 = BoundarySurfaces(Edges=cir_11)
addition_2 = Addition(A=shoulder_height, B=Slider(3, range=0..10))
Z_16 = UnitZ(Factor=shoulder_height)  # -> expr("-x", UnitVector)
Z_17 = UnitZ(Factor=addition_2)  # -> expr("-x", UnitVector)
extr_12 = Extrude(Base=boundary_11, Direction=Z_17)
extr_13 = Extrude(Base=boundary_10, Direction=Z_16)
sunion_4 = SolidUnion(Breps=[extr_13, extr_12])

# ---- group: lens hole
cir_12 = Circle(Plane=PlaneXY(0, 0, 0), Radius=cam_lens_radius)
Z_18 = UnitZ(Factor=200)
boundary_12 = BoundarySurfaces(Edges=cir_12)
extr_14 = Extrude(Base=boundary_12, Direction=Z_18)

# ----
sdiff_2 = SolidDifference(BrepsA=extr_10, BrepsB=extr_14)
sunion_5 = SolidUnion(Breps=[sdiff_2, sunion_4])
sdiff_3 = SolidDifference(BrepsA=extr_9, BrepsB=extr_11)
sdiff_4 = SolidDifference(BrepsA=sunion_5, BrepsB=extr_14)
geo = Geometry([sdiff_4, sdiff_3])

sdiff_5 = SolidDifference(BrepsA=extr_4, BrepsB=sunion_3)
sdiff_6 = SolidDifference(BrepsA=sdiff_5, BrepsB=brep)
sdiff_7 = SolidDifference(BrepsA=sdiff_6, BrepsB=sunion_2)
sdiff_8 = SolidDifference(BrepsA=sdiff_7, BrepsB=extr_5)
sdiff_9 = SolidDifference(BrepsA=sdiff_8, BrepsB=extr)

sdiff_10 = SolidDifference(BrepsA=sdiff_9, BrepsB=chop)
camera_plug = Geometry(geo)
base_plug = Geometry(sdiff_10)
brep_2 = Brep(brep)
merge = Merge(Data1=camera_plug, Data3=reflector, Data4=lens_tube, Data5=base_plug, Data6=top_mirror_cap, Data7=pole, Data9=brep_2)

# ==== cluster Tube
thickness = ClusterInput()
od = ClusterInput()
height = ClusterInput()
pln = ClusterInput()
thickness_2 = Number(thickness)
od_2 = Number(od)
height_2 = Number(height)
pln_2 = Plane(pln)
subtraction = Subtraction(A=od_2, B=thickness_2)
cir = Circle(Plane=pln_2, Radius=subtraction)
cir_2 = Circle(Plane=pln_2, Radius=od_2)
Z = UnitZ(Factor=height_2)
boundary = BoundarySurfaces(Edges=[cir, cir_2])
extr = Extrude(Base=boundary, Direction=Z)
capex = CapHolesEx(Brep=extr)  # -> Brep, Caps, Solid
tube = Brep(capex.Brep)
tube_2 = ClusterOutput(tube)

# ==== cluster TubeSpecs
T = ClusterInput()
split = TextSplit(Text=T, Separators=",")

# ---- group: OD
item = ListItem(List=split, Index=0, Wrap=True)

# ----
id = ListItem(List=split, Index=1, Wrap=True)
od = Number(item)
id_2 = Number(id)
subtraction = Subtraction(A=od, B=id_2)
division = Division(A=od, B="2")
division_2 = Division(A=subtraction, B="2")
or = Number(division)
division_3 = Division(A=id_2, B="2")
wt = Number(division_2)
ir = Number(division_3)
id_3 = ClusterOutput(id_2)
ir_2 = ClusterOutput(ir)
wt_2 = ClusterOutput(wt)
od_2 = ClusterOutput(od)
or_2 = ClusterOutput(or)

# ==== cluster Chop
depth = ClusterInput()
F = ClusterInput()
depth_2 = Number(depth)
G = ClusterInput()
Z = UnitZ(Factor=F)
move = Move(Geometry=G, Motion=Z)  # -> Geometry, Transform
Z_2 = UnitZ(Factor=expr("-x", depth_2))
boundary = BoundarySurfaces(Edges=move.Geometry)
extr = Extrude(Base=boundary, Direction=Z_2)
E = ClusterOutput(extr)
