# Grasshopper definition veryical cylinder.gh (Grasshopper 0.9.76)

xy = XYPlane(Origin=Point(58.57033594, 19.20796392, 0))
cap_height = Slider(10, range=0..10)
extra_radius = Slider(1, range=0..1)
number_slider = Slider(60, range=50..200)
number_slider_2 = Slider(42, range=0..100)
pt = Point(xy)
xy_2 = XYPlane(Origin=Point(0, 0, 0))
D = Direction(Vector(0, 0, 1))
hexgrid = Hexagonal(Plane=pt, Size=1, ExtentX=Slider(35, range=0..100), ExtentY=Slider(26, range=0..100))  # -> flatten(Cells), Points
line = LineSDL(Start=xy_2, Direction=expr("-1*x", D), Length=Slider(200, range=50..200))
circle = CircleCNR(Center=xy_2, Normal=Vector(0, 0, 1), Radius=number_slider_2)
slieve = Slieve(C=xy_2, A=extra_radius, B=number_slider_2, A_2=line)  # -> E, colour_2
top_cap = TopCap(G=circle, F=number_slider, S=xy_2, D=D, L=cap_height)
mirror = Mirror(cone=xy_2, L=number_slider, B=xy_2, R=number_slider_2)  # -> G, colour_2
lens = Lens(P=circle, S=xy_2, D=D, L=number_slider)  # -> E, colour_2
extrude = ExtrudeLinear(Profile=circle, OrientationP=PlaneXY(0, 0, 0), Axis=line)
matchingsurface = MatchingSurface(C=hexgrid.Cells)
disc = Discontinuity(Curve=hexgrid.Cells, Level=1)  # -> Points, Parameters
preview = CustomPreview(Geometry=slieve.E, Shader=slieve.colour_2)
preview_2 = CustomPreview(Geometry=lens.E, Shader=lens.colour_2)
preview_3 = CustomPreview(Geometry=mirror.G, Shader=mirror.colour_2)
srf_cp = SurfaceClosestPoint(Point=disc.Points, Surface=reparameterize(matchingsurface))  # -> Point, UVPoint, Distance
evalsrf = EvaluateSurface(Surface=reparameterize(extrude), Point=srf_cp.UVPoint)  # -> Point, Normal, Frame
pline = PolyLine(Vertices=evalsrf.Point, Closed=False)
pipe = Pipe(Curve=pline, Radius=Slider(0.5, range=0..1), Caps=0)
preview_4 = CustomPreview(Geometry=[top_cap, pipe], Shader=mirror.colour_2)

# ==== cluster MatchingSurface
C = ClusterInput()
bbox = BoundingBox(Content=C, Plane=PlaneXY(0, 0, 0), UnionBox=True)  # -> Box, Box_2
debox = DeconstructBox(Box=bbox.Box)  # -> Plane, X, Y, Z
dedomain = DeconstructDomain(Domain=debox.X)  # -> Start, End
dedomain_2 = DeconstructDomain(Domain=debox.Y)  # -> Start, End
pt = ConstructPoint(XCoordinate=dedomain.Start, YCoordinate=dedomain_2.Start, ZCoordinate=0)
pt_2 = ConstructPoint(XCoordinate=dedomain.Start, YCoordinate=dedomain_2.End, ZCoordinate=0)
pt_3 = ConstructPoint(XCoordinate=dedomain.End, YCoordinate=dedomain_2.End, ZCoordinate=0)
pt_4 = ConstructPoint(XCoordinate=dedomain.End, YCoordinate=dedomain_2.Start, ZCoordinate=0)
srf4pt = _4PointSurface(CornerA=pt, CornerB=pt_2, CornerC=pt_3, CornerD=pt_4)
srf = Surface(srf4pt)
srf_2 = ClusterOutput(srf)

# ==== cluster Slieve
A = ClusterInput()
B = ClusterInput()
A_2 = ClusterInput()
C = ClusterInput()
addition = Addition(A=A, B=B)
colour = ColourPicker(PickedColour=RGBA(145, 134, 100, 176))
circle = CircleCNR(Center=C, Normal=Vector(0, 0, 1), Radius=addition)
extrude = ExtrudeLinear(Profile=circle, OrientationP=PlaneXY(0, 0, 0), Axis=A_2)
colour_2 = ClusterOutput(colour)
E = ClusterOutput(extrude)

# ==== cluster Mirror
L = ClusterInput()
B = ClusterInput()
R = ClusterInput()
cone = ClusterInput()
vec = VectorXYZ(XComponent=0, YComponent=0, ZComponent=expr("X*0.5", L))  # -> Vector, Length
cone_2 = Cone(Base=B, Radius=R, Length=L)  # -> Cone, Tip
colour = ColourPicker(PickedColour=RGB(214, 226, 255))
move = Move(Geometry=cone, Motion=vec.Vector)  # -> Geometry, Transform
mirror = Mirror(Geometry=cone_2.Cone, Plane=move.Geometry)  # -> Geometry, Transform
G = ClusterOutput(mirror.Geometry)
colour_2 = ClusterOutput(colour)

# ==== cluster TopCap
F = ClusterInput()
G = ClusterInput()
Z = UnitZ(Factor=F)
S = ClusterInput()
D = ClusterInput()
L = ClusterInput()
move = Move(Geometry=G, Motion=Z)  # -> Geometry, Transform
line = LineSDL(Start=S, Direction=D, Length=L)
extrude = ExtrudeLinear(Profile=move.Geometry, OrientationP=PlaneXY(0, 0, 0), Axis=line)
capex = CapHolesEx(Brep=extrude)  # -> Brep, Caps, Solid
B = ClusterOutput(capex.Brep)

# ==== cluster Lens
colour = ColourPicker(PickedColour=RGBA(0, 234, 255, 61))
S = ClusterInput()
D = ClusterInput()
L = ClusterInput()
line = LineSDL(Start=S, Direction=D, Length=L)
P = ClusterInput()
extrude = ExtrudeLinear(Profile=P, OrientationP=PlaneXY(0, 0, 0), Axis=line)
E = ClusterOutput(extrude)
colour_2 = ClusterOutput(colour)
