# Grasshopper definition prototype007.gh (Grasshopper 0.9.76)
# plug-ins: Human

tube_wall_thickness = Slider(3, range=0..10)
mirror_diameter = Slider(64, range=40..100)
lens_tube_height = Slider(225, range=40..225)
mirror_offset = Slider(154.3, range=-1..300)
tube_radius = Slider(40.9, range=0..100)
tube_options = Panel("""45,39
50,44
60,54
60,50
70,64
70,60
80,74
80,70
90,84
90,80
100,94""")
list = ItemSelector(
    tube_options,
    {"45,39", "50,44", "60,54", "60,50", "70,64", "70,60", "80,74", "80,70", "90,84", "90,80", "100,94"}, selected="70,64")
pt = ConstructPoint(XCoordinate=0, YCoordinate=0, ZCoordinate=0)
tubespecs = TubeSpecs(T=list)  # -> od_2, or_2, id_3, ir_2, wt_2
xy = XYPlane(Origin=pt)

# ----
# Real tube is actually smaller than 64. Tollerance is removed from IR
itol = Number(0.4)
subtraction = Subtraction(A=tubespecs.ir_2, B=itol)

# ---- group: Overall tube
tube = Tube(thickness=tubespecs.wt_2, od=tubespecs.or_2, height=lens_tube_height, pln=xy)

# ----
pl_offset = PlaneOffset(BasePlane=xy, Offset=mirror_offset)
mirror_diameter_2 = Number(expr("x/2", mirror_diameter))
cir = Circle(Plane=pl_offset, Radius=mirror_diameter_2)
sph = Sphere(Base=pl_offset, Radius=mirror_diameter_2)
Z = UnitZ(Factor=mirror_diameter_2)
boundary = BoundarySurfaces(Edges=cir)
extr = Extrude(Base=boundary, Direction=Z)
sdiff = SolidDifference(BrepsA=sph, BrepsB=extr)

start_radius = Slider(1.5, range=0..10)
end_radius = Slider(0.92, range=0.5..1.2)
padding = Slider(1.5, range=0..3)

# ---- group: base plug controls
through_cut = Slider(11, range=0..15)
# Base plug
baseplugheight = Slider(20, range=0..100)
pi_recess_depth = Slider(18, range=0..100)

# ----
Z_2 = UnitZ(Factor=Slider(191, range=180..250))
subtraction_2 = Subtraction(A=subtraction, B=Slider(1.5, range=0..10))
xy_2 = XYPlane(Origin=Point(0, 0, 0))
cir_2 = Circle(Plane=PlaneXY(0, 0, 0), Radius=tubespecs.or_2)
cir_3 = Circle(Plane=PlaneXY(0, 0, 0), Radius=subtraction)
cir_4 = Circle(Plane=PlaneXY(0, 0, 0), Radius=subtraction_2)
move = Move(Geometry=cir_2, Motion=Z_2)  # -> Geometry, Transform
move_2 = Move(Geometry=xy_2, Motion=Z_2)  # -> Geometry, Transform
move_3 = Move(Geometry=cir_3, Motion=Z_2)  # -> Geometry, Transform
move_4 = Move(Geometry=cir_4, Motion=Z_2)  # -> Geometry, Transform
unicorn = Curve([<curve referenced from the Rhino model> x3])
project = Project(Geometry=unicorn, Plane=move_2.Geometry)  # -> Geometry, Transform
boundary_2 = BoundarySurfaces(Edges=flatten([project.Geometry, move.Geometry]))
boundary_3 = BoundarySurfaces(Edges=[move_3.Geometry, move_4.Geometry])
Z_3 = UnitZ(Factor=Slider(-4, range=-10..10))
Z_4 = UnitZ(Factor=Slider(2, range=0..10))
extr_2 = Extrude(Base=boundary_2, Direction=Z_4)
extr_3 = Extrude(Base=boundary_3, Direction=Z_3)
sunion = SolidUnion(Breps=flatten([extr_3, extr_2]))

post_outside_rad = Slider(10.25, range=0..12.5)
pole_length = Slider(-460, range=-1000..1001)
post_inside_rad = Slider(8, range=-1..11)
# Support pole
top_of_the_pole = Point(<point referenced from the Rhino model>)
cir_5 = Circle(Plane=top_of_the_pole, Radius=post_inside_rad)
cir_6 = Circle(Plane=top_of_the_pole, Radius=post_outside_rad)
Z_5 = UnitZ(Factor=pole_length)
rdiff = RegionDifference(CurvesA=cir_6, CurvesB=cir_5)
extr_4 = Extrude(Base=rdiff, Direction=Z_5)

number_slider = Slider(28, range=0..100)
crv = Curve([<curve referenced from the Rhino model> x3])
P = Plane(PlaneXY(0, 0, 0))

# ---- group: Height
subtraction_3 = Subtraction(A=baseplugheight, B=start_radius)
addition = Addition(A=padding, B=start_radius)
subtraction_4 = Subtraction(A=subtraction_3, B=padding)
dom = ConstructDomain(DomainStart=addition, DomainEnd=subtraction_4)
div = DivideDomain(Domain=dom, Count=number_slider)
dedomain = DeconstructDomain(Domain=div)  # -> Start, End

# ----
Z_6 = UnitZ(Factor=Slider(-34, range=-400..201))

# ---- group: Angles
dom_2 = ConstructDomain(DomainStart=0, DomainEnd=Slider(373, range=360..375))
div_2 = DivideDomain(Domain=dom_2, Count=number_slider)
dedomain_2 = DeconstructDomain(Domain=div_2)  # -> Start, End
rad = Radians(Degrees=dedomain_2.Start)

# ---- group: usb slot
pt_2 = Point(<point referenced from the Rhino model>)
rectangle = Rectangle(Plane=pt_2, XSize="2.5", YSize="21", Radius=0)  # -> Rectangle, Length
chop = Chop(G=rectangle.Rectangle, F=baseplugheight, depth="12")

# ---- group: port holes
crv_2 = Curve([<curve referenced from the Rhino model> x3])
Z_7 = UnitZ(Factor=through_cut)
boundary_4 = BoundarySurfaces(Edges=crv_2)
extr_5 = Extrude(Base=boundary_4, Direction=Z_7)

# ---- group: pi recess
crv_3 = Curve([<curve referenced from the Rhino model> x4])
chop_2 = Chop(G=crv_3, F=baseplugheight, depth=pi_recess_depth)
sunion_2 = SolidUnion(Breps=chop_2)

# ---- group: base plug mass
cir_7 = Circle(Plane=PlaneXY(0, 0, 0), Radius=subtraction)
boundary_5 = BoundarySurfaces(Edges=cir_7)
Z_8 = UnitZ(Factor=baseplugheight)
extr_6 = Extrude(Base=boundary_5, Direction=Z_8)

# ----
move_5 = Move(Geometry=tube, Motion=Z_6)  # -> Geometry, Transform

# ---- group: cutter
boundary_6 = BoundarySurfaces(Edges=cir_5)
boundary_7 = BoundarySurfaces(Edges=cir_6)
extr_7 = Extrude(Base=boundary_6, Direction=expr("-x", Z_5))
extr_8 = Extrude(Base=boundary_7, Direction=Z_5)
sunion_3 = SolidUnion(Breps=[extr_8, extr_7])

# ---- group: unicorn
num = Number(100)
number_slider_2 = Slider(168, range=100..200)
X = UnitX(Factor=num)
crv_4 = Curve([<curve referenced from the Rhino model> x3])
move_6 = Move(Geometry=crv_4, Motion=expr("-x", X))  # -> Geometry, Transform
chop_3 = Chop(G=move_6.Geometry, F=number_slider_2, depth=expr("x*2", number_slider_2))

# ---- group: edge points
pt_3 = PointCylindrical(BasePlane=PlaneXY(0, 0, 0), Angle=rad, Radius=subtraction, Elevation=dedomain.Start)

# ---- group: Core points
pt_4 = ConstructPoint(XCoordinate=0, YCoordinate=0, ZCoordinate=dedomain.Start)

# ----
ln = Line(StartPoint=pt_3, EndPoint=pt_4)
scale = Scale(Geometry=ln, Center=pt_4, Factor=Slider(1.006, range=0.99..1.015))  # -> Geometry, Transform
eval = EvaluateLength(Curve=scale.Geometry, Length=Slider(2.06, range=0..10), Normalized=False)  # -> Point, Tangent, Parameter
ln_2 = Line(StartPoint=pt_3, EndPoint=eval.Point)
end = EndPoints(Curve=scale.Geometry)  # -> Start, End
pl = PlaneNormal(Origin=end.Start, ZAxis=ln_2)
cir_8 = Circle(Plane=pl, Radius=start_radius)
cir_9 = Circle(Plane=pl, Radius=end_radius)
move_7 = Move(Geometry=cir_9, Motion=ln_2)  # -> Geometry, Transform
merge = Merge(Data1=graft(cir_8), Data2=graft(move_7.Geometry))
loft = Loft(Curves=merge, Options={Adjust=False, Closed=False, LoftEnds=0, LoftSimp=0, LoftType=0, Rebuild=10, Refit=0.01})
brep = Brep(<brep referenced from the Rhino model>)
top_mirror_cap = Geometry(sunion)

lens_tube = Geometry(move_5.Geometry)
reflector = Geometry(sdiff)  # disabled

pole = Geometry(extr_4)
m_to_0_0 = MTo00(brepthing=brep)
capex = CapHolesEx(Brep=loft)  # -> flatten(Brep), Caps, Solid
sdiff_2 = SolidDifference(BrepsA=m_to_0_0, BrepsB=capex.Brep)  # disabled
pipeline = GeometryPipeline(
    GroupByLayer=False,
    GroupByType=False,
    IncludeHidden=True,
    IncludeLocked=True,
    LayerFilter="basePlugInterim",
    NameFilter="*",
    TypeFilter=1073741848)
X_2 = UnitX(Factor="100")
move_8 = Move(Geometry=pipeline, Motion=X_2)  # -> Geometry, Transform
number_slider_3 = Slider(50, range=0..100)
xy_3 = XYPlane(Origin=Point(0, 0, 0))
item = ListItem(List=move_8.Geometry, Index=Slider(1, range=0..1), Wrap=True)
crv_5 = Curve([<curve referenced from the Rhino model> x9])
crv_6 = Curve(<curve referenced from the Rhino model>)
crv_7 = Curve([<curve referenced from the Rhino model> x6])
project_2 = Project(Geometry=crv_7, Plane=xy_3)  # -> Geometry, Transform

# ---- group: unicorn preview
move_9 = Move(Geometry=crv_5, Motion=expr("-x", X_2))  # -> Geometry, Transform

# ----
chop_4 = Chop(G=crv_5, F=number_slider_3, depth=expr("x*2", number_slider_3))
capex_2 = CapHolesEx(Brep=item)  # -> Brep, Caps, Solid
chop_5 = Chop(G=crv_6, F=Slider(20, range=0..100), depth=Slider(12.5, range=0..100))
chop_6 = Chop(G=project_2.Geometry, F=Slider(20, range=19..20), depth=Slider(19, range=0..100))
sdiff_3 = SolidDifference(BrepsA=capex_2.Brep, BrepsB=chop_4)
panel = Panel(sdiff_3)
sdiff_4 = SolidDifference(BrepsA=sdiff_3, BrepsB=chop_5)
sunion_4 = SolidUnion(Breps=[sdiff_4, chop_6])

# ----
# Mid camera cap
cam_lens_radius = Slider(4, range=3..10)
number_slider_4 = Slider(125, range=100..140)
addition_2 = Addition(A=number_slider_4, B=Slider(4, range=0..10))
cir_10 = Circle(Plane=PlaneXY(0, 0, 0), Radius=subtraction)
Z_9 = UnitZ(Factor=number_slider_4)
move_10 = Move(Geometry=cir_10, Motion=Z_9)  # -> Geometry, Transform
Z_10 = UnitZ(Factor=Slider(10, range=0..100))  # -> expr("-x", UnitVector)
Z_11 = UnitZ(Factor=Slider(2, range=0..100))  # -> expr("-x", UnitVector)
boundary_8 = BoundarySurfaces(Edges=move_10.Geometry)
extr_9 = Extrude(Base=boundary_8, Direction=Z_10)
extr_10 = Extrude(Base=boundary_8, Direction=Z_11)
sdiff_5 = SolidDifference(BrepsA=extr_10, BrepsB=chop_3)

# ----
# Cam suport rods
number_slider_5 = Slider(2.95, range=0..10)
subtraction_5 = Subtraction(A=subtraction, B=number_slider_5)
polygon = Polygon(Plane=P, Radius=subtraction_5, Segments=3, FilletRadius=0)  # -> Polygon, Length
rad_2 = Radians(Degrees=Slider(180, range=0..180))
Z_12 = UnitZ(Factor=1)
off_deck = Slider(3.5, range=0..10)
rot3d = Rotate3D(Geometry=polygon.Polygon, Angle=rad_2, Center=P, Axis=Z_12)  # -> Geometry, Transform
disc = Discontinuity(Curve=rot3d.Geometry, Level=1)  # -> Points, Parameters
subtraction_6 = Subtraction(A=number_slider_5, B=Slider(1.3, range=0..2))
pin_radius = Panel(subtraction_6)
cir_11 = Circle(Plane=disc.Points, Radius=subtraction_6)
Z_13 = UnitZ(Factor=off_deck)
move_11 = Move(Geometry=cir_11, Motion=Z_13)  # -> Geometry, Transform
boundary_9 = BoundarySurfaces(Edges=move_11.Geometry)
Z_14 = UnitZ(Factor=number_slider_4)
extr_11 = Extrude(Base=boundary_9, Direction=Z_14)
brep_2 = Brep(extr_11)

# ---- group: cam pins
shoulder_height = Slider(6, range=0..10)
Z_15 = UnitZ(Factor=addition_2)
pt_5 = Point([<point referenced from the Rhino model> x4])
move_12 = Move(Geometry=pt_5, Motion=Z_15)  # -> Geometry, Transform
cir_12 = Circle(Plane=move_12.Geometry, Radius=Slider(1.5, range=0..10))
cir_13 = Circle(Plane=move_12.Geometry, Radius=Slider(0.6, range=0..10))
boundary_10 = BoundarySurfaces(Edges=cir_12)
boundary_11 = BoundarySurfaces(Edges=cir_13)
addition_3 = Addition(A=shoulder_height, B=Slider(3, range=0..10))
Z_16 = UnitZ(Factor=shoulder_height)  # -> expr("-x", UnitVector)
Z_17 = UnitZ(Factor=addition_3)  # -> expr("-x", UnitVector)
extr_12 = Extrude(Base=boundary_11, Direction=Z_17)
extr_13 = Extrude(Base=boundary_10, Direction=Z_16)
sunion_5 = SolidUnion(Breps=[extr_13, extr_12])

# ---- group: lens hole
cir_14 = Circle(Plane=PlaneXY(0, 0, 0), Radius=cam_lens_radius)
Z_18 = UnitZ(Factor=200)
boundary_12 = BoundarySurfaces(Edges=cir_14)
extr_14 = Extrude(Base=boundary_12, Direction=Z_18)

# ----
multiplication = Multiplication(A=pin_radius, B=2)
pin_diameter = Panel(multiplication)

sdiff_6 = SolidDifference(BrepsA=extr_6, BrepsB=sunion_3)
sdiff_7 = SolidDifference(BrepsA=sdiff_6, BrepsB=brep_2)
sdiff_8 = SolidDifference(BrepsA=sdiff_7, BrepsB=sunion_2)
sdiff_9 = SolidDifference(BrepsA=sdiff_8, BrepsB=extr_5)
sdiff_10 = SolidDifference(BrepsA=sdiff_9, BrepsB=extr_4)

sdiff_11 = SolidDifference(BrepsA=sdiff_5, BrepsB=extr_14)
sunion_6 = SolidUnion(Breps=[sdiff_11, sunion_5])
sdiff_12 = SolidDifference(BrepsA=extr_9, BrepsB=extr_11)
sdiff_13 = SolidDifference(BrepsA=sunion_6, BrepsB=extr_14)
geo = Geometry([sdiff_13, sdiff_12])

sdiff_14 = SolidDifference(BrepsA=sdiff_10, BrepsB=chop)
camera_plug = Geometry(geo)
base_plug = Geometry(sdiff_14)
brep_3 = Brep(brep_2)
merge_2 = Merge(Data1=camera_plug, Data3=reflector, Data4=lens_tube, Data5=base_plug, Data6=top_mirror_cap, Data7=pole, Data9=brep_3)

# ==== cluster Tube
thickness = ClusterInput()
od = ClusterInput()
height = ClusterInput()
pln = ClusterInput()
thickness_2 = Number(thickness)
od_2 = Number(od)
height_2 = Number(height)
pln_2 = Plane(pln)
subtraction = Subtraction(A=od_2, B=thickness_2)
cir = Circle(Plane=pln_2, Radius=subtraction)
cir_2 = Circle(Plane=pln_2, Radius=od_2)
Z = UnitZ(Factor=height_2)
boundary = BoundarySurfaces(Edges=[cir, cir_2])
extr = Extrude(Base=boundary, Direction=Z)
capex = CapHolesEx(Brep=extr)  # -> Brep, Caps, Solid
tube = Brep(capex.Brep)
tube_2 = ClusterOutput(tube)

# ==== cluster TubeSpecs
T = ClusterInput()
split = TextSplit(Text=T, Separators=",")

# ---- group: OD
item = ListItem(List=split, Index=0, Wrap=True)

# ----
id = ListItem(List=split, Index=1, Wrap=True)
od = Number(item)
id_2 = Number(id)
subtraction = Subtraction(A=od, B=id_2)
division = Division(A=od, B="2")
division_2 = Division(A=subtraction, B="2")
or = Number(division)
division_3 = Division(A=id_2, B="2")
wt = Number(division_2)
ir = Number(division_3)
id_3 = ClusterOutput(id_2)
ir_2 = ClusterOutput(ir)
wt_2 = ClusterOutput(wt)
od_2 = ClusterOutput(od)
or_2 = ClusterOutput(or)

# ==== cluster Chop
depth = ClusterInput()
F = ClusterInput()
depth_2 = Number(depth)
G = ClusterInput()
Z = UnitZ(Factor=F)
move = Move(Geometry=G, Motion=Z)  # -> Geometry, Transform
Z_2 = UnitZ(Factor=expr("-x", depth_2))
boundary = BoundarySurfaces(Edges=move.Geometry)
extr = Extrude(Base=boundary, Direction=Z_2)
E = ClusterOutput(extr)

# ==== cluster MTo00
brepthing = ClusterInput()
brepthing_2 = Brep(brepthing)
bbox = BoundingBox(Content=brepthing_2, Plane=PlaneXY(0, 0, 0))  # -> Box, Box_2
boxprop = BoxProperties(Box=bbox.Box)  # -> Center, Diagonal, Area, Volume, Degeneracy
pdecon = Deconstruct(Point=boxprop.Center)  # -> XComponent, YComponent, ZComponent
devec = DeconstructVector(Vector=boxprop.Diagonal)  # -> XComponent, YComponent, expr("x/2", ZComponent)
subtraction = Subtraction(A=pdecon.ZComponent, B=devec.ZComponent)
pt = ConstructPoint(XCoordinate=pdecon.XComponent, YCoordinate=pdecon.YComponent, ZCoordinate=subtraction)
xy = XYPlane(Origin=Point(0, 0, 0))
vec2pt = Vector2Pt(PointA=pt, PointB=xy, Unitize=False)  # -> Vector, Length
move = Move(Geometry=brepthing_2, Motion=vec2pt.Vector)  # -> Geometry, Transform
moved_brep = Brep(move.Geometry)
moved_brep_2 = ClusterOutput(moved_brep)
