# Grasshopper definition mirror tests.gh (Grasshopper 0.9.76)

number_slider = Slider(70, range=0..100)
number_slider_2 = Slider(85, range=0..100)
number_slider_3 = Slider(19.96, range=2..20)
xy = XYPlane(Origin=Point(0, 0, 0))
X = UnitX(Factor=1)
line = LineSDL(Start=xy, Direction=X, Length=number_slider)
Y = UnitY(Factor=1)  # -> expr("-x", UnitVector)
end = EndPoints(Curve=line)  # -> Start, End
sketch_curve = Curve(<curve referenced from the Rhino model>)
cat = Catenary(PointA=end.Start, PointB=end.End, Length=number_slider_2, Gravity=Y)
list = ValueList({"end": 0, "mid": 0.5}, selected="mid")
crv = Curve(cat)
eval = EvaluateCurve(Curve=reparameterize(crv), Parameter=list)  # -> Point, Tangent, Angle
series = Series(Start=Slider(89, range=0..100), Step=expr("-x", Slider(0.5, range=0..1)), Count=Slider(80, range=5..100))
line_2 = LineSDL(Start=eval.Point, Direction=Y, Length=number_slider_3)
rad = Radians(Degrees=series)
expression = Expression(x=number_slider, Expression="x/2")
end_2 = EndPoints(Curve=line_2)  # -> Start, End
X_2 = UnitX(Factor=1)
pt = PointCylindrical(BasePlane=end_2.End, Angle=rad, Radius=Slider(500, range=0..1000), Elevation=0)
line_3 = LineSDL(Start=end_2.End, Direction=X_2, Length=expression)
ln = Line(StartPoint=end_2.End, EndPoint=pt)
ccx = CurveCurve(CurveA=crv, CurveB=ln)  # -> simplify(Points), ParamsA, ParamsB
item = ListItem(List=ccx.Points, Index=0, Wrap=True)  # -> flatten(Item)
crv_cp = CurveClosestPoint(Point=item, Curve=crv)  # -> Point, Parameter, Distance
eval_2 = EvaluateCurve(Curve=crv, Parameter=crv_cp.Parameter)  # -> Point, Tangent, Angle
pl = PlaneNormal(Origin=eval_2.Point, ZAxis=eval_2.Tangent)
ln_2 = Line(StartPoint=end_2.End, EndPoint=eval_2.Point)
mirror = Mirror(Geometry=ln_2, Plane=pl)  # -> Geometry, Transform
rainbow = Rainbow(data=ln_2)
clx = CurveLine(Curve=line_3, Line=mirror.Geometry)  # -> Points, Params, Count
lng = ListLength(List=clx.Points)  # -> flatten(Length)
int = Integer(1)
equals = Equality(FirstNumber=lng, SecondNumber=int)  # -> Equality, Inequality
cull = CullPattern(List=mirror.Geometry, CullPattern=equals.Inequality)
end_3 = EndPoints(Curve=cull)  # -> Start, End
dash = DashPattern(Curve=ln, Pattern=[0.05, 0.3])  # -> Dashes, Gaps
line_4 = LineSDL(Start=end_3.Start, Direction=cull, Length=-100)
preview = CustomPreview(Geometry=ln_2, Shader=rainbow)
preview_2 = CustomPreview(Geometry=mirror.Geometry, Shader=rainbow)
angle_contained = AngleContained(crv=line_4)  # -> pa, S, S_2, angle_3
pt_2 = Point(end_2.End)
pdecon = Deconstruct(Point=pt_2)  # -> XComponent, YComponent, ZComponent
number_slider_4 = Slider(3, range=3..30)
lineardim = LinearDimension(Line=line, PointA=end.Start, PointB=end.End, Text="{0:0.00}", Size=number_slider_4)
pt_3 = ConstructPoint(XCoordinate=pdecon.XComponent, YCoordinate=0, ZCoordinate=pdecon.ZComponent)
galapagos = Galapagos(fitness=angle_contained, gene=[number_slider_2, number_slider_3])
ln_3 = Line(StartPoint=pt_2, EndPoint=pt_3)
len = Length(Curve=ln_3)
angledim = AngularDimension(
    Center=angle_contained.pa,
    PointA=angle_contained.S,
    PointB=angle_contained.S_2,
    Reflex=False,
    Text="{0:0.0}°",
    Size=number_slider_4)
lineardim_2 = LinearDimension(Line=ln_3, PointA=pt_2, PointB=pt_3, Text="{0:0.00}", Size=number_slider_4)

# ==== cluster Rainbow
data = ClusterInput()
data_2 = Data(data)
cull = CullPattern(List=data_2, CullPattern=data_2)
lng = ListLength(List=cull)
div = DivideDomain(Domain=Domain(0, 1), Count=lng)
dedomain = DeconstructDomain(Domain=div)  # -> Start, End
hsl = ColourHSL(Alpha=1, Hue=dedomain.End, Saturation=1, Luminance=0.5)
col = Colour(hsl)
col_2 = ClusterOutput(col)

# ==== cluster AngleContained
crv = ClusterInput()
crv_2 = Curve(crv)
cull = CullPattern(List=crv_2, CullPattern=crv_2)
lng = ListLength(List=cull)
item = ListItem(List=cull, Index=expr("x-1", lng), Wrap=True)
item_2 = ListItem(List=cull, Index=0, Wrap=True)
angle = Angle(VectorA=item_2, VectorB=item)  # -> Angle, Reflex
deg = Degrees(Radians=angle.Angle)
end = EndPoints(Curve=item_2)  # -> Start, End
llx = LineLine(Line1=item_2, Line2=item)  # -> ParamA, ParamB, PointA, PointB
end_2 = EndPoints(Curve=item)  # -> Start, End
angle_2 = Number(deg)
S = ClusterOutput(end.Start)
S_2 = ClusterOutput(end_2.Start)
pa = ClusterOutput(llx.PointA)
angle_3 = ClusterOutput(angle_2)
