# Grasshopper definition mirror.gh (Grasshopper 0.9.76)

diameter = Slider(55.3, range=0..100)
division = Division(A=diameter, B=2)
rad = Radians(Degrees="180")
pt = PointPolar(BasePlane=PlaneXY(0, 0, 0), XYAngle="0", ZAngle=0, Offset=division)
pt_2 = PointPolar(BasePlane=PlaneXY(0, 0, 0), XYAngle=rad, ZAngle=0, Offset=division)
Z = UnitZ(Factor=1)
multiplication = Multiplication(A=diameter, B=0.45)
cat = Catenary(PointA=pt, PointB=pt_2, Length=Slider(66.5, range=66..67), Gravity=Z)
xy = XYPlane(Origin=Point(0, 0, 0))
Z_2 = UnitZ(Factor=1)
shatter = Shatter(Curve=reparameterize(cat), Parameters="0.5")
line = LineSDL(Start=xy, Direction=Z_2, Length=1)
item = ListItem(List=shatter, Index=0, Wrap=True)
disc = Discontinuity(Curve=item, Level=1)  # -> Points, Parameters
intcrv = Interpolate(Vertices=disc.Points, Degree=3, Periodic=False, KnotStyle=1)  # -> Curve, Length, Domain
revsrf = Revolution(Curve=intcrv.Curve, Axis=line, Domain=Domain(0, 6.283185307))
end = EndPoints(Curve=intcrv.Curve)  # -> Start, End
pdecon = Deconstruct(Point=end.End)  # -> XComponent, YComponent, ZComponent
Z_3 = UnitZ(Factor=Slider(4, range=0..10))
dome_height = Panel(pdecon.ZComponent)
move = Move(Geometry=revsrf, Motion=Z_3)  # -> Geometry, Transform
edges = BrepEdges(Brep=move.Geometry)  # -> Naked, Interior, NonManifold
cir = Circle(Plane=PlaneXY(0, 0, 0), Radius=multiplication)
item_2 = ListItem(List=edges.Naked, Index=0, Wrap=True)
merge = Merge(Data1=item_2, Data2=cir)  # -> flatten(Result)
loft = Loft(Curves=merge, Options={Adjust=True, Closed=False, LoftEnds=0, LoftSimp=0, LoftType=3, Rebuild=10, Refit=0.01})
capex = CapHolesEx(Brep=move.Geometry)  # -> Brep, Caps, Solid
capex_2 = CapHolesEx(Brep=loft)  # -> Brep, Caps, Solid
sunion = SolidUnion(Breps=flatten([capex.Brep, capex_2.Brep]))
