# Grasshopper definition 02_NAVGRAPH.gh (Grasshopper 0.9.75)
# plug-ins: LunchBox

# ---- group: 01. Create the Navmesh
pipeline = GeometryPipeline(
    GroupByLayer=False,
    GroupByType=False,
    IncludeHidden=True,
    IncludeLocked=True,
    LayerFilter="_gh_boundary_outeroffset_BVN",
    NameFilter="*",
    TypeFilter=4)
pipeline_2 = GeometryPipeline(
    GroupByLayer=False,
    GroupByType=False,
    IncludeHidden=True,
    IncludeLocked=True,
    LayerFilter="_gh_boundary_inneroffset_BVN",
    NameFilter="*",
    TypeFilter=4)
dam = DataDam(DataA=pipeline, BufferDelay=10000000, BufferMode=0)
dam_2 = DataDam(DataA=pipeline_2, BufferDelay=10000000, BufferMode=0)
whole_area = Geometry(dam)
brect = Brect(object=whole_area)
pop2d = Populate2D(Region=brect, Count=Slider(24000, range=0..100000), Seed=1)
cullout = CullOut(pt=pop2d, C=whole_area)  # disabled
del = DelaunayMesh(Points=cullout, Plane=PlaneXY(0, 0, 0))
cluster = Cluster_2(mesh=del, exclusioncrv=dam_2, inclusioncrv=dam)
offset_loose = OffsetLoose(Curve=cluster, Distance=Slider(3, range=0..10))
explode = Explode(Curve=cluster, Recursive=True)  # -> Segments, Vertices

# ---- group: 02. Bake Navgraph to Layer
nav_mesh = Curve(flatten(explode.Segments))
bake = ObjectBake(
    BakeToggle=Toggle(False),
    GeometryObjects=nav_mesh,
    Layer="_gh_nav_graph_BVN",
    ObjectName="GH_Obj",
    ObjectColor=RGB(255, 255, 255),
    LayerColor=RGB(0, 255, 140))

# ==== cluster Brect
object = ClusterInput()
object_2 = Geometry(object)
bbox = BoundingBox(Content=object_2, Plane=PlaneXY(0, 0, 0))  # -> Box, Box_2
boxprop = BoxProperties(Box=bbox.Box)  # -> Center, Diagonal, Area, Volume, Degeneracy
devec = DeconstructVector(Vector=boxprop.Diagonal)  # -> XComponent, YComponent, ZComponent
move = Move(Geometry=boxprop.Center, Motion=expr("x*-0.5", boxprop.Diagonal))  # -> Geometry, Transform
rectangle = Rectangle(Plane=move.Geometry, XSize=devec.XComponent, YSize=devec.YComponent, Radius=0)  # -> Rectangle, Length
R = ClusterOutput(rectangle.Rectangle)

# ==== cluster Cluster_2
exclusioncrv = ClusterInput()
mesh = ClusterInput()
inclusioncrv = ClusterInput()
exclusioncrv_2 = Curve(flatten(exclusioncrv))
inclusioncrv_2 = Curve(inclusioncrv)
mesh_2 = Mesh(mesh)
medges = MeshEdges(Mesh=mesh_2)  # -> NakedEdges, InteriorEdges, NonManifoldEdges
merge = Merge(Data1=medges.NakedEdges, Data2=medges.InteriorEdges, Data3=medges.NonManifoldEdges)
list = ValueList({"Outside": 0, "Coincident": 1, "Inside": 2}, selected="Inside")
cluster = Cluster(edges=merge, pos=list, C=exclusioncrv_2)
list_2 = ValueList({"Outside": 0, "Coincident": 1, "Inside": 2}, selected="Outside")
cluster_2 = Cluster(edges=cluster, pos=list_2, C=inclusioncrv_2)
exclusioncrv_3 = Curve(exclusioncrv_2)
ccx = CurveCurve(CurveA=cluster_2, CurveB=graft(exclusioncrv_3))  # -> Points, simplify(ParamsA), ParamsB
path_mapper = PathMapper(ccx.ParamsA, source="{A;B}", target="{B}")
python = PythonScript(x=path_mapper)  # -> out, flatten(a); inputs x: list
# ---------- python: Python ----------
if x != []:
    print x
a =  x == []
# ---------- end python ----------
cull = CullPattern(List=cluster_2, CullPattern=python.a)
filteredcrv = Curve(cull)
filteredcrv_2 = ClusterOutput(filteredcrv)

# ==== cluster CullOut
pt = ClusterInput()
C = ClusterInput()
pt_2 = Point(pt)
incurve = PointInCurve(Point=pt_2, Curve=C)  # -> Relationship, Point
cull = CullPattern(List=pt_2, CullPattern=incurve.Relationship)
L = ClusterOutput(cull)

# ==== cluster Cluster
edges = ClusterInput()
edges_2 = Curve(edges)
curvepoint = PointOnCurve(edges_2, parameter=0.5)
C = ClusterInput()
incurves = PointInCurves(Point=curvepoint, Curves=C)  # -> Relationship, Index, Point
pos = ClusterInput()
equals = Equality(FirstNumber=incurves.Relationship, SecondNumber=pos)  # -> Equality, Inequality
not = GateNot(A=equals.Equality)
cull = CullPattern(List=edges_2, CullPattern=flatten(not))
filteredcrv = Curve(cull)
filteredcrv_2 = ClusterOutput(filteredcrv)
