# Grasshopper definition 03_ISOVIST MODEL.gh (Grasshopper 0.9.75)
# plug-ins: Python Interpreter, LunchBox

# ---- group: 01. Isovist Model (with Basestation Points)
geometry_pipeline = GeometryPipeline(
    GroupByLayer=False,
    GroupByType=False,
    IncludeHidden=True,
    IncludeLocked=True,
    LayerFilter="BASESTATION POINTS",
    NameFilter="*",
    TypeFilter=1)
pipeline = GeometryPipeline(
    GroupByLayer=False,
    GroupByType=False,
    IncludeHidden=True,
    IncludeLocked=True,
    LayerFilter="_gh_boundary_isovist_BVN",
    NameFilter="*",
    TypeFilter=4)
point = Point(geometry_pipeline)
data_dam = DataDam(DataA=point, BufferDelay=10000000, BufferMode=0)
python = PythonScript(points=data_dam, lines=Slider(1000, range=0..1000), radius=Slider(5000, range=0..10000), boundries=pipeline)  # -> pointOut, totalIsovist, isovistsClear, overlapSpace, isovistsList, isovistTotalSurface, nonOverlapSpace; inputs points: list of Point3d, lines: Int32, radius: Int32, boundries: list
# ---------- python: Python ----------
import ghpythonlib.components as ghcomp
import rhinoscriptsyntax as rs
import Rhino.Geometry as rg




isovistsList = []
overlapSpaceList = []
isovistsClear = []
pointOut = points

for point in points:
    isovists = ghcomp.IsoVist(point,lines,radius,boundries)
    getIsovistPoints=isovists[0]
    isovistsOutline = ghcomp.PolyLine(getIsovistPoints,True)
    makeSurface = ghcomp.BoundarySurfaces(isovistsOutline)
    print makeSurface
    isovistsList.append(makeSurface)

coerceBrepList = []

for individualIsovists in isovistsList:
    coercedOneBrep = rs.coercebrep(individualIsovists)
    coerceBrepList.append(coercedOneBrep)

isovistCoercedUnion = ghcomp.RegionUnion(coerceBrepList)
isovistTotalSurface = ghcomp.BoundarySurfaces(isovistCoercedUnion)

interA = isovistsList[0:len(isovistsList)-1]
interB = isovistsList[1:]

for itsA in interA:
    for itsB in interB:
        if itsA == itsB:
            print itsA
        else:
            regionInter = ghcomp.RegionIntersection(itsA,itsB)
            surfaceInter = ghcomp.BoundarySurfaces(regionInter)
            #if len(surfaceInter) != 1:
            #    for listList in surfaceInter:
            #        print listList
            #        overlapSpaceList.append(listList)
            overlapSpaceList.append(surfaceInter)


flatOver = []

for testList in overlapSpaceList:
    testIfList = isinstance(testList, list)
    if testIfList == True:
        for isList in testList:
            flatOver.append(isList)
    else:
        flatOver.append(testList)

overlapSpace = flatOver

##asd = []

##overlapSpace = ghcomp.RegionUnion(flatOver)

##for getnotOverlapSpace in isovistsList:
##    pineapple = ghcomp.RegionDifference(getnotOverlapSpace, overlapSpace)
##    asd.append(pineapple)
##nonOverlapSpace = asd


#overlapCombination = ghcomp.RegionUnion(flatOver)
#print overlapCombination
#overlapSurface = ghcomp.BoundarySurfaces(overlapCombination)
#overlapCalcArea = ghcomp.Area(overlapSurface)
#print overlapCalcArea


#for overlapPiece in overlapCalcArea[0]:
#    overlapArea = overlapArea + overlapPiece

#print overlapSpaceList
#overlapSpace = flatOver



#ghcomp.regi

#a = isovistsList
# ---------- end python ----------
curve = Curve(python.isovistsList)

# ---- group: Bake
colour_swatch = ColourSwatch(SwatchColor=RGB(0, 255, 255))
object_bake = ObjectBake(
    BakeToggle=Toggle(False),
    GeometryObjects=curve,
    Layer="_gh_circle_isovist_BVN",
    ObjectName="GH_Obj",
    ObjectColor=colour_swatch,
    LayerColor=colour_swatch)
