# Grasshopper definition 04_SORTING BASESTATIONS & STATES.gh (Grasshopper 0.9.75)

# ---- group: Sorting Basestations
names = Panel("""Ace
Alfa
Beer
Bravo
Charlie
Coco
Dee
Echo
Edward
Foxtrot
Hotel
George
Golf
Harry
Freddie
India
Ink
Johnnie
Juliett
Kilo
King
Lima
London
Mike
Monkey
November
Nuts
Orange
Oscar
Papa
Pip
Quebec
Queen
Robert
Romeo
Sierra
Sugar
Tango
Tick
Uncle
Uniform
Vic
Victor
Whisky
William
X-ray
X-men
Yankee
Yorker
Zebra
Zulu""")
geometry_pipeline = GeometryPipeline(
    GroupByLayer=False,
    GroupByType=False,
    IncludeHidden=True,
    IncludeLocked=True,
    LayerFilter="sorting curve",
    NameFilter="*",
    TypeFilter=4)
disc = Discontinuity(Curve=geometry_pipeline, Level=1)  # -> Points, Parameters
cluster = Cluster(source_list=disc.Points, target_list=names)
sorted_points = Point(disc.Points)
basestation_xy = Deconstruct(Point=sorted_points)  # -> XComponent, YComponent, ZComponent
sph = Sphere(Base=sorted_points, Radius=Slider(600, range=0..600))
basestation_tag = TextTag3D(
    Location=disc.Points,
    Text=cluster,
    Size=Slider(1000, range=0..10000),
    Colour=ColourSwatch(SwatchColor=RGB(255, 0, 0)),
    Justification=7)
x_coords = Panel(basestation_xy.XComponent)
y_coords = Panel(basestation_xy.YComponent)

# ---- group: Sorting 'State' Locations
names_2 = Panel("""Citizen
Library Table
Library
Resource Room
Training Room
Server Room
Boardroom
Reception
Lobby
Out
Shower
My Desk
Quiet N
Meeting N
V Table N
Pebble Sofa
V Table Round
V Meeting N
Coffee Machine
V Meeting S
V Table S
Hug
Meeting S
Quiet S
Model Table
M Toilet""")
geometry_pipeline_2 = GeometryPipeline(
    GroupByLayer=False,
    GroupByType=False,
    IncludeHidden=True,
    IncludeLocked=True,
    LayerFilter="state_points",
    NameFilter="*",
    TypeFilter=1)
point = Point(geometry_pipeline_2)
deconstruct = Deconstruct(Point=point)  # -> XComponent, YComponent, ZComponent
basestation_tag_2 = TextTag3D(
    Location=point,
    Text=names_2,
    Size=Slider(1163, range=0..10000),
    Colour=ColourSwatch(SwatchColor=RGB(255, 0, 0)),
    Justification=7)
x_coords_2 = Panel(deconstruct.XComponent)
y_coords_2 = Panel(deconstruct.YComponent)

# ==== cluster Cluster
source_list = ClusterInput()
list_length = ListLength(SourceList=source_list)
construct_domain = ConstructDomain(DomainStart=0, DomainEnd=expr("x-1", list_length))
target_list = ClusterInput()
sub_list = SubList(TargetList=target_list, Domain=construct_domain, Wrap=False)  # -> List, Index
list = ClusterOutput(sub_list.List)
