# Grasshopper definition 06_AVG RSSI AT X TIME INTERVAL.gh (Grasshopper 0.9.75)
# plug-ins: Python Interpreter

# ---- group: Find avg rssi within X time interval
json_file = FilePath()
rssi = PythonScript(FilePath=json_file)  # -> rssi, a
# ---------- rssi: Python ----------
import json

if FilePath:
    
    # JSON file to read
    file = open(FilePath)
    
    # Load the data
    data = json.load(file)
    
    rssi = []
    
    for d in data:
        rssi.append( d['rssi'] )
    
    print rssi
# ---------- end rssi ----------
time = PythonScript(FilePath=json_file)  # -> flatten(time)
# ---------- time: Python ----------
import json

if FilePath:
    
    # JSON file to read
    file = open(FilePath)
    
    # Load the data
    data = json.load(file)
    
    time = []
    
    for d in data:
        time.append( d['time'] )
    
    print time
# ---------- end time ----------
larger = LargerThan(FirstNumber=rssi.rssi, SecondNumber=Slider(-100, range=-100..100))  # -> LargerThan, OrEqualTo
panel = Panel(rssi.rssi)
panel_2 = Panel(larger.LargerThan)
panel_3 = Panel(time)
cull = CullPattern(List=panel_3, CullPattern=panel_2)
cull_2 = CullPattern(List=rssi.rssi, CullPattern=panel_2)
panel_4 = Panel(cull_2)
panel_5 = Panel(cull)
interval = Slider(10, range=0..100)
lng = ListLength(List=cull)
lng_2 = ListLength(List=panel_4)
interval_average = PythonScript(timeList=panel_5, rssiList=cull_2, timeDifference=interval)  # -> avgList, a; inputs timeList: list, rssiList: list
# ---------- interval_average: Python ----------
import Rhino
import scriptcontext
import datetime

## Find me the index that is >=
## to the time difference of the first index

def StringToDateTime(string):
    return datetime.datetime.strptime(string, '%Y-%m-%dT%H:%M:%S') # Mysteriously, .%f doesn't work, so we ignore that part of the timestamp

timeDelta = datetime.timedelta(0,timeDifference) # seconds
times = [StringToDateTime(time) for time in timeList] # input is a list of strings (for whatever reason) so convert them to a floating point numbers (allows for big numbers)
instance = 0
firstTime = times[0]
currentTimePeriodEnd = firstTime + timeDelta
avgList = []

chunk = []

# while the index of f is within the range of rssiList, do something
for time, rssi in zip(times, rssiList):
    if time <= currentTimePeriodEnd:
        chunk.append(rssi)
    else:
        avg = sum(chunk)/len(chunk)
        print avg
        avgList.append(avg)
        chunk = []
        currentTimePeriodEnd = currentTimePeriodEnd + timeDelta
# starting from f, find me all the values that are <= to f and place those values into a their own list(this list will fluxuate alot)
# now take all those values that fall within those condictions and place that into a new list
# Now average that list and return the value
# incremenet the intance by 1 and then continue the loop until
# ---------- end interval_average ----------
panel_6 = Panel([lng, lng_2])
panel_7 = Panel(interval_average.avgList)
