# Grasshopper definition 07_TIME TOOLS.gh (Grasshopper 0.9.75)
# plug-ins: Python Interpreter

timer = Timer(TimerInterval=20, Target=runner_2)  # disabled
timer_2 = Timer(TimerInterval=20, Target=runner)
runner = PythonScript(reset=Toggle(True), stop=Toggle(False), record=Toggle(False), dataNum=Slider(188, range=0..500))  # -> out, rect, xy, pos, pathData
# ---------- runner: Python ----------
ghenv.Component.Message = "written by +GENEATCG"

import rhinoscriptsyntax as rs 
import Rhino as rc

rectX = 100
rectY = 100

class Runner:
    def __init__(self, x, y, mx, my):
        self.x = x
        self.y = y
        self.mx = mx
        self.my = my
        self.path = []
        
    def pt(self):
        self.x += mx
        self.y += my
        return self.x,self.y
    
    def reflect(self):
        if self.x >= rectX or self.x <= 0:
            self.mx *= -1
        if self.y >= rectY or self.y <= 0:
            self.my *= -1
        return self.mx, self.my
        
    def recordPath(self, x):
        self.path.append(x)
        
    def deletePath(self, n):
        if len(self.path) > n:
            self.path.pop(0)

if reset:
    run = Runner(3,5,1,2)
    c = rs.AddPoint(run.x, run.y, 0)
else:
    if not stop:
        mx, my = run.reflect()
        x, y = run.pt()
        xy = x, y
        pos = rs.AddPoint(x, y, 0)
        if record:
            run.recordPath(rc.Geometry.Point3d(x,y,0))
            pathData = run.path
        else:
            pathData = run.path
    else:
        pos = rs.AddPoint(x, y, 0)
        pathData = run.path
    run.deletePath(dataNum)


plane = rs.WorldXYPlane()

rect = rs.AddRectangle(plane, rectX, rectY)
# ---------- end runner ----------
runner_2 = PythonScript(
    reset=Toggle(False),
    stop=Toggle(False),
    ms=Slider(4, range=0..4),
    mc=Slider(0.001, range=0..0.003),
    ma=Slider(0.1, range=0..0.1),
    bound=Toggle(True))  # -> out, rect, pos, vec, ln
# ---------- runner_2: Python ----------
ghenv.Component.Message = "written by +GENEATCG"

import rhinoscriptsyntax as rs 
import Rhino as rc
from random import *

rectX = 600
rectY = 600

class Runner:
    def __init__(self, p, v):
        self.p = p
        self.v = v
        self.a = rs.VectorCreate( (0,0,0),(0,0,0) )
        
    def ptRun(self):
        self.v = rs.VectorAdd(self.v, self.a)
        v = rs.VectorLength(self.v)
        if v > 2:
            self.v = rs.VectorScale(rs.VectorUnitize(self.v), 2)
        self.p = rs.VectorAdd(self.p, self.v)
        
        self.a = rs.VectorCreate( (0,0,0),(0,0,0) )
    
    def reflect(self):
        if self.p[0] >= rectX or self.p[0] < 0:
            self.v[0] *= -1.2
        if self.p[1] >= rectY or self.p[1] < 0:
            self.v[1] *= -1.2
    
    def door(self):
        if self.p[0] >= rectX:
            self.p[0] -= rectX
        if self.p[0] <= 0:
            self.p[0] += rectX
        if self.p[1] >= rectY:
            self.p[1] -= rectY
        if self.p[1] <= 0:
            self.p[1] += rectY
        
    
    def flock(self):
        self.separate(ms)
        self.cohesion(mc)
        self.align(ma)
    
    def align(self, mag):
        
        steer = rs.VectorCreate( (0,0,0) , (0,0,0) )
        count = 0
        
        for i in pts:
            distance = rs.Distance(i.p, self.p)
            if distance > 0 and distance < 40:
                steer = rs.VectorAdd(steer, i.v)
                count += 1
        
        if count>0:
            steer = rs.VectorScale(steer, 1.0/count)
        
        steer = rs.VectorScale(steer, mag)
        self.a = rs.VectorAdd(self.a, steer)
    
    def cohesion(self, mag):
        
        sum = rs.VectorCreate( (0,0,0) , (0,0,0) )
        count = 0
        
        for i in pts:
            distance = rs.Distance(i.p, self.p)
            if distance > 0 and distance < 60:
                sum = rs.VectorAdd(sum, i.p)
                count += 1
        
        if count>0:
            sum = rs.VectorScale(sum, 1.0/count)
        
        steer = rs.VectorSubtract(sum, self.p)
        steer = rs.VectorScale(steer, mag)
        self.a = rs.VectorAdd(self.a, steer)
        #print(self.a)
    
    def separate(self, mag):
        
        steer = rs.VectorCreate( (0,0,0) , (0,0,0) )
        count = 0
        
        for i in pts:
            distance = rs.Distance(i.p, self.p)
            if distance > 0 and distance < 30:
                diff = rs.VectorSubtract(self.p, i.p)
                diff = rs.VectorUnitize(diff)
                diff = rs.VectorScale(diff, 1.0/distance)
                
                steer = rs.VectorAdd(steer , diff)
                count += 1
        
        if count>0:
            steer = rs.VectorScale(steer, 1.0/count)
        
        steer = rs.VectorScale(steer, mag)
        
        self.a = rs.VectorAdd(self.a, steer)
        #print(self.a)
    
    def drawPt(self):
        pt = rc.Geometry.Point3d(self.p[0], self.p[1], self.p[2])
        return pt

if reset:
    pts = []
    for i in range(20):
        p = rs.VectorCreate(   rs.AddPoint( randint(1,rectX-1),  randint(1,rectY-1),0  )  ,  rs.AddPoint(0,0,0)    )
        v = rs.VectorCreate(   rs.AddPoint( randint(1,3) ,  randint(1,3),0   )  ,  rs.AddPoint(0,0,0)    )
        run1 = Runner(p, v)
        pts.append(run1)
else:
    pos = []
    vec = []
    
    if not stop:
        for i in pts:
            pos.append(i.drawPt())
            vec.append(i.v)
        for i in pts:
            if bound:
                i.reflect()
            else:
                i.door()
            #i.separate(magnitude)
            i.flock()
            i.ptRun()
        
    else:
        for i in pts:
            pos.append(i.drawPt())
            vec.append(i.v)


plane = rs.WorldXYPlane()

rect = rs.AddRectangle(plane, rectX, rectY)
# ---------- end runner_2 ----------
panel = Panel(runner.pathData)
panel_2 = Panel(runner.xy)
panel_3 = Panel(runner.pos)
panel_4 = Panel(runner_2.vec)
panel_5 = Panel(runner_2.pos)
button = Button()
vdis = VectorDisplay(Anchor=panel_5, Vector=panel_4)
toggle = BooleanToggle(True)

# ---- group: Converting to milliseconds
timespan = VBScript(days="0", hours="2", minutes="15", seconds="30")  # -> out, span
# ---------- timespan: VB ----------
    Dim s As New TimeSpan(days, hours, minutes, seconds)
    span = s.Ticks.ToString()
# ---------- end timespan ----------
panel_6 = Panel(timespan.span)

# ---- group: To find time span between multiple times/dates
panel_7 = Panel("""July 20 2012, 13:45:00
July 20 2012, 13:45:30
July 21 2012, 09:30:00
July 21 2012, 18:59:59
July 22 2012, 12:33:00
July 22 2012, 12:34:20
July 24 2012, 07:00:00
July 25 2012, 23:59:59""")
time = Time(panel_7)
multispan = VBScript(times=time)  # -> out, spans; inputs times: list
# ---------- multispan: VB ----------
    times.Sort()
    
    Dim s As New List(Of String)
    For i As Int32 = 0 To times.Count - 2
      Dim localSpan As TimeSpan = times(i + 1) - times(i)
      s.Add(localSpan.Ticks.ToString())
    Next
    spans = s
# ---------- end multispan ----------
formatspan = VBScript(span=multispan.spans)  # -> out, format
# ---------- formatspan: VB ----------
    Dim s As New TimeSpan(Int64.Parse(span))
    format = String.Format("{0} days, {1} hours, {2} minutes & {3} seconds", s.Days, s.Hours, s.Minutes, s.Seconds)
# ---------- end formatspan ----------
panel_8 = Panel(formatspan.format)

# ---- group: Subtracting two dates
time_2 = Time("July 20 2012, 13:45:00")
time_3 = Time("Now")
subtractdates = VBScript(t0=time_2, t1=time_3)  # -> out, span
# ---------- subtractdates: VB ----------
    Dim s As TimeSpan = t1 - t0
    span = s.Ticks.ToString()
# ---------- end subtractdates ----------

# ---- group: Interpolating times/dates
time_4 = Time("Now")
time_5 = Time("July 20 2012, 13:45:00")
interpolate = VBScript(t0=time_5, t1=time_4, f=Slider(1, range=0..1))  # -> out, t
# ---------- interpolate: VB ----------
    Dim ticks0 As Int64 = t0.Ticks
    Dim ticks1 As Int64 = t1.Ticks

    Dim ticks As Int64 = Convert.ToInt64(ticks0 + f * (ticks1 - ticks0))
    t = New GH_Time(New DateTime(ticks))
# ---------- end interpolate ----------
panel_9 = Panel(interpolate.t)

# ---- group: To find span between two dates
formatspan_2 = VBScript(span=subtractdates.span)  # -> out, format; same code as formatspan
panel_10 = Panel(formatspan_2.format)

# ---- group: Adding two dates
addition = VBScript(time=time_3, span=panel_6)  # -> out, time2
# ---------- addition: C# ----------
    time2 = New GH_Time(time + New TimeSpan(Int64.Parse(span)))
# ---------- end addition ----------
panel_11 = Panel(addition.time2)

# ----
number_slider = Slider(11, range=-20..20)  # disabled
number_slider_2 = Slider(-4, range=-40..40)  # disabled
number_slider_3 = Slider(-4, range=-20..20)  # disabled
number_slider_4 = Slider(-1, range=-20..20)  # disabled
number_slider_5 = Slider(19, range=-40..40)  # disabled
number_slider_6 = Slider(-4, range=-20..20)  # disabled
smtime = ConstructSmoothTime(Days=0, Hours=0, Minutes=0, Seconds=0)  # disabled
pt = ConstructPoint(XCoordinate=number_slider, YCoordinate=number_slider_2, ZCoordinate=number_slider_3)  # disabled
pt_2 = ConstructPoint(XCoordinate=number_slider_4, YCoordinate=number_slider_5, ZCoordinate=number_slider_6)  # disabled
number_slider_7 = Slider(2.84, range=0..7)  # disabled
toggle_2 = BooleanToggle(True)  # disabled
button_2 = Button()  # disabled
timer_3 = Timer(TimerInterval=20, Target=python)  # disabled
geo = Geometry(pt)  # disabled
geo_2 = Geometry(pt_2)  # disabled
python = PythonScript(StartPt=geo, DirPt=geo_2, length=number_slider_7, Toggle=toggle_2, Reset=button_2)  # -> out, Count, a, b; inputs Toggle: Boolean, Reset: Boolean; disabled
# ---------- python: Python ----------
import scriptcontext as sc
import rhinoscriptsyntax as rs 


org = rs.AddPoint((0, 0, 0))
dir = rs.AddPoint(DirPt)
box = [20, 40, 20]

# Add the count variable to the sticky dict
if "count" not in sc.sticky:
    sc.sticky["count"] =  rs.VectorCreate(StartPt, org)
if "vel" not in sc.sticky:
    sc.sticky["vel"] = rs.VectorCreate(dir, StartPt)

def re():
    if Reset:
        sc.sticky["count"] = rs.VectorCreate(StartPt, org)
        s = rs.VectorCreate(dir, StartPt)
        sLen = rs.VectorUnitize(s)
        sc.sticky["vel"] = rs.VectorScale(sLen, length)
    return

def bound():
    if sc.sticky["count"][0]> box[0] or sc.sticky["count"][0]< -box[0]:
        sc.sticky["vel"][0] = - sc.sticky["vel"][0]
    if sc.sticky["count"][1]> box[1] or sc.sticky["count"][1]< -box[1]:
        sc.sticky["vel"][1] = - sc.sticky["vel"][1]
    if sc.sticky["count"][2]> box[2] or sc.sticky["count"][2]< -box[2]:
        sc.sticky["vel"][2] = - sc.sticky["vel"][2]
    return

def main():

    print(sc.sticky["count"])
    
    if Toggle:
        ac = sc.sticky["count"]
        bc = sc.sticky["vel"]
        add = rs.VectorAdd(ac, bc)
        sc.sticky["count"] = add
        print(sc.sticky["count"])
    
    bound()
    
    # Reset the count
    re()

    # Return count to GH
    Count = sc.sticky["count"]
    pt_x = sc.sticky["count"][0]
    pt_y = sc.sticky["count"][1]
    pt_z = sc.sticky["count"][2]
    
    a = rs.AddPoint(pt_x, pt_y, pt_z)
    
    return a

a = main()
b = box
# ---------- end python ----------
dom = ConstructDomain(DomainStart=graft(python.b), DomainEnd=expr("-x", graft(python.b)))  # disabled
bang = ExplodeTree(Data=dom)  # -> Branch0, Branch1, Branch2; disabled
panel_12 = Panel(python.out)  # disabled
sph = Sphere(Base=python.a, Radius=1)  # disabled
swatch = ColourSwatch(SwatchColor=RGBA(255, 255, 255, 54))  # disabled
box = DomainBox(Base=PlaneXY(0, 0, 0), X=bang.Branch0, Y=bang.Branch1, Z=bang.Branch2)  # disabled
panel_13 = Panel(python.a)  # disabled
preview = CustomPreview(Geometry=box, Shader=swatch)  # disabled
panel_14 = Panel(bang.Branch0)  # disabled
