# Grasshopper definition 08_BASESTATION-BASESTATION.gh (Grasshopper 0.9.75)
# plug-ins: Python Interpreter, Human, Agent, Shortest Walk in Gh

windows_simdata = FilePath("F:\BlankMindBlog\helpers\VISUALISATION\json_detection data\simdata.json")
names = PythonScript(FilePath=windows_simdata)  # -> uuids, a
# ---------- names: Python ----------
import json

if FilePath:
    
    # JSON file to read
    file = open(FilePath)
    
    # Load the data
    data = json.load(file)
    
    uuids = []
    
    for d in data:
        uuids.append( d['uuid'] )
    
    print uuids
# ---------- end names ----------
create_set = CreateSet(List=names.uuids)  # -> Set, Map
panel = Panel(create_set.Set)  # disabled
bvn_path = FilePath("F:\BlankMindBlog\helpers\basestation_location\baseStations_BVN.json")  # disabled
arup_path = FilePath("F:\BlankMindBlog\helpers\basestation_location\baseStations_ARUP.json")  # disabled

# ----
# Detections
# Given a list of names, this finds all the detections related to each of those names and returns them as a list of lists.
json_detections = PythonScript(FilePath=windows_simdata, uuid=panel)  # -> agent, time; disabled
# ---------- json_detections: Python ----------
import json

if FilePath:
    
    # JSON file to read
    file = open(FilePath)
    
    # Load the data
    detections = json.load(file)
    #data = str(detections)
    
    time = []
    agent = []
    
    for d in detections:
        if d['uuid'] == uuid:
#            print detection
            time.append( d['time'] )
            agent.append( d['agentId'] )
# ---------- end json_detections ----------
create_set_2 = CreateSet(List=json_detections.agent)  # -> Set, Map; disabled
panel_2 = Panel(create_set_2.Set)  # disabled
panel_3 = Panel(json_detections.agent)  # disabled
panel_4 = Panel(json_detections.time)  # disabled

# ----
# This maps the points so that the path is continous e.g. [0] to [1], [1] to [2]....
joining_curves = PythonScript(agent=json_detections.agent)  # -> start, end; inputs agent: list; disabled
# ---------- joining_curves: Python ----------
import ghpythonlib as gh

x = 0
start = []
end = []

while x < len(agent)-1:
    start.append(agent[x])
    end.append(agent[x + 1])
    x = x + 1
    
    print start
    print end
# ---------- end joining_curves ----------
panel_5 = Panel(joining_curves.start)  # disabled
panel_6 = Panel(joining_curves.end)  # disabled

# ----
# This takes list of detections and
# returns the x, y coords of the basestations
# Start and End Pts
number_slider = Slider(313, range=0..1000)  # disabled
detection_of_start_point = DetectionOfStartPoint(filepath=bvn_path, inputname=panel_5)  # -> x, y; disabled
detection_of_end_point = DetectionOfStartPoint(filepath=bvn_path, inputname=panel_6)  # -> x, y; disabled
start_pts = ConstructPoint(XCoordinate=detection_of_start_point.x, YCoordinate=detection_of_start_point.y, ZCoordinate=0)  # disabled
end_pts = ConstructPoint(XCoordinate=detection_of_end_point.x, YCoordinate=detection_of_end_point.y, ZCoordinate=0)  # disabled
point = Point(start_pts)  # disabled
sphere = Sphere(Base=[start_pts, end_pts], Radius=number_slider)  # disabled
panel_7 = Panel(end_pts)  # disabled
panel_8 = Panel(start_pts)  # disabled

# ----
# Obstacles and Nav Mesh BVN
geometry_pipeline = GeometryPipeline(
    GroupByLayer=False,
    GroupByType=False,
    IncludeHidden=True,
    IncludeLocked=True,
    LayerFilter="_gh_nav_graph_BVN",
    NameFilter="*",
    TypeFilter=4)  # disabled
data_dam = DataDam(DataDataA=geometry_pipeline, BufferDelay=10000000, BufferMode=0)  # disabled
geometry = Geometry(data_dam)  # disabled

number_slider_2 = Slider(10, range=0..10)  # disabled
number_slider_3 = Slider(100, range=0..100)  # disabled
construct_particle = ConstructParticle(
    UpDirection=Vector(0, 0, 1),
    Acceleration=Vector(0, 0, 0),
    Lifespan=30,
    Mass=1,
    BodySize=number_slider_3,
    HistoryLength=number_slider_2)  # disabled
number_slider_4 = Slider(20, range=0..100)  # disabled
point_emitter = PointEmitter(
    ContinuousFlow=True,
    CreationRate=1,
    NumberOfQuelea=0,
    MinimumInitialVelocity=Vector(-0.1, -0.1, -0.1),
    MaximumInitialVelocity=Vector(0.1, 0.1, 0.1),
    Point=Point(0, 0, 0))  # disabled
construct_agent = ConstructAgent(ParticleQueleaSettings=construct_particle, MaxSpeed=0.5, MaxForce=0.1, VisionRadius=number_slider_4, VisionAngle=360)  # disabled
system = System(QueleaSettings=construct_agent, Emitters=point_emitter)  # -> System, Quelea, QueleaNetwork; disabled
boolean_toggle = BooleanToggle(False)  # disabled
point_2 = Point(<point referenced from the Rhino model>)  # disabled
boolean_toggle_2 = BooleanToggle(False)  # disabled
number_slider_5 = Slider(100, range=0..100)  # disabled
timer = Timer(TimerInterval=20, Target=[engine, system])  # disabled
engine = Engine(Reset=boolean_toggle_2, System=system.System)  # disabled
arrive_force = ArriveForce(Apply=boolean_toggle, WeightMultiplier=1, AgentQuelea=system.Quelea, TargetPoint=point_2, ArrivalRadius=number_slider_5)  # -> Force, DesiredVelocity; disabled
get_particle_position = GetParticlePosition(ParticleQuelea=system.Quelea)  # -> Position, SurfacePosition; disabled
point_3 = Point(<point referenced from the Rhino model>)  # disabled
boolean_toggle_3 = BooleanToggle(False)  # disabled
deconstruct_quelea_network = DeconstructQueleaNetwork()  # disabled
arrive_force_2 = ArriveForce(Apply=boolean_toggle_3, WeightMultiplier=1, AgentQuelea=system.Quelea, TargetPoint=point_3, ArrivalRadius=5)  # -> Force, DesiredVelocity; disabled

# ----
# Direct Path
# What the path should be without the obstacles
number_slider_6 = Slider(72, range=0..100)  # disabled
line = Line(StartPoint=panel_8, EndPoint=panel_7)  # disabled
pipe = Pipe(Curve=line, Radius=number_slider_6, Caps=0)  # disabled

data = Data([panel_7, panel_8])  # disabled
create_set_3 = CreateSet(List=data)  # -> Set, Map; disabled
create_set_4 = CreateSet(List=create_set_3.Map)  # -> Set, Map; disabled
member_index = MemberIndex(Set=create_set_3.Map, Member=create_set_4.Set)  # -> Index, Count; disabled
panel_9 = Panel(member_index.Count)  # disabled

number_slider_7 = Slider(500, range=0..500)  # disabled

# ----
# shortest walk/ simulated data
shortest_walk = ShortestWalk(Curves=geometry, WantedPath=line)  # -> ShortestWalk, Succession, Direction, Length; disabled
number_slider_8 = Slider(80, range=0..100)  # disabled
number_slider_9 = Slider(1297, range=0..5000)  # disabled
point_on_curve = PointOnCurve(panel_7, parameter=0)  # disabled
curve = Curve(shortest_walk.ShortestWalk)  # disabled
text_tag_3d = TextTag3D(Location=shortest_walk.ShortestWalk, Text=graft(panel), Size=number_slider_9, Colour=RGB(255, 0, 0), Justification=7)  # disabled
discontinuity = Discontinuity(Curve=shortest_walk.ShortestWalk, Level=1)  # -> Points, Parameters; disabled
pipe_2 = Pipe(Curve=curve, Radius=number_slider_8, Caps=0)  # disabled
mesh_sphere = MeshSphere(Base=point_on_curve, Radius=number_slider_7, UCount=5, VCount=4)  # disabled

# ----
# Vectors Along Path
list_item = ListItem(List=geometry, Index=shortest_walk.Succession, Wrap=False)  # disabled
end_points = EndPoints(Curve=list_item)  # -> Start, End; disabled
evaluate_length = EvaluateLength(Curve=list_item, Length=0.5, Normalized=True)  # -> Point, Tangent, Parameter; disabled
vector_2pt = Vector2Pt(PointA=end_points.Start, PointB=end_points.End, Unitize=False)  # -> Vector, Length; disabled
remap_numbers = RemapNumbers(Values=shortest_walk.Direction, Source=Domain(0, 1), Target=Domain(-0.1, 0.1))  # disabled
amplitude = Amplitude(Vector=vector_2pt.Vector, Amplitude=remap_numbers)  # disabled
vector_display = VectorDisplay(Anchor=evaluate_length.Point, Vector=amplitude)  # disabled

point_list = PointList(Points=point_on_curve, Size=number_slider_8)  # disabled

len = Length(Curve=curve)  # disabled
bnd = Bounds(Numbers=len)  # disabled
dedomain = DeconstructDomain(Domain=bnd)  # -> Start, End; disabled
gradient = Gradient(
    LowerLimit=dedomain.Start,
    UpperLimit=dedomain.End,
    Parameter=len,
    stops=[0: RGB(255, 0, 0), 0.171: RGB(255, 212, 0), 0.342: RGB(81, 255, 0), 0.496: RGB(0, 255, 136), 0.667: RGB(0, 153, 255), 0.821: RGB(42, 0, 255), 1: RGB(255, 0, 255)])  # disabled
number_slider_10 = Slider(3, range=0..10)  # disabled
previewlw = CustomPreviewLineweights(Geometry=mesh_sphere, Shader=gradient, Thickness=number_slider_10)  # disabled

sort_list = SortList(Keys=panel_9)  # -> reverse(Keys), ValuesValuesA; disabled

number_slider_11 = Slider(165, range=0..10000)  # disabled
discontinuity_2 = Discontinuity(Curve=shortest_walk.ShortestWalk, Level=1)  # -> Points, Parameters; disabled
negative = Negative(Value=number_slider_11)  # disabled
point_4 = Point(discontinuity_2.Points)  # disabled
construct_domain = ConstructDomain(DomainStart=negative, DomainEnd=number_slider_11)  # disabled
list_length = ListLength(List=point_4)  # disabled
unit_x = UnitX(Factor=1)  # disabled
random = Random(Range=construct_domain, Number=list_length, Seed=2)  # disabled
amplitude_2 = Amplitude(Vector=unit_x, Amplitude=random)  # disabled
move = Move(Geometry=point_4, Motion=amplitude_2)  # -> Geometry, Transform; disabled
nurbs_curve = NurbsCurve(Vertices=move.Geometry, Degree=3, Periodic=False)  # -> Curve, Length, Domain; disabled

# ----
# Checkpoints
evaluate_length_2 = EvaluateLength(Curve=shortest_walk.ShortestWalk, Length=[0, 1], Normalized=True)  # -> Point, Tangent, Parameter; disabled
unit_z = UnitZ(Factor=1)  # disabled
cross_product = CrossProduct(VectorA=unit_z, VectorB=evaluate_length_2.Tangent, Unitize=False)  # -> Vector, Length; disabled
center_box = CenterBox(Base=evaluate_length_2.Point, X=0.1, Y=0.1, Z=0.07)  # disabled
construct_plane = Plane(Origin=evaluate_length_2.Point, XAxis=cross_product.Vector, YAxis=unit_z)  # disabled
T = Text(["START", "GOAL"])  # disabled
text_tag = TextTag(Location=construct_plane, Text=T)  # disabled

panel_10 = Panel(sort_list.Keys)  # disabled

panel_11 = Panel("""4
5
6
6
6
6
7""")
python_script = PythonScript(stops=panel_11)  # -> out, a; inputs stops: list
# ---------- python_script: Python ----------
import rhinoscriptsyntax as rs
import Rhino.Geometry as rg

a = []

for i in range(len(stops)-1):
    if (stops[i] == stops[i+1]):
        point = rs.AddPoint(0,0,0)
        a.append(point)
    else:
        a.append(stops[i])

a.append(stops[len(stops)-1])
# ---------- end python_script ----------
panel_12 = Panel(python_script.a)
xz_plane = XZPlane(Origin=Point(0, 0, 0))
list_item_2 = ListItem(List=python_script.a, Index=Slider(3, range=0..10), Wrap=True)
amplitude_3 = Amplitude(Vector=xz_plane, Amplitude=Slider(10, range=0..10))
move_2 = Move(Geometry=list_item_2, Motion=amplitude_3)  # -> Geometry, Transform

# ==== cluster DetectionOfStartPoint
inputname = ClusterInput()
filepath = ClusterInput()
data_json = PythonScript(FilePath=filepath, inputName=inputname)  # -> out, x, y
# ---------- data_json: Python ----------
import json

if FilePath:
    
    # JSON file to read
    file = open(FilePath)
    
    # Load the data
    data = json.load(file)
    
    # Do something with the data
    for basestation in data:
        print basestation["Name"]
#        print inputName
        if basestation["Name"] == inputName:
            x = basestation["X"]
            y = basestation["Y"]
            print x
            print y
# ---------- end data_json ----------
y = ClusterOutput(data_json.y)
x = ClusterOutput(data_json.x)
